# Dynamo graph M&E Data Exchange - Fan Coil Units & Pumps v.2.1.dyn (Dynamo 2.16.1.2727)
# packages: Data-Shapes 2022.2.106, bimorphNodes 4.2.4

# group: DYNAMO COLOUR CODING LEGEND
# note: COLOUR CODING LEGEND

# group: Python
# note: USE:
# FOR PYTHON NODES

# group: Monitor
# note: USE:
# FOR IMPORTANT WATCH NODES

# group: Conditional
# note: USE:
# FOR CONDITIONAL NODES

# group: To Revit
# note: USE:
# FOR CHANGES TO REVIT

# group: Control
# note: USE:
# FOR USER CONTROL (SLIDERS ETC.)

# group: Input
# note: USE:
# FOR FIXED INPUT (FILE PATHS ETC.)

# group: Background
# note: USE:
# FOR GENERAL WORKFLOW NODES

# group: Ray direction for walls
code_block = CodeBlock { true; }
XAxis = Vector.XAxis()
reverse = Vector.Reverse(vector=XAxis)
YAxis = Vector.YAxis()
reverse_2 = Vector.Reverse(vector=YAxis)
list_create = List.Create(item0=XAxis, item1=reverse, item2=YAxis, item3=reverse_2)

# group: Get all families of Electrical Fixtures category
python_script = Python()  # IronPython2; unwired: IN[0]
# ---------- python_script.python (12 lines) ----------
import clr
clr.AddReference("RevitServices")
import RevitServices
from RevitServices.Persistence import DocumentManager
from RevitServices.Transactions import TransactionManager

clr.AddReference('RevitAPI')
import Autodesk
from Autodesk.Revit.DB import *
from Autodesk.Revit.DB import FilteredElementCollector
doc = DocumentManager.Instance.CurrentDBDocument
OUT = FilteredElementCollector(doc).OfClass(Family).ToElements()
# ----------------------------------------
python_script_2 = Python(IN[0]=python_script)  # IronPython2
# ---------- python_script_2.python (37 lines) ----------
import System
import clr
clr.AddReference('RevitAPI')
from Autodesk.Revit.DB import *

clr.AddReference("RevitNodes")
import Revit
clr.ImportExtensions(Revit.Elements)

def GetCategory(item):
	if not item: return None
	objtype = item.GetType().ToString()
	returnID = None
	returnCat = None
	returnBic = None
	if objtype == "Autodesk.Revit.DB.ViewSchedule": returnID = item.Definition.CategoryId
	elif objtype == "Autodesk.Revit.DB.Family": returnID = item.FamilyCategoryId
	elif objtype == "Autodesk.Revit.DB.GraphicsStyle":  returnID = item.GraphicsStyleCategory.Id
	elif objtype == "Revit.Application.Document":
		if item.IsFamilyDocument: 
			clr.AddReference("RevitServices")
			import RevitServices
			from RevitServices.Persistence import DocumentManager
			returnID = DocumentManager.Instance.CurrentDBDocument.OwnerFamily.FamilyCategoryId
	elif objtype == "Autodesk.Revit.DB.Category": 
		if item.Parent: returnID = item.Parent.Id
	elif hasattr(item, "Category"): returnID = item.Category.Id
	if returnID:
		returnBic = System.Enum.ToObject(BuiltInCategory, returnID.IntegerValue)
		try: returnCat =  Revit.Elements.Category.ById(returnID.IntegerValue)
		except: pass
	return returnCat, returnBic

items = UnwrapElement(IN[0])

if isinstance(IN[0], list): OUT = map(list, zip(*[GetCategory(x) for x in items]))
else: OUT = GetCategory(items)
# ----------------------------------------
firstItem = List.FirstItem(list=python_script_2)
string_from_object = FromObject(obj=firstItem)
code_block_2 = CodeBlock { "Electrical Fixtures"; }
contains = String.Contains(string=string_from_object, searchFor=code_block_2)
filterByBoolMask = List.FilterByBoolMask(list=python_script, mask=contains)

# group: First UI
code_block_3 = CodeBlock { "Add Electrical Fixtures to Fan Coil Units or Pumps"; null; "Proceed"; "Cancel"; 800; 700; 400; }
code_block_4 = CodeBlock { "Requirements"; "Dynamo v.2, Data-Shapes and Bimorph Nodes 4.2.4 packages"; }
textnote_data = Custom[TextNote Data](Title=code_block_4.out0, TextNote=code_block_4.out1)  # package Data-Shapes; Create Data for TextNote input in UI.MultipleInputForm ++ . Check out www.data-shapes.net for more informations
code_block_5 = CodeBlock { "Mechanical Equipment"; }
code_block_6 = CodeBlock { ""; "Select mechanical equipment"; }
textnote_data_2 = Custom[TextNote Data](Title=code_block_6.out0, TextNote=code_block_6.out1)
code_block_7 = CodeBlock { "Equipment"; null; true; }
code_block_8 = CodeBlock()
# ---------- code_block_8.designscript (4 lines) ----------
["Fan Coil Units",
"Pumps"];
["FanCoilUnit",
"Pump"];
# ----------------------------------------
dropdown_data = Custom[DropDown Data](InputName=code_block_7.out0, Keys=code_block_8.out0, Values=code_block_8.out1, DefaultValueIndex=code_block_7.out1, Sorted_optional=code_block_7.out2)  # package Data-Shapes; Create data for DropDown input in UI.MultiInputForm ++ . Check out www.data-shapes.net for more infos.
list_create_2 = List.Create(item0=textnote_data_2, item1=dropdown_data)
inputgroup_data = Custom[InputGroup Data](GroupTitle=code_block_5, Inputs=list_create_2)  # package Data-Shapes; Creates a group of inputs for UI.MultipleInputForm ++ . Check out www.data-shapes.net for more infos !
code_block_9 = CodeBlock { "Electrical Fixture"; }
code_block_10 = CodeBlock()
# ---------- code_block_10.designscript (2 lines) ----------
"";
"Select electrical fixture. Make sure the family you want to use is loaded into the project before running this script. Selected fixture(s) will be placed for new mechanical equipment. Electrical fixtures already associated with mechanical equipment will be relocated";
# ----------------------------------------
textnote_data_3 = Custom[TextNote Data](Title=code_block_10.out0, TextNote=code_block_10.out1)
code_block_11 = CodeBlock { "Fixture"; null; true; }
name = Element.Name(element=filterByBoolMask.in)
dropdown_data_2 = Custom[DropDown Data](InputName=code_block_11.out0, Keys=name, Values=filterByBoolMask.in, DefaultValueIndex=code_block_11.out1, Sorted_optional=code_block_11.out2)
list_create_3 = List.Create(item0=textnote_data_3, item1=dropdown_data_2)
inputgroup_data_2 = Custom[InputGroup Data](GroupTitle=code_block_9, Inputs=list_create_3)
list_create_4 = List.Create(item0=textnote_data, item1=inputgroup_data, item2=inputgroup_data_2)
boolean = BoolSelector(true)
multipleinputform = Custom[MultipleInputForm ++](Description_optional=code_block_3.out0, Logo_optional=code_block_3.out1, ButtonText_optional=code_block_3.out2, Inputs=list_create_4, Toggle=boolean, CancelButtonText_optional=code_block_3.out3, MaxHeight_optional=code_block_3.out4, Width_optional=code_block_3.out5, LabelWidth_optional=code_block_3.out6)  # package Data-Shapes; Create a form with multiple inputs. see www.data-shapes.net for tutorials and infos!

# group: User Selection: Selected Mechanical Equipment Type
code_block_12 = CodeBlock(SelectedMechEquip=multipleinputform.User_Inputs) { SelectedMechEquip[0]; }

# group: Get mechanical equipment elements based on user selection
code_block_13 = CodeBlock { "Mechanical Equipment"; }
byName = Category.ByName(name=code_block_13)
all_elements_of_category = ElementsOfCategory(Category=byName)
flatten = List.Flatten(list=all_elements_of_category)
getFamily = FamilyInstance.GetFamily(familyInstance=all_elements_of_category)
name_2 = Family.Name(family=getFamily)
flatten_2 = List.Flatten(list=name_2)
contains_2 = String.Contains(string=flatten_2, searchFor=code_block_12)
filterByBoolMask_2 = List.FilterByBoolMask(list=flatten, mask=contains_2)
flatten_3 = List.Flatten(list=filterByBoolMask_2.in)

getLocation = Element.GetLocation(element=flatten_3)
X = Point.X(point=getLocation)
Y = Point.Y(point=getLocation)
Z = Point.Z(point=getLocation)
code_block_14 = CodeBlock(z=Z) { z+100; }
byCoordinates = Point.ByCoordinates(x=X, y=Y, z=code_block_14)

# group: Conditional
code_block_15 = CodeBlock(SelectedMechanicalEquipment=code_block_12) { SelectedMechanicalEquipment == "Pump"; }
code_block_16 = CodeBlock(trueOption=byCoordinates, falseOption=getLocation, test=code_block_15) { [trueOption, falseOption][test?0:1]; }

# group: Python to create 3D view
code_block_17 = CodeBlock()
# ---------- code_block_17.designscript (2 lines) ----------
//String
ViewName ="MELink3D";
# ----------------------------------------
code_block_18 = CodeBlock()
# ---------- code_block_18.designscript (2 lines) ----------
// Use only if you want to query a linked model
document : var = null;
# ----------------------------------------
create_3dview = Python(IN[0]=code_block_17, IN[1]=code_block_18)  # IronPython2
# ---------- create_3dview.python (53 lines) ----------
#Suggestion by Marck Ackerley
#Suggestion of improvement by Jonathan Atger
import clr
# Import DocumentManager and TransactionManager
clr.AddReference('RevitServices')
import RevitServices
from RevitServices.Persistence import DocumentManager
from RevitServices.Transactions import TransactionManager

# Import RevitAPI
clr.AddReference('RevitAPI')
import Autodesk
from Autodesk.Revit.DB import *

def ProcessParallelLists(_func, *lists):
	return map( lambda *xs: ProcessParallelLists(_func, *xs) if all(type(x) is list for x in xs) else _func(*xs), *lists )

def tolist(obj1):
    if hasattr(obj1,"__iter__"): return obj1
    else: return [obj1]

viewNames = tolist(IN[0])
inputdoc = tolist(UnwrapElement(IN[1]))
inputdoc = inputdoc[0]
	
#Inputdoc : Part of script by Andreas Dieckmann
if inputdoc == None:
	doc = DocumentManager.Instance.CurrentDBDocument
elif inputdoc.GetType().ToString() == "Autodesk.Revit.DB.Document":
	doc = inputdoc
elif inputdoc.GetType().ToString() == "Autodesk.Revit.DB.RevitLinkInstance":
	doc = inputdoc.GetLinkDocument()
else :
	doc = DocumentManager.Instance.CurrentDBDocument

#Get 3D View ViewFamilyType
viewType = FilteredElementCollector(doc).OfClass(ViewFamilyType).ToElements().Find(lambda x : x.ViewFamily == ViewFamily.ThreeDimensional)

def CreateView(name):
	view = View3D.CreateIsometric(doc, viewType.Id)
	try:view.Name = name
	except:pass
	return view

TransactionManager.Instance.ForceCloseTransaction()
t = Transaction(doc,'Create3D')
t.Start()
views=ProcessParallelLists(CreateView, viewNames)
t.Commit()
#TransactionManager.Instance.ForceCloseTransaction()

#Assign your output to the OUT variable
OUT = views, doc
# ----------------------------------------
code_block_19 = CodeBlock(x=create_3dview) { x[0]; x[1]; }

# group: Conditional
code_block_20 = CodeBlock(passThrough=list_create) { passThrough: var[]..[]; }
code_block_21 = CodeBlock(waitFor=code_block_19.out0) { waitFor: var[]..[]; }
code_block_22 = CodeBlock(passthrough=code_block_20, waitfor=code_block_21) { [passthrough,waitfor][0]; }

code_block_23 = CodeBlock { "OST_Walls"; }
byName_2 = Category.ByName(name=code_block_23)

# group: From Data-Shapes package
raybounce_on_link_category = Custom[RayBounce On Link Category](Points=code_block_16, Direction=code_block_22, ThreeDView=code_block_19.out0, Category=byName_2, lacing=CrossProduct)  # package Data-Shapes; Same functionality as raybounce but takes linked model elements into account

flatten_4 = List.Flatten(list=raybounce_on_link_category.Elements, lacing=Longest)

# group: Ray direction for ceilings & floors
ZAxis = Vector.ZAxis()
reverse_3 = Vector.Reverse(vector=ZAxis)
list_create_5 = List.Create(item0=ZAxis, item1=reverse_3)

# group: User Selection: Selected Electrical Fixture
code_block_24 = CodeBlock(SelectedElecFixture=multipleinputform.User_Inputs) { SelectedElecFixture[1]; }

types = Family.Types(family=code_block_24)
name_3 = FamilyType.Name(familyType=types)

# group: Conditional
code_block_25 = CodeBlock(FirstUIWasRun=multipleinputform.Was_Run, FirstUIWasCancelled=multipleinputform.Was_Cancelled) { FirstUIWasRun == true && FirstUIWasCancelled == false? true : false; }

# group: Second UI
code_block_26 = CodeBlock { "Add Electrical Fixtures to Fan Coil Units or Pumps"; null; "Proceed"; "Cancel"; 800; 700; 400; }
code_block_27 = CodeBlock { "Electrical Fixture"; }
code_block_28 = CodeBlock()
# ---------- code_block_28.designscript (8 lines) ----------
"Placement";
["Ceiling",
"Floor",
"Wall"];
["OST_Ceilings",
"OST_Floors",
"OST_Walls"];
0;
# ----------------------------------------
radiobuttons_data = Custom[RadioButtons Data](InputName=code_block_28.out0, Keys=code_block_28.out1, Values=code_block_28.out2, DefaultValueIndex=code_block_28.out3)  # package Data-Shapes; Create radio buttons input for UI.MultipleInputForm ++ .
code_block_29 = CodeBlock { "Fixture Type"; }
dropdown_data_3 = Custom[DropDown Data](InputName=code_block_29, Keys=name_3, Values=name_3)
list_create_6 = List.Create(item0=radiobuttons_data, item1=dropdown_data_3)
inputgroup_data_3 = Custom[InputGroup Data](GroupTitle=code_block_27, Inputs=list_create_6)
multipleinputform_2 = Custom[MultipleInputForm ++](Description_optional=code_block_26.out0, Logo_optional=code_block_26.out1, ButtonText_optional=code_block_26.out2, Inputs=inputgroup_data_3, Toggle=code_block_25, CancelButtonText_optional=code_block_26.out3, MaxHeight_optional=code_block_26.out4, Width_optional=code_block_26.out5, LabelWidth_optional=code_block_26.out6)

# group: User Selection: Selected Placement
code_block_30 = CodeBlock(SelectedPlacement=multipleinputform_2.User_Inputs) { SelectedPlacement[0]; }

# group: Conditional
code_block_31 = CodeBlock(SelectedPlacement=code_block_30) { SelectedPlacement == "OST_Ceilings"? 0: 1; }

getItemAtIndex = List.GetItemAtIndex(list=list_create_5, index=code_block_31)

# group: Conditional
code_block_32 = CodeBlock(passThrough=getItemAtIndex) { passThrough: var[]..[]; }
code_block_33 = CodeBlock(waitFor=code_block_19.out0) { waitFor: var[]..[]; }
code_block_34 = CodeBlock(passthrough=code_block_32, waitfor=code_block_33) { [passthrough,waitfor][0]; }

# group: Categories for ceilings/floors
code_block_35 = CodeBlock()
# ---------- code_block_35.designscript (2 lines) ----------
[["OST_Floors", "OST_Roofs"],
"OST_Floors"];
# ----------------------------------------
getItemAtIndex_2 = List.GetItemAtIndex(list=code_block_35, index=code_block_31)
byName_3 = Category.ByName(name=getItemAtIndex_2)

# group: From Data-Shapes package
raybounce_on_link_category_2 = Custom[RayBounce On Link Category](Points=code_block_16, Direction=code_block_34, ThreeDView=code_block_19.out0, Category=byName_3, lacing=CrossProduct)

flatten_5 = List.Flatten(list=raybounce_on_link_category_2.Elements, lacing=Longest)
code_block_36 = CodeBlock { true; }

# group: Get all Electrical Fixtures
code_block_37 = CodeBlock { "Electrical Fixtures"; }
byName_4 = Category.ByName(name=code_block_37)
all_elements_of_category_2 = ElementsOfCategory(Category=byName_4)

# group: Get only Electrical Fixtures associated with Fan Coil Units or Pumps
code_block_38 = CodeBlock { "Equipment Name"; }
getParameterValueByName = Element.GetParameterValueByName(element=all_elements_of_category_2, parameterName=code_block_38)
contains_3 = String.Contains(string=getParameterValueByName, searchFor=code_block_12)
filterByBoolMask_3 = List.FilterByBoolMask(list=all_elements_of_category_2, mask=contains_3)

# group: Get only Electrical Fixtures with a value for Equipment ID parameter
code_block_39 = CodeBlock { "Equipment ID"; }
getParameterValueByName_2 = Element.GetParameterValueByName(element=filterByBoolMask_3.in, parameterName=code_block_39)
length = String.Length(string=getParameterValueByName_2)
code_block_40 = CodeBlock { 7; }
eq = length == code_block_40
filterByBoolMask_4 = List.FilterByBoolMask(list=getParameterValueByName_2, mask=eq)
filterByBoolMask_5 = List.FilterByBoolMask(list=filterByBoolMask_3.in, mask=eq)

isEmpty = List.IsEmpty(list=filterByBoolMask_4.in)
identity = Object.Identity()  # unwired: object
code_block_41 = CodeBlock { "Equipment ID"; }

# group: User Selection: Selected Electrical Fixture Type
code_block_42 = CodeBlock(SelectedElecFixtureType=multipleinputform_2.User_Inputs) { SelectedElecFixtureType[1]; }

# group: Get family by name and type
name_4 = Family.Name(family=code_block_24)
byFamilyNameAndTypeName = FamilyType.ByFamilyNameAndTypeName(familyName=name_4, typeName=code_block_42)

# group: From BimorphNodes package
byRayBounce = Revit.LinkElement.ByRayBounce(origin=code_block_16, direction=code_block_22, view3D=code_block_19.out0, category=byName_2, lacing=CrossProduct)
byRayBounce_2 = Revit.LinkElement.ByRayBounce(origin=code_block_16, direction=code_block_34, view3D=code_block_19.out0, category=byName_3, lacing=CrossProduct)

flatten_6 = List.Flatten(list=byRayBounce.LinkElement, lacing=Longest)
flatten_7 = List.Flatten(list=byRayBounce_2.LinkElement, lacing=Longest)

# group: Conditional
code_block_43 = CodeBlock(SelectedPlacement=code_block_30) { SelectedPlacement == "OST_Walls"; }
code_block_44 = CodeBlock(trueOption=flatten_6, falseOption=flatten_7, test=code_block_43) { [trueOption, falseOption][test?0:1]; }

# group: From BimorphNodes package
element = Revit.LinkElement.Element(linkElement=code_block_44)

code_block_45 = CodeBlock { true; }
flatten_8 = List.Flatten(list=raybounce_on_link_category.Points, lacing=Longest)
flatten_9 = List.Flatten(list=raybounce_on_link_category_2.Points, lacing=Longest)

# group: Conditional
code_block_46 = CodeBlock(SelectedPlacement=code_block_30) { SelectedPlacement == "OST_Walls"; }
code_block_47 = CodeBlock(trueOption=flatten_4, falseOption=flatten_5, test=code_block_46) { [trueOption, falseOption][test?0:1]; }
code_block_48 = CodeBlock(trueOption=flatten_8, falseOption=flatten_9, test=code_block_46) { [trueOption, falseOption][test?0:1]; }

isEmpty_2 = List.IsEmpty(list=code_block_47, lacing=Longest)
allIndicesOf = List.AllIndicesOf(list=isEmpty_2, item=code_block_36)
removeItemAtIndex = List.RemoveItemAtIndex(list=flatten_3, indices=allIndicesOf)

# group: Monitor
watch = Watch(removeItemAtIndex)

removeItemAtIndex_2 = List.RemoveItemAtIndex(list=flatten_3, indices=allIndicesOf)
id = Element.Id(element=removeItemAtIndex_2)
string_from_object_2 = FromObject(obj=id)

# group: Conditional
code_block_49 = CodeBlock(trueOption=string_from_object_2, falseOption=filterByBoolMask_4.in, test=isEmpty) { [trueOption, falseOption][test?0:1]; }

contains_4 = List.Contains(list=string_from_object_2, item=code_block_49, lacing=CrossProduct)
trueForAny = List.TrueForAny(list=contains_4, queryFunction=identity, lacing=Longest)
not_ = Not(x=trueForAny)
filterByBoolMask_6 = List.FilterByBoolMask(list=removeItemAtIndex, mask=not_)

# group: Conditional
code_block_50 = CodeBlock(trueOption=removeItemAtIndex, falseOption=filterByBoolMask_6.in, test=isEmpty) { [trueOption, falseOption][test?0:1]; }

allIndicesOf_2 = List.AllIndicesOf(list=isEmpty_2, item=code_block_45)
removeItemAtIndex_3 = List.RemoveItemAtIndex(list=code_block_47, indices=allIndicesOf_2)
isNull = Object.IsNull(object=removeItemAtIndex_3, lacing=Longest)
filterByBoolMask_7 = List.FilterByBoolMask(list=removeItemAtIndex_3, mask=isNull)
removeItemAtIndex_4 = List.RemoveItemAtIndex(list=code_block_48, indices=allIndicesOf_2)
filterByBoolMask_8 = List.FilterByBoolMask(list=removeItemAtIndex_4, mask=isNull)
getLocation_2 = Element.GetLocation(element=removeItemAtIndex)

# group: Identify closest geometries to mechanical equipment
distanceTo = Geometry.DistanceTo(geometry=filterByBoolMask_8.out, other=getLocation_2)
minimumItem = List.MinimumItem(list=distanceTo)
indexOf = List.IndexOf(list=distanceTo, element=minimumItem, lacing=Longest)

# group: Identify linked elements that will host the families
getItemAtIndex_3 = List.GetItemAtIndex(list=filterByBoolMask_7.out, index=indexOf, lacing=Shortest)

indexOf_2 = List.IndexOf(list=element, element=getItemAtIndex_3, lacing=Longest)
getItemAtIndex_4 = List.GetItemAtIndex(list=code_block_44, index=indexOf_2, lacing=Longest)
getItemAtIndex_5 = List.GetItemAtIndex(list=filterByBoolMask_8.out, index=indexOf, lacing=Shortest)

# group: Identify surfaces where families will be placed
faces = Element.Faces(element=getItemAtIndex_4)
doesIntersect = Geometry.DoesIntersect(geometry=getItemAtIndex_5, other=faces)
filterByBoolMask_9 = List.FilterByBoolMask(list=faces, mask=doesIntersect)
firstItem_2 = List.FirstItem(list=filterByBoolMask_9.in, lacing=Longest)

filterByBoolMask_10 = List.FilterByBoolMask(list=firstItem_2, mask=not_)

# group: Conditional
code_block_51 = CodeBlock(trueOption=firstItem_2, falseOption=filterByBoolMask_10.in, test=isEmpty) { [trueOption, falseOption][test?0:1]; }

# group: Get 'Overall Height' parameter
elementType = Element.ElementType(element=removeItemAtIndex)
code_block_52 = CodeBlock { "Overall Height"; }
getParameterValueByName_3 = Element.GetParameterValueByName(element=elementType, parameterName=code_block_52)

code_block_53 = CodeBlock { 0; }
count = List.Count(list=getParameterValueByName_3)
ofRepeatedItem = List.OfRepeatedItem(item=code_block_53, amount=count)

# group: Conditional
code_block_54 = CodeBlock(SelectedMechEquip=code_block_12, SelectedPlacement=code_block_30) { SelectedMechEquip == "Pump" && SelectedPlacement == "OST_Walls"; }
code_block_55 = CodeBlock(trueOption=getParameterValueByName_3, falseOption=ofRepeatedItem, test=code_block_54) { [trueOption, falseOption][test?0:1]; }

# group: Get the points where families will be placed
X_2 = Point.X(point=getItemAtIndex_5)
Y_2 = Point.Y(point=getItemAtIndex_5)
Z_2 = Point.Z(point=getItemAtIndex_5)
add = Z_2 + code_block_55
byCoordinates_2 = Point.ByCoordinates(x=X_2, y=Y_2, z=add)

filterByBoolMask_11 = List.FilterByBoolMask(list=byCoordinates_2, mask=not_)

# group: Conditional
code_block_56 = CodeBlock(trueOption=byCoordinates_2, falseOption=filterByBoolMask_11.in, test=isEmpty) { [trueOption, falseOption][test?0:1]; }

normalAtPoint = Surface.NormalAtPoint(surface=firstItem_2, point=byCoordinates_2)
flatten_10 = List.Flatten(list=normalAtPoint)

# group: Conditional
ZAxis_2 = Vector.ZAxis()
XAxis_2 = Vector.XAxis()
code_block_57 = CodeBlock(trueOption=ZAxis_2, falseOption=XAxis_2, test=code_block_46) { [trueOption, falseOption][test?0:1]; }

code_block_58 = CodeBlock { 90; }
rotate = Vector.Rotate(vector=flatten_10, axis=code_block_57, degrees=code_block_58)
filterByBoolMask_12 = List.FilterByBoolMask(list=rotate, mask=not_)

# group: Conditional
code_block_59 = CodeBlock(trueOption=rotate, falseOption=filterByBoolMask_12.in, test=isEmpty) { [trueOption, falseOption][test?0:1]; }

# group: Place families in Revit
byFace = FamilyInstance.ByFace(familyType=byFamilyNameAndTypeName, face=code_block_51, location=code_block_56, referenceDirection=code_block_59)

id_2 = Element.Id(element=byFace)
string_from_object_3 = FromObject(obj=id_2)

# group: Write "Equipment ID" parameter
setParameterByName = Element.SetParameterByName(element=code_block_50, parameterName=code_block_41, value=string_from_object_3)

# group: Conditional
code_block_60 = CodeBlock(passThrough=code_block_19.out0) { passThrough: var[]..[]; }
code_block_61 = CodeBlock(waitFor=setParameterByName) { waitFor: var[]..[]; }
code_block_62 = CodeBlock(passthrough=code_block_60, waitfor=code_block_61) { [passthrough,waitfor][0]; }

# group: Python to delete 3D View
python_script_3 = Python(IN[0]=code_block_62)  # IronPython2
# ---------- python_script_3.python (42 lines) ----------
import clr

#Load Revit API
clr.AddReference('RevitAPI')
from Autodesk.Revit.DB import *
import Autodesk

#Load document reference
clr.AddReference("RevitServices")
import RevitServices
from RevitServices.Persistence import DocumentManager
from RevitServices.Transactions import TransactionManager

doc = DocumentManager.Instance.CurrentDBDocument
uiapp = DocumentManager.Instance.CurrentUIApplication
app = uiapp.Application

elementsOrIDs = IN[0]
elems = []


TransactionManager.Instance.EnsureInTransaction(doc)

count = 0
try:
	int(elementsOrIDs[0])

except:
	for e in elementsOrIDs:
		elems.append(UnwrapElement(e))
	for elem in elems:
		doc.Delete(elem.Id)
		count +=1
	
else:
	for ID in elementsOrIDs:
		id = Autodesk.Revit.DB.ElementId(int(ID))
		doc.Delete(id)
		count +=1
	
TransactionManager.Instance.TransactionTaskDone()
OUT = str(count) + " element/s have been deleted from Revit"
# ----------------------------------------

empty = List.Empty()
allIndicesOf_3 = List.AllIndicesOf(list=filterByBoolMask_4.in, item=string_from_object_2)
isEmpty_3 = List.IsEmpty(list=allIndicesOf_3, lacing=Longest)
allTrue = List.AllTrue(list=isEmpty_3)

# group: Conditional
code_block_63 = CodeBlock(trueOption=empty, falseOption=allIndicesOf_3, test=allTrue) { [trueOption, falseOption][test?0:1]; }

getItemAtIndex_6 = List.GetItemAtIndex(list=filterByBoolMask_5.in, index=code_block_63)
flatten_11 = List.Flatten(list=getItemAtIndex_6)

# group: Conditional
code_block_64 = CodeBlock(trueOption=removeItemAtIndex, falseOption=flatten_11, test=isEmpty) { [trueOption, falseOption][test?0:1]; }

filterByBoolMask_13 = List.FilterByBoolMask(list=byCoordinates_2, mask=trueForAny)
getLocation_3 = Element.GetLocation(element=code_block_64)

# group: Conditional
code_block_65 = CodeBlock(trueOption=filterByBoolMask_13.in, falseOption=getLocation_3, test=isEmpty) { [trueOption, falseOption][test?0:1]; }

addItemToEnd = List.AddItemToEnd(item=code_block_65@L1, list=filterByBoolMask_13.in@L1)

# group: Distance
code_block_66 = CodeBlock { 1000; }

pruneDuplicates = Point.PruneDuplicates(points=addItemToEnd, tolerance=code_block_66)
count_2 = List.Count(list=pruneDuplicates, lacing=Longest)
code_block_67 = CodeBlock(x=count_2) { x>1; }
filterByBoolMask_14 = List.FilterByBoolMask(list=code_block_64, mask=code_block_67)

# group: Python to get electrical circuit
python_script_4 = Python(IN[0]=filterByBoolMask_14.in)  # IronPython2
# ---------- python_script_4.python (35 lines) ----------
import clr
clr.AddReference('ProtoGeometry')
from Autodesk.DesignScript.Geometry import *

#The inputs to this node will be stored as a list in the IN variables.
if isinstance(IN[0],list):
	toggle = 0
	element = UnwrapElement(IN[0])
else:
	toggle = 1
	element = [UnwrapElement(IN[0])]

def getSystem(elem):
	system = elem.MEPModel.ElectricalSystems
	
	if system.Size == 0:
		return None
	elif system.Size == 1:	
		for sys in system:
			return sys
	else:
		return [x for x in system]

listout = []	
for x in element:
	try:
		system = getSystem(x)
		listout.append(system)
	except:
		listout.append(None)
#Assign your output to the OUT variable.
if toggle:
	OUT = system
else:
	OUT = listout
# ----------------------------------------

isNull_2 = Object.IsNull(object=python_script_4)
not_2 = Not(x=isNull_2)
filterByBoolMask_15 = List.FilterByBoolMask(list=python_script_4, mask=not_2)
empty_2 = List.Empty()
isEmpty_4 = List.IsEmpty(list=filterByBoolMask_14.in)

# group: Conditional
code_block_68 = CodeBlock(trueOption=removeItemAtIndex, falseOption=filterByBoolMask_14.in, test=isEmpty_4) { [trueOption, falseOption][test?0:1]; }

# group: Get family by name and type
getFamily_2 = FamilyInstance.GetFamily(familyInstance=code_block_68)
name_5 = Family.Name(family=getFamily_2)
name_6 = Family.Name(family=code_block_68)
byFamilyNameAndTypeName_2 = FamilyType.ByFamilyNameAndTypeName(familyName=name_5, typeName=name_6)

list_create_7 = List.Create(item0=empty_2, item1=byFamilyNameAndTypeName_2)

# group: Conditional
code_block_69 = CodeBlock(FirstUIWasRun=multipleinputform.Was_Run, FirstUIWasCancelled=multipleinputform.Was_Cancelled, SecondUIWasRun=multipleinputform_2.Was_Run, SecondUIWasCancelled=multipleinputform_2.Was_Cancelled)
# ---------- code_block_69.designscript (2 lines) ----------
FirstUIWasRun == true && FirstUIWasCancelled == false && SecondUIWasRun == true && SecondUIWasCancelled == false? 1 :
0;
# ----------------------------------------

getItemAtIndex_7 = List.GetItemAtIndex(list=list_create_7, index=code_block_69)
filterByBoolMask_16 = List.FilterByBoolMask(list=firstItem_2, mask=code_block_67)
filterByBoolMask_17 = List.FilterByBoolMask(list=filterByBoolMask_13.in, mask=code_block_67)
filterByBoolMask_18 = List.FilterByBoolMask(list=rotate, mask=code_block_67)

# group: Place families in Revit
byFace_2 = FamilyInstance.ByFace(familyType=getItemAtIndex_7, face=filterByBoolMask_16.in, location=filterByBoolMask_17.in, referenceDirection=filterByBoolMask_18.in)

filterByBoolMask_19 = List.FilterByBoolMask(list=byFace_2, mask=not_2)

# group: Python to add elements to electrical circuits
code_block_70 = CodeBlock(Circuit=filterByBoolMask_15.in) { Circuit; }
code_block_71 = CodeBlock(FilteredElements=filterByBoolMask_19.in) { FilteredElements; }
python_script_5 = Python(IN[0]=code_block_70, IN[1]=code_block_71)  # IronPython2
# ---------- python_script_5.python (49 lines) ----------
import clr

clr.AddReference("RevitServices")
import RevitServices
from RevitServices.Persistence import DocumentManager
from RevitServices.Transactions import TransactionManager
doc = DocumentManager.Instance.CurrentDBDocument

clr.AddReference("RevitAPI")
import Autodesk
from Autodesk.Revit.DB import *

clr.AddReference("RevitNodes")
import Revit
clr.ImportExtensions(Revit.Elements)
clr.ImportExtensions(Revit.GeometryConversion)

succes = []
failed = []

def AddToCircuit(sys,elements):
	TransactionManager.Instance.EnsureInTransaction(doc)
	if hasattr(elements, "__iter__"):
		for element in elements:
			elemset = ElementSet()
			elemset.Insert(element)
			try:
				sys.AddToCircuit(elemset)
				succes.append(element.ToDSType(True))
			except:
				failed.append(element.ToDSType(True))
	else:
		elemset = ElementSet()
		elemset.Insert(elements)
		try:
			sys.AddToCircuit(elemset)
			succes.append(elements.ToDSType(True))
		except:
			failed.append(elements.ToDSType(True))
	TransactionManager.Instance.TransactionTaskDone()
	

if isinstance(IN[0], list):
	for i,sys in enumerate(UnwrapElement(IN[0])):
		AddToCircuit(sys,UnwrapElement(IN[1])[i])
else:
	AddToCircuit(UnwrapElement(IN[0]),UnwrapElement(IN[1]))

OUT = succes, failed
# ----------------------------------------
code_block_72 = CodeBlock(x=python_script_5) { x[1]; }
code_block_73 = CodeBlock(Failed=code_block_72) { Failed; }
code_block_74 = CodeBlock(x=python_script_5) { x[0]; }
code_block_75 = CodeBlock(Success=code_block_74) { Success; }

# group: Get Element ID's for selected mechanical equipment
id_3 = Element.Id(element=flatten_3)

string_from_object_4 = FromObject(obj=id_3)

# group: Identify electrical fixtures that are no longer associated with mechanical equipment
contains_5 = List.Contains(list=filterByBoolMask_4.in, item=string_from_object_4, lacing=CrossProduct)
identity_2 = Object.Identity()  # unwired: object
trueForAny_2 = List.TrueForAny(list=contains_5, queryFunction=identity_2, lacing=Longest)
not_3 = Not(x=trueForAny_2)
filterByBoolMask_20 = List.FilterByBoolMask(list=filterByBoolMask_5.in, mask=not_3)

join = List.Join(list0=filterByBoolMask_14.in, list1=filterByBoolMask_20.in)

# group: Conditional
code_block_76 = CodeBlock(passThrough=join) { passThrough: var[]..[]; }
code_block_77 = CodeBlock(waitFor=code_block_75) { waitFor: var[]..[]; }
code_block_78 = CodeBlock(passthrough=code_block_76, waitfor=code_block_77) { [passthrough,waitfor][0]; }

# group: Python to delete element(s)
python_script_6 = Python(IN[0]=code_block_78)  # IronPython2; same code as python_script_3

code_block_79 = CodeBlock { "Equipment ID"; }

# group: Conditional
empty_3 = List.Empty()
code_block_80 = CodeBlock(trueOption=empty_3, falseOption=code_block_79, test=isEmpty_4) { [trueOption, falseOption][test?0:1]; }

getParameterValueByName_4 = Element.GetParameterValueByName(element=filterByBoolMask_14.in@L2, parameterName=code_block_80, lacing=Longest)
string_from_object_5 = FromObject(obj=getParameterValueByName_4)

# group: Write parameters to new elements
setParameterByName_2 = Element.SetParameterByName(element=byFace_2, parameterName=code_block_80@L1, value=string_from_object_5@L2)

count_3 = List.Count(list=setParameterByName)
code_block_81 = CodeBlock(NoOfElements=count_3)
# ---------- code_block_81.designscript (3 lines) ----------
NoOfElements==0? "You haven't placed any electrical fixtures":
NoOfElements==1? "You have successfully placed " + NoOfElements + " electrical fixture":
"Good work! You have successfully placed " + NoOfElements + " new electrical fixtures";
# ----------------------------------------

# group: Monitor
new_electrical_fixture_s = Watch(code_block_81)  # graph output

count_4 = List.Count(list=byFace_2)
code_block_82 = CodeBlock(NoOfElements=count_4)
# ---------- code_block_82.designscript (3 lines) ----------
NoOfElements==0? "No electrical fixture was relocated":
NoOfElements==1? "You relocated " + NoOfElements + " electrical fixture":
"Well done! You relocated " + NoOfElements + " electrical fixtures";
# ----------------------------------------

# group: Monitor
relocated_electrical_fixture_s = Watch(code_block_82)  # graph output

count_5 = List.Count(list=filterByBoolMask_20.in)
code_block_83 = CodeBlock(NoOfElements=count_5)
# ---------- code_block_83.designscript (3 lines) ----------
NoOfElements==0? "All good here":
NoOfElements==1? "You deleted " + NoOfElements + " electrical fixture, as the associated mechanical equipment is no longer in the model":
"You deleted " + NoOfElements + " electrical fixtures, as the associated mechanical equipment is no longer in the model";
# ----------------------------------------

# group: Monitor
deleted_electrical_fixture_s = Watch(code_block_83)  # graph output

getItemAtIndex_8 = List.GetItemAtIndex(list=flatten_3, index=allIndicesOf_2)

# group: Monitor
unable_to_place_electrical = Watch(getItemAtIndex_8)  # "Unable to place electrical fixtures for the following mechanical equipment"; graph output

code_block_84 = CodeBlock { "Electrical Fixtures"; }
byName_5 = Category.ByName(name=code_block_84)
id_4 = Element.Id(element=code_block_50)
string_from_object_6 = FromObject(obj=id_4)

# group: Write "Equipment ID" parameter
setParameterByName_3 = Element.SetParameterByName(element=byFace, parameterName=code_block_41, value=string_from_object_6)

join_2 = List.Join(list0=setParameterByName_3, list1=byFace_2)
flatten_12 = List.Flatten(list=join_2)
code_block_85 = CodeBlock { "Mark"; "Equipment Reference"; "Equipment Name"; }
filterByBoolMask_21 = List.FilterByBoolMask(list=removeItemAtIndex, mask=code_block_67)
join_3 = List.Join(list0=setParameterByName, list1=filterByBoolMask_21.in)
flatten_13 = List.Flatten(list=join_3)
getParameterValueByName_5 = Element.GetParameterValueByName(element=flatten_13, parameterName=code_block_85.out0)

# group: Write "Equipment Reference" parameter
setParameterByName_4 = Element.SetParameterByName(element=flatten_12, parameterName=code_block_85.out1, value=getParameterValueByName_5)

# group: Conditional
code_block_86 = CodeBlock(passThrough=byName_5) { passThrough: var[]..[]; }
code_block_87 = CodeBlock(waitFor=setParameterByName_4) { waitFor: var[]..[]; }
code_block_88 = CodeBlock(passthrough=code_block_86, waitfor=code_block_87) { [passthrough,waitfor][0]; }

all_elements_of_category_3 = ElementsOfCategory(Category=code_block_88)
code_block_89 = CodeBlock { "Equipment ID"; }
getParameterValueByName_6 = Element.GetParameterValueByName(element=all_elements_of_category_3, parameterName=code_block_89)
id_5 = Element.Id(element=flatten_3)
string_from_object_7 = FromObject(obj=id_5)
allIndicesOf_4 = List.AllIndicesOf(list=getParameterValueByName_6, item=string_from_object_7)
flatten_14 = List.Flatten(list=allIndicesOf_4)
getItemAtIndex_9 = List.GetItemAtIndex(list=all_elements_of_category_3, index=flatten_14)
isEmpty_5 = List.IsEmpty(list=allIndicesOf_4, lacing=Longest)
not_4 = Not(x=isEmpty_5)
filterByBoolMask_22 = List.FilterByBoolMask(list=flatten_3, mask=not_4)

# group: Data Exchange
elementType_2 = Element.ElementType(element=getItemAtIndex_9)
elementType_3 = Element.ElementType(element=filterByBoolMask_22.in)
code_block_90 = CodeBlock { ["Voltage","Number of Phases","Frequency","Motor Load","Motor Starting Method"]; }
getParameterValueByName_7 = Element.GetParameterValueByName(element=elementType_3, parameterName=code_block_90@L1)
code_block_91 = CodeBlock { 3; }
code_block_92 = CodeBlock(x=getParameterValueByName_7) { x[3]; }
code_block_93 = CodeBlock(x=code_block_92) { x==1? true: false; }
replaceItemAtIndex = List.ReplaceItemAtIndex(list=getParameterValueByName_7, index=code_block_91, item=code_block_93)
code_block_94 = CodeBlock { [0,1]; [2,3,4]; }
removeItemAtIndex_5 = List.RemoveItemAtIndex(list=replaceItemAtIndex, indices=code_block_94.out0)
transpose = List.Transpose(lists=removeItemAtIndex_5)
code_block_95 = CodeBlock { "Full Load Current"; }
getParameterValueByName_8 = Element.GetParameterValueByName(element=filterByBoolMask_22.in, parameterName=code_block_95)
list_create_8 = List.Create(item0=getParameterValueByName_8)
removeItemAtIndex_6 = List.RemoveItemAtIndex(list=replaceItemAtIndex, indices=code_block_94.out1)
join_4 = List.Join(list0=list_create_8, list1=removeItemAtIndex_6)
transpose_2 = List.Transpose(lists=join_4)

# group: Write parameters : Frequency, Motor Load, Motor Starting Method
code_block_96 = CodeBlock { ["Frequency","Motor Load","Motor Starting Method"]; }
setParameterByName_5 = Element.SetParameterByName(element=elementType_2@L1, parameterName=code_block_96, value=transpose@L2)

# group: Write parameters: Full Load Current, Voltage & Number of Phases
code_block_97 = CodeBlock { ["Full Load Current","Voltage","Number of Phases"]; }
setParameterByName_6 = Element.SetParameterByName(element=getItemAtIndex_9@L1, parameterName=code_block_97, value=transpose_2@L2)

# group: Conditional
code_block_98 = CodeBlock(FirstUIWasRun=multipleinputform.Was_Run, FirstUIWasCancelled=multipleinputform.Was_Cancelled, SecondUIWasRun=multipleinputform_2.Was_Run, SecondUIWasCancelled=multipleinputform_2.Was_Cancelled)
# ---------- code_block_98.designscript (2 lines) ----------
FirstUIWasRun == true && FirstUIWasCancelled == false && SecondUIWasRun == true && SecondUIWasCancelled == false? "Please don't forget to circuit all the newly created electrical fixtures!" :
"Ops! Something went wrong";
# ----------------------------------------

# group: Python to get element level
python_script_7 = Python(IN[0]=flatten_13)  # IronPython2
# ---------- python_script_7.python (60 lines) ----------
import clr
clr.AddReference('RevitAPI')
from Autodesk.Revit.DB import *

clr.AddReference("RevitNodes")
import Revit
clr.ImportExtensions(Revit.Elements)

#Inspired by Clockwork
def GetLevel(item):
	val = None
	if hasattr(item, "LevelId"): 
		val = item.Document.GetElement(item.LevelId)
		if val: return val
	if hasattr(item, "Level"):
		val = item.Level
		if val: return val
	if hasattr(item, "GenLevel"):
		val = item.GenLevel
		if val: return val
	if (item.GetType().ToString() in ("Autodesk.Revit.DB.Architecture.StairsRun", "Autodesk.Revit.DB.Architecture.StairsLanding")):
		item = item.GetStairs()
	if (item.GetType().ToString() == "Autodesk.Revit.DB.Architecture.Stairs") or item.Category.Id == ElementId(BuiltInCategory.OST_Ramps):
		try: return item.Document.GetElement(item.get_Parameter(BuiltInParameter.STAIRS_BASE_LEVEL_PARAM).AsElementId())
		except: pass
	if (item.GetType().ToString() == "Autodesk.Revit.DB.ExtrusionRoof"):
		try: return item.Document.GetElement(item.get_Parameter(BuiltInParameter.ROOF_CONSTRAINT_LEVEL_PARAM).AsElementId())
		except: pass
	if (item.GetType().ToString() == "Autodesk.Revit.DB.Mechanical.Duct" or "Autodesk.Revit.DB.Electrical.Conduit"):
		try: return item.Document.GetElement(item.get_Parameter(BuiltInParameter.RBS_START_LEVEL_PARAM).AsElementId())
		except: pass
	if hasattr(item, "OwnerViewId"):
		view = item.Document.GetElement(item.OwnerViewId)
		if hasattr(view, "GenLevel"):
			val = view.GenLevel
			if val: return val
	if not val:
		try: return item.Document.GetElement(item.get_Parameter(BuiltInParameter.INSTANCE_REFERENCE_LEVEL_PARAM).AsElementId())
		except: 
			try: return item.Document.GetElement(item.get_Parameter(BuiltInParameter.INSTANCE_SCHEDULE_ONLY_LEVEL_PARAM).AsElementId())
			except: 
				try: return item.Document.GetElement(item.get_Parameter(BuiltInParameter.SCHEDULE_LEVEL_PARAM).AsElementId())
				except:
					#if item is work plane based
					collector = FilteredElementCollector(item.Document).OfClass(Level).ToElements()
					try: return [level for level in collector if item.get_Parameter(BuiltInParameter.SKETCH_PLANE_PARAM).AsString().split(": ")[-1] == level.Name][0]
					except: return None

ProcessLists = lambda function, lists: [ProcessLists(function, item) if isinstance(item, list) else function(item) for item in lists]
ApplyFunction = lambda func, objs: ProcessLists(func, objs) if isinstance(objs, list) else [func(objs)]

def Unwrap(item):
    return UnwrapElement(item)
    
if isinstance(IN[0], list):
	items = ProcessLists(Unwrap, IN[0])
else:
	items = Unwrap(IN[0])

OUT=ApplyFunction(GetLevel,items)
# ----------------------------------------

# group: Write parameter 'Schedule Level'
code_block_99 = CodeBlock { "Schedule Level"; }
setParameterByName_7 = Element.SetParameterByName(element=flatten_12, parameterName=code_block_99, value=python_script_7)

# group: Conditional
code_block_100 = CodeBlock(passThrough=code_block_98) { passThrough: var[]..[]; }
code_block_101 = CodeBlock(waitFor=setParameterByName_7) { waitFor: var[]..[]; }
code_block_102 = CodeBlock(passthrough=code_block_100, waitfor=code_block_101) { [passthrough,waitfor][0]; }

# group: Python to generate pop-up message
code_block_103 = CodeBlock { "M & E Automations"; }
python_script_8 = Python(IN[0]=code_block_103, IN[1]=code_block_102)  # IronPython2
# ---------- python_script_8.python (9 lines) ----------
import clr
clr.AddReference('RevitAPIUI')
from Autodesk.Revit.UI import TaskDialog

windowTitle = IN[0]
windowMessage = IN[1]

messageDialog = TaskDialog
OUT = messageDialog.Show(windowTitle, windowMessage)
# ----------------------------------------

watch_2 = Watch(getItemAtIndex_9)
watch_3 = Watch(filterByBoolMask_22.in)

# group: Write "Equipment Name" parameter
setParameterByName_8 = Element.SetParameterByName(element=flatten_12, parameterName=code_block_85.out2, value=code_block_12, lacing=Longest)

id_6 = Element.Id(element=byFace_2)
string_from_object_8 = FromObject(obj=id_6)

# group: Write Equipment ID parameter based on new electrical fixtures
setParameterByName_9 = Element.SetParameterByName(element=flatten_13, parameterName=code_block_80, value=string_from_object_8)

filterByBoolMask_23 = List.FilterByBoolMask(list=removeItemAtIndex, mask=code_block_67)
