# Dynamo graph M&E Data Exchange - Fire & Smoke Dampers v.2.1.dyn (Dynamo 2.16.1.2727)
# packages: bimorphNodes 4.2.4, Data-Shapes 2022.2.106

# group: DYNAMO COLOUR CODING LEGEND
# note: COLOUR CODING LEGEND

# group: Python
# note: USE:
# FOR PYTHON NODES

# group: Monitor
# note: USE:
# FOR IMPORTANT WATCH NODES

# group: Conditional
# note: USE:
# FOR CONDITIONAL NODES

# group: To Revit
# note: USE:
# FOR CHANGES TO REVIT

# group: Control
# note: USE:
# FOR USER CONTROL (SLIDERS ETC.)

# group: Input
# note: USE:
# FOR FIXED INPUT (FILE PATHS ETC.)

# group: Background
# note: USE:
# FOR GENERAL WORKFLOW NODES

# group: Get only Fire and Smoke Dampers & Smoke Control Dampers elements
code_block = CodeBlock { "Duct Accessories"; }
byName = Category.ByName(name=code_block)
all_elements_of_category = ElementsOfCategory(Category=byName)
getFamily = FamilyInstance.GetFamily(familyInstance=all_elements_of_category)
name = Family.Name(family=getFamily)
code_block_2 = CodeBlock { ["HL_FireandSmokeDamper", "HL_SmokeControlDamper"]; }
contains = String.Contains(string=name, searchFor=code_block_2@L1)
filterByBoolMask = List.FilterByBoolMask(list=all_elements_of_category, mask=contains@L2)
flatten = List.Flatten(list=filterByBoolMask.in)

# group: Python to get categories
python_script = Python()  # IronPython2
# ---------- python_script.python (22 lines) ----------
import clr
clr.AddReference('RevitAPI')
from Autodesk.Revit.DB import *

clr.AddReference("RevitNodes")
import Revit
clr.ImportExtensions(Revit.Elements)
clr.ImportExtensions(Revit.GeometryConversion)

clr.AddReference("RevitServices")
import RevitServices
from RevitServices.Persistence import DocumentManager
from RevitServices.Transactions import TransactionManager

doc = DocumentManager.Instance.CurrentDBDocument
categories = doc.Settings.Categories
listout = []
	
for x in categories:
	listout.append(Revit.Elements.Category.ById(x.Id.IntegerValue))

OUT = listout
# ----------------------------------------

# group: Get Walls, Floors & Roofs from all RVT Links
name_2 = Category.Name(category=python_script)
code_block_3 = CodeBlock { ["RVT Links", "Walls", "Floors", "Roofs"]; }
indexOf = List.IndexOf(list=name_2, element=code_block_3)
getItemAtIndex = List.GetItemAtIndex(list=python_script, index=indexOf)
deconstruct = List.Deconstruct(list=getItemAtIndex)
all_elements_of_category_2 = ElementsOfCategory(Category=deconstruct.first)

# group: From BimorphNodes package
ofCategory = Revit.LinkElement.OfCategory(linkInstance=all_elements_of_category_2, category=deconstruct.rest, lacing=Longest)

# group: From BimorphNodes package
intersectsElement = Revit.Element.IntersectsElement(elementSetA=flatten, elementSetB=ofCategory)
element = Results.ElementIntersectionResult.Element(elementIntersectionResult=intersectsElement)
intersectingElements = Results.ElementIntersectionResult.IntersectingElements(elementIntersectionResult=intersectsElement)

isEmpty = List.IsEmpty(list=intersectingElements@@L2)
not_ = Not(x=isEmpty)
filterByBoolMask_2 = List.FilterByBoolMask(list=element, mask=not_)
code_block_4 = CodeBlock { 0; [1,2]; }
getItemAtIndex_2 = List.GetItemAtIndex(list=filterByBoolMask_2.in, index=code_block_4.out0)
getItemAtIndex_3 = List.GetItemAtIndex(list=filterByBoolMask_2.in, index=code_block_4.out1)
flatten_2 = List.Flatten(list=getItemAtIndex_3)

# group: Python to get element connectors
python = Python(IN[0]=flatten_2)  # IronPython2
# ---------- python.python (44 lines) ----------
import clr
import math

clr.AddReference("RevitServices")
import RevitServices
from RevitServices.Persistence import DocumentManager
from RevitServices.Transactions import TransactionManager
doc = DocumentManager.Instance.CurrentDBDocument

clr.AddReference("RevitAPI")
import Autodesk
from Autodesk.Revit.DB import *

clr.AddReference("RevitNodes")
import Revit
clr.ImportExtensions(Revit.Elements)
clr.ImportExtensions(Revit.GeometryConversion)
#The inputs to this node will be stored as a list in the IN variables.
if isinstance(IN[0], list):
	elements = UnwrapElement(IN[0])
	toggle = 0
else:
	toggle = 1
	elements = [UnwrapElement(IN[0])]
	

listout = []

for element in elements:
	try:
		connectors = element.MEPModel.ConnectorManager.Connectors
	except:
		try:
			connectors = element.ConnectorManager.Connectors
		except:			
			connectors = []
	listout.append([x for x in connectors])


#Assign your output to the OUT variable.
if toggle:
	OUT = connectors
else:
	OUT = listout
# ----------------------------------------

# group: Python to get connector location
python_2 = Python(IN[0]=python)  # IronPython2
# ---------- python_2.python (41 lines) ----------
import clr

clr.AddReference("RevitServices")
import RevitServices
from RevitServices.Persistence import DocumentManager
from RevitServices.Transactions import TransactionManager
doc = DocumentManager.Instance.CurrentDBDocument

clr.AddReference("RevitAPI")
import Autodesk
from Autodesk.Revit.DB import *

clr.AddReference("RevitNodes")
import Revit
clr.ImportExtensions(Revit.Elements)
clr.ImportExtensions(Revit.GeometryConversion)

#Many thanks to Konrad K Sobon for his awesome ProcessList function!
def Unwrap(item):
	return UnwrapElement(item)

def ProcessList(_func, _list):
    return map( lambda x: ProcessList(_func, x) if type(x)==list else _func(x), _list )

if isinstance(IN[0], list):
	connectors = ProcessList(Unwrap, IN[0])
else:
	connectors = [Unwrap(IN[0])]
	
	
def getPoint(connector):
	try:
		return connector.Origin.ToPoint()
	except:
		return None


			
#Assign your output to the OUT variable.

OUT = ProcessList(getPoint, connectors)
# ----------------------------------------

# group: Python to check if connector is primary
python_3 = Python(IN[0]=python)  # IronPython2
# ---------- python_3.python (42 lines) ----------
import clr

clr.AddReference("RevitServices")
import RevitServices
from RevitServices.Persistence import DocumentManager
from RevitServices.Transactions import TransactionManager
doc = DocumentManager.Instance.CurrentDBDocument

clr.AddReference("RevitAPI")
import Autodesk
from Autodesk.Revit.DB import *

clr.AddReference("RevitNodes")
import Revit
clr.ImportExtensions(Revit.Elements)
clr.ImportExtensions(Revit.GeometryConversion)

#Many thanks to Konrad K Sobon for his awesome ProcessList function!
def Unwrap(item):
	return UnwrapElement(item)

def ProcessList(_func, _list):
    return map( lambda x: ProcessList(_func, x) if type(x)==list else _func(x), _list )

if isinstance(IN[0], list):
	connectors = ProcessList(Unwrap, IN[0])
else:
	connectors = [Unwrap(IN[0])]
	
	
def getConnPrim(connector):
	prim = False
	try:
		prim = connector.GetMEPConnectorInfo().IsPrimary
	except:
		pass
	return prim

			
#Assign your output to the OUT variable.

OUT = ProcessList(getConnPrim, connectors)
# ----------------------------------------

not_2 = Not(x=python_3)

# group: Get the location of non-primary connectors
filterByBoolMask_3 = List.FilterByBoolMask(list=python_2, mask=not_2)

# group: Ray direction for walls
XAxis = Vector.XAxis()
reverse = Vector.Reverse(vector=XAxis)
YAxis = Vector.YAxis()
reverse_2 = Vector.Reverse(vector=YAxis)
list_create = List.Create(item0=XAxis, item1=reverse, item2=YAxis, item3=reverse_2)
code_block_5 = CodeBlock { true; }

# group: Python to create 3D view
code_block_6 = CodeBlock()
# ---------- code_block_6.designscript (2 lines) ----------
//String
ViewName ="ThreeD";
# ----------------------------------------
code_block_7 = CodeBlock()
# ---------- code_block_7.designscript (2 lines) ----------
// Use only if you want to query a linked model
document : var = null;
# ----------------------------------------
create_3dview = Python(IN[0]=code_block_6, IN[1]=code_block_7)  # IronPython2
# ---------- create_3dview.python (53 lines) ----------
#Suggestion by Marck Ackerley
#Suggestion of improvement by Jonathan Atger
import clr
# Import DocumentManager and TransactionManager
clr.AddReference('RevitServices')
import RevitServices
from RevitServices.Persistence import DocumentManager
from RevitServices.Transactions import TransactionManager

# Import RevitAPI
clr.AddReference('RevitAPI')
import Autodesk
from Autodesk.Revit.DB import *

def ProcessParallelLists(_func, *lists):
	return map( lambda *xs: ProcessParallelLists(_func, *xs) if all(type(x) is list for x in xs) else _func(*xs), *lists )

def tolist(obj1):
    if hasattr(obj1,"__iter__"): return obj1
    else: return [obj1]

viewNames = tolist(IN[0])
inputdoc = tolist(UnwrapElement(IN[1]))
inputdoc = inputdoc[0]
	
#Inputdoc : Part of script by Andreas Dieckmann
if inputdoc == None:
	doc = DocumentManager.Instance.CurrentDBDocument
elif inputdoc.GetType().ToString() == "Autodesk.Revit.DB.Document":
	doc = inputdoc
elif inputdoc.GetType().ToString() == "Autodesk.Revit.DB.RevitLinkInstance":
	doc = inputdoc.GetLinkDocument()
else :
	doc = DocumentManager.Instance.CurrentDBDocument

#Get 3D View ViewFamilyType
viewType = FilteredElementCollector(doc).OfClass(ViewFamilyType).ToElements().Find(lambda x : x.ViewFamily == ViewFamily.ThreeDimensional)

def CreateView(name):
	view = View3D.CreateIsometric(doc, viewType.Id)
	try:view.Name = name
	except:pass
	return view

TransactionManager.Instance.ForceCloseTransaction()
t = Transaction(doc,'Create3D')
t.Start()
views=ProcessParallelLists(CreateView, viewNames)
t.Commit()
#TransactionManager.Instance.ForceCloseTransaction()

#Assign your output to the OUT variable
OUT = views, doc
# ----------------------------------------
code_block_8 = CodeBlock(x=create_3dview) { x[0]; }

# group: Conditional
code_block_9 = CodeBlock(passthrough=list_create, waitfor=code_block_8) { [passthrough,waitfor][0]; }

code_block_10 = CodeBlock { "OST_Walls"; }
byName_2 = Category.ByName(name=code_block_10)

# group: From BimorphNodes package
byRayBounce = Revit.LinkElement.ByRayBounce(origin=filterByBoolMask_3.in, direction=code_block_9@L2, view3D=code_block_8, category=byName_2, findNearest=code_block_5, lacing=Longest)

flatten_3 = List.Flatten(list=byRayBounce.Point, lacing=Longest)
isEmpty_2 = List.IsEmpty(list=flatten_3, lacing=Longest)
filterByBoolMask_4 = List.FilterByBoolMask(list=flatten_2, mask=isEmpty_2)
join = List.Join(list0=getItemAtIndex_2, list1=filterByBoolMask_4.out)
code_block_11 = CodeBlock { "Equipment ID"; }
getParameterValueByName = Element.GetParameterValueByName(element=join, parameterName=code_block_11)
code_block_12 = CodeBlock { " "; }
split = String.Split(string=getParameterValueByName, separator0=code_block_12)
isEmpty_3 = List.IsEmpty(list=split, lacing=Longest)
filterByBoolMask_5 = List.FilterByBoolMask(list=join, mask=isEmpty_3)
count = List.Count(list=filterByBoolMask_5.in)

# group: First UI
code_block_13 = CodeBlock { "ME Data Exchange for Fire and Smoke Dampers"; null; "Proceed"; "Cancel"; 800; 700; 400; }
code_block_14 = CodeBlock { "Requirements"; "Dynamo v.2, Data-Shapes and Bimorph Nodes 4.2.4 packages"; }
textnote_data = Custom[TextNote Data](Title=code_block_14.out0, TextNote=code_block_14.out1)  # package Data-Shapes; Create Data for TextNote input in UI.MultipleInputForm ++ . Check out www.data-shapes.net for more informations
code_block_15 = CodeBlock { "Fixtures Required"; ["Fused Connection Unit and Fire Alarm Interface", "Junction Box"]; [0,1]; 0; }
boolean = BoolSelector(true)

radiobuttons_data = Custom[RadioButtons Data](InputName=code_block_15.out0, Keys=code_block_15.out1, Values=code_block_15.out2, DefaultValueIndex=code_block_15.out3)  # package Data-Shapes; Create radio buttons input for UI.MultipleInputForm ++ .

# group (continued): First UI
list_create_2 = List.Create(item0=textnote_data, item1=radiobuttons_data)
multipleinputform = Custom[MultipleInputForm ++](Description_optional=code_block_13.out0, Logo_optional=code_block_13.out1, ButtonText_optional=code_block_13.out2, Inputs=list_create_2, Toggle=boolean, CancelButtonText_optional=code_block_13.out3, MaxHeight_optional=code_block_13.out4, Width_optional=code_block_13.out5, LabelWidth_optional=code_block_13.out6)  # package Data-Shapes; Create a form with multiple inputs. see www.data-shapes.net for tutorials and infos!

# group: Conditional
code_block_16 = CodeBlock(LstCount=count, FirstUserInterface=multipleinputform.User_Inputs)
# ---------- code_block_16.designscript (7 lines) ----------
LstCount == 0 && FirstUserInterface == 0 ? "All good here! You haven't placed any new electrical fixtures and fire alarm devices." :
LstCount == 0 && FirstUserInterface == 1 ? "All good here! You haven't placed any new electrical fixtures." :
LstCount == 1 && FirstUserInterface == 0 ? "Nice work! You placed " + LstCount + " electrical fixture and " + LstCount + " fire alarm device." :
LstCount == 1 && FirstUserInterface == 1 ? "Nice work! You placed " + LstCount + " electrical fixture." :
LstCount > 1 && FirstUserInterface == 0 ? "Nice work! You placed " + LstCount + " electrical fixtures and " + LstCount + " fire alarm devices." :
LstCount > 1 && FirstUserInterface == 1 ? "Nice work! You placed " + LstCount + " electrical fixtures." :
"Oops! Something went wrong!";
# ----------------------------------------

# group: Watch
new_electrical_fixtures_and = Watch(code_block_16)  # "New electrical fixtures and devices"; graph output

# group: Get all Electrical Fixtures & Fire Alarm Devices
code_block_17 = CodeBlock { ["Electrical Fixtures","Fire Alarm Devices"]; }
byName_3 = Category.ByName(name=code_block_17)
all_elements_of_category_3 = ElementsOfCategory(Category=byName_3)
flatten_4 = List.Flatten(list=all_elements_of_category_3)

# group: Get only Electrical Fixtures & Fire Alarm Devices associated with Fire and Smoke Dampers & Smoke Control Dampers
code_block_18 = CodeBlock { "Equipment Name"; }
getParameterValueByName_2 = Element.GetParameterValueByName(element=flatten_4, parameterName=code_block_18)
code_block_19 = CodeBlock { ["HL_FireandSmokeDamper_", "HL_SmokeControlDamper_"]; }
contains_2 = String.Contains(string=getParameterValueByName_2, searchFor=code_block_19@L1)
filterByBoolMask_6 = List.FilterByBoolMask(list=flatten_4, mask=contains_2@L2)
flatten_5 = List.Flatten(list=filterByBoolMask_6.in)

# group: Get only Electrical Fixtures & Fire Alarm Devices with a value for Equipment ID parameter
code_block_20 = CodeBlock { "Equipment ID"; }
getParameterValueByName_3 = Element.GetParameterValueByName(element=flatten_5, parameterName=code_block_20)
length = String.Length(string=getParameterValueByName_3)
code_block_21 = CodeBlock { 7; }
eq = length == code_block_21
filterByBoolMask_7 = List.FilterByBoolMask(list=flatten_5, mask=eq)
filterByBoolMask_8 = List.FilterByBoolMask(list=getParameterValueByName_3, mask=eq)

# group: Get Element ID's of dampers
id = Element.Id(element=flatten)

string_from_object = FromObject(obj=id)

# group: Identify Electrical Fixtures & Fire Alarm Devices that are already associated with dampers
contains_3 = List.Contains(list=filterByBoolMask_8.in, item=string_from_object, lacing=CrossProduct)
identity = Object.Identity()  # unwired: object
trueForAny = List.TrueForAny(list=contains_3, queryFunction=identity, lacing=Longest)
filterByBoolMask_9 = List.FilterByBoolMask(list=filterByBoolMask_7.in, mask=trueForAny)

# group: Get Element ID's
id_2 = Element.Id(element=filterByBoolMask_9.in)

string_from_object_2 = FromObject(obj=id_2)
not_3 = Not(x=isEmpty_3)
filterByBoolMask_10 = List.FilterByBoolMask(list=split, mask=not_3)
indexOf_2 = List.IndexOf(list=string_from_object_2, element=filterByBoolMask_10.in)
code_block_22 = CodeBlock(x=indexOf_2) { x>=0; }
identity_2 = Object.Identity()  # unwired: object
trueForAny_2 = List.TrueForAny(list=code_block_22, queryFunction=identity_2, lacing=Longest)
filterByBoolMask_11 = List.FilterByBoolMask(list=filterByBoolMask_5.out, mask=trueForAny_2)
boundingBox = Element.BoundingBox(element=filterByBoolMask_11.in)
code_block_23 = CodeBlock { Point.ByCoordinates (0, 0); 10; }
byCenterPointRadius = Sphere.ByCenterPointRadius(centerPoint=code_block_23.out0, radius=code_block_23.out1)
empty = List.Empty()
list_create_3 = List.Create(item0=empty, item1=empty)
list_create_4 = List.Create(item0=list_create_3, item1=filterByBoolMask_5.out)
filterByBoolMask_12 = List.FilterByBoolMask(list=indexOf_2, mask=code_block_22)
flatten_6 = List.Flatten(list=filterByBoolMask_12.in)
isEmpty_4 = List.IsEmpty(list=flatten_6)

# group: Conditional
code_block_24 = CodeBlock(lstisempty=isEmpty_4) { lstisempty == true? 0 : 1; }

getItemAtIndex_4 = List.GetItemAtIndex(list=list_create_4, index=code_block_24)
firstItem = List.FirstItem(list=getItemAtIndex_4)
geometry = Element.Geometry(element=firstItem)
code_block_25 = CodeBlock { false; }
clean = List.Clean(list=filterByBoolMask_12.in, preserveIndices=code_block_25)
list_create_5 = List.Create(item0=empty, item1=clean)
getItemAtIndex_5 = List.GetItemAtIndex(list=list_create_5, index=code_block_24)
getItemAtIndex_6 = List.GetItemAtIndex(list=filterByBoolMask_9.in, index=getItemAtIndex_5)
firstItem_2 = List.FirstItem(list=getItemAtIndex_6, lacing=Longest)
boundingBox_2 = Element.BoundingBox(element=firstItem_2)
empty_2 = List.Empty()

# group: Distance from the damper if the damper moved
distance_from_the_damper = IntegerSlider(500, range=200..1500 step 50)

# group: Expand Bounding Box
code_block_26 = CodeBlock(BBox=boundingBox_2) { BBox; }
minPoint = BoundingBox.MinPoint(boundingBox=code_block_26)
maxPoint = BoundingBox.MaxPoint(boundingBox=code_block_26)
XAxis_2 = Vector.XAxis()
reverse_3 = Vector.Reverse(vector=XAxis_2)
YAxis_2 = Vector.YAxis()
reverse_4 = Vector.Reverse(vector=YAxis_2)
ZAxis = Vector.ZAxis()
reverse_5 = Vector.Reverse(vector=ZAxis)
join_2 = List.Join(list0=XAxis_2, list1=reverse_3, list2=YAxis_2, list3=reverse_4, list4=ZAxis, list5=reverse_5)
code_block_27 = CodeBlock(Amount=distance_from_the_damper) { Amount; }
flatten_7 = List.Flatten()  # unwired: list

list_create_6 = List.Create(item0=minPoint, item1=maxPoint)

# group (continued): Expand Bounding Box
transpose = List.Transpose(lists=list_create_6)

list_create_7 = List.Create(item0=empty_2, item1=join_2)
getItemAtIndex_7 = List.GetItemAtIndex(list=list_create_7, index=code_block_24)

# group (continued): Expand Bounding Box
byStartPointDirectionLength = Line.ByStartPointDirectionLength(startPoint=transpose@L2, direction=getItemAtIndex_7, length=code_block_27, lacing=CrossProduct)
map = List.Map(list=byStartPointDirectionLength, f_x=flatten_7)

list_create_8 = List.Create(item0=geometry, item1=map)
getItemAtIndex_8 = List.GetItemAtIndex(list=list_create_8, index=code_block_24)
isEmpty_5 = List.IsEmpty(list=getItemAtIndex_8)

# group: Conditional
code_block_28 = CodeBlock(trueOption=byCenterPointRadius, falseOption=getItemAtIndex_8, test=isEmpty_5) { [trueOption, falseOption][test?0:1]; }

# group (continued): Expand Bounding Box
byGeometry = BoundingBox.ByGeometry(geom=code_block_28)

intersects = BoundingBox.Intersects(boundingBox=boundingBox, other=byGeometry)
not_4 = Not(x=intersects)
filterByBoolMask_13 = List.FilterByBoolMask(list=filterByBoolMask_11.in, mask=not_4)
count_2 = List.Count(list=filterByBoolMask_13.in)

# group: Conditional
code_block_29 = CodeBlock(LstCount=count_2, FirstUserInterface=multipleinputform.User_Inputs)
# ---------- code_block_29.designscript (6 lines) ----------
LstCount == 0 ? "All good here! None of the dampers was relocated." :
LstCount == 1 && FirstUserInterface == 0 ? "Good job! You relocated " + LstCount + " electrical fixture and " + LstCount + " fire alarm device." :
LstCount == 1 && FirstUserInterface == 1 ? "Good job! You relocated " + LstCount + " electrical fixture." :
LstCount > 1 && FirstUserInterface == 0 ? "Good job! You relocated " + LstCount + " electrical fixtures and " + LstCount + " fire alarm devices." :
LstCount > 1 && FirstUserInterface == 1 ? "Good job! You relocated " + LstCount + " electrical fixtures." :
"Oops! Something went wrong!";
# ----------------------------------------

# group: Watch
relocated_electrical_fixtures = Watch(code_block_29)  # "Relocated electrical fixtures and devices"; graph output

# group: Watch
unable_to_place_electrical = Watch(filterByBoolMask_4.in)  # "Unable to place electrical fixtures and fire alarm devices for:"; graph output

flatten_8 = List.Flatten(list=intersectingElements, lacing=Longest)
flatten_9 = List.Flatten(list=flatten_8)
firstItem_3 = List.FirstItem(list=flatten_9)
faces = Element.Faces(element=firstItem_3)
getItemAtIndex_9 = List.GetItemAtIndex(list=flatten_8, index=code_block_4.out0)
indexOf_3 = List.IndexOf(list=getItemAtIndex_2, element=filterByBoolMask_13.out)
code_block_30 = CodeBlock(x=indexOf_3) { x >= 0; }
filterByBoolMask_14 = List.FilterByBoolMask(list=indexOf_3, mask=code_block_30)
removeItemAtIndex = List.RemoveItemAtIndex(list=getItemAtIndex_2, indices=filterByBoolMask_14.in)
indexOf_4 = List.IndexOf(list=getItemAtIndex_2, element=removeItemAtIndex)
getItemAtIndex_10 = List.GetItemAtIndex(list=getItemAtIndex_9, index=indexOf_4)

# group: Get vertical surfaces of the walls
faces_2 = Element.Faces(element=getItemAtIndex_10)
code_block_31 = CodeBlock { 0.5; }
normalAtParameter = Surface.NormalAtParameter(surface=faces_2, u=code_block_31, v=code_block_31)
Z = Vector.Z(vector=normalAtParameter)
formula = Formula("1.0e-9")
code_block_32 = CodeBlock(z=Z, almostzero=formula)
# ---------- code_block_32.designscript (2 lines) ----------
// Is vertical?
z >= (0 - almostzero) && z <= (0 + almostzero);
# ----------------------------------------
filterByBoolMask_15 = List.FilterByBoolMask(list=faces_2, mask=code_block_32)
code_block_33 = CodeBlock(VerticalSurfaces=filterByBoolMask_15.in) { VerticalSurfaces; }

# group: Python to get element connectors
python_4 = Python(IN[0]=removeItemAtIndex)  # IronPython2; same code as python

# group: Python to get connector location
python_5 = Python(IN[0]=python_4)  # IronPython2; same code as python_2

# group: Python to check if connector is primary
python_6 = Python(IN[0]=python_4)  # IronPython2; same code as python_3

not_5 = Not(x=python_6)

# group: Ge non-primary connectors and their locations
filterByBoolMask_16 = List.FilterByBoolMask(list=python_5, mask=not_5)
flatten_10 = List.Flatten(list=filterByBoolMask_16.in)
filterByBoolMask_17 = List.FilterByBoolMask(list=python_4, mask=not_5)

# group: Python to get connector direction
python_7 = Python(IN[0]=filterByBoolMask_17.in)  # IronPython2
# ---------- python_7.python (41 lines) ----------
import clr

clr.AddReference("RevitServices")
import RevitServices
from RevitServices.Persistence import DocumentManager
from RevitServices.Transactions import TransactionManager
doc = DocumentManager.Instance.CurrentDBDocument

clr.AddReference("RevitAPI")
import Autodesk
from Autodesk.Revit.DB import *

clr.AddReference("RevitNodes")
import Revit
clr.ImportExtensions(Revit.Elements)
clr.ImportExtensions(Revit.GeometryConversion)

#Many thanks to Konrad K Sobon for his awesome ProcessList function!
def Unwrap(item):
	return UnwrapElement(item)

def ProcessList(_func, _list):
    return map( lambda x: ProcessList(_func, x) if type(x)==list else _func(x), _list )

if isinstance(IN[0], list):
	connectors = ProcessList(Unwrap, IN[0])
else:
	connectors = [Unwrap(IN[0])]
	
	
def getConnDir(connector):
	try:
		return connector.CoordinateSystem.BasisZ.ToVector()
	except:
		return None


			
#Assign your output to the OUT variable.

OUT = ProcessList(getConnDir, connectors)
# ----------------------------------------

reverse_6 = Vector.Reverse(vector=python_7)
flatten_11 = List.Flatten(list=reverse_6)
code_block_34 = CodeBlock { "Overall Length"; }
getParameterValueByName_4 = Element.GetParameterValueByName(element=removeItemAtIndex, parameterName=code_block_34)
code_block_35 = CodeBlock(x=getParameterValueByName_4) { x-50; }
byStartPointDirectionLength_2 = Line.ByStartPointDirectionLength(startPoint=flatten_10, direction=flatten_11, length=code_block_35)
intersect = Geometry.Intersect(geometry=byStartPointDirectionLength_2, other=code_block_33)
isEmpty_6 = List.IsEmpty(list=intersect@@L2)
not_6 = Not(x=isEmpty_6)
filterByBoolMask_18 = List.FilterByBoolMask(list=code_block_33, mask=not_6)
firstItem_4 = List.FirstItem(list=filterByBoolMask_18.in, lacing=Longest)
list_create_9 = List.Create(item0=faces, item1=firstItem_4)
isEmpty_7 = List.IsEmpty(list=firstItem_4)

# group: Conditional
code_block_36 = CodeBlock(LstIsEmpty=isEmpty_7) { LstIsEmpty ==true? 0 : 1; }

getItemAtIndex_11 = List.GetItemAtIndex(list=list_create_9, index=code_block_36)

# group: Plane By Best Fit From Face (from Clockwork package)
vertices = Topology.Vertices(topology=getItemAtIndex_11)
pointGeometry = Vertex.PointGeometry(vertex=vertices)
byBestFitThroughPoints = Plane.ByBestFitThroughPoints(points=pointGeometry)

# group: Bounding box for dampers with min and max points
boundingBox_3 = Element.BoundingBox(element=removeItemAtIndex)
minPoint_2 = BoundingBox.MinPoint(boundingBox=boundingBox_3)
maxPoint_2 = BoundingBox.MaxPoint(boundingBox=boundingBox_3)
list_create_10 = List.Create(item0=minPoint_2, item1=maxPoint_2)
transpose_2 = List.Transpose(lists=list_create_10)

flatten_12 = List.Flatten(list=intersect, lacing=Longest)
firstItem_5 = List.FirstItem(list=flatten_12, lacing=Longest)

# group: Get closest point
distanceTo = Geometry.DistanceTo(geometry=firstItem_5, other=transpose_2)
minimumItem = List.MinimumItem(list=distanceTo)
indexOf_5 = List.IndexOf(list=distanceTo, element=minimumItem, lacing=Longest)
getItemAtIndex_12 = List.GetItemAtIndex(list=transpose_2, index=indexOf_5, lacing=Shortest)

# group: Point Pull Onto Plane
code_block_37 = CodeBlock(pl=byBestFitThroughPoints, pt=getItemAtIndex_12) { d = pl.Normal.Dot(pl.Origin.AsVector() ) - pl.Normal.Dot(pt.AsVector() ); p1 = pt.Add(pl.Normal.Scale(d) ); }

X = Point.X(point=code_block_37.p1)
Y = Point.Y(point=code_block_37.p1)
Z_2 = Point.Z(point=firstItem_5)
byCoordinates = Point.ByCoordinates(x=X, y=Y, z=Z_2)
byStartPointEndPoint = Line.ByStartPointEndPoint(startPoint=byCoordinates, endPoint=firstItem_5)
reverse_7 = Curve.Reverse(curve=byStartPointEndPoint)
direction = Line.Direction(line=reverse_7)

# group: Get all families of Electrical Fixtures category
python_script_2 = Python()  # IronPython2; unwired: IN[0]
# ---------- python_script_2.python (12 lines) ----------
import clr
clr.AddReference("RevitServices")
import RevitServices
from RevitServices.Persistence import DocumentManager
from RevitServices.Transactions import TransactionManager

clr.AddReference('RevitAPI')
import Autodesk
from Autodesk.Revit.DB import *
from Autodesk.Revit.DB import FilteredElementCollector
doc = DocumentManager.Instance.CurrentDBDocument
OUT = FilteredElementCollector(doc).OfClass(Family).ToElements()
# ----------------------------------------
python_script_3 = Python(IN[0]=python_script_2)  # IronPython2
# ---------- python_script_3.python (37 lines) ----------
import System
import clr
clr.AddReference('RevitAPI')
from Autodesk.Revit.DB import *

clr.AddReference("RevitNodes")
import Revit
clr.ImportExtensions(Revit.Elements)

def GetCategory(item):
	if not item: return None
	objtype = item.GetType().ToString()
	returnID = None
	returnCat = None
	returnBic = None
	if objtype == "Autodesk.Revit.DB.ViewSchedule": returnID = item.Definition.CategoryId
	elif objtype == "Autodesk.Revit.DB.Family": returnID = item.FamilyCategoryId
	elif objtype == "Autodesk.Revit.DB.GraphicsStyle":  returnID = item.GraphicsStyleCategory.Id
	elif objtype == "Revit.Application.Document":
		if item.IsFamilyDocument: 
			clr.AddReference("RevitServices")
			import RevitServices
			from RevitServices.Persistence import DocumentManager
			returnID = DocumentManager.Instance.CurrentDBDocument.OwnerFamily.FamilyCategoryId
	elif objtype == "Autodesk.Revit.DB.Category": 
		if item.Parent: returnID = item.Parent.Id
	elif hasattr(item, "Category"): returnID = item.Category.Id
	if returnID:
		returnBic = System.Enum.ToObject(BuiltInCategory, returnID.IntegerValue)
		try: returnCat =  Revit.Elements.Category.ById(returnID.IntegerValue)
		except: pass
	return returnCat, returnBic

items = UnwrapElement(IN[0])

if isinstance(IN[0], list): OUT = map(list, zip(*[GetCategory(x) for x in items]))
else: OUT = GetCategory(items)
# ----------------------------------------
firstItem_6 = List.FirstItem(list=python_script_3)
string_from_object_3 = FromObject(obj=firstItem_6)
code_block_38 = CodeBlock { "Electrical Fixtures"; "Fire Alarm Devices"; }
contains_4 = String.Contains(string=string_from_object_3, searchFor=code_block_38.out0)
filterByBoolMask_19 = List.FilterByBoolMask(list=python_script_2, mask=contains_4)

name_3 = Element.Name(element=filterByBoolMask_19.in)

# group: Get all families of Fire Alarm Devices category
contains_5 = String.Contains(string=string_from_object_3, searchFor=code_block_38.out1)
filterByBoolMask_20 = List.FilterByBoolMask(list=python_script_2, mask=contains_5)

name_4 = Element.Name(element=filterByBoolMask_20.in)

# group: Conditional
code_block_39 = CodeBlock(FirstUserInput=multipleinputform.User_Inputs) { FirstUserInput == 0? 0: 1; }

# group: Conditional
code_block_40 = CodeBlock(FirstUIWasRun=multipleinputform.Was_Run, FirstUIWasCancelled=multipleinputform.Was_Cancelled) { FirstUIWasRun == true && FirstUIWasCancelled == false? true : false; }

# group: Second UI
code_block_41 = CodeBlock { "ME Data Exchange for Fire and Smoke Dampers"; null; "Proceed"; "Cancel"; 800; 700; 400; }
code_block_42 = CodeBlock { "Select Fixture"; }
code_block_43 = CodeBlock()
# ---------- code_block_43.designscript (3 lines) ----------
"";
"Select electrical fixture and fire alarm device from the list. Make sure the families you want to use are loaded into the project before running this script. Selected fixtures will be placed for new fire and smoke dampers. Electrical fixtures already associated with fire and smoke dampers will be relocated";
"Select electrical fixture from the list. Make sure the family you want to use is loaded into the project before running this script. Selected fixtures will be placed for new fire and smoke dampers. Electrical fixtures already associated with fire and smoke dampers will be relocated";
# ----------------------------------------
textnote_data_2 = Custom[TextNote Data](Title=code_block_43.out0, TextNote=code_block_43.out1)
code_block_44 = CodeBlock { "Electrical Fixture"; null; true; }
dropdown_data = Custom[DropDown Data](InputName=code_block_44.out0, Keys=name_3, Values=filterByBoolMask_19.in, DefaultValueIndex=code_block_44.out1, Sorted_optional=code_block_44.out2)  # package Data-Shapes; Create data for DropDown input in UI.MultiInputForm ++ . Check out www.data-shapes.net for more infos.
code_block_45 = CodeBlock { "Fire Alarm Interface"; null; true; }
dropdown_data_2 = Custom[DropDown Data](InputName=code_block_45.out0, Keys=name_4, Values=filterByBoolMask_20.in, DefaultValueIndex=code_block_45.out1, Sorted_optional=code_block_45.out2)
list_create_11 = List.Create(item0=textnote_data_2, item1=dropdown_data, item2=dropdown_data_2)
textnote_data_3 = Custom[TextNote Data](Title=code_block_43.out0, TextNote=code_block_43.out2)
list_create_12 = List.Create(item0=textnote_data_3, item1=dropdown_data)
list_create_13 = List.Create(item0=list_create_11, item1=list_create_12)
getItemAtIndex_13 = List.GetItemAtIndex(list=list_create_13, index=code_block_39)
flatten_13 = List.Flatten(list=getItemAtIndex_13)
inputgroup_data = Custom[InputGroup Data](GroupTitle=code_block_42, Inputs=flatten_13)  # package Data-Shapes; Creates a group of inputs for UI.MultipleInputForm ++ . Check out www.data-shapes.net for more infos !
multipleinputform_2 = Custom[MultipleInputForm ++](Description_optional=code_block_41.out0, Logo_optional=code_block_41.out1, ButtonText_optional=code_block_41.out2, Inputs=inputgroup_data, Toggle=code_block_40, CancelButtonText_optional=code_block_41.out3, MaxHeight_optional=code_block_41.out4, Width_optional=code_block_41.out5, LabelWidth_optional=code_block_41.out6)

# group: User Selection: Selected Electrical Fixture
code_block_46 = CodeBlock(SelectedElecFixture=multipleinputform_2.User_Inputs) { SelectedElecFixture; }

# group: Get family name
name_5 = Family.Name(family=code_block_46)

empty_3 = List.Empty()
types = Family.Types(family=code_block_46)
name_6 = FamilyType.Name(familyType=types)
code_block_47 = CodeBlock { 0; }
getItemAtIndex_14 = List.GetItemAtIndex(list=name_6, index=code_block_47)
flatten_14 = List.Flatten(list=getItemAtIndex_14)

# group: Conditional
code_block_48 = CodeBlock(FirstUserInput=multipleinputform.User_Inputs) { FirstUserInput == 0? 1: 0; }

getItemAtIndex_15 = List.GetItemAtIndex(list=name_6, index=code_block_48)
flatten_15 = List.Flatten(list=getItemAtIndex_15)

# group: Conditional
code_block_49 = CodeBlock(SecondUIWasRun=multipleinputform_2.Was_Run, SecondUIWasCancelled=multipleinputform_2.Was_Cancelled) { SecondUIWasRun == true && SecondUIWasCancelled == false? true : false; }

# group: Third UI
code_block_50 = CodeBlock { "ME Data Exchange for Fire and Smoke Dampers"; null; "Proceed"; "Cancel"; 800; 700; 400; }
code_block_51 = CodeBlock { "Electrical Fixture Type"; null; true; }
dropdown_data_3 = Custom[DropDown Data](InputName=code_block_51.out0, Keys=flatten_14, Values=flatten_14, DefaultValueIndex=code_block_51.out1, Sorted_optional=code_block_51.out2)
code_block_52 = CodeBlock { "Fire Alarm Interface Type"; null; true; }
dropdown_data_4 = Custom[DropDown Data](InputName=code_block_52.out0, Keys=flatten_15, Values=flatten_15, DefaultValueIndex=code_block_52.out1, Sorted_optional=code_block_52.out2)
list_create_14 = List.Create(item0=dropdown_data_3, item1=dropdown_data_4)
list_create_15 = List.Create(item0=dropdown_data_3)
list_create_16 = List.Create(item0=list_create_14, item1=list_create_15)
getItemAtIndex_16 = List.GetItemAtIndex(list=list_create_16, index=code_block_39)
flatten_16 = List.Flatten(list=getItemAtIndex_16)
multipleinputform_3 = Custom[MultipleInputForm ++](Description_optional=code_block_50.out0, Logo_optional=code_block_50.out1, ButtonText_optional=code_block_50.out2, Inputs=flatten_16, Toggle=code_block_49, CancelButtonText_optional=code_block_50.out3, MaxHeight_optional=code_block_50.out4, Width_optional=code_block_50.out5, LabelWidth_optional=code_block_50.out6)

list_create_17 = List.Create(item0=empty_3, item1=multipleinputform_3.User_Inputs)

# group: Conditional
code_block_53 = CodeBlock(ThirdUIWasRun=multipleinputform_3.Was_Run, ThirdUIWasCancelled=multipleinputform_3.Was_Cancelled) { ThirdUIWasRun == true && ThirdUIWasCancelled == false? true : false; }

list_create_18 = List.Create(item0=code_block_40, item1=code_block_49, item2=code_block_53)
identity_3 = Object.Identity()  # unwired: object
trueForAll = List.TrueForAll(list=list_create_18, queryFunction=identity_3)

# group: Conditional
code_block_54 = CodeBlock(AllUIs=trueForAll) { AllUIs == true? 1 : 0; }

getItemAtIndex_17 = List.GetItemAtIndex(list=list_create_17, index=code_block_54)

# group: Get family by name and type
byFamilyNameAndTypeName = FamilyType.ByFamilyNameAndTypeName(familyName=name_5, typeName=getItemAtIndex_17)

# group: Get Unit Length parameter value
parameters = Element.Parameters(element=byFamilyNameAndTypeName)
name_7 = Parameter.Name(parameter=parameters)
code_block_55 = CodeBlock { "Unit Length"; }
contains_6 = String.Contains(string=name_7, searchFor=code_block_55)
filterByBoolMask_21 = List.FilterByBoolMask(list=parameters, mask=contains_6)
value = Parameter.Value(parameter=filterByBoolMask_21.in)
flatten_17 = List.Flatten(list=value)

code_block_56 = CodeBlock(x=flatten_17) { x[0]; }

# group: Distance from the damper
code_block_57 = CodeBlock { 25; }
code_block_58 = CodeBlock(BWIC=code_block_57, ElectricalFixtureUnitLength=code_block_56) { 100+BWIC+ElectricalFixtureUnitLength/2; }

byStartPointDirectionLength_3 = Line.ByStartPointDirectionLength(startPoint=byCoordinates, direction=direction, length=code_block_58, lacing=Longest)
endPoint = Curve.EndPoint(curve=byStartPointDirectionLength_3)

# group: FCU Location Point
watch = Watch(endPoint)

code_block_59 = CodeBlock(x=byFamilyNameAndTypeName) { x[0]; }
normalAtPoint = Surface.NormalAtPoint(surface=firstItem_4, point=endPoint)
ZAxis_2 = Vector.ZAxis()
code_block_60 = CodeBlock { 90; }
rotate = Vector.Rotate(vector=normalAtPoint, axis=ZAxis_2, degrees=code_block_60)

# group: Place Electrical Fixture families in Revit
byFace = FamilyInstance.ByFace(familyType=code_block_59, face=firstItem_4, location=endPoint, referenceDirection=rotate, lacing=Longest)

empty_4 = List.Empty()
getItemAtIndex_18 = List.GetItemAtIndex(list=byFamilyNameAndTypeName, index=code_block_48)
list_create_19 = List.Create(item0=empty_4, item1=getItemAtIndex_18)
getItemAtIndex_19 = List.GetItemAtIndex(list=list_create_19, index=code_block_48)
flatten_18 = List.Flatten(list=getItemAtIndex_19)
getItemAtIndex_20 = List.GetItemAtIndex(list=flatten_17, index=code_block_48)
code_block_61 = CodeBlock { 300; }
list_create_20 = List.Create(item0=getItemAtIndex_20, item1=code_block_61)
getItemAtIndex_21 = List.GetItemAtIndex(list=list_create_20, index=code_block_39)
flatten_19 = List.Flatten(list=getItemAtIndex_21)

# group: Distance from the FCU
code_block_62 = CodeBlock(ElectricalFixtureUnitLength=code_block_56, FireAlarmDeviceUnitLength=flatten_19) { 100+ElectricalFixtureUnitLength/2+FireAlarmDeviceUnitLength/2; }

byStartPointDirectionLength_4 = Line.ByStartPointDirectionLength(startPoint=endPoint, direction=direction, length=code_block_62, lacing=Longest)
endPoint_2 = Curve.EndPoint(curve=byStartPointDirectionLength_4)

# group: Place Fire Alarm Devices families in Revit
byFace_2 = FamilyInstance.ByFace(familyType=flatten_18, face=firstItem_4, location=endPoint_2, referenceDirection=rotate, lacing=Longest)

list_create_21 = List.Create(item0=byFace, item1=byFace_2)
transpose_3 = List.Transpose(lists=list_create_21)
flatten_20 = List.Flatten(list=transpose_3)
isNull = Object.IsNull(object=flatten_20)
not_7 = Not(x=isNull)
filterByBoolMask_22 = List.FilterByBoolMask(list=flatten_20, mask=not_7)
flatten_21 = List.Flatten(list=filterByBoolMask_22.in)
code_block_63 = CodeBlock { "Level"; "Mark"; "Schedule Level"; "Equipment ID"; "Equipment Reference"; "Equipment Name"; }
getParameterValueByName_5 = Element.GetParameterValueByName(element=removeItemAtIndex, parameterName=code_block_63.out0)

# group: Conditional
code_block_64 = CodeBlock(FirstUserInput=multipleinputform.User_Inputs) { FirstUserInput == 0? 2: 1; }

cycle = List.Cycle(list=getParameterValueByName_5@L1, amount=code_block_64)
flatten_22 = List.Flatten(list=cycle)

# group: Write 'Schedule Level' parameter
setParameterByName = Element.SetParameterByName(element=flatten_21, parameterName=code_block_63.out2, value=flatten_22)

# group: FAI Location Point
watch_2 = Watch(endPoint_2)

id_3 = Element.Id(element=removeItemAtIndex)
cycle_2 = List.Cycle(list=id_3@L1, amount=code_block_64)
flatten_23 = List.Flatten(list=cycle_2)
string_from_object_4 = FromObject(obj=flatten_23)

# group: Write 'Equipment ID' parameter
setParameterByName_2 = Element.SetParameterByName(element=flatten_21, parameterName=code_block_63.out3, value=string_from_object_4)

getParameterValueByName_6 = Element.GetParameterValueByName(element=removeItemAtIndex, parameterName=code_block_63.out1)
cycle_3 = List.Cycle(list=getParameterValueByName_6@L1, amount=code_block_64)
flatten_24 = List.Flatten(list=cycle_3)

# group: Write 'Equipment Reference' parameter
setParameterByName_3 = Element.SetParameterByName(element=flatten_21, parameterName=code_block_63.out4, value=flatten_24)

# group: Dampers clashing with Walls
watch_3 = Watch(getItemAtIndex_2)

# group: Dampers clashing with Floors & Roofs
watch_4 = Watch(flatten_2)

# group: Walls clashing with Dampers
watch_5 = Watch(getItemAtIndex_9)

indexOf_6 = List.IndexOf(list=filterByBoolMask_4.out, element=filterByBoolMask_13.out)
code_block_65 = CodeBlock(x=indexOf_6) { x >= 0; }
filterByBoolMask_23 = List.FilterByBoolMask(list=indexOf_6, mask=code_block_65)
removeItemAtIndex_2 = List.RemoveItemAtIndex(list=filterByBoolMask_4.out, indices=filterByBoolMask_23.in)
boundingBox_4 = Element.BoundingBox(element=removeItemAtIndex_2)
minPoint_3 = BoundingBox.MinPoint(boundingBox=boundingBox_4)
maxPoint_3 = BoundingBox.MaxPoint(boundingBox=boundingBox_4)
list_create_22 = List.Create(item0=minPoint_3, item1=maxPoint_3)
transpose_4 = List.Transpose(lists=list_create_22)
flatten_25 = List.Flatten(list=filterByBoolMask_3.in)
filterByBoolMask_24 = List.FilterByBoolMask(list=flatten_25, mask=isEmpty_2)
filterByBoolMask_25 = List.FilterByBoolMask(list=flatten_2, mask=isEmpty_2)
indexOf_7 = List.IndexOf(list=filterByBoolMask_25.out, element=removeItemAtIndex_2)
getItemAtIndex_22 = List.GetItemAtIndex(list=filterByBoolMask_24.out, index=indexOf_7)
distanceTo_2 = Geometry.DistanceTo(geometry=getItemAtIndex_22, other=transpose_4)
minimumItem_2 = List.MinimumItem(list=distanceTo_2)
indexOf_8 = List.IndexOf(list=distanceTo_2, element=minimumItem_2, lacing=Longest)
getItemAtIndex_23 = List.GetItemAtIndex(list=transpose_4, index=indexOf_8, lacing=Shortest)
X_2 = Point.X(point=getItemAtIndex_23)
Y_2 = Point.Y(point=getItemAtIndex_23)
filterByBoolMask_26 = List.FilterByBoolMask(list=flatten_3, mask=isEmpty_2)
getItemAtIndex_24 = List.GetItemAtIndex(list=filterByBoolMask_26.out, index=indexOf_7)

# group: Identify closest walls to fire & smoke dampers
distanceTo_3 = Geometry.DistanceTo(geometry=getItemAtIndex_24, other=getItemAtIndex_22)
minimumItem_3 = List.MinimumItem(list=distanceTo_3)
indexOf_9 = List.IndexOf(list=distanceTo_3, element=minimumItem_3, lacing=Longest)

getItemAtIndex_25 = List.GetItemAtIndex(list=getItemAtIndex_24, index=indexOf_9, lacing=Longest)
Z_3 = Point.Z(point=getItemAtIndex_25)
byCoordinates_2 = Point.ByCoordinates(x=X_2, y=Y_2, z=Z_3)
code_block_66 = CodeBlock { 1; }
chop = List.Chop(list=byCoordinates_2, lengths=code_block_66)

# group: From BimorphNodes package
byRayBounce_2 = Revit.LinkElement.ByRayBounce(origin=chop, direction=code_block_9@L2, view3D=code_block_8, category=byName_2, findNearest=code_block_5, lacing=Longest)

flatten_26 = List.Flatten(list=byRayBounce_2.Point)
byStartPointEndPoint_2 = Line.ByStartPointEndPoint(startPoint=getItemAtIndex_25, endPoint=flatten_26)
direction_2 = Line.Direction(line=byStartPointEndPoint_2)
code_block_67 = CodeBlock(x=flatten_17) { x[0]; }

# group: Distance from the damper
code_block_68 = CodeBlock { 25; }
code_block_69 = CodeBlock(BWIC=code_block_68, ElectricalFixtureUnitLength=code_block_67) { 100+BWIC+ElectricalFixtureUnitLength/2; }

byStartPointDirectionLength_5 = Line.ByStartPointDirectionLength(startPoint=flatten_26, direction=direction_2, length=code_block_69, lacing=Longest)
endPoint_3 = Curve.EndPoint(curve=byStartPointDirectionLength_5)

# group: FCU Location Point
watch_6 = Watch(endPoint_3)

getItemAtIndex_26 = List.GetItemAtIndex(list=flatten_17, index=code_block_48)
code_block_70 = CodeBlock { 300; }
list_create_23 = List.Create(item0=getItemAtIndex_26, item1=code_block_70)
getItemAtIndex_27 = List.GetItemAtIndex(list=list_create_23, index=code_block_39)
flatten_27 = List.Flatten(list=getItemAtIndex_27)

# group: Distance from the FCU
code_block_71 = CodeBlock(ElectricalFixtureUnitLength=code_block_67, FireAlarmDeviceUnitLength=flatten_27) { 100+ElectricalFixtureUnitLength/2+FireAlarmDeviceUnitLength/2; }

byStartPointDirectionLength_6 = Line.ByStartPointDirectionLength(startPoint=endPoint_3, direction=direction_2, length=code_block_71, lacing=Longest)
endPoint_4 = Curve.EndPoint(curve=byStartPointDirectionLength_6)

# group: FAI Location Point
watch_7 = Watch(endPoint_4)

flatten_28 = List.Flatten(list=byRayBounce.LinkElement, lacing=Longest)
filterByBoolMask_27 = List.FilterByBoolMask(list=flatten_28, mask=isEmpty_2)
getItemAtIndex_28 = List.GetItemAtIndex(list=filterByBoolMask_27.out, index=indexOf_7)
getItemAtIndex_29 = List.GetItemAtIndex(list=getItemAtIndex_28, index=indexOf_9, lacing=Longest)
faces_3 = Element.Faces(element=getItemAtIndex_29)
doesIntersect = Geometry.DoesIntersect(geometry=getItemAtIndex_25, other=faces_3)
filterByBoolMask_28 = List.FilterByBoolMask(list=faces_3, mask=doesIntersect)
flatten_29 = List.Flatten(list=filterByBoolMask_28.in)

# group: Surfaces where families will be placed
watch_8 = Watch(flatten_29)

normalAtPoint_2 = Surface.NormalAtPoint(surface=flatten_29, point=endPoint_3)
ZAxis_3 = Vector.ZAxis()
code_block_72 = CodeBlock { 90; }
rotate_2 = Vector.Rotate(vector=normalAtPoint_2, axis=ZAxis_3, degrees=code_block_72)

# group: Place Electrical Fixture families in Revit
byFace_3 = FamilyInstance.ByFace(familyType=code_block_59, face=flatten_29, location=endPoint_3, referenceDirection=rotate_2, lacing=Longest)

# group: Place Fire Alarm Devices families in Revit
byFace_4 = FamilyInstance.ByFace(familyType=flatten_18, face=flatten_29, location=endPoint_4, referenceDirection=rotate_2, lacing=Longest)

list_create_24 = List.Create(item0=byFace_3, item1=byFace_4)
transpose_5 = List.Transpose(lists=list_create_24)
flatten_30 = List.Flatten(list=transpose_5)
isNull_2 = Object.IsNull(object=flatten_30)
not_8 = Not(x=isNull_2)
filterByBoolMask_29 = List.FilterByBoolMask(list=flatten_30, mask=not_8)
flatten_31 = List.Flatten(list=filterByBoolMask_29.in)
code_block_73 = CodeBlock { "Level"; "Mark"; "Schedule Level"; "Equipment ID"; "Equipment Reference"; "Equipment Name"; }
getParameterValueByName_7 = Element.GetParameterValueByName(element=removeItemAtIndex_2, parameterName=code_block_73.out0)
cycle_4 = List.Cycle(list=getParameterValueByName_7@L1, amount=code_block_64)
flatten_32 = List.Flatten(list=cycle_4)

# group: Write 'Schedule Level' parameter
setParameterByName_4 = Element.SetParameterByName(element=flatten_31, parameterName=code_block_73.out2, value=flatten_32)

id_4 = Element.Id(element=removeItemAtIndex_2)
cycle_5 = List.Cycle(list=id_4@L1, amount=code_block_64)
flatten_33 = List.Flatten(list=cycle_5)
string_from_object_5 = FromObject(obj=flatten_33)

# group: Write 'Equipment ID' parameter
setParameterByName_5 = Element.SetParameterByName(element=flatten_31, parameterName=code_block_73.out3, value=string_from_object_5)

getParameterValueByName_8 = Element.GetParameterValueByName(element=removeItemAtIndex_2, parameterName=code_block_73.out1)
cycle_6 = List.Cycle(list=getParameterValueByName_8@L1, amount=code_block_64)
flatten_34 = List.Flatten(list=cycle_6)

# group: Write 'Equipment Reference' parameter
setParameterByName_6 = Element.SetParameterByName(element=flatten_31, parameterName=code_block_73.out4, value=flatten_34)

# group: Dampers clashing with Floors & Roofs and with Walls around them
watch_9 = Watch(filterByBoolMask_4.out)

# group: Electrical Fixtures that are already associated with duct accessories
watch_10 = Watch(filterByBoolMask_9.in)

# group: Electrical Fixtures & Fire Alarm Devices that are no longer associated with duct accessories
watch_11 = Watch(filterByBoolMask_9.out)

# group: Dampers that already have FCU & FIA
watch_12 = Watch(filterByBoolMask_13.out)

# group: Dampers that were relocated and require FCU & FIA
watch_13 = Watch(filterByBoolMask_13.in)

# group: Watch
watch_14 = Watch(removeItemAtIndex)

# group: Watch
watch_15 = Watch(removeItemAtIndex_2)

# group: New dampers that require FCU & FIA
watch_16 = Watch(filterByBoolMask_5.in)

filterByBoolMask_30 = List.FilterByBoolMask(list=getItemAtIndex_6, mask=not_4)
flatten_35 = List.Flatten(list=filterByBoolMask_30.in)

# group: Python to get electrical circuit
python_script_4 = Python(IN[0]=flatten_35)  # IronPython2
# ---------- python_script_4.python (35 lines) ----------
import clr
clr.AddReference('ProtoGeometry')
from Autodesk.DesignScript.Geometry import *

#The inputs to this node will be stored as a list in the IN variables.
if isinstance(IN[0],list):
	toggle = 0
	element = UnwrapElement(IN[0])
else:
	toggle = 1
	element = [UnwrapElement(IN[0])]

def getSystem(elem):
	system = elem.MEPModel.ElectricalSystems
	
	if system.Size == 0:
		return None
	elif system.Size == 1:	
		for sys in system:
			return sys
	else:
		return [x for x in system]

listout = []	
for x in element:
	try:
		system = getSystem(x)
		listout.append(system)
	except:
		listout.append(None)
#Assign your output to the OUT variable.
if toggle:
	OUT = system
else:
	OUT = listout
# ----------------------------------------

isNull_3 = Object.IsNull(object=python_script_4)
not_9 = Not(x=isNull_3)
filterByBoolMask_31 = List.FilterByBoolMask(list=python_script_4, mask=not_9)
firstItem_7 = List.FirstItem(list=getItemAtIndex_2)
empty_5 = List.Empty()
isNull_4 = Object.IsNull(object=transpose_3)
not_10 = Not(x=isNull_4)
filterByBoolMask_32 = List.FilterByBoolMask(list=transpose_3, mask=not_10)
id_5 = Element.Id(element=filterByBoolMask_32.in)
string_from_object_6 = FromObject(obj=id_5)
code_block_74 = CodeBlock { 0; }
getItemAtIndex_30 = List.GetItemAtIndex(list=string_from_object_6, index=code_block_74, lacing=Longest)
getItemAtIndex_31 = List.GetItemAtIndex(list=string_from_object_6, index=code_block_48, lacing=Longest)
code_block_75 = CodeBlock(x=getItemAtIndex_30, y=getItemAtIndex_31) { x + " " + y; }
list_create_25 = List.Create(item0=getItemAtIndex_30, item1=code_block_75)
list_create_26 = List.Create(item0=empty_5, item1=list_create_25)
isEmpty_8 = List.IsEmpty(list=list_create_25, lacing=Longest)
identity_4 = Object.Identity()  # unwired: object
trueForAll_2 = List.TrueForAll(list=isEmpty_8, queryFunction=identity_4)

# group: Conditional
code_block_76 = CodeBlock(LstIsEmpty=trueForAll_2) { LstIsEmpty ==true? 0 : 1; }

getItemAtIndex_32 = List.GetItemAtIndex(list=list_create_26, index=code_block_76)
list_create_27 = List.Create(item0=empty_5, item1=code_block_48)
getItemAtIndex_33 = List.GetItemAtIndex(list=list_create_27, index=code_block_76)
getItemAtIndex_34 = List.GetItemAtIndex(list=getItemAtIndex_32, index=getItemAtIndex_33)
flatten_36 = List.Flatten(list=getItemAtIndex_34)

# group: Write 'Equipment ID' parameter
setParameterByName_7 = Element.SetParameterByName(element=removeItemAtIndex, parameterName=code_block_63.out3, value=flatten_36)

list_create_28 = List.Create(item0=firstItem_7, item1=setParameterByName_7)
isEmpty_9 = List.IsEmpty(list=setParameterByName_7)

# group: Conditional
code_block_77 = CodeBlock(lstisempty=isEmpty_9) { lstisempty==true? 0 : 1; }

getItemAtIndex_35 = List.GetItemAtIndex(list=list_create_28, index=code_block_77)
code_block_78 = CodeBlock { "Family"; }
getParameterValueByName_9 = Element.GetParameterValueByName(element=getItemAtIndex_35, parameterName=code_block_78)
family = FamilyType.Family(familyType=getParameterValueByName_9)
name_8 = Family.Name(family=family)
code_block_79 = CodeBlock { 0; }
code_block_80 = CodeBlock { "_"; }
allIndicesOf = String.AllIndicesOf(string=name_8, searchFor=code_block_80)
lastItem = List.LastItem(list=allIndicesOf@L2)
code_block_81 = CodeBlock(x=lastItem) { x+1; }
substring = String.Substring(string=name_8, startIndex=code_block_79, length=code_block_81)
cycle_7 = List.Cycle(list=substring@L1, amount=code_block_64)
flatten_37 = List.Flatten(list=cycle_7)

# group: Write 'Equipment Name' parameter
setParameterByName_8 = Element.SetParameterByName(element=flatten_21, parameterName=code_block_63.out5, value=flatten_37)

empty_6 = List.Empty()
isNull_5 = Object.IsNull(object=transpose_5)
not_11 = Not(x=isNull_5)
filterByBoolMask_33 = List.FilterByBoolMask(list=transpose_5, mask=not_11)
id_6 = Element.Id(element=filterByBoolMask_33.in)
string_from_object_7 = FromObject(obj=id_6)
code_block_82 = CodeBlock { 0; }
getItemAtIndex_36 = List.GetItemAtIndex(list=string_from_object_7, index=code_block_82, lacing=Longest)
getItemAtIndex_37 = List.GetItemAtIndex(list=string_from_object_7, index=code_block_48, lacing=Longest)
code_block_83 = CodeBlock(x=getItemAtIndex_36, y=getItemAtIndex_37) { x + " " + y; }
list_create_29 = List.Create(item0=getItemAtIndex_36, item1=code_block_83)
list_create_30 = List.Create(item0=empty_6, item1=list_create_29)
isEmpty_10 = List.IsEmpty(list=list_create_29, lacing=Longest)
identity_5 = Object.Identity()  # unwired: object
trueForAll_3 = List.TrueForAll(list=isEmpty_10, queryFunction=identity_5)

# group: Conditional
code_block_84 = CodeBlock(LstIsEmpty=trueForAll_3) { LstIsEmpty ==true? 0 : 1; }

getItemAtIndex_38 = List.GetItemAtIndex(list=list_create_30, index=code_block_84)
list_create_31 = List.Create(item0=empty_6, item1=code_block_48)
getItemAtIndex_39 = List.GetItemAtIndex(list=list_create_31, index=code_block_84)
getItemAtIndex_40 = List.GetItemAtIndex(list=getItemAtIndex_38, index=getItemAtIndex_39)
flatten_38 = List.Flatten(list=getItemAtIndex_40)

# group: Write 'Equipment ID' parameter
setParameterByName_9 = Element.SetParameterByName(element=removeItemAtIndex_2, parameterName=code_block_73.out3, value=flatten_38)

list_create_32 = List.Create(item0=firstItem_7, item1=setParameterByName_9)
isEmpty_11 = List.IsEmpty(list=setParameterByName_9)

# group: Conditional
code_block_85 = CodeBlock(lstisempty=isEmpty_11) { lstisempty==true? 0 : 1; }

getItemAtIndex_41 = List.GetItemAtIndex(list=list_create_32, index=code_block_85)
code_block_86 = CodeBlock { "Family"; }
getParameterValueByName_10 = Element.GetParameterValueByName(element=getItemAtIndex_41, parameterName=code_block_86)
family_2 = FamilyType.Family(familyType=getParameterValueByName_10)
name_9 = Family.Name(family=family_2)
code_block_87 = CodeBlock { 0; }
code_block_88 = CodeBlock { "_"; }
allIndicesOf_2 = String.AllIndicesOf(string=name_9, searchFor=code_block_88)
lastItem_2 = List.LastItem(list=allIndicesOf_2@L2)
code_block_89 = CodeBlock(x=lastItem_2) { x+1; }
substring_2 = String.Substring(string=name_9, startIndex=code_block_87, length=code_block_89)
cycle_8 = List.Cycle(list=substring_2@L1, amount=code_block_64)
flatten_39 = List.Flatten(list=cycle_8)

# group: Write 'Equipment Name' parameter
setParameterByName_10 = Element.SetParameterByName(element=flatten_31, parameterName=code_block_73.out5, value=flatten_39)

join_3 = List.Join(list0=setParameterByName_8, list1=setParameterByName_10)
chop_2 = List.Chop(list=join_3, lengths=code_block_64)
join_4 = List.Join(list0=setParameterByName_7, list1=setParameterByName_9)
indexOf_10 = List.IndexOf(list=join_4, element=filterByBoolMask_13.in)
getItemAtIndex_42 = List.GetItemAtIndex(list=chop_2, index=indexOf_10)
flatten_40 = List.Flatten(list=getItemAtIndex_42)
filterByBoolMask_34 = List.FilterByBoolMask(list=flatten_40, mask=not_9)

# group: Python to add elements to electrical circuits
code_block_90 = CodeBlock(Circuit=filterByBoolMask_31.in) { Circuit; }
code_block_91 = CodeBlock(AddElements=filterByBoolMask_34.in) { AddElements; }
python_script_5 = Python(IN[0]=code_block_90, IN[1]=code_block_91)  # IronPython2
# ---------- python_script_5.python (49 lines) ----------
import clr

clr.AddReference("RevitServices")
import RevitServices
from RevitServices.Persistence import DocumentManager
from RevitServices.Transactions import TransactionManager
doc = DocumentManager.Instance.CurrentDBDocument

clr.AddReference("RevitAPI")
import Autodesk
from Autodesk.Revit.DB import *

clr.AddReference("RevitNodes")
import Revit
clr.ImportExtensions(Revit.Elements)
clr.ImportExtensions(Revit.GeometryConversion)

succes = []
failed = []

def AddToCircuit(sys,elements):
	TransactionManager.Instance.EnsureInTransaction(doc)
	if hasattr(elements, "__iter__"):
		for element in elements:
			elemset = ElementSet()
			elemset.Insert(element)
			try:
				sys.AddToCircuit(elemset)
				succes.append(element.ToDSType(True))
			except:
				failed.append(element.ToDSType(True))
	else:
		elemset = ElementSet()
		elemset.Insert(elements)
		try:
			sys.AddToCircuit(elemset)
			succes.append(elements.ToDSType(True))
		except:
			failed.append(elements.ToDSType(True))
	TransactionManager.Instance.TransactionTaskDone()
	

if isinstance(IN[0], list):
	for i,sys in enumerate(UnwrapElement(IN[0])):
		AddToCircuit(sys,UnwrapElement(IN[1])[i])
else:
	AddToCircuit(UnwrapElement(IN[0]),UnwrapElement(IN[1]))

OUT = succes, failed
# ----------------------------------------
code_block_92 = CodeBlock(x=python_script_5) { x[1]; }
code_block_93 = CodeBlock(Failed=code_block_92) { Failed; }
code_block_94 = CodeBlock(x=python_script_5) { x[0]; }
code_block_95 = CodeBlock(Success=code_block_94) { Success; }

join_5 = List.Join(list0=filterByBoolMask_9.out, list1=flatten_35)

# group: Conditional
code_block_96 = CodeBlock(passthrough=join_5, waitfor=code_block_95) { [passthrough,waitfor][0]; }

# group: Python to delete element(s)
python_script_6 = Python(IN[0]=code_block_96)  # IronPython2
# ---------- python_script_6.python (42 lines) ----------
import clr

#Load Revit API
clr.AddReference('RevitAPI')
from Autodesk.Revit.DB import *
import Autodesk

#Load document reference
clr.AddReference("RevitServices")
import RevitServices
from RevitServices.Persistence import DocumentManager
from RevitServices.Transactions import TransactionManager

doc = DocumentManager.Instance.CurrentDBDocument
uiapp = DocumentManager.Instance.CurrentUIApplication
app = uiapp.Application

elementsOrIDs = IN[0]
elems = []


TransactionManager.Instance.EnsureInTransaction(doc)

count = 0
try:
	int(elementsOrIDs[0])

except:
	for e in elementsOrIDs:
		elems.append(UnwrapElement(e))
	for elem in elems:
		doc.Delete(elem.Id)
		count +=1
	
else:
	for ID in elementsOrIDs:
		id = Autodesk.Revit.DB.ElementId(int(ID))
		doc.Delete(id)
		count +=1
	
TransactionManager.Instance.TransactionTaskDone()
OUT = str(count) + " element/s have been deleted from Revit"
# ----------------------------------------

join_6 = List.Join(list0=getItemAtIndex_9)

# group: Conditional
code_block_97 = CodeBlock(AllUIs=trueForAll)
# ---------- code_block_97.designscript (2 lines) ----------
AllUIs == true ? "Please don't forget to circuit all the newly created items!" :
"Oops! Something went wrong";
# ----------------------------------------

# group: Conditional
code_block_98 = CodeBlock(passthrough=code_block_97, waitfor=setParameterByName_8) { [passthrough,waitfor][0]; }

# group: Python to generate pop-up message
code_block_99 = CodeBlock { "M & E Automations"; }
python_script_7 = Python(IN[0]=code_block_99, IN[1]=code_block_98)  # IronPython2
# ---------- python_script_7.python (9 lines) ----------
import clr
clr.AddReference('RevitAPIUI')
from Autodesk.Revit.UI import TaskDialog

windowTitle = IN[0]
windowMessage = IN[1]

messageDialog = TaskDialog
OUT = messageDialog.Show(windowTitle, windowMessage)
# ----------------------------------------

# group: Conditional
code_block_100 = CodeBlock(passthrough=code_block_8, waitfor=setParameterByName_10) { [passthrough,waitfor][0]; }

# group: Python to delete element(s)
python_script_8 = Python(IN[0]=code_block_100)  # IronPython2; same code as python_script_6
