# Dynamo graph Add Colour to Fire Rated Walls v.2.0.dyn (Dynamo 2.16.1.2727)
# packages: Data-Shapes 2021.2.92, Genius Loci 2022.7.5, Clockwork for Dynamo 2.x 2.4.0

# group: Background
# note: USE:
# FOR GENERAL WORKFLOW NODES

# group: Input
# note: USE:
# FOR FIXED INPUT (FILE PATHS ETC.)

# group: Control
# note: USE:
# FOR USER CONTROL (SLIDERS ETC.)

# group: To Revit
# note: USE:
# FOR CHANGES TO REVIT

# group: Python
# note: USE:
# FOR PYTHON NODES

# group: Conditional
# note: USE:
# FOR CONDITIONAL NODES

# group: DYNAMO COLOUR CODING LEGEND
# note: COLOUR CODING LEGEND

# group: Monitor
# note: USE:
# FOR IMPORTANT WATCH NODES

result = Watch()  # graph output; unwired: arg0

# group: Get RVT Links Category
string = StringInput("RVT Links")
byName = Category.ByName(name=string)
all_elements_of_category = ElementsOfCategory(Category=byName)
name = Element.Name(element=all_elements_of_category)

# group: User Interface
code_block = CodeBlock { "Add Colour to Fire Rated Walls"; null; "Proceed"; "Cancel"; 800; 700; 400; }
code_block_2 = CodeBlock { "Select Linked Model"; null; true; }
dropdown_data = Custom[DropDown Data](InputName=code_block_2.out0, Keys=name, Values=all_elements_of_category, DefaultValueIndex=code_block_2.out1, Sorted_optional=code_block_2.out2)  # package Data-Shapes; Create data for DropDown input in UI.MultiInputForm ++ . Check out www.data-shapes.net for more infos.
code_block_3 = CodeBlock { "Fire Rating Parameter Name"; "Fire Rating"; false; }
textbox_data = Custom[TextBox Data](InputName=code_block_3.out0, DefaultText=code_block_3.out1, IsNumberEntry=code_block_3.out2)  # package Data-Shapes; Create Data for TextBox input in UI.MultipleInputForm ++ . Check out www.data-shapes.net for more informations
list_create = List.Create(item0=dropdown_data, item1=textbox_data)
boolean = BoolSelector(true)
multipleinputform = Custom[MultipleInputForm ++](Description_optional=code_block.out0, Logo_optional=code_block.out1, ButtonText_optional=code_block.out2, Inputs=list_create, Toggle=boolean, CancelButtonText_optional=code_block.out3, MaxHeight_optional=code_block.out4, Width_optional=code_block.out5, LabelWidth_optional=code_block.out6)  # package Data-Shapes; Create a form with multiple inputs. see www.data-shapes.net for tutorials and infos!

# group: User Selection: Selected Model
code_block_4 = CodeBlock(SelectedModel=multipleinputform.User_Inputs) { SelectedModel[0]; }

# group: Python to get Link Document
python_script = Python(IN[0]=code_block_4)  # IronPython2
# ---------- python_script.python (8 lines) ----------
# Load the Python Standard and DesignScript Libraries
import clr
clr.AddReference('RevitAPI')
import Autodesk
from Autodesk.Revit.DB import *

# Assign your output to the OUT variable.
OUT = UnwrapElement(IN[0]).GetLinkDocument()
# ----------------------------------------

# group: Get current document and active view
current = Document.Current()
code_block_5 = CodeBlock(passthrough=current, waitfor=python_script) { [passthrough,waitfor][0]; }
activeView = Document.ActiveView(document=code_block_5)

# group: Get View Name parameter from active view and add "Fire Rated Walls"
code_block_6 = CodeBlock { "View Name"; }
getParameterValueByName = Element.GetParameterValueByName(element=activeView, parameterName=code_block_6)
code_block_7 = CodeBlock(x=getParameterValueByName) { x + " - Fire Rated Walls"; }

# group: Python to duplicate view and rename it
code_block_8 = CodeBlock(view=activeView) { view: var[]..[]; }
code_block_9 = CodeBlock(name=code_block_7) { name: string[]..[]; }
python_script_2 = Python(IN[0]=code_block_8, IN[1]=code_block_9)  # IronPython2
# ---------- python_script_2.python (32 lines) ----------
import clr
clr.AddReference('RevitAPI')
from Autodesk.Revit.DB import *
import Autodesk

clr.AddReference("RevitServices")
import RevitServices
from RevitServices.Persistence import DocumentManager
from RevitServices.Transactions import TransactionManager

def DuplicateView(view, name, doc):
	try:
		newViewId = view.Duplicate(Autodesk.Revit.DB.ViewDuplicateOption.Duplicate)
		newView = doc.GetElement(newViewId)
		try: newView.Name = name
		except: pass
		return newView
	except: return None

doc = DocumentManager.Instance.CurrentDBDocument
views = UnwrapElement(IN[0])

TransactionManager.Instance.EnsureInTransaction(doc)
if isinstance(IN[0], list):
	OUT = []
	for view, name in zip(views, IN[1]):
		if isinstance(name, list): OUT.append([DuplicateView(view, x, doc) for x in name])
		else: OUT.append(DuplicateView(view, name, doc))
else: 
	if isinstance(IN[1], list): OUT = [DuplicateView(views, x, doc) for x in IN[1]]
	else: OUT = DuplicateView(views, IN[1], doc)
TransactionManager.Instance.TransactionTaskDone()
# ----------------------------------------
code_block_10 = CodeBlock(view=python_script_2) { view; }

# group: Python to set parameter to None for the view template
code_block_11 = CodeBlock(element=code_block_10) { element: var[]; }
code_block_12 = CodeBlock { "View Template"; }
code_block_13 = CodeBlock(paramName=code_block_12) { paramName: string; }
python_script_3 = Python(IN[0]=code_block_11, IN[1]=code_block_13)  # IronPython2
# ---------- python_script_3.python (36 lines) ----------
# Copyright(c) 2018, Dimitar Venkov
# @5devene, dimitar.ven@gmail.com
# www.badmonkeys.net

import clr

clr.AddReference('RevitAPI')
from Autodesk.Revit.DB import ElementId

clr.AddReference('RevitServices')
from RevitServices.Persistence import DocumentManager
from RevitServices.Transactions import TransactionManager
doc = DocumentManager.Instance.CurrentDBDocument

def tolist(x):
	if hasattr(x,'__iter__'): return x
	else : return [x]

inv = ElementId.InvalidElementId

items = tolist(IN[0])
param = IN[1]
OUT = []

TransactionManager.Instance.EnsureInTransaction(doc)
for i in items:
	itm = None
	par = i.InternalElement.LookupParameter(param)
	if par is not None:
		try:
			par.Set(inv)
			itm = i
		except:
			pass
	OUT.append(itm)
TransactionManager.Instance.TransactionTaskDone()
# ----------------------------------------

# group: Set Discipline parameter in Revit
code_block_14 = CodeBlock { "Discipline"; }
number = DoubleInput(4095)
setParameterByName = Element.SetParameterByName(element=python_script_3, parameterName=code_block_14, value=number)

# group: Get FilterElement
code_block_15 = CodeBlock { DSCore.Types.FindTypeByNameInAssembly("FilterElement", "RevitAPI"); }

code_block_16 = CodeBlock { "Fire Rated Walls"; "N/A"; }
list_create_2 = List.Create(item0=code_block_16.out1, item1=code_block_16.out0)
code_block_17 = CodeBlock { "ParameterElement"; }

# group: From Clockwork package
byName_2 = Custom[ElementType.ByName](name=code_block_17)  # package Clockwork for Dynamo 2.x; Retrieves an element type by its name - to be used with the OOTB node "All Elements of Type".

# group: From GeniusLoci package
all_elements_of_type = Custom[All Elements of Type+](type=byName_2)  # package Genius Loci; Get the instances of the given type. Works with ElementType, FamilyType, ViewFamilyType, Wall/Floor/Roof/CeilingType, GroupType, FilledRegionType and TextNoteType.

name_2 = Element.Name(element=all_elements_of_type)

# group: User Input: Parameter Name
code_block_18 = CodeBlock(ParameterName=multipleinputform.User_Inputs) { ParameterName[1]; }

contains = String.Contains(string=name_2, searchFor=code_block_18)
identity = Object.Identity()  # unwired: object
trueForAny = List.TrueForAny(list=contains, queryFunction=identity)

# group: Conditional
code_block_19 = CodeBlock(result=trueForAny) { result == true? 0: 1; }

getItemAtIndex = List.GetItemAtIndex(list=list_create_2, index=code_block_19)

# group: Get Walls category
string_2 = StringInput("Walls")
byName_3 = Category.ByName(name=string_2)

code_block_20 = CodeBlock { "Greater"; "0"; }

# group: Python to get all elements of category from a linked model
code_block_21 = CodeBlock(Documents_=python_script) { Documents_: var[]..[]; }
string_3 = StringInput("Walls")
byName_4 = Category.ByName(name=string_3)
python_script_4 = Python(IN[0]=code_block_21, IN[1]=byName_4)  # IronPython2
# ---------- python_script_4.python (59 lines) ----------
#Copyright(c) 2019, Data Shapes , written by Mostafa El Ayoubi mostafa.elayoubi@data-shapes.io @data_shapes
# @datashapes_io ,  http://data-shapes.io

# This node is based on Konrad Sobon's Get All Elements From Linked Model
# The main differences are list handling and working with categories and element types as well. 

import clr
clr.AddReference('ProtoGeometry')
from Autodesk.DesignScript.Geometry import *

# Import RevitAPI
clr.AddReference("RevitAPI")
import Autodesk
from Autodesk.Revit.DB import *

import System

import sys
pyt_path = r'C:\Program Files (x86)\IronPython 2.7\Lib'
sys.path.append(pyt_path)

import traceback
#The inputs to this node will be stored as a list in the IN variable.
dataEnteringNode = IN


def toList(input):
	if isinstance(input,list):
		return input
	else:
		return [input]
		
		
_linkDocs = toList(IN[0])
filterInfo = IN[1]

resultList = []

errorReport = None

try:
	for _linkDoc in _linkDocs:
		filter = ElementCategoryFilter(System.Enum.ToObject(BuiltInCategory, filterInfo.Id))
		result = FilteredElementCollector(_linkDoc).WherePasses(filter).WhereElementIsNotElementType().ToElements()
		resultList.append(result)
except:
	# if error accurs anywhere in the process catch it
	try:
		for _linkDoc in _linkDocs:
			result = FilteredElementCollector(_linkDoc).OfClass(filterInfo).ToElements()
			resultList.append(result)
	except:			
		errorReport = traceback.format_exc()

#Assign your output to the OUT variable
if errorReport == None:
	OUT = resultList
else:
	OUT = errorReport
# ----------------------------------------
flatten = List.Flatten(list=python_script_4)

getParameterValueByName_2 = Element.GetParameterValueByName(element=flatten, parameterName=code_block_18)

# group: Python to convert number to string
code_block_22 = CodeBlock(num=getParameterValueByName_2) { num: var[]; }
code_block_23 = CodeBlock { digits: int = null; }
python_script_5 = Python(IN[0]=code_block_22, IN[1]=code_block_23)  # IronPython2
# ---------- python_script_5.python (17 lines) ----------
# Copyright(c) 2017, Dimitar Venkov
# @5devene, dimitar.ven@gmail.com
# www.badmonkeys.net

def tolist(x):
	if hasattr(x,'__iter__'): return x
	else : return [x]

def n2s(n, digits=IN[1]):
	if digits is not None:
		n = round(n, digits)
	n = unicode(n)
	if n.endswith('.0'):
		n = n[:-2]
	return n

OUT = map(n2s, tolist(IN[0]))
# ----------------------------------------

length = String.Length(string=python_script_5)
code_block_24 = CodeBlock(strlen=length) { strlen > 1; }
filterByBoolMask = List.FilterByBoolMask(list=flatten, mask=code_block_24)
firstItem = List.FirstItem(list=filterByBoolMask.in)
getLocation = Element.GetLocation(element=firstItem)
code_block_25 = CodeBlock { 100; }

# group: Get all Levels
string_4 = StringInput("Levels")
byName_5 = Category.ByName(name=string_4)
all_elements_of_category_2 = ElementsOfCategory(Category=byName_5)

firstItem_2 = List.FirstItem(list=all_elements_of_category_2)
wall_types = WallTypes("Exterior - Block on Mtl. Stud")
byCurveAndHeight = Wall.ByCurveAndHeight(curve=getLocation, height=code_block_25, level=firstItem_2, wallType=wall_types)

# group: Conditional
code_block_26 = CodeBlock(passthrough=code_block_18, waitfor=byCurveAndHeight) { [passthrough,waitfor][0]; }

parameterByName = Parameter.ParameterByName(element=byCurveAndHeight, name=code_block_26)
byRuleType = Revit.Filter.FilterRule.ByRuleType(type=code_block_20.out0, value=code_block_20.out1, parameter=parameterByName)
byRules = Revit.Filter.ParameterFilterElement.ByRules(name=getItemAtIndex, categories=byName_3, rules=byRuleType)

# group: Conditional
code_block_27 = CodeBlock(passthrough=code_block_15, waitfor=byRules) { [passthrough,waitfor][0]; }

all_elements_of_type_2 = ElementsOfType(element_type=code_block_27)
name_3 = Element.Name(element=all_elements_of_type_2)
contains_2 = String.Contains(string=name_3, searchFor=code_block_16.out0)
filterByBoolMask_2 = List.FilterByBoolMask(list=all_elements_of_type_2, mask=contains_2)
list_create_3 = List.Create(item0=filterByBoolMask_2.in, item1=byRules)
getItemAtIndex_2 = List.GetItemAtIndex(list=list_create_3, index=code_block_19)

# group: Get Solid fill pattern
code_block_28 = CodeBlock { DSCore.Types.FindTypeByNameInAssembly("FillPatternElement", "RevitAPI"); }
all_elements_of_type_3 = ElementsOfType(element_type=code_block_28)
name_4 = ElementType.Name(elementType=all_elements_of_type_3)
code_block_29 = CodeBlock { "<Solid fill>"; }
eq = name_4 == code_block_29
filterByBoolMask_3 = List.FilterByBoolMask(list=all_elements_of_type_3, mask=eq)

# group: Override graphics in Revit
code_block_30 = CodeBlock { 255; }
byARGB = Color.ByARGB(red=code_block_30)
code_block_31 = CodeBlock { "Fine"; }
byProperties = Revit.Filter.OverrideGraphicSettings.ByProperties(cutFillColor=byARGB, cutFillPattern=filterByBoolMask_3.in, detailLevel=code_block_31)

# group: Set filter overrides in Revit
code_block_32 = CodeBlock { true; }
setFilterOverrides = View.SetFilterOverrides(view=setParameterByName, parameterFilter=getItemAtIndex_2, overrides=byProperties, hide=code_block_32)

# group: Add Filter to View
addFilter = View.AddFilter(view=setParameterByName, parameterFilter=getItemAtIndex_2)

# group: Conditional
code_block_33 = CodeBlock(passthrough=byCurveAndHeight, waitfor=addFilter) { [passthrough,waitfor][0]; }

empty = List.Empty()
list_create_4 = List.Create(item0=byRules, item1=empty)
getItemAtIndex_3 = List.GetItemAtIndex(list=list_create_4, index=code_block_19)
code_block_34 = CodeBlock { "ParameterElement"; }

# group: From Clockwork package
byName_6 = Custom[ElementType.ByName](name=code_block_34)

# group: From GeniusLoci package
all_elements_of_type_4 = Custom[All Elements of Type+](type=byName_6, docOrRevitLinkInstance=code_block_4)

name_5 = Element.Name(element=all_elements_of_type_4)
contains_3 = String.Contains(string=name_5, searchFor=code_block_18)
filterByBoolMask_4 = List.FilterByBoolMask(list=all_elements_of_type_4, mask=contains_3)
firstItem_3 = List.FirstItem(list=filterByBoolMask_4.out)
list_create_5 = List.Create(item0=firstItem_3, item1=filterByBoolMask_4.in)
getItemAtIndex_4 = List.GetItemAtIndex(list=list_create_5, index=code_block_19)

# group: Python to copy element from linked model
code_block_35 = CodeBlock(LinkInstance=code_block_4) { LinkInstance: var; }
python_script_6 = Python(IN[0]=code_block_35, IN[1]=getItemAtIndex_4)  # IronPython2
# ---------- python_script_6.python (46 lines) ----------
import clr

clr.AddReference('RevitServices')
from RevitServices.Persistence import DocumentManager
from RevitServices.Transactions import TransactionManager
doc = DocumentManager.Instance.CurrentDBDocument

clr.AddReference('RevitAPI')
from Autodesk.Revit.DB import *

from System.Collections.Generic import List

clr.AddReference('RevitNodes')
import Revit
clr.ImportExtensions(Revit.Elements)

def singleton(x):
	if hasattr(x,'__iter__'): return x[0]
	else : return x

def tolist(x):
	if hasattr(x,'__iter__'): return x
	else : return [x]


linkInst = UnwrapElement(singleton(IN[0]) )
elements = UnwrapElement(tolist(IN[1]) )

linkDoc = linkInst.GetLinkDocument()
tf1 = linkInst.GetTotalTransform()
eId = List[ElementId]()
for e in elements:
	try:
		id1 = e.Id
	except:
		continue
	eId.Add(id1)

TransactionManager.Instance.EnsureInTransaction(doc)
copy = ElementTransformUtils.CopyElements(linkDoc, eId, doc, tf1, None)
TransactionManager.Instance.TransactionTaskDone()
OUT = []
for i in copy:
	e = doc.GetElement(i)
	if e is not None:
		OUT.append(e.ToDSType(False))
# ----------------------------------------

list_create_6 = List.Create(item0=python_script_6, item1=empty)
getItemAtIndex_5 = List.GetItemAtIndex(list=list_create_6, index=code_block_19)
join = List.Join(list0=code_block_33, list1=getItemAtIndex_3, list2=getItemAtIndex_5)

# group: Python to delete element in the model
code_block_36 = CodeBlock(element=join) { element; }
code_block_37 = CodeBlock()
# ---------- code_block_37.designscript (2 lines) ----------
// Use only if you want to query a document
document : var[]..[] = null;
# ----------------------------------------
python_script_7 = Python(IN[0]=code_block_36, IN[1]=code_block_37)  # IronPython2
# ---------- python_script_7.python (47 lines) ----------
#Copyright(c) 2016, Dimitar Venkov
# @5devene, dimitar.ven@gmail.com

import clr
clr.AddReference('RevitAPI')
from Autodesk.Revit.DB import*
clr.AddReference('RevitServices')
import RevitServices
from RevitServices.Persistence import DocumentManager
from RevitServices.Transactions import TransactionManager

def tolist(obj1):
	if hasattr(obj1,"__iter__"): return obj1
	else: return [obj1]

elems = UnwrapElement(tolist(IN[0]))
inputdocs = tolist(UnwrapElement(IN[1]))

#Part of script from Clockwork
for inputdoc in inputdocs :
	if inputdoc == None:
		doc = DocumentManager.Instance.CurrentDBDocument
	elif inputdoc.GetType().ToString() == "Autodesk.Revit.DB.Document":
		doc = inputdoc
	elif inputdoc.GetType().ToString() == "Autodesk.Revit.DB.RevitLinkInstance":
		doc = inputdoc.GetLinkDocument()
	else: doc = None
	
	TransactionManager.Instance.ForceCloseTransaction()
	t = Transaction(doc,'delete')
	t.Start()

deleted, failed = [], []

for e in elems:
	id = None
	try:
		id = e.Id
		del_id = doc.Delete(id)
		deleted.extend([d.ToString() for d in del_id])
	except:
		if id is not None:
			failed.append(id.ToString() )
s = set(deleted)
failed1 = [x for x in failed if x not in s]
t.Commit()
OUT = len(deleted), ';'.join(deleted), ';'.join(failed1)
# ----------------------------------------
code_block_38 = CodeBlock(d=python_script_7) { d[0]; d[1]; d[2]; }
code_block_39 = CodeBlock(count=code_block_38.out0) { count; }
code_block_40 = CodeBlock(deletedIds=code_block_38.out1) { deletedIds; }
code_block_41 = CodeBlock(failedIds=code_block_38.out2) { failedIds; }
