# Dynamo graph AddGridFilterToAllTemplates.dyn "AddGridFilterToAllTemplates.DYN" (Dynamo 2.3.0.5885)
# packages: Orchid 203.2.0.7767

code_block = CodeBlock { "Zz - Grids in Linked Model"; }
categories = Categories("OST_Grids")  # frozen
select_rule_type = RuleTypes("NotEquals")
worksets = Workset("Zz_60_45 - MEP Shared Levels and Grids")  # graph input
name = Orchid.RevitProject.Common.Workset.Name(workset=worksets)
all_elements_of_category = ElementsOfCategory(Category=categories)
code_block_2 = CodeBlock { "Workset"; }
parameterByName = Parameter.ParameterByName(element=all_elements_of_category, name=code_block_2)
firstItem = List.FirstItem(list=parameterByName)
byRuleType = Revit.Filter.FilterRule.ByRuleType(type=select_rule_type, value=name, parameter=firstItem)
byRules = Revit.Filter.ParameterFilterElement.ByRules(name=code_block, categories=categories, rules=byRuleType)
byProperties = Revit.Filter.OverrideGraphicSettings.ByProperties()
setFilterOverrides = View.SetFilterOverrides(parameterFilter=byRules, overrides=byProperties)  # unwired: view
