# Dynamo graph AddGridFilterToTemplates.dyn "AddGridFilterToTemplates.DYN" (Dynamo 2.3.0.5885)
# packages: Crumple 1.0.7, Orchid 203.2.0.7767, Data-Shapes 2021.2.94, bimorphNodes 3.0.3

code_block = CodeBlock { "Zz - Grids in Linked Model"; }
categories = Categories("OST_Grids")  # frozen
select_rule_type = RuleTypes("NotEquals")
worksets = Workset("Zz_60_45 - MEP Shared Levels and Grids")  # graph input
name = Orchid.RevitProject.Common.Workset.Name(workset=worksets)
all_elements_of_category = ElementsOfCategory(Category=categories)
code_block_2 = CodeBlock { "Workset"; }
parameterByName = Parameter.ParameterByName(element=all_elements_of_category, name=code_block_2)
firstItem = List.FirstItem(list=parameterByName)
byRuleType = Revit.Filter.FilterRule.ByRuleType(type=select_rule_type, value=name, parameter=firstItem)
byRules = Revit.Filter.ParameterFilterElement.ByRules(name=code_block, categories=categories, rules=byRuleType)
byProperties = Revit.Filter.OverrideGraphicSettings.ByProperties()
setFilterOverrides = View.SetFilterOverrides(parameterFilter=byRules, overrides=byProperties)  # unwired: view
reportInstances = CAD.ReportInstances()
code_block_3 = CodeBlock { true; }
viewsAndNames = Custom[ViewsAndNames](Refresh=code_block_3)  # package Crumple; Returns all views and view templates in the model, as well as their names.
code_block_4 = CodeBlock { 1; }
getItemAtIndex = List.GetItemAtIndex(list=reportInstances.report@L2, index=code_block_4)
layerNames = CAD.LayerNames(importInstance=reportInstances.CADLinks)

# group: List BIM 360 projects and input directory path
code_block_5 = CodeBlock { 200; true; false; 1; }
# note: Custom Node: Data-Shapes v.2021.2.6
listview_data = Custom[Listview Data](InputName=getItemAtIndex, Keys=layerNames, Values=layerNames, Height_optionnal=code_block_5.out0, HilightInView_optionnal=code_block_5.out2, DisplayModeOnly_optionnal=code_block_5.out2, ShowElementCount_optionnal=code_block_5.out2, SortItems_optionnal=code_block_5.out1, ShowId_optionnal=code_block_5.out2)  # package Data-Shapes; Create data for ListView input in UI.MultiInputForm ++ . Check out www.data-shapes.net for more infos.

flatten = List.Flatten(list=listview_data)

# group: User interface #1
code_block_6 = CodeBlock { "GENERATE LEVELS AND VIEWS"; "RUN"; true; "CANCEL"; 900; 900; 350; }
# note: Custom Node: Data-Shapes v.2021.2.6
multipleinputform = Custom[MultipleInputForm ++](Description_optional=code_block_6.out0, ButtonText_optional=code_block_6.out1, Inputs=flatten, Toggle=code_block_6.out2, CancelButtonText_optional=code_block_6.out3, MaxHeight_optional=code_block_6.out4, Width_optional=code_block_6.out5, LabelWidth_optional=code_block_6.out6)  # package Data-Shapes; Create a form with multiple inputs. see www.data-shapes.net for tutorials and infos!

code_block_7 = CodeBlock { false; }
setLayerVisibility = CAD.SetLayerVisibility(importInstance=reportInstances.CADLinks, view=viewsAndNames.templist@L1, layerName=multipleinputform.User_Inputs, visible=code_block_7, lacing=CrossProduct)
