# Dynamo graph Sync Revisions with Master Issue Sheet v.2.0.dyn (Dynamo 2.16.1.2727)
# packages: Data-Shapes 2021.2.92, BumbleBee 2021.25.3, archi-lab.net 2023.213.1722

# group: Background
# note: USE:
# FOR GENERAL WORKFLOW NODES

# group: Input
# note: USE:
# FOR FIXED INPUT (FILE PATHS ETC.)

# group: Control
# note: USE:
# FOR USER CONTROL (SLIDERS ETC.)

# group: DYNAMO COLOUR CODING LEGEND
# note: COLOUR CODING LEGEND

# group: Python
# note: USE:
# FOR PYTHON NODES

# group: Monitor
# note: USE:
# FOR IMPORTANT WATCH NODES

# group: To Revit
# note: USE:
# FOR CHANGES TO REVIT

# group: Conditional
# note: USE:
# FOR CONDITIONAL NODES

# group: Get all Sheets
string = StringInput("Sheets")
byName = Category.ByName(name=string)
all_elements_of_category = ElementsOfCategory(Category=byName)

# group: Get Sheet Number
sheetNumber = Sheet.SheetNumber(sheet=all_elements_of_category)

# group: Filter out Project Landing Page
code_block = CodeBlock { "00"; }
ne = sheetNumber != code_block
filterByBoolMask = List.FilterByBoolMask(list=all_elements_of_category, mask=ne)

# group: Get Sheet Revision
code_block_2 = CodeBlock { "Sheet Revision"; }
getParameterValueByName = Element.GetParameterValueByName(element=filterByBoolMask.in, parameterName=code_block_2)

# group: User Interface
code_block_3 = CodeBlock { "Sync Revisions with Master Issue Sheet"; null; "Sync"; "Cancel"; 800; 700; 500; }
code_block_4 = CodeBlock { "Select Issue Sheet Location"; "FilePath"; "Browse"; }
filepath_data = Custom[FilePath Data](InputName=code_block_4.out0, DefaulPath=code_block_4.out1, ButtonText=code_block_4.out2)  # package Data-Shapes; Create filepath input for UI.MultipleInputForm ++ . Check out www.data-shapes.net for more infos !
code_block_5 = CodeBlock { "Sheet Name"; "Drawing Issue Sheet (new)"; false; }
textbox_data = Custom[TextBox Data](InputName=code_block_5.out0, DefaultText=code_block_5.out1, IsNumberEntry=code_block_5.out2)  # package Data-Shapes; Create Data for TextBox input in UI.MultipleInputForm ++ . Check out www.data-shapes.net for more informations
list_create = List.Create(item0=filepath_data, item1=textbox_data)
code_block_6 = CodeBlock { ""; "Please enter the cell range for the drawing reference in Master Issue Sheet"; }
textnote_data = Custom[TextNote Data](Title=code_block_6.out0, TextNote=code_block_6.out1)  # package Data-Shapes; Create Data for TextNote input in UI.MultipleInputForm ++ . Check out www.data-shapes.net for more informations
code_block_7 = CodeBlock { "Drawing Reference Extents"; }
code_block_8 = CodeBlock { "Starting Cell"; "B51"; false; }
textbox_data_2 = Custom[TextBox Data](InputName=code_block_8.out0, DefaultText=code_block_8.out1, IsNumberEntry=code_block_8.out2)
code_block_9 = CodeBlock { "Ending Cell"; "I77"; false; }
textbox_data_3 = Custom[TextBox Data](InputName=code_block_9.out0, DefaultText=code_block_9.out1, IsNumberEntry=code_block_9.out2)
list_create_2 = List.Create(item0=textbox_data_2, item1=textbox_data_3)
inputgroup_data = Custom[InputGroup Data](GroupTitle=code_block_7, Inputs=list_create_2)  # package Data-Shapes; Creates a group of inputs for UI.MultipleInputForm ++ . Check out www.data-shapes.net for more infos !
join = List.Join(list0=textnote_data, list1=inputgroup_data)
code_block_10 = CodeBlock { "Issue Date Column"; }
code_block_11 = CodeBlock { ""; "Please enter the column letter for the corresponding date you wish to sync"; }
textnote_data_2 = Custom[TextNote Data](Title=code_block_11.out0, TextNote=code_block_11.out1)
code_block_12 = CodeBlock { "Column"; "P"; false; }
textbox_data_4 = Custom[TextBox Data](InputName=code_block_12.out0, DefaultText=code_block_12.out1, IsNumberEntry=code_block_12.out2)
list_create_3 = List.Create(item0=textnote_data_2, item1=textbox_data_4)
inputgroup_data_2 = Custom[InputGroup Data](GroupTitle=code_block_10, Inputs=list_create_3)
join_2 = List.Join(list0=list_create, list1=join, list2=inputgroup_data_2)
boolean = BoolSelector(true)
multipleinputform = Custom[MultipleInputForm ++](Description_optional=code_block_3.out0, Logo_optional=code_block_3.out1, ButtonText_optional=code_block_3.out2, Inputs=join_2, Toggle=boolean, CancelButtonText_optional=code_block_3.out3, MaxHeight_optional=code_block_3.out4, Width_optional=code_block_3.out5, LabelWidth_optional=code_block_3.out6)  # package Data-Shapes; Create a form with multiple inputs. see www.data-shapes.net for tutorials and infos!

# group: User Input: File Path
code_block_13 = CodeBlock(UserInputFilePath=multipleinputform.User_Inputs) { UserInputFilePath[0]; }

code_block_14 = CodeBlock { true; }

# group: User Input: Sheet Name
code_block_15 = CodeBlock(UserInputSheetName=multipleinputform.User_Inputs) { UserInputSheetName[1]; }

# group: User Input: Drawing Reference Cell Range
code_block_16 = CodeBlock(x=multipleinputform.User_Inputs) { x[2]; x[3]; }

# group: From archilab_Bumblebee package
read_excel = Custom[Read Excel](filePath=code_block_13, runIt=code_block_14, sheetName=code_block_15, origin=code_block_16.out0, extent=code_block_16.out1)  # package BumbleBee; This node will read an excel file. You can read an entore sheet contents, read from specific origin cell, read only specific range, or do all of the former for multiple sheets at the same time.

# group: Convert data to strings
string_from_object = FromObject(obj=read_excel)

# group: Concatenates drawing reference (Project, Originator etc) from the Issue Sheet and works with Project as number or letters
code_block_17 = CodeBlock { "."; }
contains = String.Contains(string=string_from_object, searchFor=code_block_17)
code_block_18 = CodeBlock { false; }
code_block_19 = CodeBlock { true; }
list_create_4 = List.Create(item0=code_block_18, item1=code_block_19)
allFalse = List.AllFalse(list=contains)
filterByBoolMask_2 = List.FilterByBoolMask(list=string_from_object, mask=contains)
list_create_5 = List.Create(item0=filterByBoolMask_2.out, item1=filterByBoolMask_2.in)
code_block_20 = CodeBlock { 0; }
code_block_21 = CodeBlock { 6..7; }
code_block_22 = CodeBlock { ""; }
join_3 = String.Join(separator=code_block_22)  # unwired: string0
code_block_23 = CodeBlock { "-"; }
join_4 = String.Join(separator=code_block_23)  # unwired: string0

# group: Conditional
code_block_24 = CodeBlock(result=allFalse) { result==true? 0 : 1; }

# group (continued): Concatenates drawing reference (Project, Originator etc) from the Issue Sheet and works with Project as number or letters
getItemAtIndex = List.GetItemAtIndex(list=list_create_4, index=code_block_24)
allIndicesOf = List.AllIndicesOf(list=contains, item=getItemAtIndex, lacing=Longest)
getItemAtIndex_2 = List.GetItemAtIndex(list=list_create_5, index=code_block_24)
length = String.Length(string=getItemAtIndex_2)
count = List.Count(list=length, lacing=Longest)
cycle = List.Cycle(list=code_block_20, amount=count)
allIndicesOf_2 = String.AllIndicesOf(string=getItemAtIndex_2, searchFor=code_block_17)
flatten = List.Flatten(list=allIndicesOf_2, lacing=Longest)
list_create_6 = List.Create(item0=cycle, item1=flatten)
getItemAtIndex_3 = List.GetItemAtIndex(list=list_create_6, index=code_block_24)
sub = length - getItemAtIndex_3
list_create_7 = List.Create(item0=getItemAtIndex_3, item1=sub)
getItemAtIndex_4 = List.GetItemAtIndex(list=list_create_7, index=code_block_24)
remove = String.Remove(string=getItemAtIndex_2, startIndex=getItemAtIndex_3, count=getItemAtIndex_4)

# group: From archilab package
replaceItemAtIndex = archilab.Lists.Lists.ReplaceItemAtIndex(list=string_from_object, index=allIndicesOf, item=remove)

# group (continued): Concatenates drawing reference (Project, Originator etc) from the Issue Sheet and works with Project as number or letters
getItemAtIndex_5 = List.GetItemAtIndex(list=replaceItemAtIndex, index=code_block_21@L2, lacing=Longest)
map = List.Map(list=getItemAtIndex_5, function=join_3)
removeItemAtIndex = List.RemoveItemAtIndex(list=replaceItemAtIndex, indices=code_block_21@L2, lacing=Longest)
addItemToEnd = List.AddItemToEnd(item=map@L1, list=removeItemAtIndex@L2)
map_2 = List.Map(list=addItemToEnd, function=join_4)
flatten_2 = List.Flatten(list=map_2)

filterByBoolMask_3 = List.FilterByBoolMask(list=sheetNumber, mask=ne)
allIndicesOf_3 = List.AllIndicesOf(list=flatten_2, item=filterByBoolMask_3.in)
isEmpty = List.IsEmpty(list=allIndicesOf_3, lacing=Longest)
not_ = Not(x=isEmpty)
filterByBoolMask_4 = List.FilterByBoolMask(list=getParameterValueByName, mask=not_)

# group: Revisions in Revit
watch = Watch(filterByBoolMask_4.in)

# group: User Input: Date Column
code_block_25 = CodeBlock(UserInputDateColumn=multipleinputform.User_Inputs) { UserInputDateColumn[4]; }

code_block_26 = CodeBlock { 0; 1; }
remove_2 = String.Remove(string=code_block_16.out0, startIndex=code_block_26.out0, count=code_block_26.out1)

# group: Get starting cell for date based on the user selection
code_block_27 = CodeBlock(UserInputDateColumn=code_block_25, startindex=remove_2) { UserInputDateColumn + startindex; }

remove_3 = String.Remove(string=code_block_16.out1, startIndex=code_block_26.out0, count=code_block_26.out1)

# group: Get ending cell for date based on the user selection
code_block_28 = CodeBlock(UserInputDateColumn=code_block_25, endindex=remove_3) { UserInputDateColumn + endindex; }

# group: From archilab_Bumblebee package
read_excel_2 = Custom[Read Excel](filePath=code_block_13, runIt=code_block_14, sheetName=code_block_15, origin=code_block_27, extent=code_block_28)

flatten_3 = List.Flatten(list=read_excel_2)
flatten_4 = List.Flatten(list=allIndicesOf_3)
getItemAtIndex_6 = List.GetItemAtIndex(list=flatten_3, index=flatten_4)

# group: Revisions in Master Issue Sheet
watch_2 = Watch(getItemAtIndex_6)

filterByBoolMask_5 = List.FilterByBoolMask(list=filterByBoolMask.in, mask=not_)
isNull = Object.IsNull(object=getItemAtIndex_6)
not_2 = Not(x=isNull)
filterByBoolMask_6 = List.FilterByBoolMask(list=filterByBoolMask_5.in, mask=not_2)
filterByBoolMask_7 = List.FilterByBoolMask(list=getItemAtIndex_6, mask=not_2)
filterByBoolMask_8 = List.FilterByBoolMask(list=filterByBoolMask_4.in, mask=not_2)
eq = filterByBoolMask_7.in == filterByBoolMask_8.in

# group: Conditional
code_block_29 = CodeBlock(test=eq, trueresult=filterByBoolMask_8.in, falseresult=filterByBoolMask_7.in) { test ==true? trueresult : falseresult; }

# group: To Revit
code_block_30 = CodeBlock { "Sheet Revision"; }
setParameterByName = Element.SetParameterByName(element=filterByBoolMask_6.in, parameterName=code_block_30, value=code_block_29)

count_2 = List.Count(list=setParameterByName)

# group: Conditional
code_block_31 = CodeBlock(UIWasRun=multipleinputform.Was_Run, UIWasCancelled=multipleinputform.Was_Cancelled, NoOfSheets=count_2)
# ---------- code_block_31.designscript (5 lines) ----------
UIWasRun == true && UIWasCancelled == false && NoOfSheets == 1 ?
"Nice work! You updated " + NoOfSheets + " sheet" :
UIWasRun == true && UIWasCancelled == false && NoOfSheets > 1 ?
"Nice work! You updated " + NoOfSheets + " sheets" :
"Ops! Something went wrong";
# ----------------------------------------

# group: Conditional
code_block_32 = CodeBlock(passThrough=code_block_31) { passThrough: var[]..[]; }
code_block_33 = CodeBlock(waitFor=setParameterByName) { waitFor: var[]..[]; }
code_block_34 = CodeBlock(passthrough=code_block_32, waitfor=code_block_33) { [passthrough,waitfor][0]; }

# group: Python to generate pop-up message
code_block_35 = CodeBlock { "Hoare Lea | Digital Engineering"; }
python_script = Python(IN[0]=code_block_35, IN[1]=code_block_34)  # IronPython2
# ---------- python_script.python (9 lines) ----------
import clr
clr.AddReference('RevitAPIUI')
from Autodesk.Revit.UI import TaskDialog

windowTitle = IN[0]
windowMessage = IN[1]

messageDialog = TaskDialog
OUT = messageDialog.Show(windowTitle, windowMessage)
# ----------------------------------------
