# Dynamo graph Write.dyn "Write Directory Contents to Excel sheet" (Dynamo 2.3.0.5885)
# packages: SteamNodes 1.2.4, Bakery 2019.5.8

# group: DESIGN
# note: DESIGN
# note: USE:
# FOR THE BACK-END FUNCTIONALITY

# group: <PROJECT NO.> <PROJECT NAME>
# note: CREATED BY: <NAME SURNAME>
# CREATED: <YYYYMMDD>
# VERSION <0.X>
# LAST EDITED: <XXXXYYZZ>
# DYNAMO VERSION: <Dynamo 1.0.0>
# PACKAGES:
# <PACKAGES>
# NOTES:
# <NOTES>
# DYNAMO GRAPHIC STANDARD
# CREATED BY: VLADIMIR ONDEJCIK
# WHITE ARKITEKTER AB - 2016

# group: DESIGNER'S GUIDELINES
# note: DESIGNER'S GUIDELINES
# 1. DIVIDE THE DYNAMO DEFINITION INTO THE USER INTERFACE AND THE BACK-END
# 2. BUILD THE DEFINITION WITH SMALL BLOCKS
# 3. BLOCKS SHOULD ALWAYS HAVE INPUT/OUTPUT
# 4. RENAME INPUT/OUTPUT CONTAINERS TO DATA THEY CARRY
# 5. COLOR-CODE BLOCKS ACCORDING TO THE TEMPLATE

# group: USER INTERFACE AND INSTRUCTIONS
# note: 1. Browse to PDf directory
# 2. Select Output Directory to copy to.
# 4. Run script

# group: CONTROL
# note: CONTROL
# note: USE:
# FOR THE USER INPUT (SUCH AS SLIDERS,
#  NUMBERS, ....)

# group: INPUT
# note: INPUT
# note: USE:
# FOR THE INCOMMING REFFERENCES
# (FILE PATHS, GEOMETRIES ...                     )

# group: TO REVIT
# note: TO REVIT
# note: USE:
# FOR BLOCKS THAT EXPORT THE GEOMETRY AND PARAMETERS TO REVIT

# group: MONITOR
# note: MONITOR
# note: USE:
# FOR IMPORTANT WATCH NODES

# group: ANNOTATION
# note: ANNOTATION
# note: USE:
# FOR COMMENTS

# group: WIP
# note: WIP
# note: USE:
# FOR "WORK IN PROGRESS"

browse_to_excel_workbook = Filename("No file selected.")  # graph input
input_directory_path = Directory("X:\Projects\0512501 - S4 Kings Cross - Contractor Design\11 Issued and Received\11A Issued\20210616 - Security Drawings")  # graph input
search_in_sub_directories = BoolSelector(false)  # graph input

# group: Back end
fromPath = DirectoryObject(path=input_directory_path)  # "Directory.FromPath"
code_block = CodeBlock { "."; }
getDirectoryContents = FileSystem.GetDirectoryContents(directory=fromPath, searchString=code_block, includeSubdirectories=search_in_sub_directories)

# group: Filter by PDF and remove directory name
string_from_object = FromObject(obj=getDirectoryContents.files)
code_block_2 = CodeBlock { ".pdf"; }
filterByString = Custom[List.FilterByString](list=string_from_object, String=code_block_2)  # package SteamNodes; Filter a list by a string match
string_from_object_2 = FromObject(obj=fromPath)
string = StringInput("\")
add = string_from_object_2 + string

# group: Remove directory name
code_block_3 = CodeBlock { ""; }
replace = String.Replace(str=filterByString.Match, searchFor=add, replaceWith=code_block_3)

# group: Edit file name to remove ".pdf"
code_block_4 = CodeBlock { ".pdf"; }
code_block_5 = CodeBlock { ""; }
replace_2 = String.Replace(str=replace, searchFor=code_block_4, replaceWith=code_block_5)

write_to_excel_using_only_data = Custom[Write to Excel using only Data and File Path Inputs](filePath=browse_to_excel_workbook, data=replace_2)  # package Bakery; will overwrite and use Sheet1
