# Dynamo graph test script.dyn (Dynamo 2.6.1.8786)
# packages: Data-Shapes 2022.2.106

boolean_input = Custom[Boolean input]()  # package Data-Shapes; Creates a boolean input for UI.MultipleInputForm ++ . Check out www.data-shapes.net for more infos!
code_block = CodeBlock { true; }
multipleinputform = Custom[MultipleInputForm ++](Inputs=boolean_input, Toggle=code_block)  # package Data-Shapes; Create a form with multiple inputs. see www.data-shapes.net for tutorials and infos!
