# Dynamo graph Fire and Smoke Dampers Placer v.2.0.dyn "Fire and Smoke Dampers Placer v.2.0_WIP" (Dynamo 2.16.1.2727)
# packages: Data-Shapes 2021.2.92

# group: Background
# note: USE:
# FOR GENERAL WORKFLOW NODES

# group: Input
# note: USE:
# FOR FIXED INPUT (FILE PATHS ETC.)

# group: Control
# note: USE:
# FOR USER CONTROL (SLIDERS ETC.)

# group: To Revit
# note: USE:
# FOR CHANGES TO REVIT

# group: Python
# note: USE:
# FOR PYTHON NODES

# group: Conditional
# note: USE:
# FOR CONDITIONAL NODES

# group: DYNAMO COLOUR CODING LEGEND
# note: COLOUR CODING LEGEND

# group: Monitor
# note: USE:
# FOR IMPORTANT WATCH NODES

# group: Get all families of Duct Accessories category
python_script = Python()  # IronPython2; unwired: IN[0]
# ---------- python_script.python (12 lines) ----------
import clr
clr.AddReference("RevitServices")
import RevitServices
from RevitServices.Persistence import DocumentManager
from RevitServices.Transactions import TransactionManager

clr.AddReference('RevitAPI')
import Autodesk
from Autodesk.Revit.DB import *
from Autodesk.Revit.DB import FilteredElementCollector
doc = DocumentManager.Instance.CurrentDBDocument
OUT = FilteredElementCollector(doc).OfClass(Family).ToElements()
# ----------------------------------------
python_script_2 = Python(IN[0]=python_script)  # IronPython2
# ---------- python_script_2.python (37 lines) ----------
import System
import clr
clr.AddReference('RevitAPI')
from Autodesk.Revit.DB import *

clr.AddReference("RevitNodes")
import Revit
clr.ImportExtensions(Revit.Elements)

def GetCategory(item):
	if not item: return None
	objtype = item.GetType().ToString()
	returnID = None
	returnCat = None
	returnBic = None
	if objtype == "Autodesk.Revit.DB.ViewSchedule": returnID = item.Definition.CategoryId
	elif objtype == "Autodesk.Revit.DB.Family": returnID = item.FamilyCategoryId
	elif objtype == "Autodesk.Revit.DB.GraphicsStyle":  returnID = item.GraphicsStyleCategory.Id
	elif objtype == "Revit.Application.Document":
		if item.IsFamilyDocument: 
			clr.AddReference("RevitServices")
			import RevitServices
			from RevitServices.Persistence import DocumentManager
			returnID = DocumentManager.Instance.CurrentDBDocument.OwnerFamily.FamilyCategoryId
	elif objtype == "Autodesk.Revit.DB.Category": 
		if item.Parent: returnID = item.Parent.Id
	elif hasattr(item, "Category"): returnID = item.Category.Id
	if returnID:
		returnBic = System.Enum.ToObject(BuiltInCategory, returnID.IntegerValue)
		try: returnCat =  Revit.Elements.Category.ById(returnID.IntegerValue)
		except: pass
	return returnCat, returnBic

items = UnwrapElement(IN[0])

if isinstance(IN[0], list): OUT = map(list, zip(*[GetCategory(x) for x in items]))
else: OUT = GetCategory(items)
# ----------------------------------------
firstItem = List.FirstItem(list=python_script_2)
string_from_object = FromObject(obj=firstItem)
string = StringInput("Duct Accessories")
contains = String.Contains(string=string_from_object, searchFor=string)
filterByBoolMask = List.FilterByBoolMask(list=python_script, mask=contains)

name = Element.Name(element=filterByBoolMask.in)

# group: User Interface
code_block = CodeBlock { "Automatic Placement of Dampers"; null; "Proceed"; "Cancel"; 800; 700; 300; }
string_2 = StringInput("Fire Rating Parameter Name")
string_3 = StringInput("Input the name of the fire rating parameter used in the architectural model ")
textnote_data = Custom[TextNote Data](TextNote=string_3)  # package Data-Shapes; Create Data for TextNote input in UI.MultipleInputForm ++ . Check out www.data-shapes.net for more informations
string_4 = StringInput("Fire")
textbox_data = Custom[TextBox Data](DefaultText=string_4)  # package Data-Shapes; Create Data for TextBox input in UI.MultipleInputForm ++ . Check out www.data-shapes.net for more informations
list_create = List.Create(item0=textnote_data, item1=textbox_data)
inputgroup_data = Custom[InputGroup Data](GroupTitle=string_2, Inputs=list_create)  # package Data-Shapes; Creates a group of inputs for UI.MultipleInputForm ++ . Check out www.data-shapes.net for more infos !
string_5 = StringInput("Select Damper Type")
string_6 = StringInput("Select the type of damper you wish to place. Please make sure that the family is loaded in the model for the selected type.")
textnote_data_2 = Custom[TextNote Data](TextNote=string_6)
code_block_2 = CodeBlock()
# ---------- code_block_2.designscript (2 lines) ----------
["Fire Dampers", "Fire and Smoke Dampers", "Smoke Control Dampers"];
["FireDamper", "FireandSmokeDamper", "SmokeControlDamper"];
# ----------------------------------------
radiobuttons_data = Custom[RadioButtons Data](Keys=code_block_2.out0, Values=code_block_2.out1)  # package Data-Shapes; Create radio buttons input for UI.MultipleInputForm ++ .
list_create_2 = List.Create(item0=textnote_data_2, item1=radiobuttons_data)
inputgroup_data_2 = Custom[InputGroup Data](GroupTitle=string_5, Inputs=list_create_2)
list_create_3 = List.Create(item0=inputgroup_data, item1=inputgroup_data_2)
boolean = BoolSelector(true)
multipleinputform = Custom[MultipleInputForm ++](Description_optional=code_block.out0, Logo_optional=code_block.out1, ButtonText_optional=code_block.out2, Inputs=list_create_3, Toggle=boolean, CancelButtonText_optional=code_block.out3, MaxHeight_optional=code_block.out4, Width_optional=code_block.out5, LabelWidth_optional=code_block.out6)  # package Data-Shapes; Create a form with multiple inputs. see www.data-shapes.net for tutorials and infos!

# group: Selected Damper Type
code_block_3 = CodeBlock(SelectedDamperFamily=multipleinputform.User_Inputs) { SelectedDamperFamily[1]; }

contains_2 = String.Contains(string=name, searchFor=code_block_3)
filterByBoolMask_2 = List.FilterByBoolMask(list=filterByBoolMask.in, mask=contains_2)
name_2 = FamilyType.Name(familyType=filterByBoolMask_2.in)
string_7 = StringInput("RecCon")
contains_3 = String.Contains(string=name_2, searchFor=string_7)
filterByBoolMask_3 = List.FilterByBoolMask(list=name_2, mask=contains_3)
flatten = List.Flatten(list=filterByBoolMask_3.out)
code_block_4 = CodeBlock(RoundConnectorsFamilies=flatten) { RoundConnectorsFamilies; }

# group: Get all ducts
string_8 = StringInput("Ducts")
byName = Category.ByName(name=string_8)
all_elements_of_category = ElementsOfCategory(Category=byName)
code_block_5 = CodeBlock(AllDucts=all_elements_of_category) { AllDucts; }

elementType = Element.ElementType(element=code_block_5)

# group: Python to get duct shape
get_duct_shape = Python(IN[0]=elementType)  # IronPython2
# ---------- get_duct_shape.python (5 lines) ----------
import clr
# The inputs to this node will be stored as a list in the IN variables.
dataEnteringNode = IN[0] if isinstance(IN[0], list) else [IN[0]]
# Assign your output to the OUT variable.
OUT = [e.FamilyName for e in UnwrapElement(dataEnteringNode)]
# ----------------------------------------

# group: Get only round and rectangular ducts
string_9 = StringInput("Oval Duct")
ne = string_9 != get_duct_shape
filterByBoolMask_4 = List.FilterByBoolMask(list=code_block_5, mask=ne)
code_block_6 = CodeBlock(RoundandRectangularDucts=filterByBoolMask_4.in) { RoundandRectangularDucts; }

# group: Get all Walls, Floors and Roofs
code_block_7 = CodeBlock { ["Walls","Floors","Roofs"]; }
byName_2 = Category.ByName(name=code_block_7)
all_elements_of_category_2 = ElementsOfCategory(Category=byName_2)

# group: Get all Revit links
string_10 = StringInput("RVT Links")
byName_3 = Category.ByName(name=string_10)
all_elements_of_category_3 = ElementsOfCategory(Category=byName_3)

# group: Python to get Walls, Floors & Roofs from all Revit links
elements_from_all_links = Python(IN[0]=all_elements_of_category_3, IN[1]=byName_2)  # IronPython2
# ---------- elements_from_all_links.python (55 lines) ----------
# Enable Python support and load DesignScript library
import clr
clr.AddReference('ProtoGeometry')
from Autodesk.DesignScript.Geometry import *

# Import ToDSType(bool) extension method
clr.AddReference("RevitNodes")
import Revit
clr.ImportExtensions(Revit.Elements)

# Import DocumentManager and TransactionManager
clr.AddReference("RevitServices")
import RevitServices
from RevitServices.Persistence import DocumentManager
from RevitServices.Transactions import TransactionManager

# Import RevitAPI
clr.AddReference("RevitAPI")
import Autodesk
from Autodesk.Revit.DB import *

from System.Collections.Generic import List


doc = DocumentManager.Instance.CurrentDBDocument
uiapp = DocumentManager.Instance.CurrentUIApplication
app = uiapp.Application
uiDoc = uiapp.ActiveUIDocument

# The inputs to this node will be stored as a list in the IN variables.

#List of links
links = IN[0] if isinstance(IN[0], list) else [IN[0]]

#List of cats
inCats = IN[1] if isinstance(IN[1], list) else [IN[1]]


catIds = [ElementId(x.Id) for x in inCats]
categoryIds = List[ElementId](catIds)
# Place your code below this line

outElems = []


for link in links:
	link = doc.GetElement(ElementId(link.Id)).GetLinkDocument()
	collector = FilteredElementCollector(link)
	sysFilter = ElementMulticategoryFilter(categoryIds)
	elems = collector.WherePasses(sysFilter).WhereElementIsNotElementType().ToElements()
	outElems.append(elems)


# Assign your output to the OUT variable.
OUT = outElems
# ----------------------------------------

# group: All Walls, Floors & Roofs from Revit links + Walls, Floors & Roofs in our model
list_create_4 = List.Create(item0=all_elements_of_category_2, item1=elements_from_all_links)
flatten_2 = List.Flatten(list=list_create_4)
code_block_8 = CodeBlock(AllWallsFloorsRoofs=flatten_2) { AllWallsFloorsRoofs; }

# group: Parameter name
code_block_9 = CodeBlock(ParameterName=multipleinputform.User_Inputs) { ParameterName[0]; }

# group: Filter for walls, floors & roofs which have the parameter AND the parameter has a value
parameters = Element.Parameters(element=code_block_8)
name_3 = Parameter.Name(parameter=parameters)
code_block_10 = CodeBlock { true; }
contains_4 = String.Contains(string=name_3, searchFor=code_block_9, ignoreCase=code_block_10)
filterByBoolMask_5 = List.FilterByBoolMask(list=parameters, mask=contains_4)
value = Parameter.Value(parameter=filterByBoolMask_5.in)
code_block_11 = CodeBlock(x=value) { x!=""&&x!=0&&x!=null; }
countTrue = List.CountTrue(list=code_block_11@L2)
code_block_12 = CodeBlock(x=countTrue) { x>=1; }
filterByBoolMask_6 = List.FilterByBoolMask(list=code_block_8, mask=code_block_12)

# group: Intersect all ducts with walls, floors & roofs
getLocation = Element.GetLocation(element=code_block_6)
geometry = Element.Geometry(element=filterByBoolMask_6.in)
flatten_3 = List.Flatten(list=geometry)
intersectAll = Geometry.IntersectAll(geometry=getLocation, others=flatten_3, lacing=CrossProduct)

# group: Remove ducts which do not clash with fire rated walls, floors & roofs
code_block_13 = CodeBlock { 1; }
flatten_4 = List.Flatten(list=intersectAll@L3, amount=code_block_13)
string_11 = StringInput("Autodesk.DesignScript.Geometry.Line")
removeIfNot = List.RemoveIfNot(list=flatten_4@L2, type=string_11)
isEmpty = List.IsEmpty(list=removeIfNot@L2)
not_ = Not(x=isEmpty)
filterByBoolMask_7 = List.FilterByBoolMask(list=removeIfNot, mask=not_)

# group: Filtered ducts clashing with fire rated walls, floors & roofs
filterByBoolMask_8 = List.FilterByBoolMask(list=code_block_6, mask=not_)

code_block_14 = CodeBlock { 0.5; }
pointAtParameter = Curve.PointAtParameter(curve=filterByBoolMask_7.in, param=code_block_14)
count = List.Count(list=pointAtParameter, lacing=Longest)
ofRepeatedItem = List.OfRepeatedItem(item=filterByBoolMask_8.in, amount=count, lacing=Shortest)
flatten_5 = List.Flatten(list=ofRepeatedItem)
flatten_6 = List.Flatten(list=pointAtParameter)
code_block_15 = CodeBlock { 150; }
byCenterPointRadius = Sphere.ByCenterPointRadius(centerPoint=flatten_6, radius=code_block_15)

# group: Get only Fire and Smoke Dampers & Smoke Control Dampers elements in the model
string_12 = StringInput("Duct Accessories")
byName_4 = Category.ByName(name=string_12)
all_elements_of_category_4 = ElementsOfCategory(Category=byName_4)
getFamily = FamilyInstance.GetFamily(familyInstance=all_elements_of_category_4)
name_4 = Family.Name(family=getFamily)
code_block_16 = CodeBlock { ["HL_FireDamper","HL_FireandSmokeDamper", "HL_SmokeControlDamper"]; }
contains_5 = String.Contains(string=name_4, searchFor=code_block_16@L1)
filterByBoolMask_9 = List.FilterByBoolMask(list=all_elements_of_category_4, mask=contains_5@L2)
flatten_7 = List.Flatten(list=filterByBoolMask_9.in)

getLocation_2 = Element.GetLocation(element=flatten_7)
code_block_17 = CodeBlock { 150; }
byCenterPointRadius_2 = Sphere.ByCenterPointRadius(centerPoint=getLocation_2, radius=code_block_17)
doesIntersect = Geometry.DoesIntersect(geometry=byCenterPointRadius, other=byCenterPointRadius_2, lacing=CrossProduct)
identity = Object.Identity()  # unwired: object
trueForAny = List.TrueForAny(list=doesIntersect, queryFunction=identity, lacing=Longest)
isEmpty_2 = List.IsEmpty(list=doesIntersect, lacing=Longest)
not_2 = Not(x=isEmpty_2)

# group: Conditional
and_ = trueForAny && not_2

not_3 = Not(x=and_)
filterByBoolMask_10 = List.FilterByBoolMask(list=flatten_5, mask=not_3)
uniqueItems = List.UniqueItems(list=filterByBoolMask_10.in)
filterByBoolMask_11 = List.FilterByBoolMask(list=flatten_6, mask=not_3)
filterByBoolMask_12 = List.FilterByBoolMask(list=count, mask=not_3)

# group: Damper Location
chop = List.Chop(list=filterByBoolMask_11.in, lengths=filterByBoolMask_12.in)

# group: Duct shape names
string_13 = StringInput("Rectangular Duct")
string_14 = StringInput("Round Duct")
list_create_5 = List.Create(item0=string_13, item1=string_14)

types = Family.Types(family=filterByBoolMask_2.in)
flatten_8 = List.Flatten(list=types)
filterByBoolMask_13 = List.FilterByBoolMask(list=flatten_8, mask=contains_3)
flatten_9 = List.Flatten(list=filterByBoolMask_13.in)
flatten_10 = List.Flatten(list=filterByBoolMask_3.in)
code_block_18 = CodeBlock(RectangularConnectorsFamilies=flatten_10) { RectangularConnectorsFamilies; }
string_15 = StringInput("SingleBlade")
contains_6 = String.Contains(string=code_block_18, searchFor=string_15)
filterByBoolMask_14 = List.FilterByBoolMask(list=flatten_9, mask=contains_6)
list_create_6 = List.Create(item0=filterByBoolMask_14.in, item1=filterByBoolMask_14.out)
identity_2 = Object.Identity()  # unwired: object
trueForAny_2 = List.TrueForAny(list=contains_6, queryFunction=identity_2)

# group: Conditional
code_block_19 = CodeBlock(SelectedDamperType=code_block_3, SingleBlade=trueForAny_2) { SelectedDamperType == "SmokeControlDamper" && SingleBlade == true ? 0 : 1; }

getItemAtIndex = List.GetItemAtIndex(list=list_create_6, index=code_block_19)
flatten_11 = List.Flatten(list=filterByBoolMask_13.out)
list_create_7 = List.Create(item0=getItemAtIndex, item1=flatten_11)
flatten_12 = List.Flatten(list=list_create_7)
elementType_2 = Element.ElementType(element=uniqueItems)

# group: Use a dictionary to select correct damper type based on duct shape
byKeysValues = DesignScript.Builtin.Dictionary.ByKeysValues(keys=list_create_5, values=flatten_12)
get_duct_shape_2 = Python(IN[0]=elementType_2)  # IronPython2; same code as get_duct_shape
valueAtKey = DesignScript.Builtin.Dictionary.ValueAtKey(dictionary=byKeysValues, key=get_duct_shape_2)
flatten_13 = List.Flatten(list=valueAtKey)

# group: Python to place the dampers
code_block_20 = CodeBlock(FilteredDucts=uniqueItems) { FilteredDucts; }
code_block_21 = CodeBlock(DamperLocation=chop) { DamperLocation; }
code_block_22 = CodeBlock(DamperType=flatten_13) { DamperType; }
place_dampers = Python(IN[0]=code_block_20, IN[1]=code_block_21, IN[2]=code_block_22)  # IronPython2
# ---------- place_dampers.python (272 lines) ----------
import clr
import math
clr.AddReference("RevitServices")
import RevitServices
from RevitServices.Persistence import DocumentManager
from RevitServices.Transactions import TransactionManager
doc = DocumentManager.Instance.CurrentDBDocument

clr.AddReference("RevitAPI")
from Autodesk.Revit.DB import *

clr.AddReference("RevitNodes")
import Revit
clr.ImportExtensions(Revit.Elements)
clr.ImportExtensions(Revit.GeometryConversion)

from System.Collections.Generic import List

if isinstance(IN[0], list):
	ducts = UnwrapElement(IN[0])
else:
	ducts = [UnwrapElement(IN[0])]
	
if isinstance(IN[1], list):
	points = IN[1]
else:
	points = [IN[1]]

if isinstance(IN[2], list):
	famtype = UnwrapElement(IN[2])
else:
	famtype = [UnwrapElement(IN[2])]
ftl = len(famtype)
debug = []
def IsParallel(dir1,dir2):
	if dir1.Normalize().IsAlmostEqualTo(dir2.Normalize()):
		return True
	if dir1.Normalize().Negate().IsAlmostEqualTo(dir2.Normalize()):
		return True
	return False
	
def measure(startpoint, point):
	return startpoint.DistanceTo(point)
	
def copyElement(element, oldloc, loc):
	
	elementlist = List[ElementId]()
	elementlist.Add(element.Id)
	OffsetZ = (oldloc.Z - loc.Z)*-1
	OffsetX = (oldloc.X - loc.X)*-1
	OffsetY = (oldloc.Y - loc.Y)*-1
	direction = XYZ(OffsetX,OffsetY,OffsetZ)
	newelementId = ElementTransformUtils.CopyElements(doc,elementlist,direction)
	newelement = doc.GetElement(newelementId[0])
	return newelement

def GetDirection(faminstance):
	for c in faminstance.MEPModel.ConnectorManager.Connectors:
		conn = c
		break
	return conn.CoordinateSystem.BasisZ

def GetClosestDirection(faminstance, lineDirection):
	conndir = None
	flat_linedir = XYZ(lineDirection.X,lineDirection.Y,0).Normalize()
	for conn in faminstance.MEPModel.ConnectorManager.Connectors:
		conndir = conn.CoordinateSystem.BasisZ
		if flat_linedir.IsAlmostEqualTo(conndir):
			return conndir
	return conndir
	


#global variables for rotating new families
tempfamtype = None
xAxis = XYZ(1,0,0)
def placeFitting(duct,point,familytype,lineDirection):
	fittingdebug = []
	toggle = False
	isVertical = False
	
	
	global tempfamtype
	if tempfamtype == None:
		tempfamtype = familytype
		toggle = True
	elif tempfamtype != familytype:
		toggle = True
		tempfamtype = familytype
	level = duct.ReferenceLevel
	
	width = 4
	height = 4
	radius = 2
	round = False
	connectors = duct.ConnectorManager.Connectors
	for c in connectors:
		if c.ConnectorType != ConnectorType.End:
			continue
		shape = c.Shape
		if shape == ConnectorProfileType.Round:
			radius = c.Radius
			round = True	
			break
		elif shape == ConnectorProfileType.Rectangular or shape == ConnectorProfileType.Oval:
			if abs(lineDirection.Z) == 1:
				isVertical = True
				yDir = c.CoordinateSystem.BasisY
			width = c.Width
			height = c.Height
			break
		
			
	point = XYZ(point.X,point.Y,point.Z-level.Elevation)
	newfam = doc.Create.NewFamilyInstance(point,familytype,level,Structure.StructuralType.NonStructural)
	doc.Regenerate()
	transform = newfam.GetTransform()
	
	#Old script used family instance transform
	#New script uses family instance location point 
	axis = Line.CreateUnbound(newfam.Location.Point, transform.BasisZ)

	global xAxis
	if toggle:
		xAxis = GetDirection(newfam)
	fittingdebug.append(toggle)
	fittingdebug.append(axis)
	zAxis = XYZ(0,0,1)
	
	if isVertical:
		angle = xAxis.AngleOnPlaneTo(yDir,zAxis)
	else:
		angle = xAxis.AngleOnPlaneTo(lineDirection,zAxis)
	
	
	ElementTransformUtils.RotateElement(doc,newfam.Id,axis,angle)
	doc.Regenerate()
	
	if lineDirection.Z != 0:
		newAxis = GetClosestDirection(newfam,lineDirection)
		yAxis = newAxis.CrossProduct(zAxis)
		angle2 = newAxis.AngleOnPlaneTo(lineDirection,yAxis)
		axis2 = Line.CreateUnbound(newfam.Location.Point, yAxis)
		ElementTransformUtils.RotateElement(doc,newfam.Id,axis2,angle2)
	
	result = {}
	connpoints = []
	famconns = newfam.MEPModel.ConnectorManager.Connectors
	
	if round:
		for conn in famconns:
			if IsParallel(lineDirection,conn.CoordinateSystem.BasisZ) == False:
				continue
			if conn.Shape != shape:
				continue
			conn.Radius = radius
			connpoints.append(conn.Origin)
	else:
		for conn in famconns:
			if IsParallel(lineDirection,conn.CoordinateSystem.BasisZ) == False:
				continue
			if conn.Shape != shape:
				continue
			conn.Width = width
			conn.Height = height
			connpoints.append(conn.Origin)
	
	result[newfam] = connpoints
	debug.append(fittingdebug)
	return result
	
	
def ConnectElements(duct, fitting):
	ductconns = duct.ConnectorManager.Connectors
	fittingconns = fitting.MEPModel.ConnectorManager.Connectors
	for conn in fittingconns:
		for ductconn in ductconns:
			result = ductconn.Origin.IsAlmostEqualTo(conn.Origin)
			if result:
				ductconn.ConnectTo(conn)
				break
	return result

def SortedPoints(fittingspoints,ductStartPoint):
	sortedpoints = sorted(fittingspoints, key=lambda x: measure(ductStartPoint, x))
	return sortedpoints
	

ductsout = []
fittingsout = []
combilist = []

TransactionManager.Instance.EnsureInTransaction(doc)
for typ in famtype:
	if typ.IsActive == False:
		typ.Activate()
		doc.Regenerate()

for i,duct in enumerate(ducts):
	ListOfPoints = [x.ToXyz() for x in points[i]]
	familytype = famtype[i]
	#create duct location line
	ductline = duct.Location.Curve
	ductStartPoint = ductline.GetEndPoint(0)
	ductEndPoint = ductline.GetEndPoint(1)
	#get end connector to reconnect later
	endIsConnected = False
	endrefconn = None
	for ductconn in duct.ConnectorManager.Connectors:
		if ductconn.Origin.DistanceTo(ductEndPoint) < 5/304.8:
			if ductconn.IsConnected:
				endIsConnected = True
				for refconn in ductconn.AllRefs:
					if refconn.ConnectorType != ConnectorType.Logical and refconn.Owner.Id.IntegerValue != duct.Id.IntegerValue:
						endrefconn = refconn
			
	#sort the points from start of duct to end of duct
	pointlist = SortedPoints(ListOfPoints,ductStartPoint)
	
	ductlist = []
	newFittings = []
	ductlist.append(duct)
	
	tempStartPoint = None
	tempEndPoint = None
	
	lineDirection = ductline.Direction
	
	for i,p in enumerate(pointlist):		
		output = placeFitting(duct,p,familytype,lineDirection)
		newfitting = output.keys()[0]
		newFittings.append(newfitting)
		fittingpoints = output.values()[0]
		
		tempPoints = SortedPoints(fittingpoints,ductStartPoint)
		if i == 0:
			tempEndPoint = tempPoints[0]
			tempStartPoint = tempPoints[1]			
			newduct = copyElement(duct,ductStartPoint,tempStartPoint)	
			duct.Location.Curve = Line.CreateBound(ductStartPoint,tempEndPoint)
			ductlist.append(newduct)
			combilist.append([duct,newfitting])
			combilist.append([newduct,newfitting])
		else:
			combilist.append([newduct,newfitting])
			tempEndPoint = tempPoints[0]
			newduct = copyElement(duct,ductStartPoint,tempStartPoint)
			ductlist[-1].Location.Curve = Line.CreateBound(tempStartPoint,tempEndPoint)
			tempStartPoint = tempPoints[1]
			ductlist.append(newduct)
			combilist.append([newduct,newfitting])
	
	newline = Line.CreateBound(tempStartPoint,ductEndPoint)
	ductlist[-1].Location.Curve = newline
	
	ductsout.append(ductlist)
	fittingsout.append(newFittings)
	doc.Regenerate()

	if endIsConnected:
		for conn in ductlist[-1].ConnectorManager.Connectors:
			if conn.Origin.DistanceTo(ductEndPoint) < 5/304.8:
				endrefconn.ConnectTo(conn)
			
TransactionManager.Instance.TransactionTaskDone()

TransactionManager.Instance.EnsureInTransaction(doc)
for combi in combilist:
	ConnectElements(combi[0],combi[1])
TransactionManager.Instance.TransactionTaskDone()

OUT = ductsout, fittingsout, debug
# ----------------------------------------
code_block_23 = CodeBlock(x=place_dampers) { x[0]; }
code_block_24 = CodeBlock(x=place_dampers) { x[1]; }

# group: Splitted Ducts
code_block_25 = CodeBlock(SplittedDucts=code_block_23) { SplittedDucts; }

# group: Placed Dampers
code_block_26 = CodeBlock(PlacedDampers=code_block_24) { PlacedDampers; }
flatten_14 = List.Flatten(list=code_block_26)

count_2 = List.Count(list=flatten_14)

# group: Conditional
code_block_27 = CodeBlock(SelectedDamperFamily=code_block_3)
# ---------- code_block_27.designscript (3 lines) ----------
SelectedDamperFamily == "FireDamper" ? " fire" :
SelectedDamperFamily == "FireandSmokeDamper" ? " fire and smoke" :
" smoke control";
# ----------------------------------------

# group: Conditional
code_block_28 = CodeBlock(x=count_2, SelectedDamperType=code_block_27, LstCount=count_2)
# ---------- code_block_28.designscript (4 lines) ----------
x==0 ? "You haven't placed any" + SelectedDamperType + " dampers":
x==1 ? "Nice work! You placed " + LstCount + SelectedDamperType + " damper":
x>1 ? "Nice work! You placed " + LstCount + SelectedDamperType + " dampers":
"Oops something went wrong!";
# ----------------------------------------

# group: Python to generate pop-up message
code_block_29 = CodeBlock { "HL | Digital Engineering"; }
python_script_3 = Python(IN[0]=code_block_29, IN[1]=code_block_28)  # IronPython2
# ---------- python_script_3.python (9 lines) ----------
import clr
clr.AddReference('RevitAPIUI')
from Autodesk.Revit.UI import TaskDialog

windowTitle = IN[0]
windowMessage = IN[1]

messageDialog = TaskDialog
OUT = messageDialog.Show(windowTitle, windowMessage)
# ----------------------------------------
