# Dynamo graph Combined Public Health Systems_Place Access Doors v.2.1.dyn (Dynamo 2.16.1.2727)
# packages: Data-Shapes 2022.2.105

# group: DYNAMO COLOUR CODING LEGEND
# note: COLOUR CODING LEGEND

# group: Python
# note: USE:
# FOR PYTHON NODES

# group: Monitor
# note: USE:
# FOR IMPORTANT WATCH NODES

# group: Conditional
# note: USE:
# FOR CONDITIONAL NODES

# group: To Revit
# note: USE:
# FOR CHANGES TO REVIT

# group: Control
# note: USE:
# FOR USER CONTROL (SLIDERS ETC.)

# group: Input
# note: USE:
# FOR FIXED INPUT (FILE PATHS ETC.)

# group: Background
# note: USE:
# FOR GENERAL WORKFLOW NODES

# group: Get all piping systems, filter them to only show Discharge, Vent & Rainwater
code_block = CodeBlock { "Piping Systems"; }
byName = Category.ByName(name=code_block)
all_elements_of_category = ElementsOfCategory(Category=byName)
elementType = Element.ElementType(element=all_elements_of_category)
name = Element.Name(element=elementType)
code_block_2 = CodeBlock { ["Ss_50_30_02 - Rainwater", "Ss_50_30_04_97 - Discharge","Ss_50_30_04_97 - HT Discharge", "Ss_50_30_04_97 - HT Vent", "Ss_50_30_04_97 - Lab Discharge", "Ss_50_30_04_97 - Lab Vent", "Ss_50_30_04_97 - Vent"]; }
contains = String.Contains(string=name, searchFor=code_block_2@L1)
filterByBoolMask = List.FilterByBoolMask(list=all_elements_of_category, mask=contains@L2)
flatten = List.Flatten(list=filterByBoolMask.in)
name_2 = Element.Name(element=flatten)

# group: Python to sort strings with numbers
python_to_sort_strings_with = Python(IN[0]=name_2)  # "Python to sort strings with numbers"; IronPython2
# ---------- python_to_sort_strings_with.python (10 lines) ----------
import re

list = IN[0]

def natural_sort(l): 
    convert = lambda text: int(text) if text.isdigit() else text.lower() 
    alphanum_key = lambda key: [ convert(c) for c in re.split('([0-9]+)', key) ] 
    return sorted(l, key = alphanum_key)

OUT = natural_sort(list)
# ----------------------------------------

indexOf = List.IndexOf(list=name_2, element=python_to_sort_strings_with)
getItemAtIndex = List.GetItemAtIndex(list=flatten, index=indexOf)
elementType_2 = Element.ElementType(element=getItemAtIndex)
name_3 = Element.Name(element=elementType_2)

# group: Input
code_block_3 = CodeBlock { ["Ss_50_30_04_97 - Discharge","Ss_50_30_04_97 - HT Discharge", "Ss_50_30_04_97 - Lab Discharge"]; }
code_block_4 = CodeBlock { ["Ss_50_30_04_97 - HT Vent", "Ss_50_30_04_97 - Lab Vent", "Ss_50_30_04_97 - Vent"]; }
code_block_5 = CodeBlock { ["Ss_50_30_04_97 - Discharge","Ss_50_30_04_97 - HT Discharge", "Ss_50_30_04_97 - HT Vent", "Ss_50_30_04_97 - Lab Discharge", "Ss_50_30_04_97 - Lab Vent", "Ss_50_30_04_97 - Vent"]; }
code_block_6 = CodeBlock { "Ss_50_30_02 - Rainwater"; }
list_create = List.Create(item0=code_block_3, item1=code_block_4, item2=code_block_5, item3=code_block_6)

# group: Get all levels
code_block_7 = CodeBlock { "Levels"; }
byName_2 = Category.ByName(name=code_block_7)
all_elements_of_category_2 = ElementsOfCategory(Category=byName_2)

# group: Sort Levels by elevation
projectElevation = Level.ProjectElevation()  # unwired: level
sortByFunction = List.SortByFunction(list=all_elements_of_category_2, sortFunction=projectElevation)

name_4 = Element.Name(element=sortByFunction)

# group: User Interface
code_block_8 = CodeBlock { "Place Access Doors"; null; "Proceed"; "Cancel"; 800; 700; 300; }
code_block_9 = CodeBlock { "Requirements"; "Dynamo 2.0.3 or higher"; }
textnote_data = Custom[TextNote Data](Title=code_block_9.out0, TextNote=code_block_9.out1)  # package Data-Shapes; Create Data for TextNote input in UI.MultipleInputForm ++ . Check out www.data-shapes.net for more informations
code_block_10 = CodeBlock()
# ---------- code_block_10.designscript (2 lines) ----------
"Note";
"This Dynamo script places access doors on selected system(s) at selected elevation. It works with rainwater and above ground foul drainage systems.";
# ----------------------------------------
textnote_data_2 = Custom[TextNote Data](Title=code_block_10.out0, TextNote=code_block_10.out1)
code_block_11 = CodeBlock { ["All","Selected"]; }
code_block_12 = CodeBlock { "System Type"; ["Discharge","Vent","Discharge and Vent","Rainwater"]; 0..3..1; 2; }
radiobuttons_data = Custom[RadioButtons Data](InputName=code_block_12.out0, Keys=code_block_12.out1, Values=code_block_12.out2, DefaultValueIndex=code_block_12.out3)  # package Data-Shapes; Create radio buttons input for UI.MultipleInputForm ++ .
code_block_13 = CodeBlock { "Select System"; false; }
dropdown_data = Custom[DropDown Data](InputName=code_block_13.out0, Keys=python_to_sort_strings_with, Values=getItemAtIndex, Sorted_optional=code_block_13.out1)  # package Data-Shapes; Create data for DropDown input in UI.MultiInputForm ++ . Check out www.data-shapes.net for more infos.
list_create_2 = List.Create(item0=radiobuttons_data, item1=dropdown_data)
conditionalinput_data = Custom[ConditionalInput Data](Options=code_block_11, InputGroups_by_Option=list_create_2)  # package Data-Shapes; Allows to create inputs that are enabled/disabled by a condition dor UI.MultipleInputForm++.
code_block_14 = CodeBlock { "Access Door Elevation Above Each Level"; }
code_block_15 = CodeBlock { "Value in mm"; "1200"; true; }
textbox_data = Custom[TextBox Data](InputName=code_block_15.out0, DefaultText=code_block_15.out1, IsNumberEntry=code_block_15.out2)  # package Data-Shapes; Create Data for TextBox input in UI.MultipleInputForm ++ . Check out www.data-shapes.net for more informations
inputgroup_data = Custom[InputGroup Data](GroupTitle=code_block_14, Inputs=textbox_data)  # package Data-Shapes; Creates a group of inputs for UI.MultipleInputForm ++ . Check out www.data-shapes.net for more infos !
code_block_16 = CodeBlock { "Select the levels where you wish to place access doors"; }
code_block_17 = CodeBlock { "Select Levels"; false; }
listview_data = Custom[Listview Data](InputName=code_block_17.out0, Keys=name_4, Values=sortByFunction, SortItems_optionnal=code_block_17.out1, ShowId_optionnal=code_block_17.out1)  # package Data-Shapes; Create data for ListView input in UI.MultiInputForm ++ . Check out www.data-shapes.net for more infos.
inputgroup_data_2 = Custom[InputGroup Data](GroupTitle=code_block_16, Inputs=listview_data)
list_create_3 = List.Create(item0=textnote_data, item1=textnote_data_2, item2=conditionalinput_data, item3=inputgroup_data, item4=inputgroup_data_2)
boolean = BoolSelector(true)
multipleinputform = Custom[MultipleInputForm ++](Description_optional=code_block_8.out0, Logo_optional=code_block_8.out1, ButtonText_optional=code_block_8.out2, Inputs=list_create_3, Toggle=boolean, CancelButtonText_optional=code_block_8.out3, MaxHeight_optional=code_block_8.out4, Width_optional=code_block_8.out5, LabelWidth_optional=code_block_8.out6)  # package Data-Shapes; Create a form with multiple inputs. see www.data-shapes.net for tutorials and infos!

code_block_18 = CodeBlock(UserInputs=multipleinputform.User_Inputs) { UserInputs[0]@L1; UserInputs[1]@L1; UserInputs[2]@L1; UserInputs[3]@L1; UserInputs[4]@L1; }

# group: User Selection: Selected System Type
code_block_19 = CodeBlock(SelectedSystemType=code_block_18.out1) { SelectedSystemType; }

getItemAtIndex_2 = List.GetItemAtIndex(list=list_create, index=code_block_19)
contains_2 = String.Contains(string=name_3, searchFor=getItemAtIndex_2@L1)
filterByBoolMask_2 = List.FilterByBoolMask(list=getItemAtIndex, mask=contains_2@L2)
flatten_2 = List.Flatten(list=filterByBoolMask_2.in)

# group: User Selection: Selected Element
code_block_20 = CodeBlock(SelectedSystem=code_block_18.out2) { SelectedSystem; }

list_create_4 = List.Create(item0=flatten_2, item1=code_block_20)

# group: User Selection: Selected Option
code_block_21 = CodeBlock(SelectedOption=code_block_18.out0) { SelectedOption; }

# group: Conditional
code_block_22 = CodeBlock(SelectedOption=code_block_21) { SelectedOption == "All"? 0: 1; }

getItemAtIndex_3 = List.GetItemAtIndex(list=list_create_4, index=code_block_22)

# group: Python to get all elements in network
code_block_23 = CodeBlock(PipingSystem=getItemAtIndex_3) { PipingSystem; }
python_pipe_network = Python(IN[0]=code_block_23)  # IronPython2
# ---------- python_pipe_network.python (42 lines) ----------
import clr

clr.AddReference("RevitServices")
import RevitServices
from RevitServices.Persistence import DocumentManager
from RevitServices.Transactions import TransactionManager
doc = DocumentManager.Instance.CurrentDBDocument

clr.AddReference("RevitAPI")
import Autodesk
from Autodesk.Revit.DB import *

clr.AddReference("RevitNodes")
import Revit
clr.ImportExtensions(Revit.Elements)
clr.ImportExtensions(Revit.GeometryConversion)

#Many thanks to Konrad K Sobon for his awesome ProcessList function!
def Unwrap(item):
	return UnwrapElement(item)

def ProcessList(_func, _list):
    return map( lambda x: ProcessList(_func, x) if type(x)==list else _func(x), _list )

if isinstance(IN[0], list):
	systems = ProcessList(Unwrap, IN[0])
else:
	systems = [Unwrap(IN[0])]
	
	
def getNetwork(system):
	network = None
	try:
		network = [x.ToDSType(True) for x in system.PipingNetwork]
	except:
		pass
	return network

			
#Assign your output to the OUT variable.

OUT = ProcessList(getNetwork, systems)
# ----------------------------------------
code_block_24 = CodeBlock(ElementsInPipingSystem=python_pipe_network) { ElementsInPipingSystem; }

# group: Get only pipes
getCategory = Element.GetCategory(element=code_block_24)
string_from_object = FromObject(obj=getCategory)
code_block_25 = CodeBlock { "Pipes"; }
contains_3 = String.Contains(string=string_from_object, searchFor=code_block_25)
filterByBoolMask_3 = List.FilterByBoolMask(list=code_block_24, mask=contains_3)
flatten_3 = List.Flatten(list=filterByBoolMask_3.in)

# group: Get vertical pipes (Check angle to the Z axis is near 90)
getLocation = Element.GetLocation(element=flatten_3)
direction = Line.Direction(line=getLocation)
ZAxis = Vector.ZAxis()
angleWithVector = Vector.AngleWithVector(vector=direction, otherVector=ZAxis)

abs = Math.Abs(number=angleWithVector)
round = Math.Round(number=abs)
code_block_26 = CodeBlock(x=round) { x==0; x==180; }
xor = Math.Xor(bool=code_block_26.out0, otherBool=code_block_26.out1)

# group: Get only vertical pipes
filterByBoolMask_4 = List.FilterByBoolMask(list=flatten_3, mask=xor)

XY = Plane.XY()

# group: User Selection: Selected Levels
code_block_27 = CodeBlock(SelectedLevels=code_block_18.out4) { SelectedLevels; }

# group: Get Level elevation
elevation = Level.Elevation(level=code_block_27)

# group: User Selection: Selected Elevation
code_block_28 = CodeBlock(SelectedElevation=code_block_18.out3) { SelectedElevation; }

code_block_29 = CodeBlock(LevelElevation=elevation, SelectedElevation=code_block_28) { LevelElevation + SelectedElevation; }
offset = Plane.Offset(plane=XY, dist=code_block_29)

# group: Get pipe locations
getLocation_2 = Element.GetLocation(element=filterByBoolMask_4.in)

# group: Intersect pipes with planes at selected elevation and return intersecting points
intersect = Geometry.Intersect(geometry=offset, other=getLocation_2, lacing=CrossProduct)
transpose = List.Transpose(lists=intersect)
flatten_4 = List.Flatten(list=transpose, lacing=Longest)
isEmpty = List.IsEmpty(list=flatten_4, lacing=Longest)
not_ = Not(x=isEmpty)
filterByBoolMask_5 = List.FilterByBoolMask(list=flatten_4, mask=not_)

# group: Filter and get vertical pipes that could potentially be split
filterByBoolMask_6 = List.FilterByBoolMask(list=filterByBoolMask_4.in, mask=not_)

flatten_5 = List.Flatten(list=filterByBoolMask_5.in)
X = Point.X(point=flatten_5)
Y = Point.Y(point=flatten_5)
Z = Point.Z(point=flatten_5)
code_block_30 = CodeBlock(z=Z) { z+150; z-150; }
byCoordinates = Point.ByCoordinates(x=X, y=Y, z=code_block_30.out0)
code_block_31 = CodeBlock { 100; 150; }
byCenterPointRadius = Circle.ByCenterPointRadius(centerPoint=byCoordinates, radius=code_block_31.out0)
byCoordinates_2 = Vector.ByCoordinates(z=code_block_31.out1)
extrudeAsSolid = Curve.ExtrudeAsSolid(curve=byCenterPointRadius, direction=byCoordinates_2)
byCoordinates_3 = Point.ByCoordinates(x=X, y=Y, z=code_block_30.out1)
byCenterPointRadius_2 = Circle.ByCenterPointRadius(centerPoint=byCoordinates_3, radius=code_block_31.out0)
extrudeAsSolid_2 = Curve.ExtrudeAsSolid(curve=byCenterPointRadius_2, direction=byCoordinates_2)
list_create_5 = List.Create(item0=extrudeAsSolid, item1=extrudeAsSolid_2)
transpose_2 = List.Transpose(lists=list_create_5)
filterByBoolMask_7 = List.FilterByBoolMask(list=getLocation_2, mask=not_)
doesIntersect = Geometry.DoesIntersect(geometry=transpose_2, other=filterByBoolMask_7.in, lacing=CrossProduct)
allTrue = List.AllTrue(list=doesIntersect@@L2, lacing=Longest)
countTrue = List.CountTrue(list=allTrue, lacing=Longest)
code_block_32 = CodeBlock(x=countTrue) { x>0; }
count = List.Count(list=filterByBoolMask_5.in, lacing=Longest)
chop = List.Chop(list=code_block_32, lengths=count)
identity = Object.Identity()  # unwired: object
trueForAny = List.TrueForAny(list=chop, queryFunction=identity, lacing=Longest)
filterByBoolMask_8 = List.FilterByBoolMask(list=filterByBoolMask_6.in, mask=trueForAny)

# group: Filter and get vertical pipes that could potentially be split
watch = Watch(filterByBoolMask_8.in)

# group: Get Material and Diameter of pipes
code_block_33 = CodeBlock()
# ---------- code_block_33.designscript (2 lines) ----------
["Diameter",
"Material"];
# ----------------------------------------
getParameterValueByName = Element.GetParameterValueByName(element=filterByBoolMask_8.in, parameterName=code_block_33@L1)
code_block_34 = CodeBlock(PipeMaterial=getParameterValueByName) { PipeMaterial[1]; }
name_5 = Element.Name(element=code_block_34)
code_block_35 = CodeBlock(PipeDiameter=getParameterValueByName) { PipeDiameter[0]; }

# group: Conditional
code_block_36 = CodeBlock(PipeMaterial=name_5, PipeDiameter=code_block_35)
# ---------- code_block_36.designscript (6 lines) ----------
PipeMaterial == "Polypropylene" && PipeDiameter == 38? false:
PipeMaterial == "Polypropylene" && PipeDiameter == 152? false:
PipeMaterial == "Iron, Cast" && PipeDiameter > 300? false:
PipeMaterial == "PVC-U" && PipeDiameter < 82? false:
PipeMaterial == "HDPE" && PipeDiameter < 63? false:
true;
# ----------------------------------------

# group: Filter and get vertical pipes that will be split
filterByBoolMask_9 = List.FilterByBoolMask(list=filterByBoolMask_8.in, mask=code_block_36)

filterByBoolMask_10 = List.FilterByBoolMask(list=filterByBoolMask_5.in, mask=chop)
isEmpty_2 = List.IsEmpty(list=filterByBoolMask_10.in@@L1)
isNull = Object.IsNull(object=isEmpty_2)
not_2 = Not(x=isNull)
filterByBoolMask_11 = List.FilterByBoolMask(list=filterByBoolMask_10.in, mask=not_2)
filterByBoolMask_12 = List.FilterByBoolMask(list=filterByBoolMask_11.in, mask=code_block_36)

# group: Background
code_block_37 = CodeBlock { "HL_Generic_Coupling"; }
byName_3 = Family.ByName(name=code_block_37)
types = Family.Types(family=byName_3)

# group: Python to place Generic coupling by points
code_block_38 = CodeBlock(MEPCurve=filterByBoolMask_9.in) { MEPCurve: var[]..[]; }
code_block_39 = CodeBlock(ListOfPoints=filterByBoolMask_12.in) { ListOfPoints: var[]..[]; }
python_script = Python(IN[0]=code_block_38, IN[1]=code_block_39, IN[2]=types)  # IronPython2
# ---------- python_script.python (274 lines) ----------
import clr
import math
clr.AddReference("RevitServices")
import RevitServices
from RevitServices.Persistence import DocumentManager
from RevitServices.Transactions import TransactionManager
doc = DocumentManager.Instance.CurrentDBDocument

clr.AddReference("RevitAPI")
from Autodesk.Revit.DB import *

clr.AddReference("RevitNodes")
import Revit
clr.ImportExtensions(Revit.Elements)
clr.ImportExtensions(Revit.GeometryConversion)

from System.Collections.Generic import List

if isinstance(IN[0], list):
	ducts = UnwrapElement(IN[0])
else:
	ducts = [UnwrapElement(IN[0])]
	
if isinstance(IN[1], list):
	points = IN[1]
else:
	points = [IN[1]]

if isinstance(IN[2], list):
	famtype = UnwrapElement(IN[2])
else:
	famtype = [UnwrapElement(IN[2])]
ftl = len(famtype)

def IsParallel(dir1,dir2):
	if dir1.Normalize().IsAlmostEqualTo(dir2.Normalize()):
		return True
	if dir1.Normalize().Negate().IsAlmostEqualTo(dir2.Normalize()):
		return True
	return False
	
def measure(startpoint, point):
	return startpoint.DistanceTo(point)
	
def copyElement(element, oldloc, loc):
	TransactionManager.Instance.EnsureInTransaction(doc)
	elementlist = List[ElementId]()
	elementlist.Add(element.Id)
	OffsetZ = (oldloc.Z - loc.Z)*-1
	OffsetX = (oldloc.X - loc.X)*-1
	OffsetY = (oldloc.Y - loc.Y)*-1
	direction = XYZ(OffsetX,OffsetY,OffsetZ)
	newelementId = ElementTransformUtils.CopyElements(doc,elementlist,direction)
	newelement = doc.GetElement(newelementId[0])
	TransactionManager.Instance.TransactionTaskDone()
	return newelement

def GetDirection(faminstance):
	for c in faminstance.MEPModel.ConnectorManager.Connectors:
		conn = c
		break
	return conn.CoordinateSystem.BasisZ

def GetClosestDirection(faminstance, lineDirection):
	conndir = None
	flat_linedir = XYZ(lineDirection.X,lineDirection.Y,0).Normalize()
	for conn in faminstance.MEPModel.ConnectorManager.Connectors:
		conndir = conn.CoordinateSystem.BasisZ
		if flat_linedir.IsAlmostEqualTo(conndir):
			return conndir
	return conndir
	


#global variables for rotating new families
tempfamtype = None
xAxis = XYZ(1,0,0)
def placeFitting(duct,point,familytype,lineDirection):
	
	toggle = False
	isVertical = False
	
	
	global tempfamtype
	if tempfamtype == None:
		tempfamtype = familytype
		toggle = True
	elif tempfamtype != familytype:
		toggle = True
		tempfamtype = familytype
	level = duct.ReferenceLevel
	
	width = 4
	height = 4
	radius = 2
	round = False
	connectors = duct.ConnectorManager.Connectors
	for c in connectors:
		if c.ConnectorType != ConnectorType.End:
			continue
		shape = c.Shape
		if shape == ConnectorProfileType.Round:
			radius = c.Radius
			round = True	
			break
		elif shape == ConnectorProfileType.Rectangular or shape == ConnectorProfileType.Oval:
			if abs(lineDirection.Z) == 1:
				isVertical = True
				yDir = c.CoordinateSystem.BasisY
			width = c.Width
			height = c.Height
			break
		
	TransactionManager.Instance.EnsureInTransaction(doc)		
	point = XYZ(point.X,point.Y,point.Z-level.Elevation)
	newfam = doc.Create.NewFamilyInstance(point,familytype,level,Structure.StructuralType.NonStructural)
	doc.Regenerate()
	transform = newfam.GetTransform()
	axis = Line.CreateUnbound(transform.Origin, transform.BasisZ)
	global xAxis
	if toggle:
		xAxis = GetDirection(newfam)
	zAxis = XYZ(0,0,1)
	
	if isVertical:
		angle = xAxis.AngleOnPlaneTo(yDir,zAxis)
	else:
		angle = xAxis.AngleOnPlaneTo(lineDirection,zAxis)
	
	
	ElementTransformUtils.RotateElement(doc,newfam.Id,axis,angle)
	doc.Regenerate()
	
	if lineDirection.Z != 0:
		newAxis = GetClosestDirection(newfam,lineDirection)
		yAxis = newAxis.CrossProduct(zAxis)
		angle2 = newAxis.AngleOnPlaneTo(lineDirection,yAxis)
		axis2 = Line.CreateUnbound(transform.Origin, yAxis)
		ElementTransformUtils.RotateElement(doc,newfam.Id,axis2,angle2)
	
	result = {}
	connpoints = []
	famconns = newfam.MEPModel.ConnectorManager.Connectors
	
	if round:
		for conn in famconns:
			if IsParallel(lineDirection,conn.CoordinateSystem.BasisZ) == False:
				continue
			if conn.Shape != shape:
				continue
			conn.Radius = radius
			connpoints.append(conn.Origin)
	else:
		for conn in famconns:
			if IsParallel(lineDirection,conn.CoordinateSystem.BasisZ) == False:
				continue
			if conn.Shape != shape:
				continue
			conn.Width = width
			conn.Height = height
			connpoints.append(conn.Origin)
	TransactionManager.Instance.TransactionTaskDone()
	result[newfam] = connpoints
	return result
	
	
def ConnectElements(duct, fitting):
	ductconns = duct.ConnectorManager.Connectors
	fittingconns = fitting.MEPModel.ConnectorManager.Connectors
	
	TransactionManager.Instance.EnsureInTransaction(doc)
	for conn in fittingconns:
		for ductconn in ductconns:
			result = ductconn.Origin.IsAlmostEqualTo(conn.Origin)
			if result:
				ductconn.ConnectTo(conn)
				break
	TransactionManager.Instance.TransactionTaskDone()
	return result

def SortedPoints(fittingspoints,ductStartPoint):
	sortedpoints = sorted(fittingspoints, key=lambda x: measure(ductStartPoint, x))
	return sortedpoints
	

ductsout = []
fittingsout = []
combilist = []

TransactionManager.Instance.EnsureInTransaction(doc)
for typ in famtype:
	if typ.IsActive == False:
		typ.Activate()
		doc.Regenerate()
TransactionManager.Instance.TransactionTaskDone()

for i,duct in enumerate(ducts):
	ListOfPoints = [x.ToXyz() for x in points[i]]
	familytype = famtype[i%ftl]
	#create duct location line
	ductline = duct.Location.Curve
	ductStartPoint = ductline.GetEndPoint(0)
	ductEndPoint = ductline.GetEndPoint(1)
	#get end connector to reconnect later
	endIsConnected = False
	endrefconn = None
	for ductconn in duct.ConnectorManager.Connectors:
		if ductconn.Origin.DistanceTo(ductEndPoint) < 5/304.8:
			if ductconn.IsConnected:
				endIsConnected = True
				for refconn in ductconn.AllRefs:
					if refconn.ConnectorType != ConnectorType.Logical and refconn.Owner.Id.IntegerValue != duct.Id.IntegerValue:
						endrefconn = refconn
			
	#sort the points from start of duct to end of duct
	pointlist = SortedPoints(ListOfPoints,ductStartPoint)
	
	ductlist = []
	newFittings = []
	ductlist.append(duct)
	
	tempStartPoint = None
	tempEndPoint = None
	
	lineDirection = ductline.Direction
	
	for i,p in enumerate(pointlist):		
		output = placeFitting(duct,p,familytype,lineDirection)
		newfitting = output.keys()[0]
		newFittings.append(newfitting)
		fittingpoints = output.values()[0]
		
		tempPoints = SortedPoints(fittingpoints,ductStartPoint)
		if i == 0:
			tempEndPoint = tempPoints[0]
			tempStartPoint = tempPoints[1]			
			newduct = copyElement(duct,ductStartPoint,tempStartPoint)	
			duct.Location.Curve = Line.CreateBound(ductStartPoint,tempEndPoint)
			ductlist.append(newduct)
			combilist.append([duct,newfitting])
			combilist.append([newduct,newfitting])
		else:
			combilist.append([newduct,newfitting])
			tempEndPoint = tempPoints[0]
			newduct = copyElement(duct,ductStartPoint,tempStartPoint)
			ductlist[-1].Location.Curve = Line.CreateBound(tempStartPoint,tempEndPoint)
			tempStartPoint = tempPoints[1]
			ductlist.append(newduct)
			combilist.append([newduct,newfitting])
	

	
	newline = Line.CreateBound(tempStartPoint,ductEndPoint)
	ductlist[-1].Location.Curve = newline
	
	ductsout.append(ductlist)
	fittingsout.append(newFittings)
	TransactionManager.Instance.EnsureInTransaction(doc)
	doc.Regenerate()
	TransactionManager.Instance.TransactionTaskDone()

	if endIsConnected:
		for conn in ductlist[-1].ConnectorManager.Connectors:
			if conn.Origin.DistanceTo(ductEndPoint) < 5/304.8:
				endrefconn.ConnectTo(conn)
			


TransactionManager.Instance.EnsureInTransaction(doc)
for combi in combilist:
	ConnectElements(combi[0],combi[1])
TransactionManager.Instance.TransactionTaskDone()

OUT = ductsout, fittingsout
# ----------------------------------------
code_block_40 = CodeBlock(x=python_script) { x[1]; }
code_block_41 = CodeBlock(Fittings=code_block_40) { Fittings; }
code_block_42 = CodeBlock(x=python_script) { x[0]; }
code_block_43 = CodeBlock(MEPCurves=code_block_42) { MEPCurves; }

flatten_6 = List.Flatten(list=code_block_41)

# group: Delete Generic Couplings
delete = Element.Delete(element=flatten_6)

# group: Vertical pipes that will be split
watch_2 = Watch(filterByBoolMask_9.in)

# group: Vertical pipes that cannot be split
watch_3 = Watch(filterByBoolMask_9.out)

count_2 = List.Count(list=filterByBoolMask_9.out)

# group: Conditional
code_block_44 = CodeBlock(lstcount=count_2)
# ---------- code_block_44.designscript (3 lines) ----------
lstcount == 0? "All good here!":
lstcount == 1? "Only one pipe that can't have access doors and that's because they are not manufactured in this size.":
"Don't worry, you can't place access doors on " + lstcount + " pipes because they are not manufactured in these sizes.";
# ----------------------------------------

# group: Monitor
revit_content_check = Watch(code_block_44)  # graph output

# group: Monitor
unable_to_place_access_doors_on = Watch(filterByBoolMask_9.out)  # "Unable to Place Access Doors on Pipe(s)"; graph output

# group: All vertical pipes
watch_4 = Watch(filterByBoolMask_4.in)

# group: Filter and get vertical pipes that could potentially be split
watch_5 = Watch(filterByBoolMask_6.in)

# group: Get pipes in sequence
code_block_45 = CodeBlock { 0..1; }
code_block_46 = CodeBlock { 1; }
sublists = List.Sublists(list=code_block_43@L2, ranges=code_block_45, offset=code_block_46)
code_block_47 = CodeBlock { 1; }
flatten_7 = List.Flatten(list=sublists, amount=code_block_47)
count_3 = List.Count(list=sublists@L2, lacing=Longest)
code_block_48 = CodeBlock(x=count_3) { x>1; }
filterByBoolMask_13 = List.FilterByBoolMask(list=flatten_7, mask=code_block_48)

firstItem = List.FirstItem(list=filterByBoolMask_13.in, lacing=Longest)
lastItem = List.LastItem(list=filterByBoolMask_13.in, lacing=Longest)

# group: Python to place union fitting
code_block_49 = CodeBlock(MEPCurve1=firstItem) { MEPCurve1; }
code_block_50 = CodeBlock(MEPCurve2=lastItem) { MEPCurve2; }
python_script_2 = Python(IN[0]=code_block_49, IN[1]=code_block_50)  # IronPython2
# ---------- python_script_2.python (72 lines) ----------
import clr

clr.AddReference("RevitServices")
import RevitServices
from RevitServices.Persistence import DocumentManager
from RevitServices.Transactions import TransactionManager
doc = DocumentManager.Instance.CurrentDBDocument

clr.AddReference("RevitAPI")
from Autodesk.Revit.DB import *

clr.AddReference("RevitNodes")
import Revit
clr.ImportExtensions(Revit.Elements)
clr.ImportExtensions(Revit.GeometryConversion)

if isinstance(IN[0], list):
	pipe1 = UnwrapElement(IN[0])
else:
	pipe1 = [UnwrapElement(IN[0])]
if isinstance(IN[1], list):
	pipe2 = UnwrapElement(IN[1])
else:
	pipe2 = [UnwrapElement(IN[1])]

def closest_connectors(pipe1, pipe2):
	conn1 = pipe1.ConnectorManager.Connectors
	conn2 = pipe2.ConnectorManager.Connectors
	
	dist = 100000000
	connset = None
	for c in conn1:
		for d in conn2:
			conndist = c.Origin.DistanceTo(d.Origin)
			if conndist < dist:
				dist = conndist
				connset = [c,d]
	return connset

	
def check_dir(conn1,conn2):
	if conn1.CoordinateSystem.BasisZ.ToString() == conn2.CoordinateSystem.BasisZ.ToString() or conn1.CoordinateSystem.BasisZ.ToString() == (conn2.CoordinateSystem.BasisZ*-1).ToString():
		return True
	else:
		return False
	
fittings = []

for p1,p2 in zip(pipe1,pipe2):
	connectors = closest_connectors(p1,p2)
	
	if check_dir(connectors[0],connectors[1]):
		TransactionManager.Instance.EnsureInTransaction(doc)
		
		fitting = doc.Create.NewUnionFitting(connectors[0],connectors[1])
		try:
			fittings.append(fitting.ToDSType(False))
		except:
			fittings.append("fitting not created by Dynamo")
		
		TransactionManager.Instance.TransactionTaskDone()
	else:
		TransactionManager.Instance.EnsureInTransaction(doc)
	
		fitting = doc.Create.NewElbowFitting(connectors[0],connectors[1])
		fittings.append(fitting.ToDSType(False))
		
		TransactionManager.Instance.TransactionTaskDone()

			

OUT = fittings
# ----------------------------------------

# group: Count how many access doors are placed and convert to string
count_4 = List.Count(list=python_script_2)
string_from_object_2 = FromObject(obj=count_4)

# group: Conditional
code_block_51 = CodeBlock(lst1=count_4, lst2=count_2, NoOfAccessDoors=string_from_object_2)
# ---------- code_block_51.designscript (6 lines) ----------
lst1 == null? "Ooops, something went wrong!":
lst1 == 0 && lst2 > 0? "Looks like you can't have access doors in these sizes.":
lst1 == 0? "Hmmm, looks like you don't need access doors on this system.":
lst1 == 1? "Nice try, but you only placed one access door.":
lst1 < 10? "Nice work! You only placed " + NoOfAccessDoors + " access doors, but still saved a bit of manual work.":
"Wow, that's great! You placed " + NoOfAccessDoors + " access doors and saved lots of manual work. :)";
# ----------------------------------------

# group: Bounding box from access doors and then bounding box to cuboid
boundingBox = Element.BoundingBox(element=python_script_2)
toCuboid = BoundingBox.ToCuboid(boundingBox=boundingBox)

# group: Identify Levels where access doors are placed
doesIntersect_2 = Geometry.DoesIntersect(geometry=offset, other=toCuboid, lacing=CrossProduct)
transpose_3 = List.Transpose(lists=doesIntersect_2)
code_block_52 = CodeBlock { true; }
allIndicesOf = List.AllIndicesOf(list=transpose_3, item=code_block_52, lacing=Longest)
flatten_8 = List.Flatten(list=allIndicesOf)
getItemAtIndex_4 = List.GetItemAtIndex(list=code_block_27, index=flatten_8)

# group: Set 'Level' and 'Elevation from Level' parameters for access doors
code_block_53 = CodeBlock { "Level"; }
setParameterByName = Element.SetParameterByName(element=python_script_2, parameterName=code_block_53, value=getItemAtIndex_4)
code_block_54 = CodeBlock { "Elevation from Level"; }
setParameterByName_2 = Element.SetParameterByName(element=setParameterByName, parameterName=code_block_54, value=code_block_28)

# group: Conditional
code_block_55 = CodeBlock(passThrough=code_block_51) { passThrough: var[]..[]; }
code_block_56 = CodeBlock(waitFor=setParameterByName_2) { waitFor: var[]..[]; }
code_block_57 = CodeBlock(passthrough=code_block_55, waitfor=code_block_56) { [passthrough,waitfor][0]; }

# group: Python to generate pop-up message
code_block_58 = CodeBlock { "HL | Digital Engineering"; }
python_script_3 = Python(IN[0]=code_block_58, IN[1]=code_block_57)  # IronPython2
# ---------- python_script_3.python (9 lines) ----------
import clr
clr.AddReference('RevitAPIUI')
from Autodesk.Revit.UI import TaskDialog

windowTitle = IN[0]
windowMessage = IN[1]

messageDialog = TaskDialog
OUT = messageDialog.Show(windowTitle, windowMessage)
# ----------------------------------------

# group: Monitor
overall_result = Watch(code_block_51)  # graph output
