# Dynamo graph Combined Public Health Systems_Create CTD Drawing v.3.0.dyn (Dynamo 2.13.1.3887)
# author: Bogdan Pop
# Creates connection to drain by numbering and tagging pipes and plumbing fixtures
# packages: Data-Shapes 2021.2.92

# group: DYNAMO COLOUR CODING LEGEND
# note: COLOUR CODING LEGEND

# group: Monitor
# note: USE:
# FOR IMPORTANT WATCH NODES

# group: Conditional
# note: USE:
# FOR CONDITIONAL NODES

# group: Python
# note: USE:
# FOR PYTHON NODES

# group: To Revit
# note: USE:
# FOR CHANGES TO REVIT

# group: Control
# note: USE:
# FOR USER CONTROL (SLIDERS ETC.)

# group: Input
# note: USE:
# FOR FIXED INPUT (FILE PATHS ETC.)

# group: Background
# note: USE:
# FOR GENERAL WORKFLOW NODES

empty = List.Empty()

# group: Get All Views
code_block = CodeBlock { "Views"; }
byName = Category.ByName(name=code_block)
all_elements_of_category = ElementsOfCategory(Category=byName)

# group: Remove nulls
isNull = Object.IsNull(object=all_elements_of_category)
not_ = Not(x=isNull)
filterByBoolMask = List.FilterByBoolMask(list=all_elements_of_category, mask=not_)

# group: Get only Floor Plan Views
string_from_object = FromObject(obj=filterByBoolMask.in)
code_block_2 = CodeBlock { "FloorPlanView"; }
contains = String.Contains(string=string_from_object, searchFor=code_block_2)
filterByBoolMask_2 = List.FilterByBoolMask(list=filterByBoolMask.in, mask=contains)

name = Element.Name(element=filterByBoolMask_2.in)

# group: User Interface
code_block_3 = CodeBlock { "Create CTD Drawing"; null; "Proceed"; "Cancel"; 800; 700; 300; }
code_block_4 = CodeBlock { "Requirements"; "Dynamo 2.0.3 or higher"; }
textnote_data = Custom[TextNote Data](Title=code_block_4.out0, TextNote=code_block_4.out1)  # package Data-Shapes; Create Data for TextNote input in UI.MultipleInputForm ++ . Check out www.data-shapes.net for more informations
code_block_5 = CodeBlock { "System Type"; ["Discharge","Rainwater","Combined PH Systems"]; 0; }
radiobuttons_data = Custom[RadioButtons Data](InputName=code_block_5.out0, Keys=code_block_5.out1, Values=code_block_5.out1, DefaultValueIndex=code_block_5.out2)  # package Data-Shapes; Create radio buttons input for UI.MultipleInputForm ++ .
code_block_6 = CodeBlock { "Use Automated Numbering?"; }
code_block_7 = CodeBlock { "Select 'Yes' if you want to automatically number connections to drain, otherwise select 'No'"; }
textnote_data_2 = Custom[TextNote Data](TextNote=code_block_7)
code_block_8 = CodeBlock { ["Yes","No"]; 0; }
radiobuttons_data_2 = Custom[RadioButtons Data](Keys=code_block_8.out0, Values=code_block_8.out0, DefaultValueIndex=code_block_8.out1)
list_create = List.Create(item0=textnote_data_2, item1=radiobuttons_data_2)
inputgroup_data = Custom[InputGroup Data](GroupTitle=code_block_6, Inputs=list_create)  # package Data-Shapes; Creates a group of inputs for UI.MultipleInputForm ++ . Check out www.data-shapes.net for more infos !
code_block_9 = CodeBlock { "Create New CTD Floor Plans?"; }
code_block_10 = CodeBlock { "Select 'Yes' if you want to duplicate the selected floor plans and place annotations in those views. Select 'No' if you want your annotations to be placed in the selected floor plans"; }
textnote_data_3 = Custom[TextNote Data](TextNote=code_block_10)
code_block_11 = CodeBlock { ["Yes","No"]; 0; }
radiobuttons_data_3 = Custom[RadioButtons Data](Keys=code_block_11.out0, Values=code_block_11.out0, DefaultValueIndex=code_block_11.out1)
list_create_2 = List.Create(item0=textnote_data_3, item1=radiobuttons_data_3)
inputgroup_data_2 = Custom[InputGroup Data](GroupTitle=code_block_9, Inputs=list_create_2)
code_block_12 = CodeBlock { "Select Floor Plans"; 200; false; }
listview_data = Custom[Listview Data](Keys=name, Values=filterByBoolMask_2.in, Height_optionnal=code_block_12.out1, ShowId_optionnal=code_block_12.out2)  # package Data-Shapes; Create data for ListView input in UI.MultiInputForm ++ . Check out www.data-shapes.net for more infos.
list_create_3 = List.Create(item0=textnote_data, item1=radiobuttons_data, item2=inputgroup_data, item3=inputgroup_data_2, item4=listview_data)
boolean = BoolSelector(true)
multipleinputform = Custom[MultipleInputForm ++](Description_optional=code_block_3.out0, Logo_optional=code_block_3.out1, ButtonText_optional=code_block_3.out2, Inputs=list_create_3, Toggle=boolean, CancelButtonText_optional=code_block_3.out3, MaxHeight_optional=code_block_3.out4, Width_optional=code_block_3.out5, LabelWidth_optional=code_block_3.out6)  # package Data-Shapes; Create a form with multiple inputs. see www.data-shapes.net for tutorials and infos!

# group: User Selection: Floor Plans
code_block_13 = CodeBlock(SelectedFloorPlans=multipleinputform.User_Inputs) { SelectedFloorPlans[3]; }

code_block_14 = CodeBlock(views=code_block_13) { views: var[]..[]; }

# group: Get all levels
code_block_15 = CodeBlock { "Levels"; }
byName_2 = Category.ByName(name=code_block_15)
all_elements_of_category_2 = ElementsOfCategory(Category=byName_2)

# group: Sort Levels by elevation
projectElevation = Level.ProjectElevation()  # unwired: level
sortByFunction = List.SortByFunction(list=all_elements_of_category_2, sortFunction=projectElevation)

# group: Get Level elevation
projectElevation_2 = Level.ProjectElevation(level=sortByFunction)

# group: Get Level name
name_2 = Level.Name(level=sortByFunction)

# group: Sort Views selected by user from top to bottom
code_block_16 = CodeBlock { "Associated Level"; }
getParameterValueByName = Element.GetParameterValueByName(element=code_block_13, parameterName=code_block_16)
indexOf = List.IndexOf(list=name_2, element=getParameterValueByName)
getItemAtIndex = List.GetItemAtIndex(list=projectElevation_2, index=indexOf)
sort = List.Sort(list=getItemAtIndex)
reverse = List.Reverse(list=sort)
indexOf_2 = List.IndexOf(list=getItemAtIndex, element=reverse)
getItemAtIndex_2 = List.GetItemAtIndex(list=code_block_14, index=indexOf_2)
getItemAtIndex_3 = List.GetItemAtIndex(list=getItemAtIndex, index=indexOf_2)

list_create_4 = List.Create(item0=empty, item1=getItemAtIndex_2)

# group: User Selection: Was Run & Was Cancelled
code_block_17 = CodeBlock(WasRun=multipleinputform.Was_Run, WasCancelled=multipleinputform.Was_Cancelled) { WasRun == true && WasCancelled == false? 1 : 0; }

getItemAtIndex_4 = List.GetItemAtIndex(list=list_create_4, index=code_block_17)

# group: Create view name
name_3 = Element.Name(element=getItemAtIndex_2)
code_block_18 = CodeBlock(x=name_3) { x + " - CTD"; }

# group: Python to duplicate and rename view
code_block_19 = CodeBlock(view=getItemAtIndex_4) { view: var[]..[]; }
code_block_20 = CodeBlock(name=code_block_18) { name: string[]..[]; }
python_script = Python(IN[0]=code_block_19, IN[1]=code_block_20)  # IronPython2
# ---------- python_script.python (32 lines) ----------
import clr
clr.AddReference('RevitAPI')
from Autodesk.Revit.DB import *
import Autodesk

clr.AddReference("RevitServices")
import RevitServices
from RevitServices.Persistence import DocumentManager
from RevitServices.Transactions import TransactionManager

def DuplicateView(view, name, doc):
	try:
		newViewId = view.Duplicate(Autodesk.Revit.DB.ViewDuplicateOption.Duplicate)
		newView = doc.GetElement(newViewId)
		try: newView.Name = name
		except: pass
		return newView
	except: return None

doc = DocumentManager.Instance.CurrentDBDocument
views = UnwrapElement(IN[0])

TransactionManager.Instance.EnsureInTransaction(doc)
if isinstance(IN[0], list):
	OUT = []
	for view, name in zip(views, IN[1]):
		if isinstance(name, list): OUT.append([DuplicateView(view, x, doc) for x in name])
		else: OUT.append(DuplicateView(view, name, doc))
else: 
	if isinstance(IN[1], list): OUT = [DuplicateView(views, x, doc) for x in IN[1]]
	else: OUT = DuplicateView(views, IN[1], doc)
TransactionManager.Instance.TransactionTaskDone()
# ----------------------------------------
code_block_21 = CodeBlock(view=python_script) { view; }

list_create_5 = List.Create(item0=code_block_21, item1=getItemAtIndex_2)

# group: User Selection: New Floor Plans
code_block_22 = CodeBlock(NewFloorPlans=multipleinputform.User_Inputs) { NewFloorPlans[2]; }

# group: User Selection: New Floor Plans
code_block_23 = CodeBlock(NewFloorPlans=code_block_22) { NewFloorPlans=="No"? 1: 0; }

getItemAtIndex_5 = List.GetItemAtIndex(list=list_create_5, index=code_block_23)

# group: Python to change view range
code_block_24 = CodeBlock { 0; 50; }
count = List.Count(list=code_block_21)
bottom_offset_view_depth_offset = List.Cycle(list=code_block_24.out1, amount=count)
convert_between_units = DynamoConvert(bottom_offset_view_depth_offset, MeasurementType="Length", FromConversion="Millimeters", ToConversion="Feet")
bottom_offset_view_depth_offset_2 = List.Cycle(list=code_block_24.out0, amount=count)
convert_between_units_2 = DynamoConvert(bottom_offset_view_depth_offset_2, MeasurementType="Length", FromConversion="Millimeters", ToConversion="Feet")
cutoff_offset = CodeBlock(x=bottom_offset_view_depth_offset) { x-10; }
convert_between_units_3 = DynamoConvert(cutoff_offset, MeasurementType="Length", FromConversion="Millimeters", ToConversion="Feet")
convert_between_units_4 = DynamoConvert(bottom_offset_view_depth_offset_2, MeasurementType="Length", FromConversion="Millimeters", ToConversion="Feet")
python_modify_view_range = Python(IN[0]=getItemAtIndex_5, IN[1]=convert_between_units, IN[2]=convert_between_units_2, IN[3]=convert_between_units_3, IN[4]=convert_between_units_4)  # IronPython2
# ---------- python_modify_view_range.python (42 lines) ----------
import clr
clr.AddReference('RevitAPI')
from Autodesk.Revit.DB import*
clr.AddReference('RevitServices')
from RevitServices.Persistence import DocumentManager
from RevitServices.Transactions import TransactionManager

def modViewrange(vp,tof,bof,cof,dof):
	v = UnwrapElement(vp)
	viewrange = v.GetViewRange()
	asslvl = v.GenLevel
	viewrange.SetLevelId(PlanViewPlane.TopClipPlane,asslvl.Id)
	viewrange.SetOffset(PlanViewPlane.TopClipPlane,tof)
	viewrange.SetLevelId(PlanViewPlane.BottomClipPlane,asslvl.Id)
	viewrange.SetOffset(PlanViewPlane.BottomClipPlane,bof)
	viewrange.SetOffset(PlanViewPlane.CutPlane,cof)
	viewrange.SetLevelId(PlanViewPlane.ViewDepthPlane,asslvl.Id)
	if bof < dof:
		viewrange.SetOffset(PlanViewPlane.ViewDepthPlane,bof)
	else:
		viewrange.SetOffset(PlanViewPlane.ViewDepthPlane,dof)
	#Applying the viewrange to the view
	v.SetViewRange(viewrange)

doc = DocumentManager.Instance.CurrentDBDocument
count = 0

TransactionManager.Instance.EnsureInTransaction(doc)
if isinstance(IN[0],list) and isinstance(IN[1],list):
	for vp,tof,bof,cof,dof in zip(IN[0],IN[1],IN[2],IN[3],IN[4]):
		modViewrange(vp,tof,bof,cof,dof)
		count += 1
elif isinstance(IN[0],list) and isinstance(IN[1],list) == False:
	for vp in IN[0]:
		modViewrange(vp,IN[1],IN[2],IN[3],IN[4])
		count += 1
else:
	modViewrange(IN[0],IN[1],IN[2],IN[3],IN[4])
	count += 1
TransactionManager.Instance.TransactionTaskDone()

OUT = '%d view ranges altered' %(count)
# ----------------------------------------

list_create_6 = List.Create(item0=code_block_21, item1=getItemAtIndex_2)
getItemAtIndex_6 = List.GetItemAtIndex(list=list_create_6, index=code_block_23)
code_block_25 = CodeBlock { 1; }
chop = List.Chop(list=getItemAtIndex_6, lengths=code_block_25)

# group: Get Pipes category
code_block_26 = CodeBlock { "Pipes"; }
byName_3 = Category.ByName(name=code_block_26)

# group: Python to get elements of categoy in view
code_block_27 = CodeBlock(CategoryOrType=byName_3) { CategoryOrType; }
selectByCategoryAndView = Python(IN[0]=getItemAtIndex_2, IN[1]=code_block_27)  # IronPython2
# ---------- selectByCategoryAndView.python (47 lines) ----------
#Alban de Chasteigner 2018
#twitter : @geniusloci_bim
#geniusloci.bim@gmail.com

import clr
clr.AddReference('RevitAPI')
import Autodesk
from Autodesk.Revit.DB import *
clr.AddReference('RevitServices')
import RevitServices
from RevitServices.Persistence import DocumentManager
import System

def tolist(x):
    if hasattr(x,'__iter__'): return x
    else : return [x]

views = tolist(UnwrapElement(IN[0]))
cats = tolist(UnwrapElement(IN[1]))

provider = ParameterValueProvider(ElementId(BuiltInParameter.ELEM_FAMILY_PARAM))
provider2 = ParameterValueProvider(ElementId(BuiltInParameter.ELEM_TYPE_PARAM))
evaluator = FilterNumericEquals()

linkedEl,elements = [],[]
for view in views:
	doc=view.Document
	for cat in cats:
		if isinstance(cat, Category):
			collector = FilteredElementCollector(doc,view.Id).OfCategoryId(cat.Id).ToElements()
		elif isinstance(cat, System.Type): 
			collector = FilteredElementCollector(doc,view.Id).OfClass(cat).ToElements()
		elif isinstance(cat, FamilySymbol):
			filter = ElementParameterFilter(FilterElementIdRule(provider, evaluator, cat.Id))	
			collector = FilteredElementCollector(doc, view.Id).OfCategoryId(cat.Category.Id).WherePasses(filter).ToElements()
		elif isinstance(cat, TextNoteType):
			collector = FilteredElementCollector(doc, view.Id).OfClass(TextNote).WhereElementIsNotElementType().ToElements().FindAll(lambda x : x.GetTypeId() == cat.Id)
		elif isinstance(cat, ModelTextType):
			collector = FilteredElementCollector(doc, view.Id).OfClass(ModelText).WhereElementIsNotElementType().ToElements().FindAll(lambda x : x.GetTypeId() == cat.Id)
		elif isinstance(cat, HostObjAttributes):
			filter = ElementParameterFilter(FilterElementIdRule(provider2, evaluator, cat.Id))	
			collector = FilteredElementCollector(doc, view.Id).OfCategoryId(cat.Category.Id).WherePasses(filter).ToElements()
		linkedEl.append(collector)
	elements.append(linkedEl)

if not isinstance(IN[0], list) and not isinstance(IN[1], list): OUT = elements[0][0]
else: OUT = elements[0]
# ----------------------------------------

# group: Filter for pipes
code_block_28 = CodeBlock { "System Type"; }
getParameterValueByName_2 = Element.GetParameterValueByName(element=selectByCategoryAndView, parameterName=code_block_28)
name_4 = Element.Name(element=getParameterValueByName_2)
code_block_29 = CodeBlock { "Ss_50_30_02 - Rainwater"; }
contains_2 = String.Contains(string=name_4, searchFor=code_block_29)

# group: Filter for pipes
code_block_30 = CodeBlock { "Ss_50_30_04_97"; }
contains_3 = String.Contains(string=name_4, searchFor=code_block_30)
code_block_31 = CodeBlock { "System Classification"; "Sanitary"; }
getParameterValueByName_3 = Element.GetParameterValueByName(element=selectByCategoryAndView, parameterName=code_block_31.out0)
contains_4 = String.Contains(string=getParameterValueByName_3, searchFor=code_block_31.out1)

# group: Conditional
and_ = contains_3 && contains_4

filterByBoolMask_3 = List.FilterByBoolMask(list=selectByCategoryAndView, mask=and_)

# group: Get Discharge pipes
code_block_32 = CodeBlock(DischargePipes=filterByBoolMask_3.in) { DischargePipes; }

filterByBoolMask_4 = List.FilterByBoolMask(list=selectByCategoryAndView, mask=contains_2)

# group: Get Rainwater pipes
code_block_33 = CodeBlock(RainwaterPipes=filterByBoolMask_4.in) { RainwaterPipes; }

join = List.Join()  # unwired: list0, list1
combine = List.Combine(comb=join, list1=code_block_32, list2=code_block_33)
list_create_7 = List.Create(item0=code_block_32, item1=code_block_33, item2=combine)

# group: User Selection: Selected System Type
code_block_34 = CodeBlock(SelectedSystemType=multipleinputform.User_Inputs) { SelectedSystemType[0]; }

# group: Conditional
code_block_35 = CodeBlock(SelectedSystemType=code_block_34)
# ---------- code_block_35.designscript (3 lines) ----------
SelectedSystemType=="Discharge"? 0 :
SelectedSystemType=="Rainwater"? 1:
2;
# ----------------------------------------

# group: Get Discharge, Rainwater or Combined PH pipes based on user selection
getItemAtIndex_7 = List.GetItemAtIndex(list=list_create_7, index=code_block_35)

# group: Get vertical pipes (Check angle to the Z axis is near 90)
getLocation = Element.GetLocation(element=getItemAtIndex_7)
direction = Line.Direction(line=getLocation)
ZAxis = Vector.ZAxis()
angleWithVector = Vector.AngleWithVector(vector=direction, otherVector=ZAxis)
abs = Math.Abs(number=angleWithVector)
round = Math.Round(number=abs)
code_block_36 = CodeBlock(x=round) { x==0; x==180; }
xor = Math.Xor(bool=code_block_36.out0, otherBool=code_block_36.out1)
filterByBoolMask_5 = List.FilterByBoolMask(list=getItemAtIndex_7, mask=xor)

# group: Control
number_slider = DoubleSlider(100, range=0..500 step 50)

# group: Get pipes that have invert elevation +-300mm (as default) above or below the levels
code_block_37 = CodeBlock { "Invert Elevation"; }
getParameterValueByName_4 = Element.GetParameterValueByName(element=filterByBoolMask_5.in, parameterName=code_block_37)
round_2 = Math.Round(number=getParameterValueByName_4)
code_block_38 = CodeBlock(x=getItemAtIndex_3, y=number_slider) { x+y; }
le = round_2 <= code_block_38  # lacing=Longest
code_block_39 = CodeBlock(x=getItemAtIndex_3, y=number_slider) { x-y; }
ge = round_2 >= code_block_39  # lacing=Longest
and_2 = le && ge
filterByBoolMask_6 = List.FilterByBoolMask(list=filterByBoolMask_5.in, mask=and_2)

empty_2 = List.Empty()

# group: Filter empty lists
isEmpty = List.IsEmpty(list=filterByBoolMask_6.in, lacing=Longest)
not_2 = Not(x=isEmpty)
filterByBoolMask_7 = List.FilterByBoolMask(list=filterByBoolMask_6.in, mask=not_2)

count_2 = List.Count(list=filterByBoolMask_7.in)
ofRepeatedItem = List.OfRepeatedItem(item=empty_2, amount=count_2)
empty_3 = List.Empty()

# group: Get Plumbing Fixtures category
code_block_40 = CodeBlock { "Plumbing Fixtures"; }
byName_4 = Category.ByName(name=code_block_40)

# group: Python to get elements of categoy in view
code_block_41 = CodeBlock(CategoryOrType=byName_4) { CategoryOrType; }
selectByCategoryAndView_2 = Python(IN[0]=getItemAtIndex_2, IN[1]=code_block_41)  # IronPython2; same code as selectByCategoryAndView

list_create_8 = List.Create(item0=empty_3, item1=selectByCategoryAndView_2)
isEmpty_2 = List.IsEmpty(list=selectByCategoryAndView_2, lacing=Longest)
allTrue = List.AllTrue(list=isEmpty_2)

# group: Conditional
code_block_42 = CodeBlock(result=allTrue) { result==true? 0: 1; }

# group: Filter Plumbing Fixtures
getItemAtIndex_8 = List.GetItemAtIndex(list=list_create_8, index=code_block_42)
code_block_43 = CodeBlock { "Type"; }
getParameterValueByName_5 = Element.GetParameterValueByName(element=getItemAtIndex_8, parameterName=code_block_43)
family = FamilyType.Family(familyType=getParameterValueByName_5)
name_5 = Element.Name(element=family)
code_block_44 = CodeBlock { ["Channel","FloorOutlet"]; }
contains_5 = String.Contains(string=name_5, searchFor=code_block_44, lacing=CrossProduct)
code_block_45 = CodeBlock { "System Type"; }
getParameterValueByName_6 = Element.GetParameterValueByName(element=getItemAtIndex_8, parameterName=code_block_45)
code_block_46 = CodeBlock { "Undefined"; }
ne = getParameterValueByName_6 != code_block_46

# group: Get Plumbing Fixtures (Foul Drainage Systems)
transpose = List.Transpose(lists=contains_5@L3)
identity = Object.Identity()  # unwired: object
trueForAny = List.TrueForAny(list=transpose@@L2, queryFunction=identity, lacing=Longest)

# group: Python to replace Nulls with Empty list
empty_4 = List.Empty()
python_script_2 = Python(IN[0]=trueForAny, IN[1]=empty_4)  # IronPython2
# ---------- python_script_2.python (16 lines) ----------
OUT = []

def tolist(obj):
	if isinstance(obj, list):
		return obj
	else:
		return [obj]
		
for i in tolist(IN[0]):
	if i == None:
		try:
			OUT.append(tolist(IN[1])[0])
		except:
			OUT.append(tolist(IN[1]))
	else:
		OUT.append(i)
# ----------------------------------------

# group: Conditional
and_3 = python_script_2 && ne

# group (continued): Get Plumbing Fixtures (Foul Drainage Systems)
filterByBoolMask_8 = List.FilterByBoolMask(list=getItemAtIndex_8, mask=and_3, lacing=Longest)

flatten = List.Flatten(list=filterByBoolMask_8.in)

# group: Python to get all elements connected
code_block_47 = CodeBlock(element=flatten) { element: var[]..[]; }
code_block_48 = CodeBlock { IncludeInputElement: bool = false; }
python_script_3 = Python(IN[0]=code_block_47, IN[1]=code_block_48)  # IronPython2
# ---------- python_script_3.python (141 lines) ----------
import clr

import sys
pyt_path = r'C:\Program Files (x86)\IronPython 2.7\Lib'
sys.path.append(pyt_path)
import System

clr.AddReference("RevitServices")
import RevitServices
from RevitServices.Persistence import DocumentManager
from RevitServices.Transactions import TransactionManager
doc = DocumentManager.Instance.CurrentDBDocument

clr.AddReference("RevitAPI")
import Autodesk
from Autodesk.Revit.DB import *

clr.AddReference("RevitNodes")
import Revit
clr.ImportExtensions(Revit.Elements)
clr.ImportExtensions(Revit.GeometryConversion)

import collections
#The inputs to this node will be stored as a list in the IN variables.
if isinstance(IN[0],list):
	connector = UnwrapElement(IN[0])
	toggle = 0
else:
	connector = [UnwrapElement(IN[0])]
	toggle = 1
	
bool = IN[1]
		
def nextElements(elem):
	listout = []
	if elem.GetType() == Connector:
		conn = elem
		for c in conn.AllRefs:
			if c.Owner.Id.Equals(elem.Owner.Id):
				continue
			elif isinstance(c.Owner,MEPSystem):
				continue
			else:
				newelem = c.Owner
			listout.append(newelem)
		return listout
	try:
		connectors = elem.ConnectorManager.Connectors
	except:
		connectors = elem.MEPModel.ConnectorManager.Connectors
	for conn in connectors:
		for c in conn.AllRefs:			
			if c.Owner.Id.Equals(elem.Id):
				continue
			elif isinstance(c.Owner,MEPSystem):
				continue
			elif c.Owner.Id.Equals(ownerId):
				continue
			else:
				newelem = c.Owner
			listout.append(newelem)
	return listout

def nextElementsWithOwner(elem):
	listout = []
	if elem.GetType() == Connector:
		conn = elem
		for c in conn.AllRefs:
			if c.Owner.Id.Equals(elem.Owner.Id):
				continue
			elif isinstance(c.Owner,MEPSystem):
				continue
			else:
				newelem = c.Owner
			listout.append(newelem)
		return listout
	try:
		connectors = elem.ConnectorManager.Connectors
	except:
		connectors = elem.MEPModel.ConnectorManager.Connectors
	for conn in connectors:
		for c in conn.AllRefs:			
			if c.Owner.Id.Equals(elem.Id):
				continue
			elif isinstance(c.Owner,MEPSystem):
				continue
			else:
				newelem = c.Owner
			listout.append(newelem)
	return listout
	
def collector(elem):
	cont = 0
	elements = nextElements(elem)
	for x in elements:
		if x.Id in lookup:
			cont += 1
		else:
			item = doc.GetElement(x.Id)

			lookup[x.Id] = item
			collector(x)
	if cont == len(elements):
		return elem
		
def collectorWithOwner(elem):
	cont = 0
	elements = nextElementsWithOwner(elem)
	for x in elements:
		if x.Id in lookup:
			cont += 1
		else:
			item = doc.GetElement(x.Id)

			lookup[x.Id] = item
			collectorWithOwner(x)
	if cont == len(elements):
		return elem
		

listout = []
if bool:
	for x in connector:
		lookup = collections.OrderedDict()
		collectorWithOwner(x)
		listout.append(lookup.Values)
else:
	for x in connector:
		lookup = collections.OrderedDict()
		if x.GetType() == Connector:
			ownerId = x.Owner.Id
		else:
			ownerId = x.Id
		collector(x)
		listout.append(lookup.Values)

#Assign your output to the OUT variable.
if toggle:
	OUT = lookup.Values
else:
	OUT = listout
# ----------------------------------------

count_3 = List.Count(list=filterByBoolMask_8.in, lacing=Longest)

# group: Identify how many pipes are connected to plumbing fixtures and only get plumbing fixtures with ONE pipe connected in the system
getCategory = Element.GetCategory(element=python_script_3)
name_6 = Category.Name(category=getCategory)
code_block_49 = CodeBlock { "Pipes"; }
contains_6 = String.Contains(string=name_6, searchFor=code_block_49)
countTrue = List.CountTrue(list=contains_6, lacing=Longest)
code_block_50 = CodeBlock { 1; }
eq = countTrue == code_block_50
chop_2 = List.Chop(list=eq, lengths=count_3)
filterByBoolMask_9 = List.FilterByBoolMask(list=filterByBoolMask_8.in, mask=chop_2)

list_create_9 = List.Create(item0=ofRepeatedItem, item1=filterByBoolMask_9.in)

# group: Check for empty lists
isEmpty_3 = List.IsEmpty(list=filterByBoolMask_9.in, lacing=Longest)
allTrue_2 = List.AllTrue(list=isEmpty_3)

# group: Conditional
or_ = Or(bool0=allTrue, bool1=allTrue_2)
code_block_51 = CodeBlock(result=or_) { result==true? 0 : 1; }

getItemAtIndex_9 = List.GetItemAtIndex(list=list_create_9, index=code_block_51)
flatten_2 = List.Flatten(list=getItemAtIndex_9)

# group: Python to get all elements connected
code_block_52 = CodeBlock(element=flatten_2) { element: var[]..[]; }
code_block_53 = CodeBlock { IncludeInputElement: bool = false; }
python_script_4 = Python(IN[0]=code_block_52, IN[1]=code_block_53)  # IronPython2; same code as python_script_3

# group: Get pipes connected to plumbing fixtures
getCategory_2 = Element.GetCategory(element=python_script_4)
name_7 = Category.Name(category=getCategory_2)
code_block_54 = CodeBlock { "Pipes"; }
contains_7 = String.Contains(string=name_7, searchFor=code_block_54)
filterByBoolMask_10 = List.FilterByBoolMask(list=python_script_4, mask=contains_7)

count_4 = List.Count(list=getItemAtIndex_9, lacing=Longest)
chop_3 = List.Chop(list=filterByBoolMask_10.in, lengths=count_4)
flatten_3 = List.Flatten(list=chop_3, lacing=Longest)
list_create_10 = List.Create(item0=ofRepeatedItem, item1=flatten_3)
getItemAtIndex_10 = List.GetItemAtIndex(list=list_create_10, index=code_block_51)

# group: Create list of all pipes that will show info in the socket termination schedule
join_2 = List.Join()  # unwired: list0, list1
combine_2 = List.Combine(comb=join_2, list1=filterByBoolMask_6.in, list2=getItemAtIndex_10)

count_5 = List.Count(list=combine_2, lacing=Longest)
cycle = List.Cycle(list=chop@L2, amount=count_5, lacing=Shortest)

# group: Sort pipes based on X coordinate
getLocation_2 = Element.GetLocation(element=combine_2)
startPoint = Curve.StartPoint(curve=getLocation_2)
X = Point.X(point=startPoint)
code_block_55 = CodeBlock { 2; }
round_3 = Math.Round(number=X, digits=code_block_55)
uniqueItems = List.UniqueItems(list=round_3, lacing=Longest)
sort_2 = List.Sort(list=uniqueItems)
allIndicesOf = List.AllIndicesOf(list=round_3, item=sort_2, lacing=Longest)
getItemAtIndex_11 = List.GetItemAtIndex(list=combine_2, index=allIndicesOf, lacing=Longest)

# group: Sort pipes based on Y coordinate
getLocation_3 = Element.GetLocation(element=getItemAtIndex_11)
startPoint_2 = Curve.StartPoint(curve=getLocation_3)
Y = Point.Y(point=startPoint_2)
sortByKey = List.SortByKey(list=getItemAtIndex_11@L2, keys=Y@L2)
reverse_2 = List.Reverse(list=sortByKey.sortedList@L2)
flatten_4 = List.Flatten(list=reverse_2)

flatten_5 = List.Flatten(list=chop_3)

# group: Get index of the pipes connected to plumbing fixtures
indexOf_3 = List.IndexOf(list=flatten_4, element=flatten_5)

# group: Python to replace items at indices
code_block_56 = CodeBlock(seq=flatten_4) { seq: var[]..[]; }
code_block_57 = CodeBlock(replacement=flatten_2) { replacement: var[]..[]; }
code_block_58 = CodeBlock(indices=indexOf_3) { indices: int[]..[]; }
python_script_5 = Python(IN[0]=code_block_56, IN[1]=code_block_57, IN[2]=code_block_58)  # IronPython2
# ---------- python_script_5.python (9 lines) ----------
_list = IN[0]
rValues = IN[1]
iValues = IN[2]
if len(iValues) > 1 and len(rValues) == 1:
	rValues = [rValues[0]] * len(iValues)
if len(iValues) > 0:
	for (index, value) in zip(iValues, rValues):
		_list[index] = value
OUT = _list
# ----------------------------------------

chop_4 = List.Chop(list=python_script_5, lengths=count_5)

# group: Tag elements in views
code_block_59 = CodeBlock { 2000; }
byCoordinates = Vector.ByCoordinates(x=code_block_59, y=code_block_59)
code_block_60 = CodeBlock { "Right"; "Top"; }
code_block_61 = CodeBlock { true; }
byElementAndOffset = Tag.ByElementAndOffset(view=cycle, element=chop_4, offset=byCoordinates, horizontalAlignment=code_block_60.out0, verticalAlignment=code_block_60.out1, horizontal=code_block_61, addLeader=code_block_61)

flatten_6 = List.Flatten(list=byElementAndOffset)
getCategory_3 = Element.GetCategory(element=python_script_5)
string_from_object_2 = FromObject(obj=getCategory_3)
code_block_62 = CodeBlock { ["Pipes", "Plumbing Fixtures"]; }
allIndicesOf_2 = List.AllIndicesOf(list=string_from_object_2, item=code_block_62@L1)
code_block_63 = CodeBlock(Pipes=allIndicesOf_2, PlumbingFixtures=allIndicesOf_2) { Pipes[0]; PlumbingFixtures[1]; }
getItemAtIndex_12 = List.GetItemAtIndex(list=flatten_6, index=code_block_63.out0)
getItemAtIndex_13 = List.GetItemAtIndex(list=flatten_6, index=code_block_63.out1)
list_create_11 = List.Create(item0=getItemAtIndex_12, item1=getItemAtIndex_13)
code_block_64 = CodeBlock { ["HL_Tag_PipeSocketTermination", "HL_Tag_PlumbingFixtureSocketTermination"]; }
byName_5 = Family.ByName(name=code_block_64@L1)
types = Family.Types(family=byName_5)
name_8 = FamilyType.Name(familyType=types)
code_block_65 = CodeBlock { "Socket Reference"; }
contains_8 = String.Contains(string=name_8, searchFor=code_block_65)
filterByBoolMask_11 = List.FilterByBoolMask(list=types, mask=contains_8)
count_6 = List.Count(list=list_create_11, lacing=Longest)
cycle_2 = List.Cycle(list=filterByBoolMask_11.in, amount=count_6, lacing=Shortest)

# group: Change Family and Type for tags
code_block_66 = CodeBlock { "Family and Type"; }
setParameterByName = Element.SetParameterByName(element=list_create_11, parameterName=code_block_66, value=cycle_2)

empty_5 = List.Empty()
list_create_12 = List.Create(item0=empty_5, item1=code_block_21)
getItemAtIndex_14 = List.GetItemAtIndex(list=list_create_12, index=code_block_23)

# group: Delete elements in Revit
delete = Element.Delete(element=getItemAtIndex_14)

flatten_7 = List.Flatten(list=filterByBoolMask_6.in)

# group: Monitor
pipes_to_be_tagged = Watch(flatten_7)

# group: Monitor
plumbing_fixtures_to_be_tagged = Watch(flatten_2)

# group: Generate numbering of pipes
empty_6 = List.Empty()
count_7 = List.Count(list=flatten_4)
code_block_67 = CodeBlock(n=count_7) { 1..n; }
string_from_object_3 = FromObject(obj=code_block_67)
code_block_68 = CodeBlock { 2; "0"; }
padLeft = String.PadLeft(string=string_from_object_3, newLength=code_block_68.out0, padChars=code_block_68.out1)
code_block_69 = CodeBlock(n=padLeft) { "T " + n; }

list_create_13 = List.Create(item0=empty_6, item1=code_block_69)

# group: User Selection: Automatic Numbering?
code_block_70 = CodeBlock(SelectedAutomaticNumbering=multipleinputform.User_Inputs) { SelectedAutomaticNumbering[1]; }

# group: User Selection: Automatic Numbering
code_block_71 = CodeBlock(AutomaticNumbering=code_block_70) { AutomaticNumbering=="Yes"? 1: 0; }

getItemAtIndex_15 = List.GetItemAtIndex(list=list_create_13, index=code_block_71)

# group: Write 'Mark' parameter i.e. Socket Ref for all pipes
code_block_72 = CodeBlock { "Mark"; }
setParameterByName_2 = Element.SetParameterByName(element=flatten_4, parameterName=code_block_72, value=getItemAtIndex_15)

# group: Wait then passthrough
code_block_73 = CodeBlock(passthrough=code_block_72, waitfor=setParameterByName_2) { [passthrough,waitfor][0]; }

# group: Get 'Mark' parameter from pipes and write it to plumbing fixtures connected to them
getParameterValueByName_7 = Element.GetParameterValueByName(element=flatten_5, parameterName=code_block_73)
setParameterByName_3 = Element.SetParameterByName(element=flatten_2, parameterName=code_block_73, value=getParameterValueByName_7)

# group: Monitor
watch = Watch(flatten_4)

# group: Monitor
watch_2 = Watch(python_script_5)

code_block_74 = CodeBlock { "System Abbreviation"; "Type Abbreviation"; }
getParameterValueByName_8 = Element.GetParameterValueByName(element=flatten_4, parameterName=code_block_74.out0)
elementType = Element.ElementType(element=flatten_2)
getParameterValueByName_9 = Element.GetParameterValueByName(element=elementType, parameterName=code_block_74.out1)

# group: Python to replace items at indices
code_block_75 = CodeBlock(seq=getParameterValueByName_8) { seq: var[]..[]; }
code_block_76 = CodeBlock(replacement=getParameterValueByName_9) { replacement: var[]..[]; }
code_block_77 = CodeBlock(indices=indexOf_3) { indices: int[]..[]; }
python_script_6 = Python(IN[0]=code_block_75, IN[1]=code_block_76, IN[2]=code_block_77)  # IronPython2; same code as python_script_5

# group: Write parameter 'Connection Type'
code_block_78 = CodeBlock { "Connection Type"; }
setParameterByName_4 = Element.SetParameterByName(element=flatten_4, parameterName=code_block_78, value=python_script_6)

# group: Search and filter shared parameter 'Reference Level'
code_block_79 = CodeBlock { "Reference Level"; }
getParameterValueByName_10 = Element.GetParameterValueByName(element=flatten_4, parameterName=code_block_79)
name_9 = Level.Name(level=getParameterValueByName_10)
parameters = Element.Parameters(element=flatten_4)
name_10 = Parameter.Name(parameter=parameters)
contains_9 = String.Contains(string=name_10, searchFor=code_block_79)
filterByBoolMask_12 = List.FilterByBoolMask(list=parameters, mask=contains_9)
isShared = Parameter.IsShared(parameter=filterByBoolMask_12.in)
filterByBoolMask_13 = List.FilterByBoolMask(list=filterByBoolMask_12.in, mask=isShared)

# group: Write Reference Level shared parameter value
value = Parameter.Value(parameter=filterByBoolMask_13.out)
name_11 = Level.Name(level=value)
setValue = Parameter.SetValue(parameter=filterByBoolMask_13.in, value=name_11)
