# Dynamo graph Foul Drainage Systems_1_Place Sizing Connections v.2.1.dyn (Dynamo 2.16.1.2727)
# packages: Data-Shapes 2021.2.92

# group: Input
# note: USE:
# FOR FIXED INPUT (FILE PATHS ETC.)

# group: Control
# note: USE:
# FOR USER CONTROL (SLIDERS ETC.)

# group: To Revit
# note: USE:
# FOR CHANGES TO REVIT

# group: Python
# note: USE:
# FOR PYTHON NODES

# group: DYNAMO COLOUR CODING LEGEND
# note: COLOUR CODING LEGEND

# group: Monitor
# note: USE:
# FOR IMPORTANT WATCH NODES

# group: Background
# note: USE:
# FOR GENERAL WORKFLOW NODES

# group: Conditional
# note: USE:
# FOR CONDITIONAL NODES

# group: Get all piping systems, filter them to only show Discharge
code_block = CodeBlock { "Piping Systems"; }
byName = Category.ByName(name=code_block)
all_elements_of_category = ElementsOfCategory(Category=byName)
elementType = Element.ElementType(element=all_elements_of_category)
name = Element.Name(element=elementType)
code_block_2 = CodeBlock { ["Ss_50_30_04_97 - Discharge", "Ss_50_30_04_97 - HT Discharge", "Ss_50_30_04_97 - Lab Discharge"]; }
contains = String.Contains(string=name, searchFor=code_block_2@L1)
filterByBoolMask = List.FilterByBoolMask(list=all_elements_of_category, mask=contains@L2)
flatten = List.Flatten(list=filterByBoolMask.in)
name_2 = Element.Name(element=flatten)

# group: Python to sort strings with numbers
python_to_sort_strings_with = Python(IN[0]=name_2)  # "Python to sort strings with numbers"; IronPython2
# ---------- python_to_sort_strings_with.python (10 lines) ----------
import re

list = IN[0]

def natural_sort(l): 
    convert = lambda text: int(text) if text.isdigit() else text.lower() 
    alphanum_key = lambda key: [ convert(c) for c in re.split('([0-9]+)', key) ] 
    return sorted(l, key = alphanum_key)

OUT = natural_sort(list)
# ----------------------------------------

indexOf = List.IndexOf(list=name_2, element=python_to_sort_strings_with)
getItemAtIndex = List.GetItemAtIndex(list=flatten, index=indexOf)

# group: User Interface
code_block_3 = CodeBlock { "Place Sizing Connections"; null; "Proceed"; "Cancel"; 800; 700; 300; }
code_block_4 = CodeBlock { "Select System"; false; }
dropdown_data = Custom[DropDown Data](InputName=code_block_4.out0, Keys=python_to_sort_strings_with, Values=getItemAtIndex, Sorted_optional=code_block_4.out1)  # package Data-Shapes; Create data for DropDown input in UI.MultiInputForm ++ . Check out www.data-shapes.net for more infos.
code_block_5 = CodeBlock { "Use 'Manual System Name' Parameter?"; ["Yes","No"]; [true, false]; 1; }
radiobuttons_data = Custom[RadioButtons Data](InputName=code_block_5.out0, Keys=code_block_5.out1, Values=code_block_5.out2, DefaultValueIndex=code_block_5.out3)  # package Data-Shapes; Create radio buttons input for UI.MultipleInputForm ++ .
list_create = List.Create(item0=dropdown_data, item1=radiobuttons_data)
boolean = BoolSelector(true)
multipleinputform = Custom[MultipleInputForm ++](Description_optional=code_block_3.out0, Logo_optional=code_block_3.out1, ButtonText_optional=code_block_3.out2, Inputs=list_create, Toggle=boolean, CancelButtonText_optional=code_block_3.out3, MaxHeight_optional=code_block_3.out4, Width_optional=code_block_3.out5, LabelWidth_optional=code_block_3.out6)  # package Data-Shapes; Create a form with multiple inputs. see www.data-shapes.net for tutorials and infos!

# group: User selection: Selected Piping System
code_block_6 = CodeBlock(SelectedPipingSystem=multipleinputform.User_Inputs) { SelectedPipingSystem[0]; }

# group: Python to get all elements in network
python_pipe_network = Python(IN[0]=code_block_6)  # IronPython2
# ---------- python_pipe_network.python (42 lines) ----------
import clr

clr.AddReference("RevitServices")
import RevitServices
from RevitServices.Persistence import DocumentManager
from RevitServices.Transactions import TransactionManager
doc = DocumentManager.Instance.CurrentDBDocument

clr.AddReference("RevitAPI")
import Autodesk
from Autodesk.Revit.DB import *

clr.AddReference("RevitNodes")
import Revit
clr.ImportExtensions(Revit.Elements)
clr.ImportExtensions(Revit.GeometryConversion)

#Many thanks to Konrad K Sobon for his awesome ProcessList function!
def Unwrap(item):
	return UnwrapElement(item)

def ProcessList(_func, _list):
    return map( lambda x: ProcessList(_func, x) if type(x)==list else _func(x), _list )

if isinstance(IN[0], list):
	systems = ProcessList(Unwrap, IN[0])
else:
	systems = [Unwrap(IN[0])]
	
	
def getNetwork(system):
	network = None
	try:
		network = [x.ToDSType(True) for x in system.PipingNetwork]
	except:
		pass
	return network

			
#Assign your output to the OUT variable.

OUT = ProcessList(getNetwork, systems)
# ----------------------------------------

# group: Get only pipes
getCategory = Element.GetCategory(element=python_pipe_network)
name_3 = Category.Name(category=getCategory)
code_block_7 = CodeBlock { "Pipes"; }
contains_2 = String.Contains(string=name_3, searchFor=code_block_7)
filterByBoolMask_2 = List.FilterByBoolMask(list=python_pipe_network, mask=contains_2)

# group: User selection: Use Manual System Name
code_block_8 = CodeBlock(UseManualSystemName=multipleinputform.User_Inputs) { UseManualSystemName[1]; }

# group: Check whether Use Manual System Name option was used & if Manual System Name parameter has a value
code_block_9 = CodeBlock { "Manual System Name"; }
getParameterValueByName = Element.GetParameterValueByName(element=filterByBoolMask_2.in, parameterName=code_block_9)
uniqueItems = List.UniqueItems(list=getParameterValueByName, lacing=Longest)
sort = List.Sort(list=uniqueItems)
flatten_2 = List.Flatten(list=sort)
length = String.Length(string=flatten_2)
code_block_10 = CodeBlock(x=length) { x>0; }
identity = Object.Identity()  # unwired: object
trueForAll = List.TrueForAll(list=code_block_10, queryFunction=identity)
join = List.Join(list0=code_block_8, list1=trueForAll)
trueForAll_2 = List.TrueForAll(list=join, queryFunction=identity)

# group: Description based on user selection
code_block_11 = CodeBlock { "Select Level(s), Elevation and Sub-System"; "Select Level(s) and Elevation"; }
code_block_12 = CodeBlock(x=trueForAll_2, description1=code_block_11.out0, description2=code_block_11.out1) { x==true?description1:description2; }

# group: Sort levels based on elevation
string = StringInput("Levels")
byName_2 = Category.ByName(name=string)
all_elements_of_category_2 = ElementsOfCategory(Category=byName_2)
projectElevation = Level.ProjectElevation()  # unwired: level
sortByFunction = List.SortByFunction(list=all_elements_of_category_2, sortFunction=projectElevation)

# group: Get Level name
name_4 = Element.Name(element=sortByFunction)

# group: User Selection: Was Run & Was Cancelled
code_block_13 = CodeBlock(WasRun=multipleinputform.Was_Run, WasCancelled=multipleinputform.Was_Cancelled) { WasRun == true && WasCancelled == false? true : false; }

# group: User Interface
code_block_14 = CodeBlock { null; "Proceed"; "Cancel"; 800; 700; 300; }
code_block_15 = CodeBlock { "Levels"; 300; false; }
listview_data = Custom[Listview Data](InputName=code_block_15.out0, Keys=name_4, Values=sortByFunction, Height_optionnal=code_block_15.out1, SortItems_optionnal=code_block_15.out2, ShowId_optionnal=code_block_15.out2)  # package Data-Shapes; Create data for ListView input in UI.MultiInputForm ++ . Check out www.data-shapes.net for more infos.
code_block_16 = CodeBlock { "Elevation AFFL"; "100"; true; }
textbox_data = Custom[TextBox Data](InputName=code_block_16.out0, DefaultText=code_block_16.out1, IsNumberEntry=code_block_16.out2)  # package Data-Shapes; Create Data for TextBox input in UI.MultipleInputForm ++ . Check out www.data-shapes.net for more informations
list_create_2 = List.Create(item0=listview_data, item1=textbox_data)
code_block_17 = CodeBlock { "Select System"; }
dropdown_data_2 = Custom[DropDown Data](InputName=code_block_17, Keys=flatten_2, Values=flatten_2)
list_create_3 = List.Create(item0=listview_data, item1=textbox_data, item2=dropdown_data_2)
list_create_4 = List.Create(item0=list_create_2, item1=list_create_3)
code_block_18 = CodeBlock(x=trueForAll_2) { x == true? 1 : 0; }
getItemAtIndex_2 = List.GetItemAtIndex(list=list_create_4, index=code_block_18)
multipleinputform_2 = Custom[MultipleInputForm ++](Description_optional=code_block_12, Logo_optional=code_block_14.out0, ButtonText_optional=code_block_14.out1, Inputs=getItemAtIndex_2, Toggle=code_block_13, CancelButtonText_optional=code_block_14.out2, MaxHeight_optional=code_block_14.out3, Width_optional=code_block_14.out4, LabelWidth_optional=code_block_14.out5)

# group: Conditional
count = List.Count(list=multipleinputform_2.User_Inputs)
code_block_19 = CodeBlock(x=count) { x > 2? 2 : 0; }

getItemAtIndex_3 = List.GetItemAtIndex(list=multipleinputform_2.User_Inputs, index=code_block_19)
allIndicesOf = List.AllIndicesOf(list=getParameterValueByName, item=getItemAtIndex_3, lacing=Longest)
isEmpty = List.IsEmpty(list=allIndicesOf, lacing=Longest)
identity_2 = Object.Identity()  # unwired: object
trueForAll_3 = List.TrueForAll(list=isEmpty, queryFunction=identity_2)

# group: Scope IF
code_block_20 = CodeBlock { 0; }
code_block_21 = CodeBlock(True=code_block_20) { True: var[]..[]; }
code_block_22 = CodeBlock(False=allIndicesOf) { False: var[]..[]; }
code_block_23 = CodeBlock(test=trueForAll_3) { test: var[]..[]; }
code_block_24 = CodeBlock(trueval=code_block_21, falseval=code_block_22, test=code_block_23) { result = [trueval, falseval]; result[test ? 0 : 1]; }

getItemAtIndex_4 = List.GetItemAtIndex(list=filterByBoolMask_2.in, index=code_block_24.out1, lacing=Longest)
list_create_5 = List.Create(item0=getItemAtIndex_4, item1=filterByBoolMask_2.in)

# group: Conditional
code_block_25 = CodeBlock(x=count) { x > 2? 0 : 1; }

getItemAtIndex_5 = List.GetItemAtIndex(list=list_create_5, index=code_block_25)
flatten_3 = List.Flatten(list=getItemAtIndex_5)

# group: Select ONLY vertical pipes
code_block_26 = CodeBlock { "Slope"; }
getParameterValueByName_2 = Element.GetParameterValueByName(element=flatten_3, parameterName=code_block_26)
code_block_27 = CodeBlock(x=getParameterValueByName_2) { x !=0; }
filterByBoolMask_3 = List.FilterByBoolMask(list=flatten_3, mask=code_block_27)
filterByBoolMask_4 = List.FilterByBoolMask(list=getParameterValueByName_2, mask=code_block_27)
code_block_28 = CodeBlock(x=filterByBoolMask_4.in) { 1/x; }
flatten_4 = List.Flatten(list=code_block_28)
code_block_29 = CodeBlock { 0; }
python_script = Python(IN[0]=flatten_4, IN[1]=code_block_29)  # IronPython2
# ---------- python_script.python (8 lines) ----------
items = IN[0]
rep = IN[1]
elementlist = list()
for item in items:
	if item is None: 
		item = rep
	elementlist.append(item)
OUT = elementlist
# ----------------------------------------
round = Math.Round(number=python_script)
code_block_30 = CodeBlock { 0; }
eq = round == code_block_30
filterByBoolMask_5 = List.FilterByBoolMask(list=filterByBoolMask_3.in, mask=eq)

# group: User Selection: Levels
code_block_31 = CodeBlock(SelectedLevels=multipleinputform_2.User_Inputs) { SelectedLevels[0]; }

# group: Sort selected levels based on elevation
projectElevation_2 = Level.ProjectElevation(level=code_block_31)
sort_2 = List.Sort(list=projectElevation_2)
indexOf_2 = List.IndexOf(list=projectElevation_2, element=sort_2)
getItemAtIndex_6 = List.GetItemAtIndex(list=code_block_31, index=indexOf_2)

# group: Get Level elevation
elevation = Level.Elevation(level=getItemAtIndex_6)

# group: User Selection: Elevation
code_block_32 = CodeBlock(SelectedElevation=multipleinputform_2.User_Inputs) { SelectedElevation[1]; }

# group: General Workflow
code_block_33 = CodeBlock(LvlElevation=elevation, SelectedElevation=code_block_32) { LvlElevation+SelectedElevation; }

# group: Get pipe intersection points with levels
getLocation = Element.GetLocation(element=filterByBoolMask_5.in)
XY = Plane.XY()
code_block_34 = CodeBlock(x=XY, LvlElevation1=code_block_33) { x.Offset(LvlElevation1); }
intersect = Geometry.Intersect(geometry=getLocation, other=code_block_34, lacing=CrossProduct)

isEmpty_2 = List.IsEmpty(list=intersect@@L2)
identity_3 = Object.Identity()  # unwired: object
trueForAll_4 = List.TrueForAll(list=isEmpty_2, queryFunction=identity_3, lacing=Longest)
not_ = Not(x=trueForAll_4)
filterByBoolMask_6 = List.FilterByBoolMask(list=filterByBoolMask_5.in, mask=not_)
getLocation_2 = Element.GetLocation(element=filterByBoolMask_6.in)
startPoint = Curve.StartPoint(curve=getLocation_2)
X = Point.X(point=startPoint)
Y = Point.Y(point=startPoint)
code_block_35 = CodeBlock { "Invert Elevation"; }
getParameterValueByName_3 = Element.GetParameterValueByName(element=filterByBoolMask_6.in, parameterName=code_block_35)
code_block_36 = CodeBlock { "Length"; }
getParameterValueByName_4 = Element.GetParameterValueByName(element=filterByBoolMask_6.in, parameterName=code_block_36)
code_block_37 = CodeBlock(IE=getParameterValueByName_3, L=getParameterValueByName_4) { IE+L; }
byCoordinates = Point.ByCoordinates(x=X, y=Y, z=code_block_37)
byCoordinates_2 = Point.ByCoordinates(x=X, y=Y, z=getParameterValueByName_3)
code_block_38 = CodeBlock { 1; }
chop = List.Chop(list=byCoordinates_2, lengths=code_block_38)
filterByBoolMask_7 = List.FilterByBoolMask(list=intersect, mask=not_)
flatten_5 = List.Flatten(list=filterByBoolMask_7.in, lacing=Longest)
Z = Point.Z(point=flatten_5)
byCoordinates_3 = Point.ByCoordinates(x=X, y=Y, z=Z)
addItemToFront = List.AddItemToFront(item=chop@L1, list=byCoordinates_3@L2)
addItemToEnd = List.AddItemToEnd(item=byCoordinates@L1, list=addItemToFront@L2)
count_2 = List.Count(list=addItemToEnd, lacing=Longest)
code_block_39 = CodeBlock(n=count_2) { n-1; }
ofRepeatedItem = List.OfRepeatedItem(item=filterByBoolMask_6.in@L1, amount=code_block_39, lacing=Shortest)
flatten_6 = List.Flatten(list=ofRepeatedItem)

# group: Get Family and Type
code_block_40 = CodeBlock { "Family and Type"; }
getParameterValueByName_5 = Element.GetParameterValueByName(element=flatten_6, parameterName=code_block_40)

firstItem = List.FirstItem(list=getParameterValueByName_5)
list_create_6 = List.Create(item0=firstItem)
removeItemAtIndex = List.RemoveItemAtIndex(list=addItemToEnd, indices=code_block_39, lacing=Longest)
code_block_41 = CodeBlock { 1; }
chop_2 = List.Chop(list=removeItemAtIndex@L2, lengths=code_block_41)
code_block_42 = CodeBlock { 0; }
removeItemAtIndex_2 = List.RemoveItemAtIndex(list=addItemToEnd, indices=code_block_42, lacing=Longest)
code_block_43 = CodeBlock { 1; }
chop_3 = List.Chop(list=removeItemAtIndex_2@L2, lengths=code_block_43)
addItemToFront_2 = List.AddItemToFront(item=chop_2@L1, list=chop_3@L2)
firstItem_2 = List.FirstItem(list=addItemToFront_2, lacing=Longest)
lastItem = List.LastItem(list=addItemToFront_2, lacing=Longest)
byStartPointEndPoint = Line.ByStartPointEndPoint(startPoint=firstItem_2, endPoint=lastItem)

# group: Get System Type
code_block_44 = CodeBlock { "System Type"; }
getParameterValueByName_6 = Element.GetParameterValueByName(element=flatten_6, parameterName=code_block_44)

# group: Get All Levels
string_2 = StringInput("Levels")
byName_3 = Category.ByName(name=string_2)
all_elements_of_category_3 = ElementsOfCategory(Category=byName_3)

# group: Sort levels based on elevation
projectElevation_3 = Level.ProjectElevation(level=all_elements_of_category_3)
sort_3 = List.Sort(list=projectElevation_3)
indexOf_3 = List.IndexOf(list=projectElevation_3, element=sort_3)
getItemAtIndex_7 = List.GetItemAtIndex(list=all_elements_of_category_3, index=indexOf_3)
code_block_45 = CodeBlock(x=getItemAtIndex_7) { x[0]; }

# group: Get Diameter
code_block_46 = CodeBlock { "Diameter"; }
getParameterValueByName_7 = Element.GetParameterValueByName(element=flatten_6, parameterName=code_block_46)

# group: Python to create pipes by lines
code_block_47 = CodeBlock(Lines=byStartPointEndPoint) { Lines; }
code_block_48 = CodeBlock(PipeType=getParameterValueByName_5) { PipeType; }
code_block_49 = CodeBlock(SystemType=getParameterValueByName_6) { SystemType; }
code_block_50 = CodeBlock(level=code_block_45) { level; }
code_block_51 = CodeBlock(Diameter=getParameterValueByName_7) { Diameter; }
python_pipe_by_lines = Python(IN[0]=code_block_47, IN[1]=code_block_48, IN[2]=code_block_49, IN[3]=code_block_50, IN[4]=code_block_51)  # IronPython2
# ---------- python_pipe_by_lines.python (69 lines) ----------
import clr

clr.AddReference("RevitServices")
import RevitServices
from RevitServices.Persistence import DocumentManager
from RevitServices.Transactions import TransactionManager
doc = DocumentManager.Instance.CurrentDBDocument

clr.AddReference("RevitAPI")
import Autodesk
from Autodesk.Revit.DB import *

clr.AddReference("RevitNodes")
import Revit
clr.ImportExtensions(Revit.Elements)
clr.ImportExtensions(Revit.GeometryConversion)


if isinstance(IN[0], list):
	lines = IN[0]
else:
	lines = [IN[0]]
FirstPoint = [x.StartPoint for x in lines]
SecondPoint = [x.EndPoint for x in lines]
if isinstance(IN[1], list):
	pipetype = UnwrapElement(IN[1])
else:
	pipetype = [UnwrapElement(IN[1])]
ptl = len(pipetype)

if isinstance(IN[2], list):
	systemtype = UnwrapElement(IN[2])
else:
	systemtype = [UnwrapElement(IN[2])]
stl = len(systemtype)
if isinstance(IN[3], list):
	level = UnwrapElement(IN[3])
else:
	level = [UnwrapElement(IN[3])]
ll = len(level)
if isinstance(IN[4], list):
	diameter = IN[4]
else:
	diameter = [IN[4]]
dl = len(diameter)

elements = []

TransactionManager.Instance.EnsureInTransaction(doc)
for i,x in enumerate(FirstPoint):
	try:
		levelid = level[i%ll].Id
		systypeid = systemtype[i%stl].Id
		pipetypeid = pipetype[i%ptl].Id
		diam = diameter[i%dl]
		
		pipe = Autodesk.Revit.DB.Plumbing.Pipe.Create(doc,systypeid,pipetypeid,levelid,x.ToXyz(),SecondPoint[i].ToXyz())
		
		param = pipe.get_Parameter(BuiltInParameter.RBS_PIPE_DIAMETER_PARAM)
		param.SetValueString(diam.ToString())
	
		elements.append(pipe.ToDSType(False))	
	except:
		elements.append(None)

TransactionManager.Instance.TransactionTaskDone()


OUT = elements
# ----------------------------------------

# group: Get 'Manual System Name' parameter
code_block_52 = CodeBlock { "Manual System Name"; }
getParameterValueByName_8 = Element.GetParameterValueByName(element=flatten_6, parameterName=code_block_52)

# group: Set 'Manual System Name' parameter to new pipes
setParameterByName = Element.SetParameterByName(element=python_pipe_by_lines, parameterName=code_block_52, value=getParameterValueByName_8)

# group: Wait then Passthrough
code_block_53 = CodeBlock(passthrough=filterByBoolMask_6.in, waitfor=setParameterByName) { [passthrough,waitfor][0]; }

# group: Python to delete existing pipes
python_script_2 = Python(IN[0]=code_block_53)  # IronPython2
# ---------- python_script_2.python (42 lines) ----------
import clr

#Load Revit API
clr.AddReference('RevitAPI')
from Autodesk.Revit.DB import *
import Autodesk

#Load document reference
clr.AddReference("RevitServices")
import RevitServices
from RevitServices.Persistence import DocumentManager
from RevitServices.Transactions import TransactionManager

doc = DocumentManager.Instance.CurrentDBDocument
uiapp = DocumentManager.Instance.CurrentUIApplication
app = uiapp.Application

elementsOrIDs = IN[0]
elems = []


TransactionManager.Instance.EnsureInTransaction(doc)

count = 0
try:
	int(elementsOrIDs[0])

except:
	for e in elementsOrIDs:
		elems.append(UnwrapElement(e))
	for elem in elems:
		doc.Delete(elem.Id)
		count +=1
	
else:
	for ID in elementsOrIDs:
		id = Autodesk.Revit.DB.ElementId(int(ID))
		doc.Delete(id)
		count +=1
	
TransactionManager.Instance.TransactionTaskDone()
OUT = str(count) + " element/s have been deleted from Revit"
# ----------------------------------------

# group: Wait then Passthrough
code_block_54 = CodeBlock(passthrough=python_pipe_by_lines, waitfor=python_script_2) { [passthrough,waitfor][0]; }

flatten_7 = List.Flatten(list=intersect)
code_block_55 = CodeBlock { 25; }
byCenterPointRadius = Sphere.ByCenterPointRadius(centerPoint=flatten_7, radius=code_block_55)
getLocation_3 = Element.GetLocation(element=code_block_54)
doesIntersect = Geometry.DoesIntersect(geometry=byCenterPointRadius, other=getLocation_3, lacing=CrossProduct)
code_block_56 = CodeBlock { true; }
allIndicesOf_2 = List.AllIndicesOf(list=doesIntersect, item=code_block_56, lacing=Longest)

# group: Input
code_block_57 = CodeBlock { "HL_FoulDrainage_SizingConnection"; }
byName_4 = Family.ByName(name=code_block_57)
types = Family.Types(family=byName_4)

name_5 = Element.Name(element=firstItem)

# group: Set family index based on pipe type
code_block_58 = CodeBlock(PipeType=name_5)
# ---------- code_block_58.designscript (7 lines) ----------
PipeType=="HL_Pipe_Generic"? 0:
PipeType=="HL_Pipe_CastIron"? 0:
PipeType=="HL_Pipe_HDPE"? 1:
PipeType=="HL_Pipe_UPVC"? 2:
PipeType=="HL_Pipe_Polypropylene"? 3:
PipeType=="HL_Pipe_StainlessSteel - Drainage"? 4:
0;
# ----------------------------------------

# group: Get the correct family index based on pipe type
getItemAtIndex_8 = List.GetItemAtIndex(list=types, index=code_block_58)

# group: Python to add Routing Preference
add_routing_preference_rule_for = Python(IN[0]=list_create_6, IN[1]=getItemAtIndex_8)  # "Add routing preference rule for this union, if it is not first"; IronPython2
# ---------- add_routing_preference_rule_for.python (39 lines) ----------
# Enable Python support and load DesignScript library
import clr
clr.AddReference('ProtoGeometry')
from Autodesk.DesignScript.Geometry import *

# Import RevitAPI
clr.AddReference("RevitAPI")
import Autodesk
from Autodesk.Revit.DB import *

# Import DocumentManager and TransactionManager
clr.AddReference("RevitServices")
import RevitServices
from RevitServices.Persistence import DocumentManager
from RevitServices.Transactions import TransactionManager

# The inputs to this node will be stored as a list in the IN variables.
listOfPipeTypes = UnwrapElement(IN[0])
unionFamilyType = UnwrapElement(IN[1])

doc = DocumentManager.Instance.CurrentDBDocument

# Place your code below this line

TransactionManager.Instance.EnsureInTransaction(doc)

unions = RoutingPreferenceRuleGroupType.Unions

for pipeType in listOfPipeTypes:
	firstRule = pipeType.RoutingPreferenceManager.GetRule(unions, 0)
	if firstRule.MEPPartId != unionFamilyType.Id:
		newRule = RoutingPreferenceRule(unionFamilyType.Id, "Dynamo Rule")
		prefs = pipeType.RoutingPreferenceManager
		prefs.AddRule(unions, newRule, 0)
	
TransactionManager.Instance.TransactionTaskDone()

# Assign your output to the OUT variable.
OUT = listOfPipeTypes
# ----------------------------------------

# group: Wait then Passthrough
code_block_59 = CodeBlock(passthrough=allIndicesOf_2, waitfor=add_routing_preference_rule_for) { [passthrough,waitfor][0]; }

getItemAtIndex_9 = List.GetItemAtIndex(list=code_block_54@L2, index=code_block_59@L2, lacing=Longest)
count_3 = List.Count(list=getItemAtIndex_9, lacing=Longest)
code_block_60 = CodeBlock(x=count_3) { x>1; }
filterByBoolMask_8 = List.FilterByBoolMask(list=getItemAtIndex_9, mask=code_block_60)
firstItem_3 = List.FirstItem(list=filterByBoolMask_8.in, lacing=Longest)
lastItem_2 = List.LastItem(list=filterByBoolMask_8.in, lacing=Longest)

# group: Python to join pipes with Union fitting
python_script_3 = Python(IN[0]=firstItem_3, IN[1]=lastItem_2)  # IronPython2
# ---------- python_script_3.python (72 lines) ----------
import clr

clr.AddReference("RevitServices")
import RevitServices
from RevitServices.Persistence import DocumentManager
from RevitServices.Transactions import TransactionManager
doc = DocumentManager.Instance.CurrentDBDocument

clr.AddReference("RevitAPI")
from Autodesk.Revit.DB import *

clr.AddReference("RevitNodes")
import Revit
clr.ImportExtensions(Revit.Elements)
clr.ImportExtensions(Revit.GeometryConversion)

if isinstance(IN[0], list):
	pipe1 = UnwrapElement(IN[0])
else:
	pipe1 = [UnwrapElement(IN[0])]
if isinstance(IN[1], list):
	pipe2 = UnwrapElement(IN[1])
else:
	pipe2 = [UnwrapElement(IN[1])]

def closest_connectors(pipe1, pipe2):
	conn1 = pipe1.ConnectorManager.Connectors
	conn2 = pipe2.ConnectorManager.Connectors
	
	dist = 100000000
	connset = None
	for c in conn1:
		for d in conn2:
			conndist = c.Origin.DistanceTo(d.Origin)
			if conndist < dist:
				dist = conndist
				connset = [c,d]
	return connset

	
def check_dir(conn1,conn2):
	if conn1.CoordinateSystem.BasisZ.ToString() == conn2.CoordinateSystem.BasisZ.ToString() or conn1.CoordinateSystem.BasisZ.ToString() == (conn2.CoordinateSystem.BasisZ*-1).ToString():
		return True
	else:
		return False
	
fittings = []

for p1,p2 in zip(pipe1,pipe2):
	connectors = closest_connectors(p1,p2)
	
	if check_dir(connectors[0],connectors[1]):
		TransactionManager.Instance.EnsureInTransaction(doc)
		
		fitting = doc.Create.NewUnionFitting(connectors[0],connectors[1])
		try:
			fittings.append(fitting.ToDSType(False))
		except:
			fittings.append("fitting not created by Dynamo")
		
		TransactionManager.Instance.TransactionTaskDone()
	else:
		TransactionManager.Instance.EnsureInTransaction(doc)
	
		fitting = doc.Create.NewElbowFitting(connectors[0],connectors[1])
		fittings.append(fitting.ToDSType(False))
		
		TransactionManager.Instance.TransactionTaskDone()

			

OUT = fittings
# ----------------------------------------

doesIntersect_2 = Geometry.DoesIntersect(geometry=getLocation, other=code_block_34, lacing=CrossProduct)
code_block_61 = CodeBlock { true; }
allIndicesOf_3 = List.AllIndicesOf(list=doesIntersect_2, item=code_block_61, lacing=Longest)
getItemAtIndex_10 = List.GetItemAtIndex(list=getItemAtIndex_6@L2, index=allIndicesOf_3@L2, lacing=Longest)
flatten_8 = List.Flatten(list=getItemAtIndex_10)

# group: Set 'Level' and 'Elevation from Level' parameters
code_block_62 = CodeBlock { "Level"; }
setParameterByName_2 = Element.SetParameterByName(element=python_script_3, parameterName=code_block_62, value=flatten_8)
code_block_63 = CodeBlock { "Elevation from Level"; }
setParameterByName_3 = Element.SetParameterByName(element=setParameterByName_2, parameterName=code_block_63, value=code_block_32, lacing=Longest)

code_block_64 = CodeBlock { "Manual System Name"; }

# group: Python to get fittings & accessories connected to pipes
python_script_4 = Python(IN[0]=filterByBoolMask_6.in)  # IronPython2
# ---------- python_script_4.python (23 lines) ----------
import clr
clr.AddReference('ProtoGeometry')
from Autodesk.DesignScript.Geometry import *
#The inputs to this node will be stored as a list in the IN variables.
if isinstance(IN[0], list):
	curves = UnwrapElement(IN[0])
else:
	curves = [UnwrapElement(IN[0])]

refs = []

for curve in curves:
	connMan = curve.ConnectorManager
	fittings = []
	for conn in connMan.Connectors:
		if conn.IsConnected:
			for lc in conn.AllRefs:
				if connMan.Owner.Id !=  lc.Owner.Id:
					fittings.append(lc.Owner)
	refs.append(fittings)

#Assign your output to the OUT variable.
OUT = refs
# ----------------------------------------
flatten_9 = List.Flatten(list=python_script_4)

boundingBox = Element.BoundingBox(element=flatten_9)

# group: Wait then Passthrough
code_block_65 = CodeBlock(passthrough=python_pipe_by_lines, waitfor=setParameterByName_3) { [passthrough,waitfor][0]; }

boundingBox_2 = Element.BoundingBox(element=code_block_65)
intersects = BoundingBox.Intersects(boundingBox=boundingBox, other=boundingBox_2, lacing=CrossProduct)
code_block_66 = CodeBlock { true; }
allIndicesOf_4 = List.AllIndicesOf(list=intersects, item=code_block_66, lacing=Longest)
getItemAtIndex_11 = List.GetItemAtIndex(list=python_pipe_by_lines, index=allIndicesOf_4)
flatten_10 = List.Flatten(list=getItemAtIndex_11)

# group: Python to get element connectors
python_connector = Python(IN[0]=flatten_10)  # IronPython2
# ---------- python_connector.python (44 lines) ----------
import clr
import math

clr.AddReference("RevitServices")
import RevitServices
from RevitServices.Persistence import DocumentManager
from RevitServices.Transactions import TransactionManager
doc = DocumentManager.Instance.CurrentDBDocument

clr.AddReference("RevitAPI")
import Autodesk
from Autodesk.Revit.DB import *

clr.AddReference("RevitNodes")
import Revit
clr.ImportExtensions(Revit.Elements)
clr.ImportExtensions(Revit.GeometryConversion)
#The inputs to this node will be stored as a list in the IN variables.
if isinstance(IN[0], list):
	elements = UnwrapElement(IN[0])
	toggle = 0
else:
	toggle = 1
	elements = [UnwrapElement(IN[0])]
	

listout = []

for element in elements:
	try:
		connectors = element.MEPModel.ConnectorManager.Connectors
	except:
		try:
			connectors = element.ConnectorManager.Connectors
		except:			
			connectors = []
	listout.append([x for x in connectors])


#Assign your output to the OUT variable.
if toggle:
	OUT = connectors
else:
	OUT = listout
# ----------------------------------------

# group: Python to check if connector is connected
python_connector_is_connected = Python(IN[0]=python_connector)  # IronPython2
# ---------- python_connector_is_connected.python (42 lines) ----------
import clr

clr.AddReference("RevitServices")
import RevitServices
from RevitServices.Persistence import DocumentManager
from RevitServices.Transactions import TransactionManager
doc = DocumentManager.Instance.CurrentDBDocument

clr.AddReference("RevitAPI")
import Autodesk
from Autodesk.Revit.DB import *

clr.AddReference("RevitNodes")
import Revit
clr.ImportExtensions(Revit.Elements)
clr.ImportExtensions(Revit.GeometryConversion)

#Many thanks to Konrad K Sobon for his awesome ProcessList function!
def Unwrap(item):
	return UnwrapElement(item)

def ProcessList(_func, _list):
    return map( lambda x: ProcessList(_func, x) if type(x)==list else _func(x), _list )

if isinstance(IN[0], list):
	connectors = ProcessList(Unwrap, IN[0])
else:
	connectors = [Unwrap(IN[0])]
	
	
def IsConnected(connector):
	bool = False
	try:
		bool = connector.IsConnected
	except:
		pass
	return bool

			
#Assign your output to the OUT variable.

OUT = ProcessList(IsConnected, connectors)
# ----------------------------------------

not_2 = Not(x=python_connector_is_connected)
filterByBoolMask_9 = List.FilterByBoolMask(list=python_connector, mask=not_2)
count_4 = List.Count(list=getItemAtIndex_11, lacing=Longest)
chop_4 = List.Chop(list=filterByBoolMask_9.in, lengths=count_4)
flatten_11 = List.Flatten(list=chop_4, lacing=Longest)

# group: Python to get connector location
python_connector_location = Python(IN[0]=flatten_11)  # IronPython2
# ---------- python_connector_location.python (41 lines) ----------
import clr

clr.AddReference("RevitServices")
import RevitServices
from RevitServices.Persistence import DocumentManager
from RevitServices.Transactions import TransactionManager
doc = DocumentManager.Instance.CurrentDBDocument

clr.AddReference("RevitAPI")
import Autodesk
from Autodesk.Revit.DB import *

clr.AddReference("RevitNodes")
import Revit
clr.ImportExtensions(Revit.Elements)
clr.ImportExtensions(Revit.GeometryConversion)

#Many thanks to Konrad K Sobon for his awesome ProcessList function!
def Unwrap(item):
	return UnwrapElement(item)

def ProcessList(_func, _list):
    return map( lambda x: ProcessList(_func, x) if type(x)==list else _func(x), _list )

if isinstance(IN[0], list):
	connectors = ProcessList(Unwrap, IN[0])
else:
	connectors = [Unwrap(IN[0])]
	
	
def getPoint(connector):
	try:
		return connector.Origin.ToPoint()
	except:
		return None


			
#Assign your output to the OUT variable.

OUT = ProcessList(getPoint, connectors)
# ----------------------------------------

Z_2 = Point.Z(point=python_connector_location)
sort_4 = List.Sort(list=Z_2, lacing=Longest)
indexOf_4 = List.IndexOf(list=Z_2, element=sort_4, lacing=Longest)
getItemAtIndex_12 = List.GetItemAtIndex(list=flatten_11, index=indexOf_4, lacing=Longest)
flatten_12 = List.Flatten(list=getItemAtIndex_12)

# group: Wait then Passthrough
code_block_67 = CodeBlock(passthrough=flatten_9, waitfor=setParameterByName_3) { [passthrough,waitfor][0]; }

# group: Python to get element connectors
python_connector_2 = Python(IN[0]=code_block_67)  # IronPython2; same code as python_connector

# group: Python to check if connector is connected
python_connector_is_connected_2 = Python(IN[0]=python_connector_2)  # IronPython2; same code as python_connector_is_connected

not_3 = Not(x=python_connector_is_connected_2)
filterByBoolMask_10 = List.FilterByBoolMask(list=python_connector_2, mask=not_3)

# group: Python to get connector location
python_connector_location_2 = Python(IN[0]=filterByBoolMask_10.in)  # IronPython2; same code as python_connector_location

Z_3 = Point.Z(point=python_connector_location_2)
sort_5 = List.Sort(list=Z_3, lacing=Longest)
indexOf_5 = List.IndexOf(list=Z_3, element=sort_5, lacing=Longest)
getItemAtIndex_13 = List.GetItemAtIndex(list=filterByBoolMask_10.in, index=indexOf_5, lacing=Longest)
flatten_13 = List.Flatten(list=getItemAtIndex_13)
list_create_7 = List.Create(item0=flatten_12, item1=flatten_13)
transpose = List.Transpose(lists=list_create_7)
firstItem_4 = List.FirstItem(list=transpose, lacing=Shortest)
lastItem_3 = List.LastItem(list=transpose, lacing=Shortest)

# group: Python to connect connectors
code_block_68 = CodeBlock(Connector1=firstItem_4) { Connector1; }
code_block_69 = CodeBlock(Connector2=lastItem_3) { Connector2; }
python = Python(IN[0]=code_block_68, IN[1]=code_block_69)  # IronPython2
# ---------- python.python (52 lines) ----------
import clr

clr.AddReference("RevitServices")
import RevitServices
from RevitServices.Persistence import DocumentManager
from RevitServices.Transactions import TransactionManager
doc = DocumentManager.Instance.CurrentDBDocument

clr.AddReference("RevitAPI")
import Autodesk
from Autodesk.Revit.DB import *

clr.AddReference("RevitNodes")
import Revit
clr.ImportExtensions(Revit.Elements)
clr.ImportExtensions(Revit.GeometryConversion)

#ProcessList function!
def Unwrap(item):
	return UnwrapElement(item)
	
def ProcessList(_func, _list):
    return map( lambda x: ProcessList(_func, x) if type(x)==list else _func(x), _list )

def ProcessList2(_func, _list, _list2):
    return map( lambda x,y: ProcessList2(_func, x, y) if type(x)==list else _func(x,y), _list, _list2 )

if isinstance(IN[0], list):
	connectors = IN[0]
else:
	connectors = [IN[0]]
	
if isinstance(IN[1], list):
	connectors2 = IN[1]
else:
	connectors2 = [IN[1]]
	
	
def ConnectTo(connector, conn2):
	bool = False
	try:
		TransactionManager.Instance.EnsureInTransaction(doc)
		connector.ConnectTo(conn2)
		bool = True
		TransactionManager.Instance.TransactionTaskDone()
	except:
		pass
	return bool

			
#Assign your output to the OUT variable.
OUT = ProcessList2(ConnectTo, connectors, connectors2)
# ----------------------------------------

code_block_70 = CodeBlock(passthrough=setParameterByName_3, waitfor=python) { [passthrough,waitfor][0]; }

# group: Python to get pipes connected to sizing connections
python_script_5 = Python(IN[0]=code_block_70)  # IronPython2
# ---------- python_script_5.python (22 lines) ----------
import clr
clr.AddReference('ProtoGeometry')
from Autodesk.DesignScript.Geometry import *
#The inputs to this node will be stored as a list in the IN variables.
if isinstance(IN[0], list):
	fittings = UnwrapElement(IN[0])
else:
	fittings = [UnwrapElement(IN[0])]

refs = []

for x in fittings:
	connset = x.MEPModel.ConnectorManager.Connectors
	conn_pipes = []
	for c in connset:
		if c.IsConnected:
			for lc in c.AllRefs:
				conn_pipes.append(lc.Owner)
	refs.append(conn_pipes)

#Assign your output to the OUT variable.
OUT = refs
# ----------------------------------------

# group: Get only pipes
getCategory_2 = Element.GetCategory(element=python_script_5)
name_6 = Category.Name(category=getCategory_2)
code_block_71 = CodeBlock { "Pipes"; }
eq_2 = name_6 == code_block_71
filterByBoolMask_11 = List.FilterByBoolMask(list=python_script_5, mask=eq_2)

firstItem_5 = List.FirstItem(list=filterByBoolMask_11.in, lacing=Longest)
flatten_14 = List.Flatten(list=firstItem_5)
getParameterValueByName_9 = Element.GetParameterValueByName(element=flatten_14, parameterName=code_block_64)

# group: Set 'Manual System Name' parameter
setParameterByName_4 = Element.SetParameterByName(element=setParameterByName_2, parameterName=code_block_64, value=getParameterValueByName_9)

# group: Wait then Passthrough
code_block_72 = CodeBlock(passthrough=list_create_6, waitfor=setParameterByName_4) { [passthrough,waitfor][0]; }

# group: Wait then Passthrough
code_block_73 = CodeBlock(passthrough=getItemAtIndex_8, waitfor=setParameterByName_4) { [passthrough,waitfor][0]; }

# group: Python to remove Routing Preference
remove_routing_preference_rule = Python(IN[0]=code_block_72, IN[1]=code_block_73)  # "Remove routing preference rule for this union if it is first"; IronPython2
# ---------- remove_routing_preference_rule.python (38 lines) ----------
# Enable Python support and load DesignScript library
import clr
clr.AddReference('ProtoGeometry')
from Autodesk.DesignScript.Geometry import *

# Import RevitAPI
clr.AddReference("RevitAPI")
import Autodesk
from Autodesk.Revit.DB import *

# Import DocumentManager and TransactionManager
clr.AddReference("RevitServices")
import RevitServices
from RevitServices.Persistence import DocumentManager
from RevitServices.Transactions import TransactionManager

# The inputs to this node will be stored as a list in the IN variables.
listOfPipeTypes = UnwrapElement(IN[0])
unionFamilyType = UnwrapElement(IN[1])

doc = DocumentManager.Instance.CurrentDBDocument

# Place your code below this line

TransactionManager.Instance.EnsureInTransaction(doc)

unions = RoutingPreferenceRuleGroupType.Unions

for pipeType in listOfPipeTypes:
	firstRule = pipeType.RoutingPreferenceManager.GetRule(unions, 0)
	if firstRule.MEPPartId == unionFamilyType.Id:
		prefs = pipeType.RoutingPreferenceManager
		prefs.RemoveRule(unions, 0)
	
TransactionManager.Instance.TransactionTaskDone()

# Assign your output to the OUT variable.
OUT = listOfPipeTypes
# ----------------------------------------
