# Dynamo graph Foul Drainage Systems_2b_Produce Calculations v.2.0.dyn (Dynamo 2.16.1.2727)
# packages: Data-Shapes 2021.2.92

# group: DYNAMO COLOUR CODING LEGEND
# note: COLOUR CODING LEGEND

# group: Monitor
# note: USE:
# FOR IMPORTANT WATCH NODES

# group: Conditional
# note: USE:
# FOR CONDITIONAL NODES

# group: Python
# note: USE:
# FOR PYTHON NODES

# group: To Revit
# note: USE:
# FOR CHANGES TO REVIT

# group: Control
# note: USE:
# FOR USER CONTROL (SLIDERS ETC.)

# group: Input
# note: USE:
# FOR FIXED INPUT (FILE PATHS ETC.)

# group: Background
# note: USE:
# FOR GENERAL WORKFLOW NODES

# group: Get all piping systems, filter them to only show Discharge
code_block = CodeBlock { "Piping Systems"; }
byName = Category.ByName(name=code_block)
all_elements_of_category = ElementsOfCategory(Category=byName)
elementType = Element.ElementType(element=all_elements_of_category)
name = Element.Name(element=elementType)
code_block_2 = CodeBlock { ["Ss_50_30_04_97 - Discharge", "Ss_50_30_04_97 - HT Discharge", "Ss_50_30_04_97 - Lab Discharge"]; }
contains = String.Contains(string=name, searchFor=code_block_2@L1)
filterByBoolMask = List.FilterByBoolMask(list=all_elements_of_category, mask=contains@L2)
flatten = List.Flatten(list=filterByBoolMask.in)
name_2 = Element.Name(element=flatten)

# group: Python to sort strings with numbers
python_to_sort_strings_with = Python(IN[0]=name_2)  # "Python to sort strings with numbers"; IronPython2
# ---------- python_to_sort_strings_with.python (10 lines) ----------
import re

list = IN[0]

def natural_sort(l): 
    convert = lambda text: int(text) if text.isdigit() else text.lower() 
    alphanum_key = lambda key: [ convert(c) for c in re.split('([0-9]+)', key) ] 
    return sorted(l, key = alphanum_key)

OUT = natural_sort(list)
# ----------------------------------------

indexOf = List.IndexOf(list=name_2, element=python_to_sort_strings_with)
getItemAtIndex = List.GetItemAtIndex(list=flatten, index=indexOf)

# group: User Interface
code_block_3 = CodeBlock { "Foul Drainage Systems Calculations"; null; "Proceed"; "Cancel"; 800; 700; 300; }
code_block_4 = CodeBlock { "Select System"; false; }
dropdown_data = Custom[DropDown Data](InputName=code_block_4.out0, Keys=python_to_sort_strings_with, Values=getItemAtIndex, Sorted_optional=code_block_4.out1)  # package Data-Shapes; Create data for DropDown input in UI.MultiInputForm ++ . Check out www.data-shapes.net for more infos.
code_block_5 = CodeBlock()
# ---------- code_block_5.designscript (6 lines) ----------
"Frequency Factor";
["Intermittent use, e.g. in dwelling, guesthouse, office",
"Frequent use, e.g. in hospital, school, restaurant, hotel",
"Congested use, e.g. in toilers and/or showers open to public",
"Special use, e.g. laboratory"];
[0.5, 0.7, 1, 1.2];
# ----------------------------------------
radiobuttons_data = Custom[RadioButtons Data](InputName=code_block_5.out0, Keys=code_block_5.out1, Values=code_block_5.out2)  # package Data-Shapes; Create radio buttons input for UI.MultipleInputForm ++ .
code_block_6 = CodeBlock { "System Type"; ["Primary Ventilated System", "Secondary Ventilated System"]; }
radiobuttons_data_2 = Custom[RadioButtons Data](InputName=code_block_6.out0, Keys=code_block_6.out1, Values=code_block_6.out1)
code_block_7 = CodeBlock { "Pumped or Continuous Discharge?"; ["Pumped Discharge","Continuous Discharge"]; }
radiobuttons_data_3 = Custom[RadioButtons Data](InputName=code_block_7.out0, Keys=code_block_7.out1, Values=code_block_7.out1)
list_create = List.Create(item0=dropdown_data, item1=radiobuttons_data, item2=radiobuttons_data_2, item3=radiobuttons_data_3)
boolean = BoolSelector(true)
multipleinputform = Custom[MultipleInputForm ++](Description_optional=code_block_3.out0, Logo_optional=code_block_3.out1, ButtonText_optional=code_block_3.out2, Inputs=list_create, Toggle=boolean, CancelButtonText_optional=code_block_3.out3, MaxHeight_optional=code_block_3.out4, Width_optional=code_block_3.out5, LabelWidth_optional=code_block_3.out6)  # package Data-Shapes; Create a form with multiple inputs. see www.data-shapes.net for tutorials and infos!

# group: User Selection: Selected Piping System
code_block_8 = CodeBlock(SelectedPipingSystem=multipleinputform.User_Inputs) { SelectedPipingSystem[0]; }

# group: User Selection: Frequency Factor
code_block_9 = CodeBlock(FrequencyFactor=multipleinputform.User_Inputs) { FrequencyFactor[1]; }

# group: Set 'Frequency Factor' parameter
code_block_10 = CodeBlock { "DP Frequency Factor (K)"; }
setParameterByName = Element.SetParameterByName(element=code_block_8, parameterName=code_block_10, value=code_block_9)

# group: User Selection: System Type
code_block_11 = CodeBlock(SystemType=multipleinputform.User_Inputs) { SystemType[2]; }

# group: Set System Type, i.e. Primary or Secondary ventilated system
code_block_12 = CodeBlock { 1; }
setParameterByName_2 = Element.SetParameterByName(element=code_block_8, parameterName=code_block_11, value=code_block_12)

# group: Python to Get All Elements in Piping System
python_all_elements_in_piping = Python(IN[0]=code_block_8)  # "Python: All Elements in Piping System"; IronPython2
# ---------- python_all_elements_in_piping.python (42 lines) ----------
import clr

clr.AddReference("RevitServices")
import RevitServices
from RevitServices.Persistence import DocumentManager
from RevitServices.Transactions import TransactionManager
doc = DocumentManager.Instance.CurrentDBDocument

clr.AddReference("RevitAPI")
import Autodesk
from Autodesk.Revit.DB import *

clr.AddReference("RevitNodes")
import Revit
clr.ImportExtensions(Revit.Elements)
clr.ImportExtensions(Revit.GeometryConversion)

#ProcessList function!
def Unwrap(item):
	return UnwrapElement(item)

def ProcessList(_func, _list):
    return map( lambda x: ProcessList(_func, x) if type(x)==list else _func(x), _list )

if isinstance(IN[0], list):
	systems = ProcessList(Unwrap, IN[0])
else:
	systems = [Unwrap(IN[0])]
	
	
def getNetwork(system):
	network = None
	try:
		network = [x.ToDSType(True) for x in system.PipingNetwork]
	except:
		pass
	return network

			
#Assign your output to the OUT variable.

OUT = ProcessList(getNetwork, systems)
# ----------------------------------------

# group: Get only pipes
getCategory = Element.GetCategory(element=python_all_elements_in_piping)
name_3 = Category.Name(category=getCategory)
code_block_13 = CodeBlock { "Pipes"; }
eq = name_3 == code_block_13
filterByBoolMask_2 = List.FilterByBoolMask(list=python_all_elements_in_piping, mask=eq)

get_all_discharge_pipes_with_du = CodeBlock(t3=filterByBoolMask_2.in)  # "Get All Discharge Pipes with DU>0"
# ---------- get_all_discharge_pipes_with_du.designscript (8 lines) ----------
t2 = t3;
DischargePipes = t2;
t1 = DischargePipes.GetParameterValueByName("Fixture Units");
DU = t1;
bool1 = DU > 0;
t4 = DSCore.List.FilterByBoolMask(t3, bool1);
t5 = Dictionary.ValueAtKey(t4, "in");
t6 = Dictionary.ValueAtKey(t4, "out");
# ----------------------------------------
get_fixture_units_parameter = CodeBlock(DischargePipes=get_all_discharge_pipes_with_du.t5) { DischargePipes.GetParameterValueByName("Fixture Units"); }

# group: Write 'DP ...' parameter based on user selection
code_block_14 = CodeBlock(k=code_block_9)
# ---------- code_block_14.designscript (5 lines) ----------
k== 0.5? "DP Intermittent Use":
k== 0.7? "DP Frequent Use":
k== 1? "DP Congested Use":
k== 1.2? "DP Special Use":
1;
# ----------------------------------------
setParameterByName_3 = Element.SetParameterByName(element=get_all_discharge_pipes_with_du.t5, parameterName=code_block_14, value=get_fixture_units_parameter)

# group: User Selection: Pumped or Continuous
code_block_15 = CodeBlock(PumpedOrContinuous=multipleinputform.User_Inputs) { PumpedOrContinuous[3]; }

# group: Check whether Pumped or Continuous was selected
code_block_16 = CodeBlock(lst=code_block_15) { lst==null? "null" : lst; }
code_block_17 = CodeBlock { ["Pumped", "Continuous"]; }
contains_2 = String.Contains(string=code_block_16, searchFor=code_block_17, lacing=CrossProduct)
identity = Object.Identity()  # unwired: object
trueForAny = List.TrueForAny(list=contains_2, queryFunction=identity)

# group: Python to get all elements in network
python_pipe_network = Python(IN[0]=code_block_8)  # IronPython2
# ---------- python_pipe_network.python (42 lines) ----------
import clr

clr.AddReference("RevitServices")
import RevitServices
from RevitServices.Persistence import DocumentManager
from RevitServices.Transactions import TransactionManager
doc = DocumentManager.Instance.CurrentDBDocument

clr.AddReference("RevitAPI")
import Autodesk
from Autodesk.Revit.DB import *

clr.AddReference("RevitNodes")
import Revit
clr.ImportExtensions(Revit.Elements)
clr.ImportExtensions(Revit.GeometryConversion)

#Many thanks to Konrad K Sobon for his awesome ProcessList function!
def Unwrap(item):
	return UnwrapElement(item)

def ProcessList(_func, _list):
    return map( lambda x: ProcessList(_func, x) if type(x)==list else _func(x), _list )

if isinstance(IN[0], list):
	systems = ProcessList(Unwrap, IN[0])
else:
	systems = [Unwrap(IN[0])]
	
	
def getNetwork(system):
	network = None
	try:
		network = [x.ToDSType(True) for x in system.PipingNetwork]
	except:
		pass
	return network

			
#Assign your output to the OUT variable.

OUT = ProcessList(getNetwork, systems)
# ----------------------------------------

# group: Get only pipes
getCategory_2 = Element.GetCategory(element=python_pipe_network)
name_4 = Category.Name(category=getCategory_2)
code_block_18 = CodeBlock { "Pipes"; }
contains_3 = String.Contains(string=name_4, searchFor=code_block_18)
filterByBoolMask_3 = List.FilterByBoolMask(list=python_pipe_network, mask=contains_3)

# group: Get lowest pipe in the system
code_block_19 = CodeBlock { "Invert Elevation"; }
getParameterValueByName = Element.GetParameterValueByName(element=filterByBoolMask_3.in, parameterName=code_block_19)
minimumItem = List.MinimumItem(list=getParameterValueByName)
indexOf_2 = List.IndexOf(list=getParameterValueByName, element=minimumItem, lacing=Longest)
getItemAtIndex_2 = List.GetItemAtIndex(list=filterByBoolMask_3.in, index=indexOf_2, lacing=Longest)

# group: Conditional
code_block_20 = CodeBlock(FirstUIWasRun=multipleinputform.Was_Run, FirstUIWasCancelled=multipleinputform.Was_Cancelled, UserSelectedPumpedOrContinuous=trueForAny) { FirstUIWasRun == true && FirstUIWasCancelled == false && UserSelectedPumpedOrContinuous == true? true : false; }

# group: User Interface
code_block_21 = CodeBlock { "Pumped Discharge Data"; }
code_block_22 = CodeBlock { "Continuous Discharge Data"; }
list_create_2 = List.Create(item0=code_block_21, item1=code_block_22)
code_block_23 = CodeBlock(x=contains_2, y=list_create_2) { x[0] == true?y[0]:y[1]; }
code_block_24 = CodeBlock { null; "Proceed"; "Cancel"; 800; 700; 400; }
code_block_25 = CodeBlock { "Select Element"; "Select Starting Element"; true; }
code_block_26 = CodeBlock()
# ---------- code_block_26.designscript (4 lines) ----------
["Pipes",
"Pipe Fittings",
"Pipe Accessories",
"Plumbing Fixtures"];
# ----------------------------------------
byName_2 = Category.ByName(name=code_block_26)
selectmodelelements_data = Custom[SelectModelElements Data](InputName=code_block_25.out0, ButtonText=code_block_25.out1, CategoryFilter=byName_2, SelectSingleElement=code_block_25.out2)  # package Data-Shapes; Creates a Revit element selection input for UI.MultipleInputForm++ . Check out www.data-shapes.net for more infos!
code_block_27 = CodeBlock { "Pumped Flow Rate [l/s]"; }
code_block_28 = CodeBlock { "Continuous Flow Rate [l/s]"; }
list_create_3 = List.Create(item0=code_block_27, item1=code_block_28)
code_block_29 = CodeBlock(x=contains_2, y=list_create_3) { x[0] == true? y[0] : y[1]; }
code_block_30 = CodeBlock { true; }
textbox_data = Custom[TextBox Data](InputName=code_block_29, IsNumberEntry=code_block_30)  # package Data-Shapes; Create Data for TextBox input in UI.MultipleInputForm ++ . Check out www.data-shapes.net for more informations
list_create_4 = List.Create(item0=selectmodelelements_data, item1=textbox_data)
multipleinputform_2 = Custom[MultipleInputForm ++](Description_optional=code_block_23, Logo_optional=code_block_24.out0, ButtonText_optional=code_block_24.out1, Inputs=list_create_4, Toggle=code_block_20, CancelButtonText_optional=code_block_24.out2, MaxHeight_optional=code_block_24.out3, Width_optional=code_block_24.out4, LabelWidth_optional=code_block_24.out5)

# group: User Selection: Selected Element
code_block_31 = CodeBlock(SelectedElement=multipleinputform_2.User_Inputs) { SelectedElement[0]; }

list_create_5 = List.Create(item0=getItemAtIndex_2, item1=code_block_31)

# group: Conditional
code_block_32 = CodeBlock(PumpedOrContinuous=trueForAny, x=list_create_5) { PumpedOrContinuous==false? x[0] : x[1]; }

# group: Python to get downstream elements
code_block_33 = CodeBlock(Element=code_block_32) { _Element; }
python_script = Python(IN[0]=code_block_33)  # IronPython2
# ---------- python_script.python (166 lines) ----------
import clr
import math

clr.AddReference("RevitServices")
import RevitServices
from RevitServices.Persistence import DocumentManager
from RevitServices.Transactions import TransactionManager
doc = DocumentManager.Instance.CurrentDBDocument

clr.AddReference("RevitAPI")
import Autodesk
from Autodesk.Revit.DB import *

clr.AddReference("RevitNodes")
import Revit
clr.ImportExtensions(Revit.Elements)
clr.ImportExtensions(Revit.GeometryConversion)
#The inputs to this node will be stored as a list in the IN variables.
if isinstance(IN[0], list):
	elements = UnwrapElement(IN[0])
else:
	elements = [UnwrapElement(IN[0])]
	
def getSize(x):
	try:
		conns = x.ConnectorManager.Connectors
	except:
		conns = x.MEPModel.ConnectorManager.Connectors
	maxsize = 0
	for c in conns:
		if c.Shape != ConnectorProfileType.Round:
			continue
		else:
			startsize = c.Radius * 2
		if startsize > maxsize:
			maxsize = startsize
	return maxsize
	
factor = 99999

def nextElement(elem,sys):
	sysname = next.get_Parameter(BuiltInParameter.RBS_SYSTEM_CLASSIFICATION_PARAM).AsString()
	for s in sysname.split(","):
		if s in sys.split(","):
			break
	else:
		return 4
	if "Return" in sysname or "Sanitary" in sysname:
		direction = FlowDirectionType.In
	else:
		direction = FlowDirectionType.Out
	try:
		connectors = elem.ConnectorManager.Connectors
		for conn in connectors:
			if conn.Domain != Domain.DomainPiping:
				continue
			elif conn.Direction == direction:
				continue
			else:
				endconn = conn
		for c in endconn.AllRefs:
			if c.Owner.Id.Equals(elem.Id):
				continue
			elif c.Owner.GetType() == Mechanical.MechanicalSystem or c.Owner.GetType() == Plumbing.PipingSystem:
				return 0
			else:
				newelem = c.Owner
		return newelem
	except AttributeError:
		connectors = elem.MEPModel.ConnectorManager.Connectors
		if connectors.Size == 1:
			for conn in connectors:
				if conn.Domain != Domain.DomainPiping:
					continue
				endconn = conn
			if endconn.AllRefs.Size == 1:
				for c in endconn.AllRefs:
					if c.Owner.GetType() == Mechanical.MechanicalSystem or c.Owner.GetType() == Plumbing.PipingSystem:
						return 1
			for c in endconn.AllRefs:
				if c.Owner.Id.Equals(elem.Id):
					continue
				elif c.Owner.GetType() == Mechanical.MechanicalSystem or c.Owner.GetType() == Plumbing.PipingSystem:
					continue
				else:
					newelem = c.Owner
			return newelem
		elif connectors.Size == 2:
			for conn in connectors:
				if conn.Domain != Domain.DomainPiping:
					continue
				if conn.Direction == direction:
					continue
				else:
					endconn = conn
			if endconn.AllRefs.Size == 1:
				for c in endconn.AllRefs:
					if c.Owner.GetType() == Mechanical.MechanicalSystem or c.Owner.GetType() == Plumbing.PipingSystem:
						return 2
			for c in endconn.AllRefs:
				if c.Owner.Id.Equals(elem.Id):
					continue
				elif c.Owner.GetType() == Mechanical.MechanicalSystem or c.Owner.GetType() == Plumbing.PipingSystem:
					continue
				else:
					newelem = c.Owner
			return newelem
		else:
			for conn in connectors:
				if conn.Domain != Domain.DomainPiping:
					continue
				if conn.Direction != direction:
					endconn = conn
			if endconn.AllRefs.Size == 1:
				for c in endconn.AllRefs:
					if c.Owner.GetType() == Mechanical.MechanicalSystem or c.Owner.GetType() == Plumbing.PipingSystem:
						return 3
			for c in endconn.AllRefs:
				if c.Owner.Id.Equals(elem.Id):
					continue
				elif c.Owner.GetType() == Mechanical.MechanicalSystem or c.Owner.GetType() == Plumbing.PipingSystem:
					continue
				else:
					newelem = c.Owner
			return newelem

result = []
endlist = []
for j,x in enumerate(elements):
	listout = []
	ids = []
	sysclass = x.get_Parameter(BuiltInParameter.RBS_SYSTEM_CLASSIFICATION_PARAM).AsString()
	startsize = getSize(x)
	next = x
	i = 0
	while True:
		if i > 1000:
			result.append(next.Id.ToString() + ": end of loop")
			break
		try:
			next = nextElement(next,sysclass)
			i += 1
		except Exception as e:
			result.append(next.Id.ToString() + ": probably a direction error")
			break		
		if isinstance(next, int):
			result.append(next.ToString() + ": open end or different system classification")
			break
		if next.Id in ids:
			result.append(next.Id.ToString() + ": double element")
			break
		i += 1
		nextsize = getSize(next)
		if nextsize > startsize * factor:
			result.append(next.Id.ToString() + ": size end")
			break
		ids.append(next.Id)
		listout.append(next)
	endlist.append(listout)


#Assign your output to the OUT variable.
if len(endlist) == 1:
	OUT = listout, result
else:
	OUT = endlist, result
# ----------------------------------------
code_block_34 = CodeBlock(x=python_script) { x[0]; }
code_block_35 = CodeBlock(Elements=code_block_34) { _Elements; }

getCategory_3 = Element.GetCategory(element=code_block_35)
name_5 = Category.Name(category=getCategory_3)
code_block_36 = CodeBlock { "Pipes"; }
contains_4 = String.Contains(string=name_5, searchFor=code_block_36)
filterByBoolMask_4 = List.FilterByBoolMask(list=code_block_35, mask=contains_4)
code_block_37 = CodeBlock { "DP Pumped Flow Rate"; }
code_block_38 = CodeBlock { "DP Continuous Flow Rate"; }
list_create_6 = List.Create(item0=code_block_37, item1=code_block_38)

# group: Conditional
code_block_39 = CodeBlock(x=contains_2, y=list_create_6) { x[0]==true? y[0]:y[1]; }

empty = List.Empty()
list_create_7 = List.Create(item0=multipleinputform_2.User_Inputs, item1=empty)

# group: Conditional
code_block_40 = CodeBlock(PumpedOrContinuous=trueForAny) { PumpedOrContinuous == false? 0: 1; }

getItemAtIndex_3 = List.GetItemAtIndex(list=list_create_7@L2, index=code_block_40, lacing=Shortest)
string_from_object = FromObject(obj=getItemAtIndex_3)
code_block_41 = CodeBlock { "Set toggle to true!"; }
contains_5 = String.Contains(string=string_from_object, searchFor=code_block_41)

# group: Conditional
code_block_42 = CodeBlock(lst=contains_5, dischargevalue=getItemAtIndex_3) { lst == true? "" : dischargevalue; }

getParameterValueByName_2 = Element.GetParameterValueByName(element=filterByBoolMask_4.in, parameterName=code_block_39)

# group: Conditional
code_block_43 = CodeBlock(lst=getParameterValueByName_2) { lst>0.001?lst:null; }
code_block_44 = CodeBlock(lst=code_block_43) { lst==null?0:lst; }

# group: Write 'DP Pumped Flow Rate' OR 'DP Continuous Flow Rate' parameter based on selection
add = code_block_42 + code_block_44  # lacing=Longest
setParameterByName_4 = Element.SetParameterByName(element=filterByBoolMask_4.in, parameterName=code_block_39, value=add, lacing=Longest)

# group: Wait then passthrough
code_block_45 = CodeBlock(passthrough=get_all_discharge_pipes_with_du.t5, waitfor=setParameterByName_4) { [passthrough,waitfor][0]; }

flatten_2 = List.Flatten(list=code_block_45)

# group: Calculate Flow Rates
calculate_discharge_flow_rates = CodeBlock(DU=get_fixture_units_parameter, k=code_block_9) { Flow = Math.Sqrt(DU) * k; }
flatten_3 = List.Flatten(list=calculate_discharge_flow_rates)

# group: Write 'DP Waste Water Flow Rate' parameter
code_block_46 = CodeBlock { "DP Waste Water Flow Rate"; }
setParameterByName_5 = Element.SetParameterByName(element=flatten_2, parameterName=code_block_46, value=flatten_3)

# group: Calculate Total Discharge Flow Rate
code_block_47 = CodeBlock { "DP Waste Water Flow Rate"; "DP Continuous Flow Rate"; "DP Pumped Flow Rate"; }
getParameterValueByName_3 = Element.GetParameterValueByName(element=setParameterByName_5, parameterName=code_block_47.out0)
code_block_48 = CodeBlock(lst=getParameterValueByName_3) { lst>0.001? lst : null; }
code_block_49 = CodeBlock(lst=code_block_48) { lst==null? 0 : lst; }
getParameterValueByName_4 = Element.GetParameterValueByName(element=setParameterByName_5, parameterName=code_block_47.out1)
code_block_50 = CodeBlock(lst=getParameterValueByName_4) { lst>0.001? lst : null; }
code_block_51 = CodeBlock(lst=code_block_50) { lst==null? 0 : lst; }
getParameterValueByName_5 = Element.GetParameterValueByName(element=setParameterByName_5, parameterName=code_block_47.out2)
code_block_52 = CodeBlock(lst=getParameterValueByName_5) { lst>0.001? lst : null; }
code_block_53 = CodeBlock(lst=code_block_52) { lst==null? 0 : lst; }
code_block_54 = CodeBlock(Qww=code_block_49, Qc=code_block_51, Qp=code_block_53) { Qtot=Qww+Qc+Qp; }

# group: Write 'DP Total Flow Rate' parameter
code_block_55 = CodeBlock { "DP Total Flow Rate"; }
setParameterByName_6 = Element.SetParameterByName(element=setParameterByName_5, parameterName=code_block_55, value=code_block_54)

# group: Write 'DP Frequency Factor' parameter
code_block_56 = CodeBlock { "DP Frequency Factor (K)"; }
setParameterByName_7 = Element.SetParameterByName(element=flatten_2, parameterName=code_block_56, value=code_block_9, lacing=Longest)
