# Dynamo graph Foul Drainage Systems_3_Export Data to Excel v.2.0.dyn (Dynamo 2.16.1.2727)
# packages: Data-Shapes 2021.2.92, BumbleBee 2021.25.3

# group: DYNAMO COLOUR CODING LEGEND
# note: COLOUR CODING LEGEND

# group: Monitor
# note: USE:
# FOR IMPORTANT WATCH NODES

# group: Conditional
# note: USE:
# FOR CONDITIONAL NODES

# group: Python
# note: USE:
# FOR PYTHON NODES

# group: To Revit
# note: USE:
# FOR CHANGES TO REVIT

# group: Input
# note: USE:
# FOR FIXED INPUT (FILE PATHS ETC.)

# group: Control
# note: USE:
# FOR USER CONTROL (SLIDERS ETC.)

# group: Background
# note: USE:
# FOR GENERAL WORKFLOW NODES

# group: Get all piping systems, filter them to only show Discharge
code_block = CodeBlock { "Piping Systems"; }
byName = Category.ByName(name=code_block)
all_elements_of_category = ElementsOfCategory(Category=byName)
elementType = Element.ElementType(element=all_elements_of_category)
name = Element.Name(element=elementType)
code_block_2 = CodeBlock { ["Ss_50_30_04_97 - Discharge", "Ss_50_30_04_97 - HT Discharge", "Ss_50_30_04_97 - Lab Discharge"]; }
contains = String.Contains(string=name, searchFor=code_block_2@L1)
filterByBoolMask = List.FilterByBoolMask(list=all_elements_of_category, mask=contains@L2)
flatten = List.Flatten(list=filterByBoolMask.in)
name_2 = Element.Name(element=flatten)

# group: Python to sort strings with numbers
python_to_sort_strings_with = Python(IN[0]=name_2)  # "Python to sort strings with numbers"; IronPython2
# ---------- python_to_sort_strings_with.python (10 lines) ----------
import re

list = IN[0]

def natural_sort(l): 
    convert = lambda text: int(text) if text.isdigit() else text.lower() 
    alphanum_key = lambda key: [ convert(c) for c in re.split('([0-9]+)', key) ] 
    return sorted(l, key = alphanum_key)

OUT = natural_sort(list)
# ----------------------------------------

indexOf = List.IndexOf(list=name_2, element=python_to_sort_strings_with)
getItemAtIndex = List.GetItemAtIndex(list=flatten, index=indexOf)

# group: User Interface
code_block_3 = CodeBlock { "Export Foul Drainage Data to Excel"; null; "Proceed"; "Cancel"; 800; 700; 300; }
code_block_4 = CodeBlock { "Select Systems"; 240; false; }
listview_data = Custom[Listview Data](InputName=code_block_4.out0, Keys=python_to_sort_strings_with, Values=getItemAtIndex, Height_optionnal=code_block_4.out1, SortItems_optionnal=code_block_4.out2, ShowId_optionnal=code_block_4.out2)  # package Data-Shapes; Create data for ListView input in UI.MultiInputForm ++ . Check out www.data-shapes.net for more infos.
code_block_5 = CodeBlock { "Use 'Manual System Name' Parameter?"; ["Yes","No"]; [true, false]; }
radiobuttons_data = Custom[RadioButtons Data](InputName=code_block_5.out0, Keys=code_block_5.out1, Values=code_block_5.out2)  # package Data-Shapes; Create radio buttons input for UI.MultipleInputForm ++ .
code_block_6 = CodeBlock { "Excel File"; "Browse..."; "Select Foul Drainage Calculations file"; }
filepath_data = Custom[FilePath Data](InputName=code_block_6.out0, DefaulPath=code_block_6.out1, ButtonText=code_block_6.out2)  # package Data-Shapes; Create filepath input for UI.MultipleInputForm ++ . Check out www.data-shapes.net for more infos !
list_create = List.Create(item0=listview_data, item1=radiobuttons_data, item2=filepath_data)
boolean = BoolSelector(true)
multipleinputform = Custom[MultipleInputForm ++](Description_optional=code_block_3.out0, Logo_optional=code_block_3.out1, ButtonText_optional=code_block_3.out2, Inputs=list_create, Toggle=boolean, CancelButtonText_optional=code_block_3.out3, MaxHeight_optional=code_block_3.out4, Width_optional=code_block_3.out5, LabelWidth_optional=code_block_3.out6)  # package Data-Shapes; Create a form with multiple inputs. see www.data-shapes.net for tutorials and infos!

# group: Conditional
code_block_7 = CodeBlock(FirstUIWasRun=multipleinputform.Was_Run, FirstUIWasCancelled=multipleinputform.Was_Cancelled) { FirstUIWasRun == true && FirstUIWasCancelled == false? true : false; }

# group: User Selection: Selected Excel File
code_block_8 = CodeBlock(ExcelFile=multipleinputform.User_Inputs) { ExcelFile[2]; }

code_block_9 = CodeBlock { true; }
code_block_10 = CodeBlock { ""; }
code_block_11 = CodeBlock()
# ---------- code_block_11.designscript (8 lines) ----------
["Level Ref",
"Element ID",
"Diameter",
"Discharge Units",
"Qww [L/s]",
"Qc [L/s]",
"Qp [L/s]",
"Qtot [L/s]"];
# ----------------------------------------
count = List.Count(list=code_block_11)
ofRepeatedItem = List.OfRepeatedItem(item=code_block_10, amount=count)

# group: User Selection: Selected Piping System
code_block_12 = CodeBlock(SelectedPipingSystem=multipleinputform.User_Inputs) { SelectedPipingSystem[0]; }

# group: Python to get all elements in network
python_pipe_network = Python(IN[0]=code_block_12)  # IronPython2
# ---------- python_pipe_network.python (42 lines) ----------
import clr

clr.AddReference("RevitServices")
import RevitServices
from RevitServices.Persistence import DocumentManager
from RevitServices.Transactions import TransactionManager
doc = DocumentManager.Instance.CurrentDBDocument

clr.AddReference("RevitAPI")
import Autodesk
from Autodesk.Revit.DB import *

clr.AddReference("RevitNodes")
import Revit
clr.ImportExtensions(Revit.Elements)
clr.ImportExtensions(Revit.GeometryConversion)

#Many thanks to Konrad K Sobon for his awesome ProcessList function!
def Unwrap(item):
	return UnwrapElement(item)

def ProcessList(_func, _list):
    return map( lambda x: ProcessList(_func, x) if type(x)==list else _func(x), _list )

if isinstance(IN[0], list):
	systems = ProcessList(Unwrap, IN[0])
else:
	systems = [Unwrap(IN[0])]
	
	
def getNetwork(system):
	network = None
	try:
		network = [x.ToDSType(True) for x in system.PipingNetwork]
	except:
		pass
	return network

			
#Assign your output to the OUT variable.

OUT = ProcessList(getNetwork, systems)
# ----------------------------------------

# group: Check if piping system contains "HL_FoulDrainage_SizingConnection" family
code_block_13 = CodeBlock { "Family"; }
getParameterValueByName = Element.GetParameterValueByName(element=python_pipe_network, parameterName=code_block_13)
string_from_object = FromObject(object=getParameterValueByName)
code_block_14 = CodeBlock { "HL_FoulDrainage_SizingConnection"; }
contains_2 = String.Contains(string=string_from_object, searchFor=code_block_14)
identity = Object.Identity()  # unwired: object
trueForAny = List.TrueForAny(list=contains_2, queryFunction=identity, lacing=Longest)

filterByBoolMask_2 = List.FilterByBoolMask(list=python_pipe_network, mask=trueForAny)

# group: Get only pipes
getCategory = Element.GetCategory(element=filterByBoolMask_2.in)
name_3 = Category.Name(category=getCategory)
code_block_15 = CodeBlock { "Pipes"; }
contains_3 = String.Contains(string=name_3, searchFor=code_block_15)
filterByBoolMask_3 = List.FilterByBoolMask(list=filterByBoolMask_2.in, mask=contains_3)

# group: Get lowest pipe in the system
code_block_16 = CodeBlock { "Invert Elevation"; }
getParameterValueByName_2 = Element.GetParameterValueByName(element=filterByBoolMask_3.in, parameterName=code_block_16)
minimumItem = List.MinimumItem(list=getParameterValueByName_2, lacing=Longest)
allIndicesOf = List.AllIndicesOf(list=getParameterValueByName_2, item=minimumItem, lacing=Longest)
getItemAtIndex_2 = List.GetItemAtIndex(list=filterByBoolMask_3.in, index=allIndicesOf, lacing=Longest)
flatten_2 = List.Flatten(list=getItemAtIndex_2)

# group: Python to evaluate elements in each network and output a sublist for each branch
network_evaluator = Python(IN[0]=flatten_2)  # IronPython2
# ---------- network_evaluator.python (397 lines) ----------
# Enable Python support and load DesignScript library
import clr
clr.AddReference('ProtoGeometry')
from Autodesk.DesignScript.Geometry import *

clr.AddReference("RevitAPI")
import Autodesk
from Autodesk.Revit.DB import *

clr.AddReference("RevitNodes")
import Revit
clr.ImportExtensions(Revit.Elements)

# The inputs to this node will be stored as a list in the IN variables.
# Angled branching network evaluator by Jared Linden jaredlindena@hoarelea.com 

dataEnteringNode = UnwrapElement(IN[0])

debug = []

class Run:

	def __init__(self, _number, _parent, _start_id):
		self.parent = _parent
		self.start_id = _start_id
		self.number = _number
		self.__branches = 0
		
	def depth(self):
		return self.parent.depth() + 1 if self.parent else 1
		
	def runString(self):
		return str(self.number) if self.parent is None else self.parent.runString() + "." + str(self.number)
		
	def branch(self, start_id):
		self.__branches += 1
		return Run(self.__branches, self, start_id)
		
	def __eq__(self, other):
		if not isinstance(other, Run): 
			return False
		return self.number == other.number and self.depth() == other.depth() if self.parent == other.parent else False
		
	def __lt__(self, other):
		if self.depth() == other.depth() and self.number == other.number:
			return self.parent < other.parent if self.parent else - 1
		else:
			return self.number < other.number if self.depth() == other.depth() else self.depth() < other.depth()
	
	def __hash__(self):
		return self.number * 31 + self.depth()
	

class Edge:
	
	def __init__(self, _run, _start_connector):
		self.run = _run
		self.end = None
		self.start = _start_connector.node
		self.__connector = _start_connector
		
	def evaluate(self):
		current = self.__connector.connectedElement()
		while(isinstance(current, SectionElement)):
			current = current.nextElement()
		self.end = current
		
class ConnectorHelper:
	
	def __init__(self, _node, _connector, _element_container):
		self.node = _node
		self.id = connected(_connector).Owner.Id.IntegerValue
		self.direction = _connector.CoordinateSystem.BasisZ
		self.edge = None
		self.__connector = _connector
		self.__element_container = _element_container
		
	def setEdge(self, _edge):
		self.edge = _edge
		
	def hasEvaluated(self):
		return self.edge is not None
		
	def evaluateEdge(self, run):
		self.edge = Edge(run, self)
		self.edge.evaluate()

		
	def connectedElement(self):
		return self.__element_container.getNetworkElement(connected(self.__connector).Owner, self.node, self.edge)

class SectionElement:

	def __init__(self, _elem, _edge, _prev_id, _source, _added):
		self.edge = _edge
		self.added = _added
		self.prev_id = _prev_id
		self.element = _elem
		self.source = _source
		self.id = _elem.Id.IntegerValue
		self.main_run = _edge.run
		
	def getMainRun(self):
		return self.edge.run
		
	def nextElement(self):
		try:
			next_elem = next(iter(y.Owner for y in [connected(x) for x in getNodeConnectors(self.element)] if y.Owner.Id.IntegerValue != self.prev_id))
		except:
			next_elem = next(iter(y.Owner for y in [connected(x) for x in getAllConnectors(self.element)] if y.Owner.Id.IntegerValue != self.prev_id))
		return self.source.getNetworkElement(next_elem, self, self.edge)


class TerminalElement:
	def __init__(self, _element, _edge, _added):
		self.element = _element
		self.added = _added
		self.edge = _edge
		self.id = _element.Id.IntegerValue
		
	def getMainRun(self):
		return self.edge.run


class BranchElement(object):
	
	def __init__(self, element):
		self.id = element.Id.IntegerValue


class StartElement(BranchElement):
	
	def __init__(self, _element, _run, _element_source, _added):
		self.element = _element
		self.__source = _element_source
		self.added = _added
		self.main_run = _run
		self.paused = False
		self.id = _element.Id.IntegerValue
		self.__connectors = [ConnectorHelper(self, x, _element_source) for x in getAllConnectors(_element)]
		if len(self.__connectors) != 0:
			self.__out1 = self.__connectors[0]
			self.__out2 = None
			if len(self.__connectors) > 1:
				self.__out2 = self.__connectors[1]
		super(StartElement, self).__init__(_element)
		
	def getMainRun(self):
		return self.main_run

	def hasMainNext(self):
		return True
	
	def evaluateMain(self):
		if not self.__out1.hasEvaluated():
			return self.__out1.evaluateEdge(self.main_run)
		elif self.__out2 is not None and not self.__out2.hasEvaluated():
			return self.__out2.evaluateEdge(self.main_run)
		else:
			return self.__out1.evaluateEdge(self.main_run)
			
	def evaluateNextBranch(self):
		con = sorted((x for x in self.__connectors if not x.hasEvaluated()), key = lambda x: self.__out1.direction.AngleTo(x.direction))[0]
		con.evaluateEdge(self.getMainRun().branch(self.id))
		
	def hasEvaluated(self):
		return all(x.hasEvaluated() for x in self.__connectors)
		
	def hasEvaluatedMain(self):
		return self.__out1.hasEvaluated() and (self.__out2 is None or self.__out2.hasEvaluated())
		
	def setIncomingEdge(self, connector_id, edge):
		[x for x in self.__connectors if x.id == connector_id][0].setEdge(edge)
			

class NodeElement(BranchElement):

	def __init__(self, _element, _edge, _prev_id, _source, _added):
		self.element = _element
		self.__source = _source
		self.__prev_id = _prev_id
		self.id = _element.Id.IntegerValue
		self.added = _added
		self.__connectors = [ConnectorHelper(self, x, _source) for x in getAllConnectors(_element)]
		self.paused = False
		next(iter(x for x in self.__connectors if x.id == _prev_id)).setEdge(_edge)
		self.paused = not self.hasMainNext()
		super(NodeElement, self).__init__(_element)
		
	def inConnectors(self):
		return (x for x in self.__connectors if x.edge is not None and x.edge.start.id != self.id)
		
	def getInMain(self):
		return sorted(self.inConnectors(), key = lambda x: x.edge.run)[0]
		
	def getMainRun(self):
		return sorted((x for x in self.__connectors if x.hasEvaluated()), key = lambda x: x.edge.run)[0].edge.run
		
	def hasMainNext(self):
		main_in_dir = self.getInMain().direction.Negate()
		return len([x for x in self.__connectors if not x.hasEvaluated()]) == 1 or any(x for x in self.__connectors if x.direction.AngleTo(main_in_dir) < 0.05 and not x.hasEvaluated())
		
	def evaluateMain(self):
		self.paused = False
		main_in_dir = self.getInMain().direction.Negate()
		sorted((x for x in self.__connectors if not x.hasEvaluated()), key = lambda x: main_in_dir.AngleTo(x.direction))[0].evaluateEdge(self.getMainRun())
		
	def evaluateNextBranch(self):
		main_in_dir = self.getInMain().direction.Negate()
		con = sorted((x for x in self.__connectors if not x.hasEvaluated()), key = lambda x: main_in_dir.AngleTo(x.direction))[0]
		con.evaluateEdge(self.getMainRun().branch(self.id))
		
	def hasEvaluated(self):
		return all(x.hasEvaluated() for x in self.__connectors)
		
	def hasEvaluatedMain(self):
		return len([x for x in self.__connectors if x.hasEvaluated() and x.edge.run == self.getMainRun()]) == 2
		
	def setIncomingEdge(self, connector_id, edge):
		next(iter(x for x in self.__connectors if x.id == connector_id)).setEdge(edge)
		
			
class ElementContainer:

	def __init__(self):
		self.__elems = {}
		self.__number = 1
		
	def getNetworkElement(self, element, prev, edge):
		id = element.Id.IntegerValue
		if id in self.__elems:
			elem = self.__elems[id]
			if isinstance(elem, NodeElement):
				elem.setIncomingEdge(prev.id, edge)
			return elem
		else:
			if isNodeElement(element):
				new = NodeElement(element, edge, prev.id, self, self.__number)
			elif isSectionElement(element):
				new = SectionElement(element, edge, prev.id, self, self.__number)
			elif isTermainalElement(element):
				new = TerminalElement(element, edge, self.__number)
			else:
				raise Exception("Unknow element type connected to network")
			self.__elems[id] = new
			self.__number += 1
			return new
			
	def networkElements(self):
		return sorted(sorted(self.__elems.values(), key = lambda x:x.getMainRun()), key = lambda y:y.added)
		
	def setStart(self, start_node):
		self.__elems[start_node.id] = start_node
		
	def nodes(self):
		return (x for x in self.__elems.values() if isinstance(x, BranchElement)) #or isinstance(x, NodeElement))


def isValidConnector(connector):
	return (connector.ConnectorType == ConnectorType.End or connector.ConnectorType == ConnectorType.Curve) and connector.IsConnected and (isinstance(connector.Owner, MEPCurve) or isinstance(connector.Owner, FamilyInstance))

#Return Connector
def connected(connector):
	try:
		return [x for x in connector.AllRefs if isValidConnector(x) and x.Owner.Id.IntegerValue != connector.Owner.Id.IntegerValue][0]
	except:
		raise Exception("Connector not connected")
	
def connectedId(connector):
	return connected(connector).Owner.Id.IntegerValue
	
def getAllConnectors(element):
	try:
		connectors = element.MEPModel.ConnectorManager.Connectors
	except:
		connectors = element.ConnectorManager.Connectors
	return [x for x in connectors if isValidIterableConnector(x)]
	
def isValidIterableConnector(connector):
	return isValidConnector(connector) and len([x for x in connected(connector).ConnectorManager.Connectors]) > 1
	
def getNodeConnectors(element):
	return [x for x in getAllConnectors(element) if not isPipeConnectedToCap(connected(x).Owner)]
	
def isPipeConnectedToCap(elem):
	try:
		length = elem.Location.Curve.Length
	except:
		length = 10
	if length > 1.5:
		return False
	try:
		connectors = elem.MEPModel.ConnectorManager.Connectors
	except:
		connectors = elem.ConnectorManager.Connectors
	return any(len([y for y in connected(x).ConnectorManager.Connectors if isValidConnector(y)]) < 2 for x in [z for z in connectors if isValidConnector(z)])
	
def isSectionElement(element):
	return len(getAllConnectors(element)) == 2 or len(getNodeConnectors(element)) == 2
	
def isNodeElement(element):
	return len(getNodeConnectors(element)) > 2
	
def isTermainalElement(element):
	return len(getAllConnectors(element)) == 1 or len(getNodeConnectors(element)) == 1
	
def firstOrNone(list):
	return next(iter(list), None)
	
def mainLoop(root_element):

	element_container = ElementContainer()
	root_run = Run(1, None, root_element.Id.IntegerValue)
	start_node = StartElement(root_element, root_run, element_container, 0)
	element_container.setStart(start_node)
	
	safety = 0
	while firstOrNone(x for x in element_container.nodes() if not x.hasEvaluated()) is not None:
		ordered_unevaluated = sorted(sorted((x for x in element_container.nodes() if not x.hasEvaluated()), key = lambda x: x.getMainRun()), key = lambda y:y.added)
		safety +=1
		if safety > 999:
			raise Exception("To many loops")
		first_with_next = firstOrNone((x for x in ordered_unevaluated if not x.hasEvaluatedMain() and not x.paused and x.hasMainNext()))
		if first_with_next is not None:
			first_with_next.evaluateMain()
			continue
			
		first_with_branch = firstOrNone((x for x in ordered_unevaluated if x.hasEvaluatedMain() and not x.paused))
		if first_with_branch is not None:
			first_with_branch.evaluateNextBranch()
			continue
			
		first_paused_with_main = firstOrNone((x for x in ordered_unevaluated if x.hasMainNext() and x.paused and not x.hasEvaluatedMain()))
		if first_paused_with_main is not None:
			first_paused_with_main.evaluateMain()
			continue
			
		first_paused_branch = firstOrNone((x for x in ordered_unevaluated if not x.hasEvaluatedMain() and x.paused))
		if first_paused_branch is not None:
			first_paused_branch.evaluateMain()
			continue
			
		raise Exception("Unknown state")
	return element_container.networkElements()


	
in_elements = dataEnteringNode


output = []


def addToRunsDict(elem, runsdict):
	run = elem.getMainRun()
	runstart = run.start_id
	runstring = run
	if runstart not in runsdict:
		runsdict[runstart] = {}
	if runstring not in runsdict[runstart]:
		runsdict[runstart][runstring] = []
	runsdict[runstart][runstring].append(elem)
	
safe1 = 0

def getRunElements(elems, runsdict):
	list = []
	global safe1
	safe1 +=1
	if safe1 > 100:
		raise Exception("Too many recursions")
	sorted_elems = sorted(elems, key = lambda x:x.added)
	for x in sorted_elems:
		list.append(x.element)
		if x.id in runsdict:
			for key in sorted(runsdict[x.id].keys()):
				subl = runsdict[x.id].pop(key)
				list.append(getRunElements(subl, runsdict))
	return list
	
networks = []
all_done =[]
for element in (me for me in in_elements if me.Id.IntegerValue not in all_done):
	runsdict = {}
	output = []
	network = mainLoop(element)
	for x in network:
		addToRunsDict(x, runsdict)
	
	#done_list.append(element.Id.IntegerValue)
	first = runsdict[element.Id.IntegerValue].keys()[0]
	lems = runsdict[element.Id.IntegerValue].pop(first)
	networks.append(getRunElements(lems, runsdict))
	all_done.extend([x.id for x in network])
#debug = [[x.getMainRun().runString(), x.element, x.added, x] for x in network]

OUT = networks#, debug
# ----------------------------------------
code_block_17 = CodeBlock(out=network_evaluator) { out; }

flatten_3 = List.Flatten(list=code_block_17)

# group: Get only pipes
getCategory_2 = Element.GetCategory(element=flatten_3)
string_from_object_2 = FromObject(obj=getCategory_2)
code_block_18 = CodeBlock { "Pipes"; }
contains_4 = String.Contains(string=string_from_object_2, searchFor=code_block_18)

filterByBoolMask_4 = List.FilterByBoolMask(list=flatten_3, mask=contains_4)

# group: Python to get a number for each item in a list depending on depth and sub list number
code_block_19 = CodeBlock(ElementTree=code_block_17) { ElementTree; TreeNumber=1; }
get_tag = Python(IN[0]=code_block_19.ElementTree, IN[1]=code_block_19.TreeNumber)  # IronPython2
# ---------- get_tag.python (41 lines) ----------
# Enable Python support and load DesignScript library
import clr
clr.AddReference('ProtoGeometry')
from Autodesk.DesignScript.Geometry import *

#By Jared Linden jaredlinden@hoarela.com
# The inputs to this node will be stored as a list in the IN variables.
dataEnteringNode = IN[0]
number = IN[1]

output = []

#Sweet sweet recursion
def GetTagRecursive(item, current_branch):
		
	item_tags = []
	
	next_branches = current_branch[:]+[0]
	for x in item:
		#Check iterable
		if isinstance(x,list):
			next_branches[-1] = next_branches[-1] + 1
			item_tags.append(GetTagRecursive(x, next_branches))
		else:
			st = str(current_branch[0])
			for i in current_branch[1:]:
				st += "." + str(i)
			item_tags.append(st)
	return item_tags	
	
current_number = number
for network in dataEnteringNode:
	network_tags = []
	blobs = GetTagRecursive(network, [number])
	for x in blobs:
		network_tags.append(x)
	output.append(network_tags)
	number +=1

# Assign your output to the OUT variable.
OUT = output
# ----------------------------------------
flatten_4 = List.Flatten(list=get_tag)

filterByBoolMask_5 = List.FilterByBoolMask(list=flatten_4, mask=contains_4)
groupByKey = List.GroupByKey(list=filterByBoolMask_4.in, keys=filterByBoolMask_5.in)

# group: Get only discharge pipes
code_block_20 = CodeBlock { "System Classification"; }
getParameterValueByName_3 = Element.GetParameterValueByName(element=groupByKey.groups, parameterName=code_block_20)
code_block_21 = CodeBlock { "Sanitary"; }
contains_5 = String.Contains(string=getParameterValueByName_3, searchFor=code_block_21)
filterByBoolMask_6 = List.FilterByBoolMask(list=groupByKey.groups, mask=contains_5)

# group: Get only pipes with DU > 0
reverse = List.Reverse(list=filterByBoolMask_6.in, lacing=Longest)
code_block_22 = CodeBlock { "Fixture Units"; }
getParameterValueByName_4 = Element.GetParameterValueByName(element=reverse, parameterName=code_block_22)
code_block_23 = CodeBlock { 0; }
ne = getParameterValueByName_4 != code_block_23
filterByBoolMask_7 = List.FilterByBoolMask(list=reverse, mask=ne, lacing=Longest)

# group: Get first indices of pipes with DU's > 0
code_block_24 = CodeBlock { "Fixture Units"; }
getParameterValueByName_5 = Element.GetParameterValueByName(element=filterByBoolMask_7.in, parameterName=code_block_24)
uniqueItems = List.UniqueItems(list=getParameterValueByName_5, lacing=Longest)
indexOf_2 = List.IndexOf(list=getParameterValueByName_5, element=uniqueItems, lacing=Longest)
getItemAtIndex_3 = List.GetItemAtIndex(list=filterByBoolMask_7.in, index=indexOf_2, lacing=Longest)

firstItem = List.FirstItem(list=getItemAtIndex_3, lacing=Longest)
code_block_25 = CodeBlock { "System Name"; }
getParameterValueByName_6 = Element.GetParameterValueByName(element=firstItem, parameterName=code_block_25)
code_block_26 = CodeBlock { "Manual System Name"; }
getParameterValueByName_7 = Element.GetParameterValueByName(element=firstItem, parameterName=code_block_26)
list_create_2 = List.Create(item0=getParameterValueByName_6, item1=getParameterValueByName_7)

# group: User Selection: Use Manual System Name
code_block_27 = CodeBlock(UseManualSystemName=multipleinputform.User_Inputs) { UseManualSystemName[1]; }

# group: Conditional
code_block_28 = CodeBlock(usemanualsystemname=code_block_27) { usemanualsystemname==true? 1 : 0; }

# group: Conditional
getItemAtIndex_4 = List.GetItemAtIndex(list=list_create_2, index=code_block_28)
code_block_29 = CodeBlock { ""; }
eq = code_block_29 == _  # unwired: y
replaceByCondition = Replace(item=getItemAtIndex_4, replaceWith=getParameterValueByName_6, condition=eq)

code_block_30 = CodeBlock(SystemName=replaceByCondition) { "Stack Ref = " + SystemName; }

# group: Get all Piping Systems
string = StringInput("Piping Systems")
byName_2 = Category.ByName(name=string)
all_elements_of_category_2 = ElementsOfCategory(Category=byName_2)

code_block_31 = CodeBlock { "System Name"; }
getParameterValueByName_8 = Element.GetParameterValueByName(element=all_elements_of_category_2, parameterName=code_block_31)
indexOf_3 = List.IndexOf(list=getParameterValueByName_8, element=getParameterValueByName_6)
getItemAtIndex_5 = List.GetItemAtIndex(list=all_elements_of_category_2, index=indexOf_3)
code_block_32 = CodeBlock { "Primary Ventilated System"; "Secondary Ventilated System"; "DP Frequency Factor (K)"; "Contains WC:"; }
getParameterValueByName_9 = Element.GetParameterValueByName(element=getItemAtIndex_5, parameterName=code_block_32.out0)
getParameterValueByName_10 = Element.GetParameterValueByName(element=getItemAtIndex_5, parameterName=code_block_32.out1)

# group: Conditional
code_block_33 = CodeBlock(lst=getParameterValueByName_9) { lst>0?lst:0; }
code_block_34 = CodeBlock(lst=getParameterValueByName_10) { lst>0?lst:0; }
code_block_35 = CodeBlock(PVS=code_block_33, SVS=code_block_34)
# ---------- code_block_35.designscript (3 lines) ----------
PVS==1 && SVS==0? "Primary Ventilated":
PVS==0 && SVS==1? "Secondary Ventilated":
"Check Piping System Type";
# ----------------------------------------

code_block_36 = CodeBlock(SystemType=code_block_35) { "System Type: " + SystemType; }
getParameterValueByName_11 = Element.GetParameterValueByName(element=getItemAtIndex_5, parameterName=code_block_32.out2)
string_from_object_3 = FromObject(obj=getParameterValueByName_11)
code_block_37 = CodeBlock { 3; }
code_block_38 = CodeBlock { 5; }
remove = String.Remove(string=string_from_object_3, startIndex=code_block_37, count=code_block_38)
code_block_39 = CodeBlock(K=remove) { "Frequency Factor = " + K; }
count_2 = List.Count(list=getParameterValueByName_11)
cycle = List.Cycle(list=code_block_32.out3, amount=count_2)

# group: Python to get fittings connected to pipes
flatten_5 = List.Flatten(list=getItemAtIndex_3)
python_script = Python(IN[0]=flatten_5)  # IronPython2
# ---------- python_script.python (23 lines) ----------
import clr
clr.AddReference('ProtoGeometry')
from Autodesk.DesignScript.Geometry import *
#The inputs to this node will be stored as a list in the IN variables.
if isinstance(IN[0], list):
	curves = UnwrapElement(IN[0])
else:
	curves = [UnwrapElement(IN[0])]

refs = []

for curve in curves:
	connMan = curve.ConnectorManager
	fittings = []
	for conn in connMan.Connectors:
		if conn.IsConnected:
			for lc in conn.AllRefs:
				if connMan.Owner.Id !=  lc.Owner.Id:
					fittings.append(lc.Owner)
	refs.append(fittings)

#Assign your output to the OUT variable.
OUT = refs
# ----------------------------------------

# group: Sort levels based on elevation
string_2 = StringInput("Levels")
byName_3 = Category.ByName(name=string_2)
all_elements_of_category_3 = ElementsOfCategory(Category=byName_3)
projectElevation = Level.ProjectElevation()  # unwired: level
sortByFunction = List.SortByFunction(list=all_elements_of_category_3, sortFunction=projectElevation)

name_4 = Level.Name(level=sortByFunction)
projectElevation_2 = Level.ProjectElevation(level=sortByFunction)

# group: Determine levels where pipes are located
count_3 = List.Count(list=getItemAtIndex_3, lacing=Longest)
flatten_6 = List.Flatten(list=getItemAtIndex_3)
getLocation = Element.GetLocation(element=flatten_6)
startPoint = Curve.StartPoint(curve=getLocation)
Z = Point.Z(point=startPoint)
endPoint = Curve.EndPoint(curve=getLocation)
Z_2 = Point.Z(point=endPoint)
max = Math.Max(value1=Z, value2=Z_2)
gt = max > projectElevation_2  # lacing=CrossProduct
code_block_40 = CodeBlock { false; }
indexOf_4 = List.IndexOf(list=gt, element=code_block_40, lacing=Longest)
code_block_41 = CodeBlock(x=indexOf_4) { x-1; }
getItemAtIndex_6 = List.GetItemAtIndex(list=name_4, index=code_block_41)
chop = List.Chop(list=getItemAtIndex_6, lengths=count_3)

chop_2 = List.Chop(list=python_script, lengths=count_3)
flatten_7 = List.Flatten(list=chop_2, lacing=Longest)

# group: Get only Sizing Connections
code_block_42 = CodeBlock { "Family"; }
getParameterValueByName_12 = Element.GetParameterValueByName(element=flatten_7, parameterName=code_block_42)
string_from_object_4 = FromObject(obj=getParameterValueByName_12)
code_block_43 = CodeBlock { "HL_FoulDrainage_SizingConnection"; }
contains_6 = String.Contains(string=string_from_object_4, searchFor=code_block_43)
filterByBoolMask_8 = List.FilterByBoolMask(list=flatten_7, mask=contains_6)
uniqueItems_2 = List.UniqueItems(list=filterByBoolMask_8.in, lacing=Longest)

# group: Check whether systems contain WC
code_block_44 = CodeBlock { "WC With 6 l Cistern"; "WC With 7.5 l Cistern"; "WC With 7.5 l Cistern"; }
getParameterValueByName_13 = Element.GetParameterValueByName(element=uniqueItems_2, parameterName=code_block_44.out0)
code_block_45 = CodeBlock(x=getParameterValueByName_13) { x>0; }
identity_2 = Object.Identity()  # unwired: object
trueForAny_2 = List.TrueForAny(list=code_block_45, queryFunction=identity_2, lacing=Longest)
getParameterValueByName_14 = Element.GetParameterValueByName(element=uniqueItems_2, parameterName=code_block_44.out1)
code_block_46 = CodeBlock(x=getParameterValueByName_14) { x>0; }
identity_3 = Object.Identity()  # unwired: object
trueForAny_3 = List.TrueForAny(list=code_block_46, queryFunction=identity_3, lacing=Longest)
getParameterValueByName_15 = Element.GetParameterValueByName(element=uniqueItems_2, parameterName=code_block_44.out2)
code_block_47 = CodeBlock(x=getParameterValueByName_15) { x>0; }
identity_4 = Object.Identity()  # unwired: object
trueForAny_4 = List.TrueForAny(list=code_block_47, queryFunction=identity_4, lacing=Longest)
list_create_3 = List.Create(item0=trueForAny_2, item1=trueForAny_3, item2=trueForAny_4)
transpose = List.Transpose(lists=list_create_3)
identity_5 = Object.Identity()  # unwired: object
trueForAny_5 = List.TrueForAny(list=transpose, queryFunction=identity_5, lacing=Longest)
code_block_48 = CodeBlock(result=trueForAny_5) { result==true?"Yes":"No"; }

code_block_49 = CodeBlock(x=cycle, y=code_block_48) { x+" "+y; }
list_create_4 = List.Create(item0=code_block_30, item1=code_block_36, item2=code_block_39, item3=code_block_49)
transpose_2 = List.Transpose(lists=list_create_4)
count_4 = List.Count(list=transpose_2)
ofRepeatedItem_2 = List.OfRepeatedItem(item=ofRepeatedItem, amount=count_4)
id = Element.Id(element=getItemAtIndex_3)
addItemToFront = List.AddItemToFront(item=chop@L1, list=id@L1)
code_block_50 = CodeBlock()
# ---------- code_block_50.designscript (6 lines) ----------
["Diameter",
"Fixture Units",
"DP Waste Water Flow Rate",
"DP Continuous Flow Rate",
"DP Pumped Flow Rate",
"DP Total Flow Rate"];
# ----------------------------------------
getParameterValueByName_16 = Element.GetParameterValueByName(element=getItemAtIndex_3@@L1, parameterName=code_block_50)
addItemToFront_2 = List.AddItemToFront(item=addItemToFront@L2, list=getParameterValueByName_16@@L2, lacing=Longest)
flatten_8 = List.Flatten(list=addItemToFront_2@@L3, lacing=Longest)
lastItem = List.LastItem(list=flatten_8@L3)
code_block_51 = CodeBlock { 7; }
getItemAtIndex_7 = List.GetItemAtIndex(list=lastItem@@L2, index=code_block_51, lacing=Longest)
code_block_52 = CodeBlock { ["","","Total Flow Rate"]; }
code_block_53 = CodeBlock { ["","","Total DU"]; }
code_block_54 = CodeBlock { 3; }
getItemAtIndex_8 = List.GetItemAtIndex(list=lastItem@@L2, index=code_block_54, lacing=Longest)
code_block_55 = CodeBlock { 1; }
chop_3 = List.Chop(list=getItemAtIndex_8, lengths=code_block_55)
addItemToFront_3 = List.AddItemToFront(item=code_block_53, list=chop_3@L2)
flatten_9 = List.Flatten(list=addItemToFront_3, lacing=Longest)
addItemToEnd = List.AddItemToEnd(item=code_block_52, list=flatten_9@L2)
flatten_10 = List.Flatten(list=addItemToEnd, lacing=Longest)
addItemToEnd_2 = List.AddItemToEnd(item=getItemAtIndex_7, list=flatten_10@L2, lacing=Longest)
ofRepeatedItem_3 = List.OfRepeatedItem(item=code_block_11, amount=count_4)
addItemToFront_4 = List.AddItemToFront(item=ofRepeatedItem_3@L2, list=flatten_8@L3)
addItemToFront_5 = List.AddItemToFront(item=transpose_2@L2, list=addItemToFront_4@@L3)
addItemToEnd_3 = List.AddItemToEnd(item=addItemToEnd_2, list=addItemToFront_5@L3, lacing=Longest)
addItemToEnd_4 = List.AddItemToEnd(item=ofRepeatedItem_2, list=addItemToEnd_3@L3, lacing=Longest)
code_block_56 = CodeBlock { 1; }
flatten_11 = List.Flatten(list=addItemToEnd_4, amount=code_block_56)

# group: Write Discharge Systems & Pipes data to Excel
code_block_57 = CodeBlock { "Systems & Pipes"; "A17"; }
bb_data = Custom[BB Data](sheetName=code_block_57.out0, origin=code_block_57.out1, data=flatten_11)  # package BumbleBee; This node is a building block for different modes of writing to Excel files. You can combines this node into a list to write to multiple sheets or use just one to write to a single sheet.
write_excel = Custom[Write Excel](filePath=code_block_8, runIt=code_block_9, BBData=bb_data)  # package BumbleBee; This node will write data to Excel file and based on how your BBData nodes are structured it will either override the exsting file, create a new one and write a single worksheet or write multiple worksheets.

code_block_58 = CodeBlock { ""; }
code_block_59 = CodeBlock { "Level Ref"; }

# group: Get sizing connections parameters
sizing_connection_parameters = CodeBlock()
# ---------- sizing_connection_parameters.designscript (18 lines) ----------
["Wash Basin",
"Bidet",
"Shower Without Plug",
"Shower With Plug",
"Single Urinal With Cistern",
"Slab Urinal",
"Bath",
"Kitchen Sink",
"Dishwasher (Household)",
"Washing Machine Up To 6 kg",
"Washing Machine Up To 12 kg",
"WC With 6 l Cistern",
"WC With 7.5 l Cistern",
"WC With 9 l Cistern",
"User Defined Appliance 1",
"User Defined Appliance 2",
"User Defined Appliance 3",
"Discharge Units"];
# ----------------------------------------
code_block_60 = CodeBlock { "Level"; }
getParameterValueByName_17 = Element.GetParameterValueByName(element=uniqueItems_2, parameterName=code_block_60)
projectElevation_3 = Level.ProjectElevation(level=getParameterValueByName_17)
sortByKey = List.SortByKey(list=uniqueItems_2, keys=projectElevation_3, lacing=Longest)
reverse_2 = List.Reverse(list=sortByKey.sortedList, lacing=Longest)
code_block_61 = CodeBlock { "Level"; }
getParameterValueByName_18 = Element.GetParameterValueByName(element=reverse_2, parameterName=code_block_61, lacing=Longest)
name_5 = Level.Name(level=getParameterValueByName_18)
getParameterValueByName_19 = Element.GetParameterValueByName(element=reverse_2@@L1, parameterName=sizing_connection_parameters)
addItemToFront_6 = List.AddItemToFront(item=name_5@L1, list=getParameterValueByName_19@@L2, lacing=Longest)

join = List.Join(list0=code_block_59, list1=sizing_connection_parameters)
count_5 = List.Count(list=join)
ofRepeatedItem_4 = List.OfRepeatedItem(item=code_block_58, amount=count_5)
ofRepeatedItem_5 = List.OfRepeatedItem(item=ofRepeatedItem_4, amount=count_4)
lastItem_2 = List.LastItem(list=addItemToFront_6@@L2, lacing=Longest)
sum = Math.Sum(values=lastItem_2)
code_block_62 = CodeBlock(n=count_5) { n-2; }
ofRepeatedItem_6 = List.OfRepeatedItem(item=code_block_58, amount=code_block_62)
code_block_63 = CodeBlock { ["Total DU"]; }
join_2 = List.Join(list0=ofRepeatedItem_6, list1=code_block_63)
addItemToEnd_5 = List.AddItemToEnd(item=sum@L1, list=join_2)
ofRepeatedItem_7 = List.OfRepeatedItem(item=join, amount=count_4)
addItemToFront_7 = List.AddItemToFront(item=ofRepeatedItem_7@L2, list=addItemToFront_6@L3)
addItemToFront_8 = List.AddItemToFront(item=transpose_2@L2, list=addItemToFront_7@@L3)
addItemToEnd_6 = List.AddItemToEnd(item=addItemToEnd_5, list=addItemToFront_8@L3, lacing=Longest)
addItemToEnd_7 = List.AddItemToEnd(item=ofRepeatedItem_5, list=addItemToEnd_6@L3, lacing=Longest)
code_block_64 = CodeBlock { 1; }
flatten_12 = List.Flatten(list=addItemToEnd_7, amount=code_block_64)

# group: Write Discharge Systems & Sizing Connections data to Excel
code_block_65 = CodeBlock { "Systems & Sizing Connections"; "A17"; "S13"; }
bb_data_2 = Custom[BB Data](sheetName=code_block_65.out0, origin=code_block_65.out1, data=flatten_12)
write_excel_2 = Custom[Write Excel](filePath=code_block_8, runIt=code_block_9, BBData=bb_data_2)

# group: Get DU's for User Defined Appliances
flatten_13 = List.Flatten(list=uniqueItems_2)
elementType_2 = Element.ElementType(element=flatten_13)
code_block_66 = CodeBlock()
# ---------- code_block_66.designscript (3 lines) ----------
["User Defined Appliance 1 DU",
"User Defined Appliance 2 DU",
"User Defined Appliance 3 DU"];
# ----------------------------------------
getParameterValueByName_20 = Element.GetParameterValueByName(element=elementType_2, parameterName=code_block_66@L1)
maximumItem = List.MaximumItem(list=getParameterValueByName_20, lacing=Longest)

# group: Write User Defined Appliances data to Excel
bb_data_3 = Custom[BB Data](sheetName=code_block_65.out0, origin=code_block_65.out2, data=maximumItem)
write_excel_3 = Custom[Write Excel](filePath=code_block_8, runIt=code_block_9, byColumn=code_block_9, BBData=bb_data_3)
