# Dynamo graph Foul Drainage Systems_Clear Parameter Values v.2.0.dyn (Dynamo 2.16.1.2727)
# packages: Data-Shapes 2021.2.92

# group: DYNAMO COLOUR CODING LEGEND
# note: COLOUR CODING LEGEND

# group: Monitor
# note: USE:
# FOR IMPORTANT WATCH NODES

# group: Conditional
# note: USE:
# FOR CONDITIONAL NODES

# group: Python
# note: USE:
# FOR PYTHON NODES

# group: To Revit
# note: USE:
# FOR CHANGES TO REVIT

# group: Input
# note: USE:
# FOR FIXED INPUT (FILE PATHS ETC.)

# group: Control
# note: USE:
# FOR USER CONTROL (SLIDERS ETC.)

# group: Background
# note: USE:
# FOR GENERAL WORKFLOW NODES

# group: Get all piping systems, filter them to only show Discharge
code_block = CodeBlock { "Piping Systems"; }
byName = Category.ByName(name=code_block)
all_elements_of_category = ElementsOfCategory(Category=byName)
elementType = Element.ElementType(element=all_elements_of_category)
name = Element.Name(element=elementType)
code_block_2 = CodeBlock { ["Ss_50_30_04_97 - Discharge", "Ss_50_30_04_97 - HT Discharge", "Ss_50_30_04_97 - Lab Discharge"]; }
contains = String.Contains(string=name, searchFor=code_block_2@L1)
filterByBoolMask = List.FilterByBoolMask(list=all_elements_of_category, mask=contains@L2)
flatten = List.Flatten(list=filterByBoolMask.in)
name_2 = Element.Name(element=flatten)

# group: Python to sort strings with numbers
python_to_sort_strings_with = Python(IN[0]=name_2)  # "Python to sort strings with numbers"; IronPython2
# ---------- python_to_sort_strings_with.python (10 lines) ----------
import re

list = IN[0]

def natural_sort(l): 
    convert = lambda text: int(text) if text.isdigit() else text.lower() 
    alphanum_key = lambda key: [ convert(c) for c in re.split('([0-9]+)', key) ] 
    return sorted(l, key = alphanum_key)

OUT = natural_sort(list)
# ----------------------------------------

indexOf = List.IndexOf(list=name_2, element=python_to_sort_strings_with)
getItemAtIndex = List.GetItemAtIndex(list=flatten, index=indexOf)

# group: User Interface
code_block_3 = CodeBlock { "Clear Parameter Values"; null; "Proceed"; "Cancel"; 800; 700; 300; }
code_block_4 = CodeBlock { "Select System(s)"; false; }
listview_data = Custom[Listview Data](InputName=code_block_4.out0, Keys=python_to_sort_strings_with, Values=getItemAtIndex, SortItems_optionnal=code_block_4.out1, ShowId_optionnal=code_block_4.out1)  # package Data-Shapes; Create data for ListView input in UI.MultiInputForm ++ . Check out www.data-shapes.net for more infos.
boolean = BoolSelector(true)
multipleinputform = Custom[MultipleInputForm ++](Description_optional=code_block_3.out0, Logo_optional=code_block_3.out1, ButtonText_optional=code_block_3.out2, Inputs=listview_data, Toggle=boolean, CancelButtonText_optional=code_block_3.out3, MaxHeight_optional=code_block_3.out4, Width_optional=code_block_3.out5, LabelWidth_optional=code_block_3.out6)  # package Data-Shapes; Create a form with multiple inputs. see www.data-shapes.net for tutorials and infos!

# group: User Selection: Selected Piping System
code_block_5 = CodeBlock(SelectedPipingSystem=multipleinputform.User_Inputs) { SelectedPipingSystem[0]; }

# group: Python to get all elements in network
python_pipe_network = Python(IN[0]=code_block_5)  # IronPython2
# ---------- python_pipe_network.python (42 lines) ----------
import clr

clr.AddReference("RevitServices")
import RevitServices
from RevitServices.Persistence import DocumentManager
from RevitServices.Transactions import TransactionManager
doc = DocumentManager.Instance.CurrentDBDocument

clr.AddReference("RevitAPI")
import Autodesk
from Autodesk.Revit.DB import *

clr.AddReference("RevitNodes")
import Revit
clr.ImportExtensions(Revit.Elements)
clr.ImportExtensions(Revit.GeometryConversion)

#Many thanks to Konrad K Sobon for his awesome ProcessList function!
def Unwrap(item):
	return UnwrapElement(item)

def ProcessList(_func, _list):
    return map( lambda x: ProcessList(_func, x) if type(x)==list else _func(x), _list )

if isinstance(IN[0], list):
	systems = ProcessList(Unwrap, IN[0])
else:
	systems = [Unwrap(IN[0])]
	
	
def getNetwork(system):
	network = None
	try:
		network = [x.ToDSType(True) for x in system.PipingNetwork]
	except:
		pass
	return network

			
#Assign your output to the OUT variable.

OUT = ProcessList(getNetwork, systems)
# ----------------------------------------

# group: Get only pipes
getCategory = Element.GetCategory(element=python_pipe_network)
name_3 = Category.Name(category=getCategory)
code_block_6 = CodeBlock { "Pipes"; }
contains_2 = String.Contains(string=name_3, searchFor=code_block_6)
filterByBoolMask_2 = List.FilterByBoolMask(list=python_pipe_network, mask=contains_2)
flatten_2 = List.Flatten(list=filterByBoolMask_2.in)

# group: Identify parameters with value
pipe_parameters = CodeBlock()
# ---------- pipe_parameters.designscript (9 lines) ----------
["DP Intermittent Use",
"DP Frequent Use",
"DP Congested Use",
"DP Special Use",
"DP Waste Water Flow Rate",
"DP Continuous Flow Rate",
"DP Pumped Flow Rate",
"DP Total Flow Rate",
"DP Frequency Factor (K)"];
# ----------------------------------------
code_block_7 = CodeBlock { "Manual System Name"; }
join = List.Join(list0=pipe_parameters, list1=code_block_7)
getParameterValueByName = Element.GetParameterValueByName(element=flatten_2, parameterName=pipe_parameters, lacing=CrossProduct)
transpose = List.Transpose(lists=getParameterValueByName)
flatten_3 = List.Flatten(list=transpose, lacing=Longest)
getParameterValueByName_2 = Element.GetParameterValueByName(element=flatten_2, parameterName=code_block_7)
length = String.Length(string=getParameterValueByName_2)
list_create = List.Create(item0=length)
join_2 = List.Join(list0=flatten_3, list1=list_create)
code_block_8 = CodeBlock(x=join_2) { x>0; }
code_block_9 = CodeBlock(lst=code_block_8) { lst==null?false:lst; }
identity = Object.Identity()  # unwired: object
trueForAny = List.TrueForAny(list=code_block_9, queryFunction=identity, lacing=Longest)
filterByBoolMask_3 = List.FilterByBoolMask(list=join, mask=trueForAny)

# group: Python to get fittings and accessories connected to pipes
python_script = Python(IN[0]=flatten_2)  # IronPython2
# ---------- python_script.python (23 lines) ----------
import clr
clr.AddReference('ProtoGeometry')
from Autodesk.DesignScript.Geometry import *
#The inputs to this node will be stored as a list in the IN variables.
if isinstance(IN[0], list):
	curves = UnwrapElement(IN[0])
else:
	curves = [UnwrapElement(IN[0])]

refs = []

for curve in curves:
	connMan = curve.ConnectorManager
	fittings = []
	for conn in connMan.Connectors:
		if conn.IsConnected:
			for lc in conn.AllRefs:
				if connMan.Owner.Id !=  lc.Owner.Id:
					fittings.append(lc.Owner)
	refs.append(fittings)

#Assign your output to the OUT variable.
OUT = refs
# ----------------------------------------

flatten_4 = List.Flatten(list=python_script)
uniqueItems = List.UniqueItems(list=flatten_4)

# group: Get only sizing connections
elementType_2 = Element.ElementType(element=uniqueItems)
code_block_10 = CodeBlock { "Family Name"; }
getParameterValueByName_3 = Element.GetParameterValueByName(element=elementType_2, parameterName=code_block_10)
code_block_11 = CodeBlock { "SizingConnection"; }
contains_3 = String.Contains(string=getParameterValueByName_3, searchFor=code_block_11)
filterByBoolMask_4 = List.FilterByBoolMask(list=uniqueItems, mask=contains_3)

# group: Identify parameters with value
sizing_connection_instance = CodeBlock()  # "Sizing Connection Instance Parameters"
# ---------- sizing_connection_instance.designscript (17 lines) ----------
["Wash Basin",
"Bidet",
"Shower Without Plug",
"Shower With Plug",
"Single Urinal With Cistern",
"Slab Urinal",
"Bath",
"Kitchen Sink",
"Dishwasher (Household)",
"Washing Machine Up To 6 kg",
"Washing Machine Up To 12 kg",
"WC With 6 l Cistern",
"WC With 7.5 l Cistern",
"WC With 9 l Cistern",
"User Defined Appliance 1",
"User Defined Appliance 2",
"User Defined Appliance 3"];
# ----------------------------------------
list_create_2 = List.Create(item0=filterByBoolMask_4.in)
getParameterValueByName_4 = Element.GetParameterValueByName(element=list_create_2, parameterName=sizing_connection_instance, lacing=Longest)
code_block_12 = CodeBlock(x=getParameterValueByName_4) { x>0; }
code_block_13 = CodeBlock(lst=code_block_12) { lst==null?false:lst; }
identity_2 = Object.Identity()  # unwired: object
trueForAny_2 = List.TrueForAny(list=code_block_13, queryFunction=identity_2, lacing=Longest)
filterByBoolMask_5 = List.FilterByBoolMask(list=sizing_connection_instance, mask=trueForAny_2)
sizing_connections_type = CodeBlock()  # "Sizing Connections Type Parameters"
# ---------- sizing_connections_type.designscript (3 lines) ----------
["User Defined Appliance 1 DU",
"User Defined Appliance 2 DU",
"User Defined Appliance 3 DU"];
# ----------------------------------------
elementType_3 = Element.ElementType(element=list_create_2)
getParameterValueByName_5 = Element.GetParameterValueByName(element=elementType_3, parameterName=sizing_connections_type, lacing=Longest)
code_block_14 = CodeBlock(x=getParameterValueByName_5) { x>0; }
identity_3 = Object.Identity()  # unwired: object
trueForAny_3 = List.TrueForAny(list=code_block_14, queryFunction=identity_3, lacing=Longest)
filterByBoolMask_6 = List.FilterByBoolMask(list=sizing_connections_type, mask=trueForAny_3)

join_3 = List.Join(list0=filterByBoolMask_5.in, list1=filterByBoolMask_6.in)

# group: Conditional
code_block_15 = CodeBlock(FirstUIWasRun=multipleinputform.Was_Run, FirstUIWasCancelled=multipleinputform.Was_Cancelled) { FirstUIWasRun == true && FirstUIWasCancelled == false? true : false; }

# group: User Interface
code_block_16 = CodeBlock { "Select Parameter(s)"; null; "Proceed"; "Cancel"; 900; 700; 500; }
code_block_17 = CodeBlock { "Pipe Parameters"; true; false; }
listview_data_2 = Custom[Listview Data](InputName=code_block_17.out0, Keys=filterByBoolMask_3.in, Values=filterByBoolMask_3.in, SortItems_optionnal=code_block_17.out1, ShowId_optionnal=code_block_17.out2)
code_block_18 = CodeBlock { "Piping System Parameters"; ["DP Frequency Factor (K)", "System Type"]; false; }
listview_data_3 = Custom[Listview Data](InputName=code_block_18.out0, Keys=code_block_18.out1, Values=code_block_18.out1, SortItems_optionnal=code_block_18.out2, ShowId_optionnal=code_block_18.out2)
code_block_19 = CodeBlock { "Sizing Connections Parameters"; true; false; }
listview_data_4 = Custom[Listview Data](InputName=code_block_19.out0, Keys=join_3, Values=join_3, SortItems_optionnal=code_block_19.out1, ShowId_optionnal=code_block_19.out2)
list_create_3 = List.Create(item0=listview_data_2, item1=listview_data_3, item2=listview_data_4)
multipleinputform_2 = Custom[MultipleInputForm ++](Description_optional=code_block_16.out0, Logo_optional=code_block_16.out1, ButtonText_optional=code_block_16.out2, Inputs=list_create_3, Toggle=code_block_15, CancelButtonText_optional=code_block_16.out3, MaxHeight_optional=code_block_16.out4, Width_optional=code_block_16.out5, LabelWidth_optional=code_block_16.out6)

# group: User Selection: Pipe Parameters
code_block_20 = CodeBlock(SelectedPipeParameters=multipleinputform_2.User_Inputs) { SelectedPipeParameters[0]; }

code_block_21 = CodeBlock { "Manual System Name"; }
contains_4 = String.Contains(string=code_block_20, searchFor=code_block_21)
filterByBoolMask_7 = List.FilterByBoolMask(list=code_block_20, mask=contains_4)

# group: Clear value for Manual System Name and Set parameter values to 0 for the rest of selected parameters
code_block_22 = CodeBlock { 0; }
setParameterByName = Element.SetParameterByName(element=flatten_2, parameterName=filterByBoolMask_7.out, value=code_block_22, lacing=CrossProduct)
code_block_23 = CodeBlock { ""; }
setParameterByName_2 = Element.SetParameterByName(element=flatten_2, parameterName=filterByBoolMask_7.in, value=code_block_23, lacing=CrossProduct)

empty = List.Empty()

# group: User Selection: Piping System Parameters
code_block_24 = CodeBlock(SelectedPipingSystemParameters=multipleinputform_2.User_Inputs) { SelectedPipingSystemParameters[1]; }

code_block_25 = CodeBlock { "DP Frequency Factor (K)"; }
contains_5 = String.Contains(string=code_block_24, searchFor=code_block_25)
filterByBoolMask_8 = List.FilterByBoolMask(list=code_block_24, mask=contains_5)
code_block_26 = CodeBlock { "System Type"; }
contains_6 = String.Contains(string=code_block_24, searchFor=code_block_26)
filterByBoolMask_9 = List.FilterByBoolMask(list=code_block_24, mask=contains_6)
join_4 = List.Join(list0=filterByBoolMask_8.in, list1=filterByBoolMask_9.in)
piping_system_parameters = CodeBlock { ["Primary Ventilated System","Secondary Ventilated System"]; }
replace = String.Replace(string=join_4, searchFor=code_block_26, replaceWith=piping_system_parameters@L2, lacing=Longest)
uniqueItems_2 = List.UniqueItems(list=replace, lacing=Longest)
flatten_5 = List.Flatten(list=uniqueItems_2)
list_create_4 = List.Create(item0=empty, item1=flatten_5)
isEmpty = List.IsEmpty(list=code_block_24)

# group: Conditional
code_block_27 = CodeBlock(x=isEmpty) { x==true?0:1; }

getItemAtIndex_2 = List.GetItemAtIndex(list=list_create_4, index=code_block_27)

# group: Set parameter values to 0 for Piping System
code_block_28 = CodeBlock { 0; }
setParameterByName_3 = Element.SetParameterByName(element=code_block_5, parameterName=getItemAtIndex_2, value=code_block_28, lacing=CrossProduct)

# group: User Selection: Sizing Connections Parameters
code_block_29 = CodeBlock(SelectedSizingConnectionsParameters=multipleinputform_2.User_Inputs) { SelectedSizingConnectionsParameters[2]; }

code_block_30 = CodeBlock { "DU"; }
endsWith = String.EndsWith(string=code_block_29, searchFor=code_block_30)
filterByBoolMask_10 = List.FilterByBoolMask(list=code_block_29, mask=endsWith)

# group: Set instance parameters' values to 0 for Sizing Connections
code_block_31 = CodeBlock { 0; }
setParameterByName_4 = Element.SetParameterByName(element=list_create_2, parameterName=filterByBoolMask_10.out, value=code_block_31, lacing=Longest)

# group: Set type parameters' values to 0 for Sizing Connections
code_block_32 = CodeBlock { 0; }
setParameterByName_5 = Element.SetParameterByName(element=elementType_3, parameterName=filterByBoolMask_10.in, value=code_block_32, lacing=Longest)
