# Dynamo graph Foul Drainage Systems_Remove Sizing Connections v.2.0.dyn (Dynamo 2.13.1.3887)
# packages: Data-Shapes 2021.2.92

# group: DYNAMO COLOUR CODING LEGEND
# note: COLOUR CODING LEGEND

# group: Monitor
# note: USE:
# FOR IMPORTANT WATCH NODES

# group: Conditional
# note: USE:
# FOR CONDITIONAL NODES

# group: Python
# note: USE:
# FOR PYTHON NODES

# group: To Revit
# note: USE:
# FOR CHANGES TO REVIT

# group: Control
# note: USE:
# FOR USER CONTROL (SLIDERS ETC.)

# group: Input
# note: USE:
# FOR FIXED INPUT (FILE PATHS ETC.)

# group: Background
# note: USE:
# FOR GENERAL WORKFLOW NODES

# group: Get all piping systems, filter them to only show Discharge
code_block = CodeBlock { "Piping Systems"; }
byName = Category.ByName(name=code_block)
all_elements_of_category = ElementsOfCategory(Category=byName)
elementType = Element.ElementType(element=all_elements_of_category)
name = Element.Name(element=elementType)
code_block_2 = CodeBlock { ["Ss_50_30_04_97 - Discharge", "Ss_50_30_04_97 - HT Discharge", "Ss_50_30_04_97 - Lab Discharge"]; }
contains = String.Contains(string=name, searchFor=code_block_2@L1)
filterByBoolMask = List.FilterByBoolMask(list=all_elements_of_category, mask=contains@L2)
flatten = List.Flatten(list=filterByBoolMask.in)
name_2 = Element.Name(element=flatten)

# group: Python to sort strings with numbers
python_to_sort_strings_with = Python(IN[0]=name_2)  # "Python to sort strings with numbers"; IronPython2
# ---------- python_to_sort_strings_with.python (10 lines) ----------
import re

list = IN[0]

def natural_sort(l): 
    convert = lambda text: int(text) if text.isdigit() else text.lower() 
    alphanum_key = lambda key: [ convert(c) for c in re.split('([0-9]+)', key) ] 
    return sorted(l, key = alphanum_key)

OUT = natural_sort(list)
# ----------------------------------------

indexOf = List.IndexOf(list=name_2, element=python_to_sort_strings_with)
getItemAtIndex = List.GetItemAtIndex(list=flatten, index=indexOf)

# group: User Interface
code_block_3 = CodeBlock { "Remove Sizing Connections"; null; "Proceed"; "Cancel"; 800; 700; 300; }
code_block_4 = CodeBlock { "Select System"; false; }
dropdown_data = Custom[DropDown Data](InputName=code_block_4.out0, Keys=python_to_sort_strings_with, Values=getItemAtIndex, Sorted_optional=code_block_4.out1)  # package Data-Shapes; Create data for DropDown input in UI.MultiInputForm ++ . Check out www.data-shapes.net for more infos.
code_block_5 = CodeBlock { "Use 'Manual System Name' Parameter?"; ["Yes","No"]; [true, false]; 1; }
radiobuttons_data = Custom[RadioButtons Data](InputName=code_block_5.out0, Keys=code_block_5.out1, Values=code_block_5.out2, DefaultValueIndex=code_block_5.out3)  # package Data-Shapes; Create radio buttons input for UI.MultipleInputForm ++ .
list_create = List.Create(item0=dropdown_data, item1=radiobuttons_data)
boolean = BoolSelector(true)
multipleinputform = Custom[MultipleInputForm ++](Description_optional=code_block_3.out0, Logo_optional=code_block_3.out1, ButtonText_optional=code_block_3.out2, Inputs=list_create, Toggle=boolean, CancelButtonText_optional=code_block_3.out3, MaxHeight_optional=code_block_3.out4, Width_optional=code_block_3.out5, LabelWidth_optional=code_block_3.out6)  # package Data-Shapes; Create a form with multiple inputs. see www.data-shapes.net for tutorials and infos!

# group: User selection: Selected Piping System
code_block_6 = CodeBlock(SelectedPipingSystem=multipleinputform.User_Inputs) { SelectedPipingSystem[0]; }

# group: Python to get all elements in network
python_pipe_network = Python(IN[0]=code_block_6)  # IronPython2
# ---------- python_pipe_network.python (42 lines) ----------
import clr

clr.AddReference("RevitServices")
import RevitServices
from RevitServices.Persistence import DocumentManager
from RevitServices.Transactions import TransactionManager
doc = DocumentManager.Instance.CurrentDBDocument

clr.AddReference("RevitAPI")
import Autodesk
from Autodesk.Revit.DB import *

clr.AddReference("RevitNodes")
import Revit
clr.ImportExtensions(Revit.Elements)
clr.ImportExtensions(Revit.GeometryConversion)

#Many thanks to Konrad K Sobon for his awesome ProcessList function!
def Unwrap(item):
	return UnwrapElement(item)

def ProcessList(_func, _list):
    return map( lambda x: ProcessList(_func, x) if type(x)==list else _func(x), _list )

if isinstance(IN[0], list):
	systems = ProcessList(Unwrap, IN[0])
else:
	systems = [Unwrap(IN[0])]
	
	
def getNetwork(system):
	network = None
	try:
		network = [x.ToDSType(True) for x in system.PipingNetwork]
	except:
		pass
	return network

			
#Assign your output to the OUT variable.

OUT = ProcessList(getNetwork, systems)
# ----------------------------------------

# group: Get only pipes
getCategory = Element.GetCategory(element=python_pipe_network)
name_3 = Category.Name(category=getCategory)
code_block_7 = CodeBlock { "Pipes"; }
contains_2 = String.Contains(string=name_3, searchFor=code_block_7)
filterByBoolMask_2 = List.FilterByBoolMask(list=python_pipe_network, mask=contains_2)

# group: Get lowest pipe in the system
code_block_8 = CodeBlock { "Invert Elevation"; }
getParameterValueByName = Element.GetParameterValueByName(element=filterByBoolMask_2.in, parameterName=code_block_8)
minimumItem = List.MinimumItem(list=getParameterValueByName)
indexOf_2 = List.IndexOf(list=getParameterValueByName, element=minimumItem, lacing=Longest)
getItemAtIndex_2 = List.GetItemAtIndex(list=filterByBoolMask_2.in, index=indexOf_2, lacing=Longest)

# group: Python to evaluate elements in each network and output a sublist for each branch
network_evaluator = Python(IN[0]=getItemAtIndex_2)  # IronPython2
# ---------- network_evaluator.python (397 lines) ----------
# Enable Python support and load DesignScript library
import clr
clr.AddReference('ProtoGeometry')
from Autodesk.DesignScript.Geometry import *

clr.AddReference("RevitAPI")
import Autodesk
from Autodesk.Revit.DB import *

clr.AddReference("RevitNodes")
import Revit
clr.ImportExtensions(Revit.Elements)

# The inputs to this node will be stored as a list in the IN variables.
# Angled branching network evaluator by Jared Linden jaredlindena@hoarelea.com 

dataEnteringNode = UnwrapElement(IN[0])

debug = []

class Run:

	def __init__(self, _number, _parent, _start_id):
		self.parent = _parent
		self.start_id = _start_id
		self.number = _number
		self.__branches = 0
		
	def depth(self):
		return self.parent.depth() + 1 if self.parent else 1
		
	def runString(self):
		return str(self.number) if self.parent is None else self.parent.runString() + "." + str(self.number)
		
	def branch(self, start_id):
		self.__branches += 1
		return Run(self.__branches, self, start_id)
		
	def __eq__(self, other):
		if not isinstance(other, Run): 
			return False
		return self.number == other.number and self.depth() == other.depth() if self.parent == other.parent else False
		
	def __lt__(self, other):
		if self.depth() == other.depth() and self.number == other.number:
			return self.parent < other.parent if self.parent else - 1
		else:
			return self.number < other.number if self.depth() == other.depth() else self.depth() < other.depth()
	
	def __hash__(self):
		return self.number * 31 + self.depth()
	

class Edge:
	
	def __init__(self, _run, _start_connector):
		self.run = _run
		self.end = None
		self.start = _start_connector.node
		self.__connector = _start_connector
		
	def evaluate(self):
		current = self.__connector.connectedElement()
		while(isinstance(current, SectionElement)):
			current = current.nextElement()
		self.end = current
		
class ConnectorHelper:
	
	def __init__(self, _node, _connector, _element_container):
		self.node = _node
		self.id = connected(_connector).Owner.Id.IntegerValue
		self.direction = _connector.CoordinateSystem.BasisZ
		self.edge = None
		self.__connector = _connector
		self.__element_container = _element_container
		
	def setEdge(self, _edge):
		self.edge = _edge
		
	def hasEvaluated(self):
		return self.edge is not None
		
	def evaluateEdge(self, run):
		self.edge = Edge(run, self)
		self.edge.evaluate()

		
	def connectedElement(self):
		return self.__element_container.getNetworkElement(connected(self.__connector).Owner, self.node, self.edge)

class SectionElement:

	def __init__(self, _elem, _edge, _prev_id, _source, _added):
		self.edge = _edge
		self.added = _added
		self.prev_id = _prev_id
		self.element = _elem
		self.source = _source
		self.id = _elem.Id.IntegerValue
		self.main_run = _edge.run
		
	def getMainRun(self):
		return self.edge.run
		
	def nextElement(self):
		try:
			next_elem = next(iter(y.Owner for y in [connected(x) for x in getNodeConnectors(self.element)] if y.Owner.Id.IntegerValue != self.prev_id))
		except:
			next_elem = next(iter(y.Owner for y in [connected(x) for x in getAllConnectors(self.element)] if y.Owner.Id.IntegerValue != self.prev_id))
		return self.source.getNetworkElement(next_elem, self, self.edge)


class TerminalElement:
	def __init__(self, _element, _edge, _added):
		self.element = _element
		self.added = _added
		self.edge = _edge
		self.id = _element.Id.IntegerValue
		
	def getMainRun(self):
		return self.edge.run


class BranchElement(object):
	
	def __init__(self, element):
		self.id = element.Id.IntegerValue


class StartElement(BranchElement):
	
	def __init__(self, _element, _run, _element_source, _added):
		self.element = _element
		self.__source = _element_source
		self.added = _added
		self.main_run = _run
		self.paused = False
		self.id = _element.Id.IntegerValue
		self.__connectors = [ConnectorHelper(self, x, _element_source) for x in getAllConnectors(_element)]
		if len(self.__connectors) != 0:
			self.__out1 = self.__connectors[0]
			self.__out2 = None
			if len(self.__connectors) > 1:
				self.__out2 = self.__connectors[1]
		super(StartElement, self).__init__(_element)
		
	def getMainRun(self):
		return self.main_run

	def hasMainNext(self):
		return True
	
	def evaluateMain(self):
		if not self.__out1.hasEvaluated():
			return self.__out1.evaluateEdge(self.main_run)
		elif self.__out2 is not None and not self.__out2.hasEvaluated():
			return self.__out2.evaluateEdge(self.main_run)
		else:
			return self.__out1.evaluateEdge(self.main_run)
			
	def evaluateNextBranch(self):
		con = sorted((x for x in self.__connectors if not x.hasEvaluated()), key = lambda x: self.__out1.direction.AngleTo(x.direction))[0]
		con.evaluateEdge(self.getMainRun().branch(self.id))
		
	def hasEvaluated(self):
		return all(x.hasEvaluated() for x in self.__connectors)
		
	def hasEvaluatedMain(self):
		return self.__out1.hasEvaluated() and (self.__out2 is None or self.__out2.hasEvaluated())
		
	def setIncomingEdge(self, connector_id, edge):
		[x for x in self.__connectors if x.id == connector_id][0].setEdge(edge)
			

class NodeElement(BranchElement):

	def __init__(self, _element, _edge, _prev_id, _source, _added):
		self.element = _element
		self.__source = _source
		self.__prev_id = _prev_id
		self.id = _element.Id.IntegerValue
		self.added = _added
		self.__connectors = [ConnectorHelper(self, x, _source) for x in getAllConnectors(_element)]
		self.paused = False
		next(iter(x for x in self.__connectors if x.id == _prev_id)).setEdge(_edge)
		self.paused = not self.hasMainNext()
		super(NodeElement, self).__init__(_element)
		
	def inConnectors(self):
		return (x for x in self.__connectors if x.edge is not None and x.edge.start.id != self.id)
		
	def getInMain(self):
		return sorted(self.inConnectors(), key = lambda x: x.edge.run)[0]
		
	def getMainRun(self):
		return sorted((x for x in self.__connectors if x.hasEvaluated()), key = lambda x: x.edge.run)[0].edge.run
		
	def hasMainNext(self):
		main_in_dir = self.getInMain().direction.Negate()
		return len([x for x in self.__connectors if not x.hasEvaluated()]) == 1 or any(x for x in self.__connectors if x.direction.AngleTo(main_in_dir) < 0.05 and not x.hasEvaluated())
		
	def evaluateMain(self):
		self.paused = False
		main_in_dir = self.getInMain().direction.Negate()
		sorted((x for x in self.__connectors if not x.hasEvaluated()), key = lambda x: main_in_dir.AngleTo(x.direction))[0].evaluateEdge(self.getMainRun())
		
	def evaluateNextBranch(self):
		main_in_dir = self.getInMain().direction.Negate()
		con = sorted((x for x in self.__connectors if not x.hasEvaluated()), key = lambda x: main_in_dir.AngleTo(x.direction))[0]
		con.evaluateEdge(self.getMainRun().branch(self.id))
		
	def hasEvaluated(self):
		return all(x.hasEvaluated() for x in self.__connectors)
		
	def hasEvaluatedMain(self):
		return len([x for x in self.__connectors if x.hasEvaluated() and x.edge.run == self.getMainRun()]) == 2
		
	def setIncomingEdge(self, connector_id, edge):
		next(iter(x for x in self.__connectors if x.id == connector_id)).setEdge(edge)
		
			
class ElementContainer:

	def __init__(self):
		self.__elems = {}
		self.__number = 1
		
	def getNetworkElement(self, element, prev, edge):
		id = element.Id.IntegerValue
		if id in self.__elems:
			elem = self.__elems[id]
			if isinstance(elem, NodeElement):
				elem.setIncomingEdge(prev.id, edge)
			return elem
		else:
			if isNodeElement(element):
				new = NodeElement(element, edge, prev.id, self, self.__number)
			elif isSectionElement(element):
				new = SectionElement(element, edge, prev.id, self, self.__number)
			elif isTermainalElement(element):
				new = TerminalElement(element, edge, self.__number)
			else:
				raise Exception("Unknow element type connected to network")
			self.__elems[id] = new
			self.__number += 1
			return new
			
	def networkElements(self):
		return sorted(sorted(self.__elems.values(), key = lambda x:x.getMainRun()), key = lambda y:y.added)
		
	def setStart(self, start_node):
		self.__elems[start_node.id] = start_node
		
	def nodes(self):
		return (x for x in self.__elems.values() if isinstance(x, BranchElement)) #or isinstance(x, NodeElement))


def isValidConnector(connector):
	return (connector.ConnectorType == ConnectorType.End or connector.ConnectorType == ConnectorType.Curve) and connector.IsConnected and (isinstance(connector.Owner, MEPCurve) or isinstance(connector.Owner, FamilyInstance))

#Return Connector
def connected(connector):
	try:
		return [x for x in connector.AllRefs if isValidConnector(x) and x.Owner.Id.IntegerValue != connector.Owner.Id.IntegerValue][0]
	except:
		raise Exception("Connector not connected")
	
def connectedId(connector):
	return connected(connector).Owner.Id.IntegerValue
	
def getAllConnectors(element):
	try:
		connectors = element.MEPModel.ConnectorManager.Connectors
	except:
		connectors = element.ConnectorManager.Connectors
	return [x for x in connectors if isValidIterableConnector(x)]
	
def isValidIterableConnector(connector):
	return isValidConnector(connector) and len([x for x in connected(connector).ConnectorManager.Connectors]) > 1
	
def getNodeConnectors(element):
	return [x for x in getAllConnectors(element) if not isPipeConnectedToCap(connected(x).Owner)]
	
def isPipeConnectedToCap(elem):
	try:
		length = elem.Location.Curve.Length
	except:
		length = 10
	if length > 1.5:
		return False
	try:
		connectors = elem.MEPModel.ConnectorManager.Connectors
	except:
		connectors = elem.ConnectorManager.Connectors
	return any(len([y for y in connected(x).ConnectorManager.Connectors if isValidConnector(y)]) < 2 for x in [z for z in connectors if isValidConnector(z)])
	
def isSectionElement(element):
	return len(getAllConnectors(element)) == 2 or len(getNodeConnectors(element)) == 2
	
def isNodeElement(element):
	return len(getNodeConnectors(element)) > 2
	
def isTermainalElement(element):
	return len(getAllConnectors(element)) == 1 or len(getNodeConnectors(element)) == 1
	
def firstOrNone(list):
	return next(iter(list), None)
	
def mainLoop(root_element):

	element_container = ElementContainer()
	root_run = Run(1, None, root_element.Id.IntegerValue)
	start_node = StartElement(root_element, root_run, element_container, 0)
	element_container.setStart(start_node)
	
	safety = 0
	while firstOrNone(x for x in element_container.nodes() if not x.hasEvaluated()) is not None:
		ordered_unevaluated = sorted(sorted((x for x in element_container.nodes() if not x.hasEvaluated()), key = lambda x: x.getMainRun()), key = lambda y:y.added)
		safety +=1
		if safety > 999:
			raise Exception("To many loops")
		first_with_next = firstOrNone((x for x in ordered_unevaluated if not x.hasEvaluatedMain() and not x.paused and x.hasMainNext()))
		if first_with_next is not None:
			first_with_next.evaluateMain()
			continue
			
		first_with_branch = firstOrNone((x for x in ordered_unevaluated if x.hasEvaluatedMain() and not x.paused))
		if first_with_branch is not None:
			first_with_branch.evaluateNextBranch()
			continue
			
		first_paused_with_main = firstOrNone((x for x in ordered_unevaluated if x.hasMainNext() and x.paused and not x.hasEvaluatedMain()))
		if first_paused_with_main is not None:
			first_paused_with_main.evaluateMain()
			continue
			
		first_paused_branch = firstOrNone((x for x in ordered_unevaluated if not x.hasEvaluatedMain() and x.paused))
		if first_paused_branch is not None:
			first_paused_branch.evaluateMain()
			continue
			
		raise Exception("Unknown state")
	return element_container.networkElements()


	
in_elements = dataEnteringNode


output = []


def addToRunsDict(elem, runsdict):
	run = elem.getMainRun()
	runstart = run.start_id
	runstring = run
	if runstart not in runsdict:
		runsdict[runstart] = {}
	if runstring not in runsdict[runstart]:
		runsdict[runstart][runstring] = []
	runsdict[runstart][runstring].append(elem)
	
safe1 = 0

def getRunElements(elems, runsdict):
	list = []
	global safe1
	safe1 +=1
	if safe1 > 100:
		raise Exception("Too many recursions")
	sorted_elems = sorted(elems, key = lambda x:x.added)
	for x in sorted_elems:
		list.append(x.element)
		if x.id in runsdict:
			for key in sorted(runsdict[x.id].keys()):
				subl = runsdict[x.id].pop(key)
				list.append(getRunElements(subl, runsdict))
	return list
	
networks = []
all_done =[]
for element in (me for me in in_elements if me.Id.IntegerValue not in all_done):
	runsdict = {}
	output = []
	network = mainLoop(element)
	for x in network:
		addToRunsDict(x, runsdict)
	
	#done_list.append(element.Id.IntegerValue)
	first = runsdict[element.Id.IntegerValue].keys()[0]
	lems = runsdict[element.Id.IntegerValue].pop(first)
	networks.append(getRunElements(lems, runsdict))
	all_done.extend([x.id for x in network])
#debug = [[x.getMainRun().runString(), x.element, x.added, x] for x in network]

OUT = networks#, debug
# ----------------------------------------

flatten_2 = List.Flatten(list=network_evaluator)

# group: Python to get a number for each item in a list depending on depth and sub list number
code_block_9 = CodeBlock(ElementTree=network_evaluator) { ElementTree; TreeNumber=1; }
get_tag = Python(IN[0]=code_block_9.ElementTree, IN[1]=code_block_9.TreeNumber)  # IronPython2
# ---------- get_tag.python (41 lines) ----------
# Enable Python support and load DesignScript library
import clr
clr.AddReference('ProtoGeometry')
from Autodesk.DesignScript.Geometry import *

#By Jared Linden jaredlinden@hoarela.com
# The inputs to this node will be stored as a list in the IN variables.
dataEnteringNode = IN[0]
number = IN[1]

output = []

#Sweet sweet recursion
def GetTagRecursive(item, current_branch):
		
	item_tags = []
	
	next_branches = current_branch[:]+[0]
	for x in item:
		#Check iterable
		if isinstance(x,list):
			next_branches[-1] = next_branches[-1] + 1
			item_tags.append(GetTagRecursive(x, next_branches))
		else:
			st = str(current_branch[0])
			for i in current_branch[1:]:
				st += "." + str(i)
			item_tags.append(st)
	return item_tags	
	
current_number = number
for network in dataEnteringNode:
	network_tags = []
	blobs = GetTagRecursive(network, [number])
	for x in blobs:
		network_tags.append(x)
	output.append(network_tags)
	number +=1

# Assign your output to the OUT variable.
OUT = output
# ----------------------------------------
flatten_3 = List.Flatten(list=get_tag)

groupByKey = List.GroupByKey(list=flatten_2, keys=flatten_3)

# group: Get only sizing connections
elementType_2 = Element.ElementType(element=groupByKey.groups)
code_block_10 = CodeBlock { "Family Name"; }
getParameterValueByName_2 = Element.GetParameterValueByName(element=elementType_2, parameterName=code_block_10)
code_block_11 = CodeBlock { "SizingConnection"; }
contains_3 = String.Contains(string=getParameterValueByName_2, searchFor=code_block_11)
filterByBoolMask_3 = List.FilterByBoolMask(list=groupByKey.groups, mask=contains_3)

# group: Get only pipes
getCategory_2 = Element.GetCategory(element=groupByKey.groups)
name_4 = Category.Name(category=getCategory_2)
code_block_12 = CodeBlock { "Pipes"; }
contains_4 = String.Contains(string=name_4, searchFor=code_block_12)
filterByBoolMask_4 = List.FilterByBoolMask(list=groupByKey.groups, mask=contains_4)

# group: Get only Sanitary pipes
code_block_13 = CodeBlock { "System Classification"; }
getParameterValueByName_3 = Element.GetParameterValueByName(element=filterByBoolMask_4.in, parameterName=code_block_13)
code_block_14 = CodeBlock { "Sanitary"; }
contains_5 = String.Contains(string=getParameterValueByName_3, searchFor=code_block_14)
filterByBoolMask_5 = List.FilterByBoolMask(list=filterByBoolMask_4.in, mask=contains_5)

code_block_15 = CodeBlock { ""; }
code_block_16 = CodeBlock { "System Name"; }
getParameterValueByName_4 = Element.GetParameterValueByName(element=filterByBoolMask_5.in, parameterName=code_block_16)

# group: User selection: Use Manual System Name
code_block_17 = CodeBlock(UseManualSystemName=multipleinputform.User_Inputs) { UseManualSystemName[1]; }

# group: Check whether Use Manual System Name option was used & if Manual System Name parameter has a value
code_block_18 = CodeBlock { "Manual System Name"; }
getParameterValueByName_5 = Element.GetParameterValueByName(element=filterByBoolMask_5.in, parameterName=code_block_18)
uniqueItems = List.UniqueItems(list=getParameterValueByName_5, lacing=Longest)
sort = List.Sort(list=uniqueItems)
flatten_4 = List.Flatten(list=sort)
length = String.Length(string=flatten_4)
code_block_19 = CodeBlock(x=length) { x>0; }
identity = Object.Identity()  # unwired: object
trueForAll = List.TrueForAll(list=code_block_19, queryFunction=identity)
join = List.Join(list0=code_block_17, list1=trueForAll)
trueForAll_2 = List.TrueForAll(list=join, queryFunction=identity)

list_create_2 = List.Create(item0=getParameterValueByName_4, item1=flatten_4)

# group: Conditional
code_block_20 = CodeBlock(x=trueForAll_2) { x==false? 0 : 1; }

getItemAtIndex_3 = List.GetItemAtIndex(list=list_create_2, index=code_block_20)
flatten_5 = List.Flatten(list=getItemAtIndex_3)

# group: User Selection: Was Run & Was Cancelled
code_block_21 = CodeBlock(WasRun=multipleinputform.Was_Run, WasCancelled=multipleinputform.Was_Cancelled, ManualSystemName=trueForAll_2) { WasRun == true && WasCancelled == false && ManualSystemName == true? true : false; }

# group: User Interface
code_block_22 = CodeBlock { "Select Sub-System(s)"; null; "Proceed"; "Cancel"; 800; 700; 300; }
code_block_23 = CodeBlock { "Sub-Systems"; 400; false; }
listview_data = Custom[Listview Data](InputName=code_block_23.out0, Keys=flatten_5, Values=flatten_5, Height_optionnal=code_block_23.out1, ShowId_optionnal=code_block_23.out2)  # package Data-Shapes; Create data for ListView input in UI.MultiInputForm ++ . Check out www.data-shapes.net for more infos.
multipleinputform_2 = Custom[MultipleInputForm ++](Description_optional=code_block_22.out0, Logo_optional=code_block_22.out1, ButtonText_optional=code_block_22.out2, Inputs=listview_data, Toggle=code_block_21, CancelButtonText_optional=code_block_22.out3, MaxHeight_optional=code_block_22.out4, Width_optional=code_block_22.out5, LabelWidth_optional=code_block_22.out6)

list_create_3 = List.Create(item0=code_block_15, item1=multipleinputform_2.User_Inputs)
getItemAtIndex_4 = List.GetItemAtIndex(list=list_create_3, index=code_block_20)
allIndicesOf = List.AllIndicesOf(list=flatten_4, item=getItemAtIndex_4)
getItemAtIndex_5 = List.GetItemAtIndex(list=filterByBoolMask_3.in, index=allIndicesOf@L1)
list_create_4 = List.Create(item0=filterByBoolMask_3.in, item1=getItemAtIndex_5)

# group: Sizing Connections
getItemAtIndex_6 = List.GetItemAtIndex(list=list_create_4, index=code_block_20)
flatten_6 = List.Flatten(list=getItemAtIndex_6)

# group: Get Levels & sort them based on elevation
string = StringInput("Levels")
byName_2 = Category.ByName(name=string)
all_elements_of_category_2 = ElementsOfCategory(Category=byName_2)
projectElevation = Level.ProjectElevation()  # unwired: level
sortByFunction = List.SortByFunction(list=all_elements_of_category_2, sortFunction=projectElevation)

# group: Determine Levels for Sizing Connections
name_5 = Level.Name(level=sortByFunction)
getLocation = Element.GetLocation(element=getItemAtIndex_6)
Z = Point.Z(point=getLocation)
projectElevation_2 = Level.ProjectElevation(level=sortByFunction)
lt = Z@@L1 < projectElevation_2  # lacing=CrossProduct
code_block_24 = CodeBlock { true; }
firstIndexOf = List.FirstIndexOf(list=lt@@L2, item=code_block_24, lacing=Longest)
code_block_25 = CodeBlock(x=firstIndexOf) { x-1; }
getItemAtIndex_7 = List.GetItemAtIndex(list=name_5, index=code_block_25)

flatten_7 = List.Flatten(list=getItemAtIndex_7)
uniqueItems_2 = List.UniqueItems(list=flatten_7)

# group: User Selection: Was Run & Was Cancelled
code_block_26 = CodeBlock(WasRun=multipleinputform.Was_Run, WasCancelled=multipleinputform.Was_Cancelled) { WasRun == true && WasCancelled == false? true : false; }

# group: User Interface
code_block_27 = CodeBlock { "Remove Connection(s) at Selected Level(s)"; null; "Proceed"; "Cancel"; 800; 700; 300; }
code_block_28 = CodeBlock { "Level(s)"; 400; false; }
listview_data_2 = Custom[Listview Data](InputName=code_block_28.out0, Keys=uniqueItems_2, Values=uniqueItems_2, Height_optionnal=code_block_28.out1, ShowId_optionnal=code_block_28.out2)
multipleinputform_3 = Custom[MultipleInputForm ++](Description_optional=code_block_27.out0, Logo_optional=code_block_27.out1, ButtonText_optional=code_block_27.out2, Inputs=listview_data_2, Toggle=code_block_26, CancelButtonText_optional=code_block_27.out3, MaxHeight_optional=code_block_27.out4, Width_optional=code_block_27.out5, LabelWidth_optional=code_block_27.out6)

# group: User Selection: Selected Levels
code_block_29 = CodeBlock(SelectedLevels=multipleinputform_3.User_Inputs) { SelectedLevels[0]; }

allIndicesOf_2 = List.AllIndicesOf(list=flatten_7, item=code_block_29)
code_block_30 = CodeBlock { 1; }
flatten_8 = List.Flatten(list=allIndicesOf_2, amount=code_block_30)
getItemAtIndex_8 = List.GetItemAtIndex(list=flatten_6, index=flatten_8)

# group: Delete sizing connections at selected level(s)
delete = Element.Delete(element=getItemAtIndex_8)
