# Dynamo graph Foul Drainage Systems_Pipe Numbering v.2.0.dyn "Foul Drainage Systems_Pipe Numbering v.1.4" (Dynamo 2.13.1.3887)
# packages: Data-Shapes 2022.2.103

# group: DYNAMO COLOUR CODING LEGEND
# note: COLOUR CODING LEGEND

# group: Monitor
# note: USE:
# FOR IMPORTANT WATCH NODES

# group: Conditional
# note: USE:
# FOR CONDITIONAL NODES

# group: Python
# note: USE:
# FOR PYTHON NODES

# group: To Revit
# note: USE:
# FOR CHANGES TO REVIT

# group: Control
# note: USE:
# FOR USER CONTROL (SLIDERS ETC.)

# group: Input
# note: USE:
# FOR FIXED INPUT (FILE PATHS ETC.)

# group: Background
# note: USE:
# FOR GENERAL WORKFLOW NODES

# group: Get Only Piping Systems Containing 'Sanitary' in System Classification
code_block = CodeBlock { "Piping Systems"; }
byName = Category.ByName(name=code_block)
all_elements_of_category = ElementsOfCategory(Category=byName)
elementType = Element.ElementType(element=all_elements_of_category)
code_block_2 = CodeBlock { "System Classification"; }
getParameterValueByName = Element.GetParameterValueByName(element=elementType, parameterName=code_block_2)
code_block_3 = CodeBlock { "Sanitary"; }
contains = String.Contains(string=getParameterValueByName, searchFor=code_block_3)
filterByBoolMask = List.FilterByBoolMask(list=all_elements_of_category, mask=contains)

name = Element.Name(element=filterByBoolMask.in)

# group: Python to sort strings with numbers
python_to_sort_strings_with = Python(IN[0]=name)  # "Python to sort strings with numbers"; IronPython2
# ---------- python_to_sort_strings_with.python (10 lines) ----------
import re

list = IN[0]

def natural_sort(l): 
    convert = lambda text: int(text) if text.isdigit() else text.lower() 
    alphanum_key = lambda key: [ convert(c) for c in re.split('([0-9]+)', key) ] 
    return sorted(l, key = alphanum_key)

OUT = natural_sort(list)
# ----------------------------------------

indexOf = List.IndexOf(list=name, element=python_to_sort_strings_with)
getItemAtIndex = List.GetItemAtIndex(list=filterByBoolMask.in, index=indexOf)

# group: User Interface
code_block_4 = CodeBlock { "Set Foul Drainage System Number"; null; "Proceed"; "Cancel"; 800; 700; 300; }
code_block_5 = CodeBlock { ["Pipe","System"]; }
code_block_6 = CodeBlock { "Select Pipe"; "Select"; }
code_block_7 = CodeBlock { "Pipes"; }
byName_2 = Category.ByName(name=code_block_7)
boolean = BoolSelector(true)
selectmodelelements_data = Custom[SelectModelElements Data](InputName=code_block_6.out0, ButtonText=code_block_6.out1, CategoryFilter=byName_2, SelectSingleElement=boolean)  # package Data-Shapes; Creates a Revit element selection input for UI.MultipleInputForm++ . Check out www.data-shapes.net for more infos!
code_block_8 = CodeBlock { "Select System"; }
boolean_2 = BoolSelector(false)
dropdown_data = Custom[DropDown Data](InputName=code_block_8, Keys=python_to_sort_strings_with, Values=getItemAtIndex, Sorted_optional=boolean_2)  # package Data-Shapes; Create data for DropDown input in UI.MultiInputForm ++ . Check out www.data-shapes.net for more infos.
list_create = List.Create(item0=selectmodelelements_data, item1=dropdown_data)
conditionalinput_data = Custom[ConditionalInput Data](Options=code_block_5, InputGroups_by_Option=list_create)  # package Data-Shapes; Allows to create inputs that are enabled/disabled by a condition dor UI.MultipleInputForm++.
code_block_9 = CodeBlock { "Choose Number"; }
boolean_3 = BoolSelector(true)
textbox_data = Custom[TextBox Data](InputName=code_block_9, IsNumberEntry=boolean_3)  # package Data-Shapes; Create Data for TextBox input in UI.MultipleInputForm ++ . Check out www.data-shapes.net for more informations
list_create_2 = List.Create(item0=conditionalinput_data, item1=textbox_data)
boolean_4 = BoolSelector(true)
multipleinputform = Custom[MultipleInputForm ++](Description_optional=code_block_4.out0, Logo_optional=code_block_4.out1, ButtonText_optional=code_block_4.out2, Inputs=list_create_2, Toggle=boolean_4, CancelButtonText_optional=code_block_4.out3, MaxHeight_optional=code_block_4.out4, Width_optional=code_block_4.out5, LabelWidth_optional=code_block_4.out6)  # package Data-Shapes; Create a form with multiple inputs. see www.data-shapes.net for tutorials and infos!

# group: User Selection: Selected Method
code_block_10 = CodeBlock(Method=multipleinputform.User_Inputs) { Method == "Pipe"? [1] : [2]; }

getItemAtIndex_2 = List.GetItemAtIndex(list=multipleinputform.User_Inputs, index=code_block_10)
code_block_11 = CodeBlock { "System Name"; }
getParameterValueByName_2 = Element.GetParameterValueByName(element=getItemAtIndex_2, parameterName=code_block_11)
indexOf_2 = List.IndexOf(list=python_to_sort_strings_with, element=getParameterValueByName_2)
getItemAtIndex_3 = List.GetItemAtIndex(list=getItemAtIndex, index=indexOf_2)

# group: Python to get all elements in network
python_pipe_network = Python(IN[0]=getItemAtIndex_3)  # IronPython2
# ---------- python_pipe_network.python (42 lines) ----------
import clr

clr.AddReference("RevitServices")
import RevitServices
from RevitServices.Persistence import DocumentManager
from RevitServices.Transactions import TransactionManager
doc = DocumentManager.Instance.CurrentDBDocument

clr.AddReference("RevitAPI")
import Autodesk
from Autodesk.Revit.DB import *

clr.AddReference("RevitNodes")
import Revit
clr.ImportExtensions(Revit.Elements)
clr.ImportExtensions(Revit.GeometryConversion)

#Many thanks to Konrad K Sobon for his awesome ProcessList function!
def Unwrap(item):
	return UnwrapElement(item)

def ProcessList(_func, _list):
    return map( lambda x: ProcessList(_func, x) if type(x)==list else _func(x), _list )

if isinstance(IN[0], list):
	systems = ProcessList(Unwrap, IN[0])
else:
	systems = [Unwrap(IN[0])]
	
	
def getNetwork(system):
	network = None
	try:
		network = [x.ToDSType(True) for x in system.PipingNetwork]
	except:
		pass
	return network

			
#Assign your output to the OUT variable.

OUT = ProcessList(getNetwork, systems)
# ----------------------------------------

# group: Get only pipes
getCategory = Element.GetCategory(element=python_pipe_network)
string_from_object = FromObject(obj=getCategory)
code_block_12 = CodeBlock { "Pipes"; }
contains_2 = String.Contains(string=string_from_object, searchFor=code_block_12)
filterByBoolMask_2 = List.FilterByBoolMask(list=python_pipe_network, mask=contains_2)

# group: Get lowest pipe in the system
code_block_13 = CodeBlock { "Invert Elevation"; }
getParameterValueByName_3 = Element.GetParameterValueByName(element=filterByBoolMask_2.in, parameterName=code_block_13)
minimumItem = List.MinimumItem(list=getParameterValueByName_3, lacing=Longest)
allIndicesOf = List.AllIndicesOf(list=getParameterValueByName_3, item=minimumItem, lacing=Longest)
getItemAtIndex_4 = List.GetItemAtIndex(list=filterByBoolMask_2.in, index=allIndicesOf, lacing=Longest)
flatten = List.Flatten(list=getItemAtIndex_4)

# group: Python to evaluate elements in each network and output a sublist for each branch
network_evaluator = Python(IN[0]=flatten)  # IronPython2
# ---------- network_evaluator.python (397 lines) ----------
# Enable Python support and load DesignScript library
import clr
clr.AddReference('ProtoGeometry')
from Autodesk.DesignScript.Geometry import *

clr.AddReference("RevitAPI")
import Autodesk
from Autodesk.Revit.DB import *

clr.AddReference("RevitNodes")
import Revit
clr.ImportExtensions(Revit.Elements)

# The inputs to this node will be stored as a list in the IN variables.
# Angled branching network evaluator by Jared Linden jaredlindena@hoarelea.com 

dataEnteringNode = UnwrapElement(IN[0])

debug = []

class Run:

	def __init__(self, _number, _parent, _start_id):
		self.parent = _parent
		self.start_id = _start_id
		self.number = _number
		self.__branches = 0
		
	def depth(self):
		return self.parent.depth() + 1 if self.parent else 1
		
	def runString(self):
		return str(self.number) if self.parent is None else self.parent.runString() + "." + str(self.number)
		
	def branch(self, start_id):
		self.__branches += 1
		return Run(self.__branches, self, start_id)
		
	def __eq__(self, other):
		if not isinstance(other, Run): 
			return False
		return self.number == other.number and self.depth() == other.depth() if self.parent == other.parent else False
		
	def __lt__(self, other):
		if self.depth() == other.depth() and self.number == other.number:
			return self.parent < other.parent if self.parent else - 1
		else:
			return self.number < other.number if self.depth() == other.depth() else self.depth() < other.depth()
	
	def __hash__(self):
		return self.number * 31 + self.depth()
	

class Edge:
	
	def __init__(self, _run, _start_connector):
		self.run = _run
		self.end = None
		self.start = _start_connector.node
		self.__connector = _start_connector
		
	def evaluate(self):
		current = self.__connector.connectedElement()
		while(isinstance(current, SectionElement)):
			current = current.nextElement()
		self.end = current
		
class ConnectorHelper:
	
	def __init__(self, _node, _connector, _element_container):
		self.node = _node
		self.id = connected(_connector).Owner.Id.IntegerValue
		self.direction = _connector.CoordinateSystem.BasisZ
		self.edge = None
		self.__connector = _connector
		self.__element_container = _element_container
		
	def setEdge(self, _edge):
		self.edge = _edge
		
	def hasEvaluated(self):
		return self.edge is not None
		
	def evaluateEdge(self, run):
		self.edge = Edge(run, self)
		self.edge.evaluate()

		
	def connectedElement(self):
		return self.__element_container.getNetworkElement(connected(self.__connector).Owner, self.node, self.edge)

class SectionElement:

	def __init__(self, _elem, _edge, _prev_id, _source, _added):
		self.edge = _edge
		self.added = _added
		self.prev_id = _prev_id
		self.element = _elem
		self.source = _source
		self.id = _elem.Id.IntegerValue
		self.main_run = _edge.run
		
	def getMainRun(self):
		return self.edge.run
		
	def nextElement(self):
		try:
			next_elem = next(iter(y.Owner for y in [connected(x) for x in getNodeConnectors(self.element)] if y.Owner.Id.IntegerValue != self.prev_id))
		except:
			next_elem = next(iter(y.Owner for y in [connected(x) for x in getAllConnectors(self.element)] if y.Owner.Id.IntegerValue != self.prev_id))
		return self.source.getNetworkElement(next_elem, self, self.edge)


class TerminalElement:
	def __init__(self, _element, _edge, _added):
		self.element = _element
		self.added = _added
		self.edge = _edge
		self.id = _element.Id.IntegerValue
		
	def getMainRun(self):
		return self.edge.run


class BranchElement(object):
	
	def __init__(self, element):
		self.id = element.Id.IntegerValue


class StartElement(BranchElement):
	
	def __init__(self, _element, _run, _element_source, _added):
		self.element = _element
		self.__source = _element_source
		self.added = _added
		self.main_run = _run
		self.paused = False
		self.id = _element.Id.IntegerValue
		self.__connectors = [ConnectorHelper(self, x, _element_source) for x in getAllConnectors(_element)]
		if len(self.__connectors) != 0:
			self.__out1 = self.__connectors[0]
			self.__out2 = None
			if len(self.__connectors) > 1:
				self.__out2 = self.__connectors[1]
		super(StartElement, self).__init__(_element)
		
	def getMainRun(self):
		return self.main_run

	def hasMainNext(self):
		return True
	
	def evaluateMain(self):
		if not self.__out1.hasEvaluated():
			return self.__out1.evaluateEdge(self.main_run)
		elif self.__out2 is not None and not self.__out2.hasEvaluated():
			return self.__out2.evaluateEdge(self.main_run)
		else:
			return self.__out1.evaluateEdge(self.main_run)
			
	def evaluateNextBranch(self):
		con = sorted((x for x in self.__connectors if not x.hasEvaluated()), key = lambda x: self.__out1.direction.AngleTo(x.direction))[0]
		con.evaluateEdge(self.getMainRun().branch(self.id))
		
	def hasEvaluated(self):
		return all(x.hasEvaluated() for x in self.__connectors)
		
	def hasEvaluatedMain(self):
		return self.__out1.hasEvaluated() and (self.__out2 is None or self.__out2.hasEvaluated())
		
	def setIncomingEdge(self, connector_id, edge):
		[x for x in self.__connectors if x.id == connector_id][0].setEdge(edge)
			

class NodeElement(BranchElement):

	def __init__(self, _element, _edge, _prev_id, _source, _added):
		self.element = _element
		self.__source = _source
		self.__prev_id = _prev_id
		self.id = _element.Id.IntegerValue
		self.added = _added
		self.__connectors = [ConnectorHelper(self, x, _source) for x in getAllConnectors(_element)]
		self.paused = False
		next(iter(x for x in self.__connectors if x.id == _prev_id)).setEdge(_edge)
		self.paused = not self.hasMainNext()
		super(NodeElement, self).__init__(_element)
		
	def inConnectors(self):
		return (x for x in self.__connectors if x.edge is not None and x.edge.start.id != self.id)
		
	def getInMain(self):
		return sorted(self.inConnectors(), key = lambda x: x.edge.run)[0]
		
	def getMainRun(self):
		return sorted((x for x in self.__connectors if x.hasEvaluated()), key = lambda x: x.edge.run)[0].edge.run
		
	def hasMainNext(self):
		main_in_dir = self.getInMain().direction.Negate()
		return len([x for x in self.__connectors if not x.hasEvaluated()]) == 1 or any(x for x in self.__connectors if x.direction.AngleTo(main_in_dir) < 0.05 and not x.hasEvaluated())
		
	def evaluateMain(self):
		self.paused = False
		main_in_dir = self.getInMain().direction.Negate()
		sorted((x for x in self.__connectors if not x.hasEvaluated()), key = lambda x: main_in_dir.AngleTo(x.direction))[0].evaluateEdge(self.getMainRun())
		
	def evaluateNextBranch(self):
		main_in_dir = self.getInMain().direction.Negate()
		con = sorted((x for x in self.__connectors if not x.hasEvaluated()), key = lambda x: main_in_dir.AngleTo(x.direction))[0]
		con.evaluateEdge(self.getMainRun().branch(self.id))
		
	def hasEvaluated(self):
		return all(x.hasEvaluated() for x in self.__connectors)
		
	def hasEvaluatedMain(self):
		return len([x for x in self.__connectors if x.hasEvaluated() and x.edge.run == self.getMainRun()]) == 2
		
	def setIncomingEdge(self, connector_id, edge):
		next(iter(x for x in self.__connectors if x.id == connector_id)).setEdge(edge)
		
			
class ElementContainer:

	def __init__(self):
		self.__elems = {}
		self.__number = 1
		
	def getNetworkElement(self, element, prev, edge):
		id = element.Id.IntegerValue
		if id in self.__elems:
			elem = self.__elems[id]
			if isinstance(elem, NodeElement):
				elem.setIncomingEdge(prev.id, edge)
			return elem
		else:
			if isNodeElement(element):
				new = NodeElement(element, edge, prev.id, self, self.__number)
			elif isSectionElement(element):
				new = SectionElement(element, edge, prev.id, self, self.__number)
			elif isTermainalElement(element):
				new = TerminalElement(element, edge, self.__number)
			else:
				raise Exception("Unknow element type connected to network")
			self.__elems[id] = new
			self.__number += 1
			return new
			
	def networkElements(self):
		return sorted(sorted(self.__elems.values(), key = lambda x:x.getMainRun()), key = lambda y:y.added)
		
	def setStart(self, start_node):
		self.__elems[start_node.id] = start_node
		
	def nodes(self):
		return (x for x in self.__elems.values() if isinstance(x, BranchElement)) #or isinstance(x, NodeElement))


def isValidConnector(connector):
	return (connector.ConnectorType == ConnectorType.End or connector.ConnectorType == ConnectorType.Curve) and connector.IsConnected and (isinstance(connector.Owner, MEPCurve) or isinstance(connector.Owner, FamilyInstance))

#Return Connector
def connected(connector):
	try:
		return [x for x in connector.AllRefs if isValidConnector(x) and x.Owner.Id.IntegerValue != connector.Owner.Id.IntegerValue][0]
	except:
		raise Exception("Connector not connected")
	
def connectedId(connector):
	return connected(connector).Owner.Id.IntegerValue
	
def getAllConnectors(element):
	try:
		connectors = element.MEPModel.ConnectorManager.Connectors
	except:
		connectors = element.ConnectorManager.Connectors
	return [x for x in connectors if isValidIterableConnector(x)]
	
def isValidIterableConnector(connector):
	return isValidConnector(connector) and len([x for x in connected(connector).ConnectorManager.Connectors]) > 1
	
def getNodeConnectors(element):
	return [x for x in getAllConnectors(element) if not isPipeConnectedToCap(connected(x).Owner)]
	
def isPipeConnectedToCap(elem):
	try:
		length = elem.Location.Curve.Length
	except:
		length = 10
	if length > 1.5:
		return False
	try:
		connectors = elem.MEPModel.ConnectorManager.Connectors
	except:
		connectors = elem.ConnectorManager.Connectors
	return any(len([y for y in connected(x).ConnectorManager.Connectors if isValidConnector(y)]) < 2 for x in [z for z in connectors if isValidConnector(z)])
	
def isSectionElement(element):
	return len(getAllConnectors(element)) == 2 or len(getNodeConnectors(element)) == 2
	
def isNodeElement(element):
	return len(getNodeConnectors(element)) > 2
	
def isTermainalElement(element):
	return len(getAllConnectors(element)) == 1 or len(getNodeConnectors(element)) == 1
	
def firstOrNone(list):
	return next(iter(list), None)
	
def mainLoop(root_element):

	element_container = ElementContainer()
	root_run = Run(1, None, root_element.Id.IntegerValue)
	start_node = StartElement(root_element, root_run, element_container, 0)
	element_container.setStart(start_node)
	
	safety = 0
	while firstOrNone(x for x in element_container.nodes() if not x.hasEvaluated()) is not None:
		ordered_unevaluated = sorted(sorted((x for x in element_container.nodes() if not x.hasEvaluated()), key = lambda x: x.getMainRun()), key = lambda y:y.added)
		safety +=1
		if safety > 999:
			raise Exception("To many loops")
		first_with_next = firstOrNone((x for x in ordered_unevaluated if not x.hasEvaluatedMain() and not x.paused and x.hasMainNext()))
		if first_with_next is not None:
			first_with_next.evaluateMain()
			continue
			
		first_with_branch = firstOrNone((x for x in ordered_unevaluated if x.hasEvaluatedMain() and not x.paused))
		if first_with_branch is not None:
			first_with_branch.evaluateNextBranch()
			continue
			
		first_paused_with_main = firstOrNone((x for x in ordered_unevaluated if x.hasMainNext() and x.paused and not x.hasEvaluatedMain()))
		if first_paused_with_main is not None:
			first_paused_with_main.evaluateMain()
			continue
			
		first_paused_branch = firstOrNone((x for x in ordered_unevaluated if not x.hasEvaluatedMain() and x.paused))
		if first_paused_branch is not None:
			first_paused_branch.evaluateMain()
			continue
			
		raise Exception("Unknown state")
	return element_container.networkElements()


	
in_elements = dataEnteringNode


output = []


def addToRunsDict(elem, runsdict):
	run = elem.getMainRun()
	runstart = run.start_id
	runstring = run
	if runstart not in runsdict:
		runsdict[runstart] = {}
	if runstring not in runsdict[runstart]:
		runsdict[runstart][runstring] = []
	runsdict[runstart][runstring].append(elem)
	
safe1 = 0

def getRunElements(elems, runsdict):
	list = []
	global safe1
	safe1 +=1
	if safe1 > 5000:
		raise Exception("Too many recursions")
	sorted_elems = sorted(elems, key = lambda x:x.added)
	for x in sorted_elems:
		list.append(x.element)
		if x.id in runsdict:
			for key in sorted(runsdict[x.id].keys()):
				subl = runsdict[x.id].pop(key)
				list.append(getRunElements(subl, runsdict))
	return list
	
networks = []
all_done =[]
for element in (me for me in in_elements if me.Id.IntegerValue not in all_done):
	runsdict = {}
	output = []
	network = mainLoop(element)
	for x in network:
		addToRunsDict(x, runsdict)
	
	#done_list.append(element.Id.IntegerValue)
	first = runsdict[element.Id.IntegerValue].keys()[0]
	lems = runsdict[element.Id.IntegerValue].pop(first)
	networks.append(getRunElements(lems, runsdict))
	all_done.extend([x.id for x in network])
#debug = [[x.getMainRun().runString(), x.element, x.added, x] for x in network]

OUT = networks#, debug
# ----------------------------------------
code_block_14 = CodeBlock(out=network_evaluator) { out; }

code_block_15 = CodeBlock { 1; }
flatten_2 = List.Flatten(list=code_block_14, amount=code_block_15)
flatten_3 = List.Flatten(list=flatten_2)
code_block_16 = CodeBlock { "System Abbreviation"; }
getParameterValueByName_4 = Element.GetParameterValueByName(element=flatten_3, parameterName=code_block_16)

# group: User Input: Input Number
code_block_17 = CodeBlock(InputNumber=multipleinputform.User_Inputs) { InputNumber[3]; }

ceiling = Math.Ceiling(number=code_block_17)

# group: Get a number for each item in a list depending on depth and sub list number
code_block_18 = CodeBlock(ElementTree=flatten_2, TreeNumber=ceiling) { ElementTree; TreeNumber; }
get_tag = Python(IN[0]=code_block_18.ElementTree, IN[1]=code_block_18.TreeNumber)  # IronPython2
# ---------- get_tag.python (37 lines) ----------
# Enable Python support and load DesignScript library
import clr
clr.AddReference('ProtoGeometry')
from Autodesk.DesignScript.Geometry import *

#By Jared Linden jaredlinden@hoarela.com
# The inputs to this node will be stored as a list in the IN variables.
dataEnteringNode = IN[0]
number = IN[1]

output = []

#Sweet sweet recursion
def GetTagRecursive(item, current_branch):
		
	item_tags = []
	
	next_branches = current_branch[:]+[0]
	for x in item:
		#Check iterable
		if isinstance(x,list):
			next_branches[-1] = next_branches[-1] + 1
			item_tags.append(GetTagRecursive(x, next_branches))
		else:
			st = str(current_branch[0])
			for i in current_branch[1:]:
				st += "." + str(i)
			item_tags.append(st)
	return item_tags	
	

blobs = GetTagRecursive(dataEnteringNode, [number])
for x in blobs:
	output.append(x)

# Assign your output to the OUT variable.
OUT = output
# ----------------------------------------

flatten_4 = List.Flatten(list=get_tag)
code_block_19 = CodeBlock(x=getParameterValueByName_4, y=flatten_4) { x + " " + y; }

# group: Set Manual System Name Parameter
string = StringInput("Manual System Name")
setParameterByName = Element.SetParameterByName(element=flatten_3, parameterName=string, value=code_block_19)
