# Dynamo graph Foul Drainage Systems_Place Traps v.2.0.dyn (Dynamo 2.16.1.2727)
# packages: Data-Shapes 2022.2.103

# group: DYNAMO COLOUR CODING LEGEND
# note: COLOUR CODING LEGEND

# group: Monitor
# note: USE:
# FOR IMPORTANT WATCH NODES

# group: Python
# note: USE:
# FOR PYTHON NODES

# group: Conditional
# note: USE:
# FOR CONDITIONAL NODES

# group: To Revit
# note: USE:
# FOR CHANGES TO REVIT

# group: Control
# note: USE:
# FOR USER CONTROL (SLIDERS ETC.)

# group: Input
# note: USE:
# FOR FIXED INPUT (FILE PATHS ETC.)

# group: Background
# note: USE:
# FOR GENERAL WORKFLOW NODES

# group: User Interface
code_block = CodeBlock { "Place Traps"; null; "Proceed"; "Cancel"; 800; 700; 300; }
code_block_2 = CodeBlock { "Note"; }
code_block_3 = CodeBlock { "This Dynamo script places traps on open ends of pipes. You can select single or multiple pipes."; }
textnote_data = Custom[TextNote Data](Title=code_block_2, TextNote=code_block_3)  # package Data-Shapes; Create Data for TextNote input in UI.MultipleInputForm ++ . Check out www.data-shapes.net for more informations
code_block_4 = CodeBlock { "Select Pipes"; "Select"; }
code_block_5 = CodeBlock { "Pipes"; }
byName = Category.ByName(name=code_block_5)
selectmodelelements_data = Custom[SelectModelElements Data](InputName=code_block_4.out0, ButtonText=code_block_4.out1, CategoryFilter=byName)  # package Data-Shapes; Creates a Revit element selection input for UI.MultipleInputForm++ . Check out www.data-shapes.net for more infos!
code_block_6 = CodeBlock { "Trap Type"; ["Bottle Trap","P Trap", "Bath Trap", "Shower Trap", "Waterless Trap"]; 0; }
radiobuttons_data = Custom[RadioButtons Data](InputName=code_block_6.out0, Keys=code_block_6.out1, Values=code_block_6.out1, DefaultValueIndex=code_block_6.out2)  # package Data-Shapes; Create radio buttons input for UI.MultipleInputForm ++ .
list_create = List.Create(item0=textnote_data, item1=selectmodelelements_data, item2=radiobuttons_data)
boolean = BoolSelector(true)
multipleinputform = Custom[MultipleInputForm ++](Description_optional=code_block.out0, Logo_optional=code_block.out1, ButtonText_optional=code_block.out2, Inputs=list_create, Toggle=boolean, CancelButtonText_optional=code_block.out3, MaxHeight_optional=code_block.out4, Width_optional=code_block.out5, LabelWidth_optional=code_block.out6)  # package Data-Shapes; Create a form with multiple inputs. see www.data-shapes.net for tutorials and infos!

code_block_7 = CodeBlock(UserInputs=multipleinputform.User_Inputs) { UserInputs[0]@L1; UserInputs[1]@L1; }

# group: User Selection: Selected System Type
code_block_8 = CodeBlock(SelectedTrap=code_block_7.out1) { SelectedTrap; }

# group: Conditional
code_block_9 = CodeBlock(SelectedTrap=code_block_8)
# ---------- code_block_9.designscript (6 lines) ----------
SelectedTrap == "Bottle Trap"? "HL_TrapBottle":
SelectedTrap == "P Trap"? "HL_TrapP":
SelectedTrap == "Bath Trap"? "HL_TrapBath":
SelectedTrap == "Shower Trap"? "HL_TrapShower":
SelectedTrap == "Waterless Trap"? "HL_MUPVCWaste_TrapSelfSealing":
"HL_TrapBottle";
# ----------------------------------------

byName_2 = Family.ByName(name=code_block_9)
types = Family.Types(family=byName_2)
name = Element.Name(element=types)
toNumber = String.ToNumber(string=name)
sortByKey = List.SortByKey(list=types, keys=toNumber)

# group: User Selection: Selected Option
code_block_10 = CodeBlock(SelectedPipes=code_block_7.out0) { SelectedPipes; }

# group: Get Diameter of selected pipes
code_block_11 = CodeBlock { "Diameter"; }
getParameterValueByName = Element.GetParameterValueByName(element=code_block_10, parameterName=code_block_11)

# group: Select only pipes that can connect to selected trap type
eq = getParameterValueByName == toNumber  # lacing=CrossProduct
identity = Object.Identity()  # unwired: object
trueForAny = List.TrueForAny(list=eq, queryFunction=identity, lacing=Longest)
filterByBoolMask = List.FilterByBoolMask(list=code_block_10, mask=trueForAny)

# group: Sort and group pipes by Diameter
code_block_12 = CodeBlock { "Diameter"; }
getParameterValueByName_2 = Element.GetParameterValueByName(element=filterByBoolMask.in, parameterName=code_block_12)
sortByKey_2 = List.SortByKey(list=filterByBoolMask.in, keys=getParameterValueByName_2)

# group: Python: Element Connectors
python_element_connectors = Python(IN[0]=sortByKey_2.sortedList)  # IronPython2
# ---------- python_element_connectors.python (44 lines) ----------
import clr
import math

clr.AddReference("RevitServices")
import RevitServices
from RevitServices.Persistence import DocumentManager
from RevitServices.Transactions import TransactionManager
doc = DocumentManager.Instance.CurrentDBDocument

clr.AddReference("RevitAPI")
import Autodesk
from Autodesk.Revit.DB import *

clr.AddReference("RevitNodes")
import Revit
clr.ImportExtensions(Revit.Elements)
clr.ImportExtensions(Revit.GeometryConversion)
#The inputs to this node will be stored as a list in the IN variables.
if isinstance(IN[0], list):
	elements = UnwrapElement(IN[0])
	toggle = 0
else:
	toggle = 1
	elements = [UnwrapElement(IN[0])]
	

listout = []

for element in elements:
	try:
		connectors = element.MEPModel.ConnectorManager.Connectors
	except:
		try:
			connectors = element.ConnectorManager.Connectors
		except:			
			connectors = []
	listout.append([x for x in connectors])


#Assign your output to the OUT variable.
if toggle:
	OUT = connectors
else:
	OUT = listout
# ----------------------------------------

# group: Python: Connector Is Connected
python_connector_is_connected = Python(IN[0]=python_element_connectors)  # IronPython2
# ---------- python_connector_is_connected.python (42 lines) ----------
import clr

clr.AddReference("RevitServices")
import RevitServices
from RevitServices.Persistence import DocumentManager
from RevitServices.Transactions import TransactionManager
doc = DocumentManager.Instance.CurrentDBDocument

clr.AddReference("RevitAPI")
import Autodesk
from Autodesk.Revit.DB import *

clr.AddReference("RevitNodes")
import Revit
clr.ImportExtensions(Revit.Elements)
clr.ImportExtensions(Revit.GeometryConversion)

#Many thanks to Konrad K Sobon for his awesome ProcessList function!
def Unwrap(item):
	return UnwrapElement(item)

def ProcessList(_func, _list):
    return map( lambda x: ProcessList(_func, x) if type(x)==list else _func(x), _list )

if isinstance(IN[0], list):
	connectors = ProcessList(Unwrap, IN[0])
else:
	connectors = [Unwrap(IN[0])]
	
	
def IsConnected(connector):
	bool = False
	try:
		bool = connector.IsConnected
	except:
		pass
	return bool

			
#Assign your output to the OUT variable.

OUT = ProcessList(IsConnected, connectors)
# ----------------------------------------

not_ = Not(x=python_connector_is_connected)
identity_2 = Object.Identity()  # unwired: object
trueForAny_2 = List.TrueForAny(list=not_, queryFunction=identity_2, lacing=Longest)
filterByBoolMask_2 = List.FilterByBoolMask(list=sortByKey_2.sortedKeys, mask=trueForAny_2)
eq_2 = filterByBoolMask_2.in == sortByKey.sortedKeys  # lacing=CrossProduct
code_block_13 = CodeBlock { true; }
indexOf = List.IndexOf(list=eq_2, element=code_block_13, lacing=Longest)
getItemAtIndex = List.GetItemAtIndex(list=sortByKey.sortedList, index=indexOf)
filterByBoolMask_3 = List.FilterByBoolMask(list=python_element_connectors, mask=not_)
flatten = List.Flatten(list=filterByBoolMask_3.in)

# group: Python: Get Connector Location
python_get_connector_location = Python(IN[0]=flatten)  # IronPython2
# ---------- python_get_connector_location.python (41 lines) ----------
import clr

clr.AddReference("RevitServices")
import RevitServices
from RevitServices.Persistence import DocumentManager
from RevitServices.Transactions import TransactionManager
doc = DocumentManager.Instance.CurrentDBDocument

clr.AddReference("RevitAPI")
import Autodesk
from Autodesk.Revit.DB import *

clr.AddReference("RevitNodes")
import Revit
clr.ImportExtensions(Revit.Elements)
clr.ImportExtensions(Revit.GeometryConversion)

#Many thanks to Konrad K Sobon for his awesome ProcessList function!
def Unwrap(item):
	return UnwrapElement(item)

def ProcessList(_func, _list):
    return map( lambda x: ProcessList(_func, x) if type(x)==list else _func(x), _list )

if isinstance(IN[0], list):
	connectors = ProcessList(Unwrap, IN[0])
else:
	connectors = [Unwrap(IN[0])]
	
	
def getPoint(connector):
	try:
		return connector.Origin.ToPoint()
	except:
		return None


			
#Assign your output to the OUT variable.

OUT = ProcessList(getPoint, connectors)
# ----------------------------------------

# group: Place family by point
byPoint = FamilyInstance.ByPoint(familyType=getItemAtIndex, point=python_get_connector_location, lacing=Longest)

# group: Python: Get Connector Direction
python_connector_direction = Python(IN[0]=flatten)  # IronPython2
# ---------- python_connector_direction.python (41 lines) ----------
import clr

clr.AddReference("RevitServices")
import RevitServices
from RevitServices.Persistence import DocumentManager
from RevitServices.Transactions import TransactionManager
doc = DocumentManager.Instance.CurrentDBDocument

clr.AddReference("RevitAPI")
import Autodesk
from Autodesk.Revit.DB import *

clr.AddReference("RevitNodes")
import Revit
clr.ImportExtensions(Revit.Elements)
clr.ImportExtensions(Revit.GeometryConversion)

#Many thanks to Konrad K Sobon for his awesome ProcessList function!
def Unwrap(item):
	return UnwrapElement(item)

def ProcessList(_func, _list):
    return map( lambda x: ProcessList(_func, x) if type(x)==list else _func(x), _list )

if isinstance(IN[0], list):
	connectors = ProcessList(Unwrap, IN[0])
else:
	connectors = [Unwrap(IN[0])]
	
	
def getConnDir(connector):
	try:
		return connector.CoordinateSystem.BasisZ.ToVector()
	except:
		return None


			
#Assign your output to the OUT variable.

OUT = ProcessList(getConnDir, connectors)
# ----------------------------------------

# group: Get angle between connector and XZ axis
XAxis = Vector.XAxis()
ZAxis = Vector.ZAxis()
angleAboutAxis = Vector.AngleAboutAxis(vector=python_connector_direction, otherVector=XAxis, rotationAxis=ZAxis)

# group: Rotate family
setRotation = FamilyInstance.SetRotation(familyInstance=byPoint, degree=angleAboutAxis)

# group: Python: Element Connectors
python_element_connectors_2 = Python(IN[0]=setRotation)  # IronPython2; same code as python_element_connectors

# group: Python: Connector Is Primary
python_connector_is_primary = Python(IN[0]=python_element_connectors_2)  # IronPython2
# ---------- python_connector_is_primary.python (42 lines) ----------
import clr

clr.AddReference("RevitServices")
import RevitServices
from RevitServices.Persistence import DocumentManager
from RevitServices.Transactions import TransactionManager
doc = DocumentManager.Instance.CurrentDBDocument

clr.AddReference("RevitAPI")
import Autodesk
from Autodesk.Revit.DB import *

clr.AddReference("RevitNodes")
import Revit
clr.ImportExtensions(Revit.Elements)
clr.ImportExtensions(Revit.GeometryConversion)

#Many thanks to Konrad K Sobon for his awesome ProcessList function!
def Unwrap(item):
	return UnwrapElement(item)

def ProcessList(_func, _list):
    return map( lambda x: ProcessList(_func, x) if type(x)==list else _func(x), _list )

if isinstance(IN[0], list):
	connectors = ProcessList(Unwrap, IN[0])
else:
	connectors = [Unwrap(IN[0])]
	
	
def getConnPrim(connector):
	prim = False
	try:
		prim = connector.GetMEPConnectorInfo().IsPrimary
	except:
		pass
	return prim

			
#Assign your output to the OUT variable.

OUT = ProcessList(getConnPrim, connectors)
# ----------------------------------------

filterByBoolMask_4 = List.FilterByBoolMask(list=python_element_connectors_2, mask=python_connector_is_primary)

# group: Python: Get Connector Location
python_get_connector_location_2 = Python(IN[0]=filterByBoolMask_4.in)  # IronPython2; same code as python_get_connector_location

flatten_2 = List.Flatten(list=python_get_connector_location_2)

# group: Place family by point
byPoint_2 = FamilyInstance.ByPoint(familyType=getItemAtIndex, point=flatten_2, lacing=Longest)

code_block_14 = CodeBlock(angle=angleAboutAxis) { 180+angle; }

# group: Rotate family
setRotation_2 = FamilyInstance.SetRotation(familyInstance=byPoint_2, degree=code_block_14)

code_block_15 = CodeBlock { 1; }
chop = List.Chop(list=flatten, lengths=code_block_15)

# group: Python: Element Connectors
python_element_connectors_3 = Python(IN[0]=setRotation_2)  # IronPython2; same code as python_element_connectors

# group: Conditional
list_create_2 = List.Create(item0=setRotation, item1=setRotation_2)
code_block_16 = CodeBlock(SelectedTrap=code_block_8) { SelectedTrap == "Waterless Trap"? 1: 0; }
getItemAtIndex_2 = List.GetItemAtIndex(list=list_create_2, index=code_block_16)
list_create_3 = List.Create(item0=python_element_connectors_3, item1=filterByBoolMask_4.in)
getItemAtIndex_3 = List.GetItemAtIndex(list=list_create_3, index=code_block_16)

# group: Wait then passthrough
code_block_17 = CodeBlock(passThrough=getItemAtIndex_2) { passThrough: var[]..[]; }
code_block_18 = CodeBlock(waitFor=byPoint_2) { waitFor: var[]..[]; }
code_block_19 = CodeBlock(passthrough=code_block_17, waitfor=code_block_18) { [passthrough,waitfor][0]; }

# group: Delete Elements
delete = Element.Delete(element=code_block_19)

# group: Python: Element Connectors
code_block_20 = CodeBlock(connector=chop) { connector; }
code_block_21 = CodeBlock(Connector2=getItemAtIndex_3) { Connector2; }
python = Python(IN[0]=code_block_20, IN[1]=code_block_21)  # IronPython2
# ---------- python.python (52 lines) ----------
import clr

clr.AddReference("RevitServices")
import RevitServices
from RevitServices.Persistence import DocumentManager
from RevitServices.Transactions import TransactionManager
doc = DocumentManager.Instance.CurrentDBDocument

clr.AddReference("RevitAPI")
import Autodesk
from Autodesk.Revit.DB import *

clr.AddReference("RevitNodes")
import Revit
clr.ImportExtensions(Revit.Elements)
clr.ImportExtensions(Revit.GeometryConversion)

#Many thanks to Konrad K Sobon for his awesome ProcessList function!
def Unwrap(item):
	return UnwrapElement(item)
	
def ProcessList(_func, _list):
    return map( lambda x: ProcessList(_func, x) if type(x)==list else _func(x), _list )

def ProcessList2(_func, _list, _list2):
    return map( lambda x,y: ProcessList2(_func, x, y) if type(x)==list else _func(x,y), _list, _list2 )

if isinstance(IN[0], list):
	connectors = IN[0]
else:
	connectors = [IN[0]]
	
if isinstance(IN[1], list):
	connectors2 = IN[1]
else:
	connectors2 = [IN[1]]
	
	
def ConnectTo(connector, conn2):
	bool = False
	try:
		TransactionManager.Instance.EnsureInTransaction(doc)
		connector.ConnectTo(conn2)
		bool = True
		TransactionManager.Instance.TransactionTaskDone()
	except:
		pass
	return bool

			
#Assign your output to the OUT variable.
OUT = ProcessList2(ConnectTo, connectors, connectors2)
# ----------------------------------------
