# Dynamo graph Foul Drainage Systems_Pipe Annotations_Multiple Levels v.3.1.dyn (Dynamo 2.16.1.2727)
# packages: Data-Shapes 2021.2.92

# group: DYNAMO COLOUR CODING LEGEND
# note: COLOUR CODING LEGEND

# group: Python
# note: USE:
# FOR PYTHON NODES

# group: Monitor
# note: USE:
# FOR IMPORTANT WATCH NODES

# group: Conditional
# note: USE:
# FOR CONDITIONAL NODES

# group: To Revit
# note: USE:
# FOR CHANGES TO REVIT

# group: Control
# note: USE:
# FOR USER CONTROL (SLIDERS ETC.)

# group: Input
# note: USE:
# FOR FIXED INPUT (FILE PATHS ETC.)

# group: Background
# note: USE:
# FOR GENERAL WORKFLOW NODES

# group: Get all piping systems, filter them to only show Discharge & Vent
string = StringInput("Piping Systems")
byName = Category.ByName(name=string)
all_elements_of_category = ElementsOfCategory(Category=byName)
elementType = Element.ElementType(element=all_elements_of_category)
name = Element.Name(element=elementType)
code_block = CodeBlock { ["Ss_50_30_04_97 - Discharge","Ss_50_30_04_97 - HT Discharge", "Ss_50_30_04_97 - HT Vent", "Ss_50_30_04_97 - Lab Discharge", "Ss_50_30_04_97 - Lab Vent", "Ss_50_30_04_97 - Vent"]; }
contains = String.Contains(string=name, searchFor=code_block@L1)
filterByBoolMask = List.FilterByBoolMask(list=all_elements_of_category, mask=contains@L2)
flatten = List.Flatten(list=filterByBoolMask.in)
name_2 = Element.Name(element=flatten)

# group: Python to sort strings with numbers
python_to_sort_strings_with = Python(IN[0]=name_2)  # "Python to sort strings with numbers"; IronPython2
# ---------- python_to_sort_strings_with.python (10 lines) ----------
import re

list = IN[0]

def natural_sort(l): 
    convert = lambda text: int(text) if text.isdigit() else text.lower() 
    alphanum_key = lambda key: [ convert(c) for c in re.split('([0-9]+)', key) ] 
    return sorted(l, key = alphanum_key)

OUT = natural_sort(list)
# ----------------------------------------

indexOf = List.IndexOf(list=name_2, element=python_to_sort_strings_with)
getItemAtIndex = List.GetItemAtIndex(list=flatten, index=indexOf)
code_block_2 = CodeBlock { ["All","Selected"]; }
code_block_3 = CodeBlock { "All Rainwater systems"; }
textnote_data = Custom[TextNote Data](TextNote=code_block_3)  # package Data-Shapes; Create Data for TextNote input in UI.MultipleInputForm ++ . Check out www.data-shapes.net for more informations
code_block_4 = CodeBlock { "Select System"; false; }
listview_data = Custom[Listview Data](InputName=code_block_4.out0, Keys=python_to_sort_strings_with, Values=getItemAtIndex, SortItems_optionnal=code_block_4.out1, ShowId_optionnal=code_block_4.out1)  # package Data-Shapes; Create data for ListView input in UI.MultiInputForm ++ . Check out www.data-shapes.net for more infos.
list_create = List.Create(item0=textnote_data, item1=listview_data)
conditionalinput_data = Custom[ConditionalInput Data](Options=code_block_2, InputGroups_by_Option=list_create)  # package Data-Shapes; Allows to create inputs that are enabled/disabled by a condition dor UI.MultipleInputForm++.

# group: Get All Views
string_2 = StringInput("Views")
byName_2 = Category.ByName(name=string_2)
all_elements_of_category_2 = ElementsOfCategory(Category=byName_2)

# group: Remove nulls
isNull = Object.IsNull(object=all_elements_of_category_2)
not_ = Not(x=isNull)
filterByBoolMask_2 = List.FilterByBoolMask(list=all_elements_of_category_2, mask=not_)

# group: Get only Floor Plan Views
string_from_object = FromObject(object=filterByBoolMask_2.in)
code_block_5 = CodeBlock { "FloorPlanView"; }
contains_2 = String.Contains(string=string_from_object, searchFor=code_block_5)
filterByBoolMask_3 = List.FilterByBoolMask(list=filterByBoolMask_2.in, mask=contains_2)

name_3 = Element.Name(element=filterByBoolMask_3.in)

# group: Get All Levels
string_3 = StringInput("Levels")
byName_3 = Category.ByName(name=string_3)
all_elements_of_category_3 = ElementsOfCategory(Category=byName_3)

# group: Sort Levels by Elevation
projectElevation = Level.ProjectElevation()  # unwired: level
sortByFunction = List.SortByFunction(list=all_elements_of_category_3, sortFunction=projectElevation)

name_4 = Level.Name(level=sortByFunction)

# group: User Interface
code_block_6 = CodeBlock { "Do you have low level connections?"; null; "Proceed"; "Cancel"; 700; 300; }
code_block_7 = CodeBlock { ["Yes","No"]; [true,false]; 1; }
radiobuttons_data = Custom[RadioButtons Data](Keys=code_block_7.out0, Values=code_block_7.out1, DefaultValueIndex=code_block_7.out2)  # package Data-Shapes; Create radio buttons input for UI.MultipleInputForm ++ .
boolean = BoolSelector(true)
multipleinputform = Custom[MultipleInputForm ++](Description_optional=code_block_6.out0, Logo_optional=code_block_6.out1, ButtonText_optional=code_block_6.out2, Inputs=radiobuttons_data, Toggle=boolean, CancelButtonText_optional=code_block_6.out3, Width_optional=code_block_6.out4, LabelWidth_optional=code_block_6.out5)  # package Data-Shapes; Create a form with multiple inputs. see www.data-shapes.net for tutorials and infos!

# group: User Selection: Low Level Connections?
code_block_8 = CodeBlock(LowLevelConnections=multipleinputform.User_Inputs) { LowLevelConnections[0]; }

# group: Check whether to run the next UI
code_block_9 = CodeBlock(WasCancelled=multipleinputform.Was_Cancelled, userselection=code_block_8)
# ---------- code_block_9.designscript (4 lines) ----------
WasCancelled == false && userselection == true? true :
WasCancelled == false && userselection == false? false :
WasCancelled == true? false :
true;
# ----------------------------------------

# group: User Interface
code_block_10 = CodeBlock { "Select Low Level Pipe(s)"; null; "Proceed"; "Cancel"; 700; 300; }
code_block_11 = CodeBlock { "Select"; }
code_block_12 = CodeBlock { "Pipes"; }
byName_4 = Category.ByName(name=code_block_12)
selectmodelelements_data = Custom[SelectModelElements Data](ButtonText=code_block_11, CategoryFilter=byName_4)  # package Data-Shapes; Creates a Revit element selection input for UI.MultipleInputForm++ . Check out www.data-shapes.net for more infos!
multipleinputform_2 = Custom[MultipleInputForm ++](Description_optional=code_block_10.out0, Logo_optional=code_block_10.out1, ButtonText_optional=code_block_10.out2, Inputs=selectmodelelements_data, Toggle=code_block_9, CancelButtonText_optional=code_block_10.out3, Width_optional=code_block_10.out4, LabelWidth_optional=code_block_10.out5)

# group: Check whether to run the next UI
code_block_13 = CodeBlock(UI1WasCancelled=multipleinputform.Was_Cancelled, UI2WasCancelled=multipleinputform_2.Was_Cancelled)
# ---------- code_block_13.designscript (3 lines) ----------
UI1WasCancelled == true? false :
UI2WasCancelled == true? false :
true;
# ----------------------------------------

# group: User Interface
code_block_14 = CodeBlock { "Above Ground Foul Drainage Systems Annotations"; null; "Proceed"; "Cancel"; 800; 700; 300; }
code_block_15 = CodeBlock { "Select 'All' if you want to tag all above ground foul drainage systems in the model. 'Selected' option allows you to select and tag only specific foul drainage systems."; }
textnote_data_2 = Custom[TextNote Data](TextNote=code_block_15)
code_block_16 = CodeBlock { "Select the type of tag you wish to use."; }
textnote_data_3 = Custom[TextNote Data](TextNote=code_block_16)
code_block_17 = CodeBlock { "Select Tag"; ["Size and System Abbreviation", "Size and System Name Manual"]; 0; false; }
dropdown_data = Custom[DropDown Data](InputName=code_block_17.out0, Keys=code_block_17.out1, Values=code_block_17.out1, DefaultValueIndex=code_block_17.out2, Sorted_optional=code_block_17.out3)  # package Data-Shapes; Create data for DropDown input in UI.MultiInputForm ++ . Check out www.data-shapes.net for more infos.
code_block_18 = CodeBlock { "Select the floor plan views where you wish to place your tags."; }
textnote_data_4 = Custom[TextNote Data](TextNote=code_block_18)
code_block_19 = CodeBlock { "Select Views"; false; }
listview_data_2 = Custom[Listview Data](InputName=code_block_19.out0, Keys=name_3, Values=filterByBoolMask_3.in, ShowId_optionnal=code_block_19.out1)
code_block_20 = CodeBlock { "Select the levels relevant to the foul drainage systems."; }
textnote_data_5 = Custom[TextNote Data](TextNote=code_block_20)
code_block_21 = CodeBlock { "Select Levels"; false; }
listview_data_3 = Custom[Listview Data](InputName=code_block_21.out0, Keys=name_4, Values=sortByFunction, SortItems_optionnal=code_block_21.out1, ShowId_optionnal=code_block_21.out1)
list_create_2 = List.Create(item0=textnote_data_2, item1=conditionalinput_data, item2=textnote_data_3, item3=dropdown_data, item4=textnote_data_4, item5=listview_data_2, item6=textnote_data_5, item7=listview_data_3)
multipleinputform_3 = Custom[MultipleInputForm ++](Description_optional=code_block_14.out0, Logo_optional=code_block_14.out1, ButtonText_optional=code_block_14.out2, Inputs=list_create_2, Toggle=code_block_13, CancelButtonText_optional=code_block_14.out3, MaxHeight_optional=code_block_14.out4, Width_optional=code_block_14.out5, LabelWidth_optional=code_block_14.out6)

# group: User Selection: Selected Systems
code_block_22 = CodeBlock(SelectedSystems=multipleinputform_3.User_Inputs) { SelectedSystems[1]; }

list_create_3 = List.Create(item0=getItemAtIndex, item1=code_block_22)

# group: User Selection: Selected Systems Option
code_block_23 = CodeBlock(SelectedSystemsOption=multipleinputform_3.User_Inputs) { SelectedSystemsOption[0]; }

# group: Conditional
code_block_24 = CodeBlock(result=code_block_23) { result=="All"? 0 : 1; }

getItemAtIndex_2 = List.GetItemAtIndex(list=list_create_3, index=code_block_24)
elementType_2 = Element.ElementType(element=getItemAtIndex_2)
name_5 = Element.Name(element=elementType_2)

# group: Input
code_block_25 = CodeBlock { ["Ss_50_30_04_97 - Discharge","Ss_50_30_04_97 - HT Discharge", "Ss_50_30_04_97 - Lab Discharge"]; }
code_block_26 = CodeBlock { ["Ss_50_30_04_97 - HT Vent", "Ss_50_30_04_97 - Lab Vent", "Ss_50_30_04_97 - Vent"]; }
list_create_4 = List.Create(item0=code_block_25, item1=code_block_26)

code_block_27 = CodeBlock { 0; 1; }
getItemAtIndex_3 = List.GetItemAtIndex(list=list_create_4, index=code_block_27.out0)
contains_3 = String.Contains(string=name_5, searchFor=getItemAtIndex_3@L1)
filterByBoolMask_4 = List.FilterByBoolMask(list=getItemAtIndex_2, mask=contains_3@L2)
flatten_2 = List.Flatten(list=filterByBoolMask_4.in)

# group: Python to get all elements in network
code_block_28 = CodeBlock(PipingSystem=flatten_2) { PipingSystem; }
python_pipe_network = Python(IN[0]=code_block_28)  # IronPython2
# ---------- python_pipe_network.python (42 lines) ----------
import clr

clr.AddReference("RevitServices")
import RevitServices
from RevitServices.Persistence import DocumentManager
from RevitServices.Transactions import TransactionManager
doc = DocumentManager.Instance.CurrentDBDocument

clr.AddReference("RevitAPI")
import Autodesk
from Autodesk.Revit.DB import *

clr.AddReference("RevitNodes")
import Revit
clr.ImportExtensions(Revit.Elements)
clr.ImportExtensions(Revit.GeometryConversion)

#Many thanks to Konrad K Sobon for his awesome ProcessList function!
def Unwrap(item):
	return UnwrapElement(item)

def ProcessList(_func, _list):
    return map( lambda x: ProcessList(_func, x) if type(x)==list else _func(x), _list )

if isinstance(IN[0], list):
	systems = ProcessList(Unwrap, IN[0])
else:
	systems = [Unwrap(IN[0])]
	
	
def getNetwork(system):
	network = None
	try:
		network = [x.ToDSType(True) for x in system.PipingNetwork]
	except:
		pass
	return network

			
#Assign your output to the OUT variable.

OUT = ProcessList(getNetwork, systems)
# ----------------------------------------
code_block_29 = CodeBlock(ElementsInPipingSystem=python_pipe_network) { ElementsInPipingSystem; }

# group: Get only pipes
getCategory = Element.GetCategory(element=code_block_29)
string_from_object_2 = FromObject(obj=getCategory)
code_block_30 = CodeBlock { "Pipes"; }
contains_4 = String.Contains(string=string_from_object_2, searchFor=code_block_30)
filterByBoolMask_5 = List.FilterByBoolMask(list=code_block_29, mask=contains_4)
flatten_3 = List.Flatten(list=filterByBoolMask_5.in)

# group: Python to determine pipes' verticality
filter_lines = Python(IN[0]=flatten_3)  # IronPython2
# ---------- filter_lines.python (30 lines) ----------
#Alban de Chasteigner 2020
#twitter : @geniusloci_bim
#geniusloci.bim@gmail.com

import clr
clr.AddReference('RevitAPI')
import Autodesk
from Autodesk.Revit.DB import *

clr.AddReference('RevitNodes')
import Revit
clr.ImportExtensions(Revit.GeometryConversion)

elements = UnwrapElement(IN[0]) if isinstance(IN[0],list) else [UnwrapElement(IN[0])]
	
horizontal,vertical, slope =[],[],[]

for element in elements:
	if hasattr(element, "Explode"):
		curve=element.ToRevitType()
	elif hasattr(element, "Location") and isinstance(element.Location, Autodesk.Revit.DB.LocationCurve):
		curve=element.Location.Curve
	if round(curve.GetEndPoint(0).Z,2) == round(curve.GetEndPoint(1).Z,2):
		horizontal.append(element)
	elif round(curve.GetEndPoint(0).X,2) == round(curve.GetEndPoint(1).X,2) and round(curve.GetEndPoint(0).Y,2) == round(curve.GetEndPoint(1).Y,2):
		vertical.append(element)
	else: slope.append(element)
	
if isinstance(IN[0], (list)): OUT = vertical,horizontal,slope
else: OUT = vertical[0],horizontal[0],slope[0]
# ----------------------------------------
code_block_31 = CodeBlock(x=filter_lines) { x[0]; x[1]; x[2]; }
code_block_32 = CodeBlock(Vertical=code_block_31.out0) { Vertical; }
code_block_33 = CodeBlock(Horizontal=code_block_31.out1) { Horizontal; }
code_block_34 = CodeBlock(Sloping=code_block_31.out2) { Sloping; }

# group: User Input: Low Level Pipes
code_block_35 = CodeBlock(SelectedPipes=multipleinputform_2.User_Inputs) { SelectedPipes[0]; }

indexOf_2 = List.IndexOf(list=code_block_32, element=code_block_35)

# group: Remove Low Level Connection Pipes
removeItemAtIndex = List.RemoveItemAtIndex(list=code_block_32, indices=indexOf_2)

# group: Select All Sanitary Plumbing Fixtures
code_block_36 = CodeBlock { "Plumbing Fixtures"; }
byName_5 = Category.ByName(name=code_block_36)
all_elements_of_category_4 = ElementsOfCategory(Category=byName_5)
code_block_37 = CodeBlock { "System Classification"; }
getParameterValueByName = Element.GetParameterValueByName(element=all_elements_of_category_4, parameterName=code_block_37)
code_block_38 = CodeBlock { "Sanitary"; }
contains_5 = String.Contains(string=getParameterValueByName, searchFor=code_block_38, lacing=Longest)
filterByBoolMask_6 = List.FilterByBoolMask(list=all_elements_of_category_4, mask=contains_5)

# group: Python to get elements connected to Plumbing Fixtures
python_script = Python(IN[0]=filterByBoolMask_6.in)  # IronPython2
# ---------- python_script.python (63 lines) ----------
import clr
import math

clr.AddReference("RevitServices")
import RevitServices
from RevitServices.Persistence import DocumentManager
from RevitServices.Transactions import TransactionManager
doc = DocumentManager.Instance.CurrentDBDocument

clr.AddReference("RevitAPI")
import Autodesk
from Autodesk.Revit.DB import *

clr.AddReference("RevitNodes")
import Revit
clr.ImportExtensions(Revit.Elements)
clr.ImportExtensions(Revit.GeometryConversion)
#The inputs to this node will be stored as a list in the IN variables.
if isinstance(IN[0], list):
	fittings = UnwrapElement(IN[0])
	toggle = 0
else:
	toggle = 1
	fittings = [UnwrapElement(IN[0])]
	
rep = []
ref = []

for fitting in fittings:

	report = []
	refs = []
	
	try:
		connectors = fitting.MEPModel.ConnectorManager.Connectors
	except:
		try:
			connectors = fitting.ConnectorManager.Connectors
		except:
			rep.append(None)
			ref.append(None)
			continue
	for conn in connectors:
		result = ""
		try:
			result += "Direction: " + conn.Direction.ToString()
		except:
			result += "Direction: N/A"
		result += ", AllRefs Size: " + conn.AllRefs.Size.ToString()
		result += ", Domain: " + conn.Domain.ToString()
		result += ", Type: " + conn.ConnectorType.ToString()
		report.append(result)
		for c in conn.AllRefs:
			refs.append(c.Owner)
	rep.append(report)
	ref.append(refs)


#Assign your output to the OUT variable.
if toggle:
	OUT = report, refs
else:
	OUT = rep,ref
# ----------------------------------------
code_block_39 = CodeBlock(x=python_script) { x[1]; }
code_block_40 = CodeBlock(ConnectedElements=code_block_39) { ConnectedElements; }
code_block_41 = CodeBlock(x=python_script) { x[0]; }
code_block_42 = CodeBlock(Direction=code_block_41) { Direction; }

# group: Get pipes connected to Plumbing Fixtures
string_from_object_3 = FromObject(obj=code_block_40)
code_block_43 = CodeBlock { "Pipe"; }
contains_6 = String.Contains(string=string_from_object_3, searchFor=code_block_43)
filterByBoolMask_7 = List.FilterByBoolMask(list=code_block_40, mask=contains_6)
flatten_4 = List.Flatten(list=filterByBoolMask_7.in)

# group: Remove pipes connected to Plumbing Fixtures
indexOf_3 = List.IndexOf(list=removeItemAtIndex, element=flatten_4)
removeItemAtIndex_2 = List.RemoveItemAtIndex(list=removeItemAtIndex, indices=indexOf_3)

# group: User Selection: Floor Plan(s)
code_block_44 = CodeBlock(SelectedViews=multipleinputform_3.User_Inputs) { SelectedViews[3]; }

code_block_45 = CodeBlock { "Associated Level"; }
getParameterValueByName_2 = Element.GetParameterValueByName(element=code_block_44, parameterName=code_block_45)

# group: User Selection: Levels
code_block_46 = CodeBlock(SelectedLevels=multipleinputform_3.User_Inputs) { SelectedLevels[4]; }

name_6 = Level.Name(level=code_block_46)
indexOf_4 = List.IndexOf(list=getParameterValueByName_2, element=name_6)
code_block_47 = CodeBlock(x=indexOf_4) { x >= 0; }
filterByBoolMask_8 = List.FilterByBoolMask(list=indexOf_4, mask=code_block_47)
getItemAtIndex_4 = List.GetItemAtIndex(list=code_block_44, index=filterByBoolMask_8.in)

# group: Python to get all Pipes in selected views
code_block_48 = CodeBlock { "Pipes"; }
byName_6 = Category.ByName(name=code_block_48)
python_script_2 = Python(IN[0]=getItemAtIndex_4, IN[1]=byName_6)  # IronPython2
# ---------- python_script_2.python (40 lines) ----------
import clr
clr.AddReference('RevitAPI')
from Autodesk.Revit.DB import *

clr.AddReference("RevitNodes")
import Revit
clr.ImportExtensions(Revit.Elements)
clr.ImportExtensions(Revit.GeometryConversion)

clr.AddReference("RevitServices")
import RevitServices
from RevitServices.Persistence import DocumentManager

doc = DocumentManager.Instance.CurrentDBDocument
toggle = 0
if isinstance(IN[0], list):
	view = UnwrapElement(IN[0])
else:
	toggle = 1
	view = [UnwrapElement(IN[0])]

if isinstance(IN[1], list):
	category = UnwrapElement(IN[1])
else:
	category = [UnwrapElement(IN[1])]
	
listout = []

for x in view:
	viewlist = []
	for c in category:
		collector = FilteredElementCollector(doc,x.Id)
		elements = collector.OfCategoryId(c.Id).ToElements()
		viewlist.append(elements)
	listout.append(viewlist)

if toggle:
	OUT = viewlist
else:
	OUT = listout
# ----------------------------------------
code_block_49 = CodeBlock(Pipes=python_script_2) { Pipes; }
flatten_5 = List.Flatten(list=code_block_49, lacing=Longest)

# group: Get only vertical pipes visible in active view
indexOf_5 = List.IndexOf(list=removeItemAtIndex_2, element=flatten_5)
code_block_50 = CodeBlock(x=indexOf_5) { x>=0; }
filterByBoolMask_9 = List.FilterByBoolMask(list=indexOf_5, mask=code_block_50)
isEmpty = List.IsEmpty(list=filterByBoolMask_9.in, lacing=Longest)
filterByBoolMask_10 = List.FilterByBoolMask(list=filterByBoolMask_9.in, mask=isEmpty)
getItemAtIndex_5 = List.GetItemAtIndex(list=removeItemAtIndex_2, index=filterByBoolMask_10.out)

# group: Get Pipe Locations
getLocation = Element.GetLocation(element=getItemAtIndex_5)

# group: Identify Which Pipes Have the Same X & Y Coordinates
startPoint = Curve.StartPoint(curve=getLocation)
Y = Point.Y(point=startPoint)
round = Math.Round(number=Y)
groupByKey = List.GroupByKey(list=startPoint, keys=round, lacing=Shortest)
X = Point.X(point=groupByKey.groups)
round_2 = Math.Round(number=X)
groupByKey_2 = List.GroupByKey(list=groupByKey.groups@@L2, keys=round_2@L2, lacing=Shortest)
indexOf_6 = List.IndexOf(list=startPoint, element=groupByKey_2.groups, lacing=Longest)
getItemAtIndex_6 = List.GetItemAtIndex(list=getItemAtIndex_5@L2, index=indexOf_6, lacing=Longest)
code_block_51 = CodeBlock { 1; }
flatten_6 = List.Flatten(list=getItemAtIndex_6@L4, amount=code_block_51@L1, lacing=Longest)

# group: Vertical pipes that will be tagged
firstItem = List.FirstItem(list=flatten_6@L2, lacing=Longest)

# group: Get Pipe Locations
getLocation_2 = Element.GetLocation(element=firstItem)

# group: Tag Location: X Coordinate
set_tag_location_away_from = DoubleSlider(2500, range=-10000..10000 step 100)  # "Set Tag Location Away from Element_X Axis"

# group: Tag Location: Y Coordinate
set_tag_location_away_from_2 = DoubleSlider(2500, range=-10000..10000 step 100)  # "Set Tag Location Away from Element_Y Axis"

# group: Pipe Tag Location
endPoint = Curve.EndPoint(curve=getLocation_2)
X_2 = Point.X(point=endPoint)
code_block_52 = CodeBlock(x=X_2, y=set_tag_location_away_from) { x+y; }
Y_2 = Point.Y(point=endPoint)
code_block_53 = CodeBlock(x=Y_2, y=set_tag_location_away_from_2) { x+y; }
byCoordinates = Point.ByCoordinates(x=code_block_52, y=code_block_53)

# group: User Selection: Pipe Tag
code_block_54 = CodeBlock(PipeTag=multipleinputform_3.User_Inputs) { PipeTag[2]; }

# group: Pipes to be tagged
flatten_7 = List.Flatten(list=firstItem)

filterByBoolMask_11 = List.FilterByBoolMask(list=getItemAtIndex_4, mask=isEmpty)

# group: Views
count = List.Count(list=flatten_6, lacing=Longest)
cycle = List.Cycle(list=filterByBoolMask_11.out, amount=count, lacing=Longest)
flatten_8 = List.Flatten(list=cycle)

# group: Identify index numbers inside th HL_Tag_Pipe family for required types
code_block_55 = CodeBlock { "HL_Tag_Pipe"; }
byName_7 = Family.ByName(name=code_block_55)
types = Family.Types(family=byName_7)
string_from_object_4 = FromObject(obj=types)
code_block_56 = CodeBlock()
# ---------- code_block_56.designscript (11 lines) ----------
["System Name Manual and AT LL",
"System Name Manual and AT HL",
"System Name Manual and FA CTD",
"System Name Manual and FA DTB",
"System Name Manual and FA DTHL",
"System Name Manual and FA DTLL",
"System Name Manual and FHL CTD",
"System Name Manual and FHL DTB",
"System Name Manual and FHL DTLL",
"System Name Manual and FLL CTD",
"System Name Manual and FLL DTB"];
# ----------------------------------------
contains_7 = String.Contains(string=string_from_object_4@L1, searchFor=code_block_56)
code_block_57 = CodeBlock { true; }
contains_8 = List.Contains(list=contains_7@L2, item=code_block_57)
allIndicesOf = List.AllIndicesOf(list=contains_8, item=code_block_57)
code_block_58 = CodeBlock()
# ---------- code_block_58.designscript (11 lines) ----------
["Abbreviation and AT HL",
"Abbreviation and AT LL",
"Abbreviation and FA DTLL",
"Abbreviation and FA CTD",
"Abbreviation and FA DTB",
"Abbreviation and FA DTHL",
"Abbreviation and FLL CTD",
"Abbreviation and FLL DTB",
"Abbreviation and FHL CTD",
"Abbreviation and FHL DTLL",
"Abbreviation and FHL DTB"];
# ----------------------------------------
contains_9 = String.Contains(string=string_from_object_4@L1, searchFor=code_block_58)
code_block_59 = CodeBlock { true; }
contains_10 = List.Contains(list=contains_9@L2, item=code_block_59)
allIndicesOf_2 = List.AllIndicesOf(list=contains_10, item=code_block_59)
code_block_60 = CodeBlock()
# ---------- code_block_60.designscript (9 lines) ----------
["System Name Manual and AT LL",
"System Name Manual and AT HL",
"System Name Manual and FB RTA",
"System Name Manual and FB RTHL",
"System Name Manual and FB RTLL",
"System Name Manual and FB TO ATM",
"System Name Manual and FHL RTA",
"System Name Manual and FLL RTA",
"System Name Manual and FLL RTHL"];
# ----------------------------------------
contains_11 = String.Contains(string=string_from_object_4@L1, searchFor=code_block_60)
code_block_61 = CodeBlock { true; }
contains_12 = List.Contains(list=contains_11@L2, item=code_block_61)
allIndicesOf_3 = List.AllIndicesOf(list=contains_12, item=code_block_61)
code_block_62 = CodeBlock()
# ---------- code_block_62.designscript (9 lines) ----------
["Abbreviation and AT HL",
"Abbreviation and AT LL",
"Abbreviation and FLL RTHL",
"Abbreviation and FLL RTA",
"Abbreviation and FB TO ATM",
"Abbreviation and FB RTLL",
"Abbreviation and FB RTHL",
"Abbreviation and FB RTA",
"Abbreviation and FHL RTA"];
# ----------------------------------------
contains_13 = String.Contains(string=string_from_object_4@L1, searchFor=code_block_62)
code_block_63 = CodeBlock { true; }
contains_14 = List.Contains(list=contains_13@L2, item=code_block_63)
allIndicesOf_4 = List.AllIndicesOf(list=contains_14, item=code_block_63)

# group: Dictionary for Tags-Size and System Name Manual
code_block_64 = CodeBlock { ["AT LL","AT HL","FA CTD","FA DTB","FA DTHL","FA DTLL","FHL CTD","FHL DTB","FHL DTLL","FLL CTD","FLL DTB"]; }
byKeysValues = DesignScript.Builtin.Dictionary.ByKeysValues(keys=code_block_64, values=allIndicesOf)

# group: Dictionary for Tags-Size and System Abbreviation
code_block_65 = CodeBlock { ["AT HL","AT LL","FA DTLL","FA CTD","FA DTB","FA DTHL","FLL CTD","FLL DTB","FHL CTD","FHL DTLL","FHL DTB"]; }
byKeysValues_2 = DesignScript.Builtin.Dictionary.ByKeysValues(keys=code_block_65, values=allIndicesOf_2)

# group: Get Invert & Top Elevations
code_block_66 = CodeBlock { "Length"; }
getParameterValueByName_3 = Element.GetParameterValueByName(element=flatten_6, parameterName=code_block_66)
code_block_67 = CodeBlock { "Invert Elevation"; }
getParameterValueByName_4 = Element.GetParameterValueByName(element=flatten_6, parameterName=code_block_67)
top_elevation = CodeBlock(x=getParameterValueByName_3, y=getParameterValueByName_4) { x+y; }
round_3 = Math.Round(number=top_elevation)
round_4 = Math.Round(number=getParameterValueByName_4)

projectElevation_2 = Level.ProjectElevation(level=code_block_46)
code_block_68 = CodeBlock { "Associated Level"; }
getParameterValueByName_5 = Element.GetParameterValueByName(element=filterByBoolMask_11.out, parameterName=code_block_68)
maximumItem = List.MaximumItem(list=projectElevation_2)
indexOf_7 = List.IndexOf(list=projectElevation_2, element=maximumItem)
getItemAtIndex_7 = List.GetItemAtIndex(list=name_6, index=indexOf_7)
lastItem = List.LastItem(list=getParameterValueByName_5)
eq = getItemAtIndex_7 == lastItem
indexOf_8 = List.IndexOf(list=name_6, element=lastItem)
code_block_69 = CodeBlock(val=indexOf_8) { val+1; }
code_block_70 = CodeBlock(result=eq, val1=indexOf_8, val2=code_block_69) { result == true? val1 : val2; }
getItemAtIndex_8 = List.GetItemAtIndex(list=name_6, index=code_block_70)
join = List.Join(list0=getParameterValueByName_5, list1=getItemAtIndex_8)
indexOf_9 = List.IndexOf(list=name_6, element=join)
getItemAtIndex_9 = List.GetItemAtIndex(list=projectElevation_2, index=indexOf_9)
code_block_71 = CodeBlock { 0..1; }
code_block_72 = CodeBlock { 1; }
sublists = List.Sublists(list=getItemAtIndex_9, ranges=code_block_71, offset=code_block_72)
count_2 = List.Count(list=sublists@L2)
code_block_73 = CodeBlock(x=count_2) { x>1; }
filterByBoolMask_12 = List.FilterByBoolMask(list=sublists, mask=code_block_73)
firstItem_2 = List.FirstItem(list=filterByBoolMask_12.in, lacing=Longest)
round_5 = Math.Round(number=firstItem_2)
lastItem_2 = List.LastItem(list=filterByBoolMask_12.in, lacing=Longest)
round_6 = Math.Round(number=lastItem_2)

# group: Identify whether pipe is FA, FHL or FLL
code_block_74 = CodeBlock(PipeTop=round_3, LvlBottomElevation=round_5, LvlTopElevation=round_6)
# ---------- code_block_74.designscript (3 lines) ----------
PipeTop>=(LvlBottomElevation+LvlTopElevation)/2 && PipeTop<LvlTopElevation?"FHL":
PipeTop<(LvlBottomElevation+LvlTopElevation)/2 && PipeTop>LvlBottomElevation?"FLL":
PipeTop>LvlTopElevation?"FA":"";
# ----------------------------------------
code_block_75 = CodeBlock(x=code_block_74) { x=="FA"?1:x=="FHL"?2:x=="FLL"?3:4; }
minimumItem = List.MinimumItem(list=code_block_75)
code_block_76 = CodeBlock(x=minimumItem) { x==1?"FA":x==2?"FHL":x==3?"FLL":""; }

# group: Identify whether pipe CTD, DTB, DTHL or DTLL
code_block_77 = CodeBlock(PipeInvert=round_4, LvlBottomElevation=round_5, LvlTopElevation=round_6)
# ---------- code_block_77.designscript (5 lines) ----------
PipeInvert<LvlBottomElevation?"DTB":
PipeInvert==LvlBottomElevation?"CTD":
PipeInvert>(LvlBottomElevation+LvlTopElevation)/2?"DTHL":
PipeInvert<(LvlBottomElevation+LvlTopElevation)/2 && PipeInvert>LvlBottomElevation?"DTLL":
"ERROR";
# ----------------------------------------
code_block_78 = CodeBlock(x=code_block_77) { x=="CTD"?1:x=="DTB"?2:x=="DTLL"?3:x=="DTHL"?4:5; }
minimumItem_2 = List.MinimumItem(list=code_block_78)
code_block_79 = CodeBlock(x=minimumItem_2) { x==1?"CTD":x==2?"DTB":x==3?"DTLL":x==4?"DTHL":""; }

# group: Create string
code_block_80 = CodeBlock(x=code_block_76, y=code_block_79) { x+" "+y; }

code_block_81 = CodeBlock { "FHL DTHL"; }
code_block_82 = CodeBlock { "AT HL"; }
replace = String.Replace(string=code_block_80, searchFor=code_block_81, replaceWith=code_block_82)
code_block_83 = CodeBlock { "FLL DTLL"; }
code_block_84 = CodeBlock { "AT LL"; }
replace_2 = String.Replace(string=replace, searchFor=code_block_83, replaceWith=code_block_84)

# group: Get Values from Dictionary Based on Selected Pipe Tag
list_create_5 = List.Create(item0=byKeysValues, item1=byKeysValues_2)
code_block_85 = CodeBlock(PipeTag=code_block_54, x=list_create_5) { PipeTag=="Size and System Name Manual"?x[0]:x[1]; }
valueAtKey = DesignScript.Builtin.Dictionary.ValueAtKey(dictionary=code_block_85, key=replace_2)

# group: Pipe Tag Type
code_block_86 = CodeBlock { "HL_Tag_Pipe"; }
byName_8 = Family.ByName(name=code_block_86)
types_2 = Family.Types(family=byName_8)
code_block_87 = CodeBlock(PipeTag=code_block_54) { PipeTag=="Size and System Name Manual"?5:7; }
getItemAtIndex_10 = List.GetItemAtIndex(list=types_2, index=code_block_87)
getItemAtIndex_11 = List.GetItemAtIndex(list=types_2, index=valueAtKey)
flatten_9 = List.Flatten(list=getItemAtIndex_11)

# group: Create Pipe Tags for DP
code_block_88 = CodeBlock { LinkInstance:var=null; }
code_block_89 = CodeBlock(x=count) { x>0?true:false; }
identity = Object.Identity()  # unwired: object
trueForAny = List.TrueForAny(list=code_block_89, queryFunction=identity)
python_script_3 = Python(IN[0]=byCoordinates, IN[1]=getItemAtIndex_10, IN[2]=flatten_7, IN[3]=flatten_8, IN[4]=code_block_88, IN[5]=trueForAny)  # IronPython2
# ---------- python_script_3.python (215 lines) ----------
import clr
clr.AddReference('ProtoGeometry')
from Autodesk.DesignScript.Geometry import *

# Import Element wrapper extension methods
clr.AddReference("RevitNodes")
import Revit
clr.ImportExtensions(Revit.Elements)

# Import geometry conversion extension methods
clr.ImportExtensions(Revit.GeometryConversion)

# Import DocumentManager and TransactionManager
clr.AddReference("RevitServices")
import RevitServices
from RevitServices.Persistence import DocumentManager
from RevitServices.Transactions import TransactionManager

doc = DocumentManager.Instance.CurrentDBDocument
uiapp = DocumentManager.Instance.CurrentUIApplication
app = uiapp.Application

# Import RevitAPI
clr.AddReference("RevitAPI")
import Autodesk
from Autodesk.Revit.DB import *

import sys
pyt_path = r'C:\Program Files (x86)\IronPython 2.7\Lib'
sys.path.append(pyt_path)

#The inputs to this node will be stored as a list in the IN variable.
dataEnteringNode = IN

locationPts = UnwrapElement(IN[0])
tagType = UnwrapElement(IN[1])
elements = UnwrapElement(IN[2])

if IN[4] != None:
	link = UnwrapElement(IN[4])
else:
	link = None
	
RunIt = IN[5]

if isinstance(IN[3], list):
	views = []
	for i in IN[3]:
		views.append(UnwrapElement(i))
else:
	views = UnwrapElement(IN[3])

def toRvtPoint(point):
	return point.ToXyz()

def toRvtId(_id):
	if isinstance(_id, int) or isinstance(_id, str):
		id = ElementId(int(_id))
		return id
	elif isinstance(_id, ElementId):
		return _id

def GetUVPoint(pt):
	if type(pt) == Autodesk.DesignScript.Geometry.Point:
		return Autodesk.Revit.DB.UV(pt.X, pt.Y)
	elif type(pt) == Autodesk.DesignScript.Geometry.UV:
		return Autodesk.Revit.DB.UV(pt.U, pt.V)

def CreateSpaceTag(space, uv, view):
	doc = DocumentManager.Instance.CurrentDBDocument
	return doc.Create.NewSpaceTag(space, uv, view)

tagTypeId = toRvtId(tagType.Id)
chk = []
try:
	errorReport = None
	if RunIt:
		if tagType.Category.Id == ElementId(BuiltInCategory.OST_RoomTags):

			roomTags = []
			if isinstance(views, list):
				#pulled views for statement out
				for j in views:
					for i,k in zip(elements, locationPts):
						TransactionManager.Instance.EnsureInTransaction(doc)
						#added the if statement to get roomId from the linked element.
						if link != None:
							roomId = LinkElementId(link.Id, i.Id)
						else:
							roomId = LinkElementId(i.Id)
						location = Autodesk.Revit.DB.UV(toRvtPoint(k).X, toRvtPoint(k).Y)
						roomTag = doc.Create.NewRoomTag(roomId, location, j.Id)
						roomTag.RoomTagType = tagType
						chk.append(roomId)
						roomTags.append(roomTag)
						TransactionManager.Instance.TransactionTaskDone()
			else:
				TransactionManager.Instance.EnsureInTransaction(doc)
				for i, j in zip(elements, locationPts):
					if link != None:
						roomId = LinkElementId(link.Id, i.Id)
					else:
						roomId = LinkElementId(i.Id)
					location = Autodesk.Revit.DB.UV(toRvtPoint(j).X, toRvtPoint(j).Y)
					roomTag = doc.Create.NewRoomTag(roomId, location, views.Id)
					roomTag.RoomTagType = tagType
					roomTags.append(roomTag)
				TransactionManager.Instance.TransactionTaskDone()
			result = roomTags
		elif tagType.Category.Id == ElementId(BuiltInCategory.OST_MEPSpaceTags):
			TransactionManager.Instance.EnsureInTransaction(doc)
			roomTags = []
			if isinstance(views, list):
				for j in views:
					for i, k in zip(elements, locationPts):
						uv = GetUVPoint(k)
						spaceTag = CreateSpaceTag(i, uv, j)
						spaceTag.SpaceTagType = tagType
						roomTags.append(spaceTag)
			else:
				for i, j in zip(elements, locationPts):
					uv = GetUVPoint(j)
					spaceTag = CreateSpaceTag(i, uv, views)
					spaceTag.SpaceTagType = tagType
					roomTags.append(spaceTag)
			TransactionManager.Instance.TransactionTaskDone()
			result = roomTags
		elif tagType.Category.Id == ElementId(BuiltInCategory.OST_MultiCategoryTags):
			TransactionManager.Instance.EnsureInTransaction(doc)
			multitags = []
			if isinstance(views, list):
				for j in views:
					for i, k in zip(elements, locationPts):
						if link != None:
							reference = Reference(i).CreateLinkReference(link)
						else:
							reference = Reference(i)
						location = toRvtPoint(k)
						tag = IndependentTag.Create(doc,j.Id, reference, False, TagMode.TM_ADDBY_MULTICATEGORY, TagOrientation.Horizontal, location)
					tag.ChangeTypeId(tagTypeId)
					multitags.append(tag)
			else:
				for i, j in zip(elements, locationPts):
					if link != None:
						reference = Reference(i).CreateLinkReference(link)
					else:
						reference = Reference(i)
					location = toRvtPoint(j)
					tag = IndependentTag.Create(doc, views.Id, reference, False, TagMode.TM_ADDBY_MULTICATEGORY, TagOrientation.Horizontal, location)
					tag.ChangeTypeId(tagTypeId)
					multitags.append(tag)
			TransactionManager.Instance.TransactionTaskDone()
			result = multitags
		elif tagType.Category.Id == ElementId(BuiltInCategory.OST_MaterialTags):
			TransactionManager.Instance.EnsureInTransaction(doc)
			Mattags = []
			if isinstance(views, list):
				for i,j,k in zip(elements, views, locationPts):
					if link != None:
						reference = Reference(i).CreateLinkReference(link)
					else:
						reference = Reference(i)
					location = toRvtPoint(k)
					tag = IndependentTag.Create(doc, j.Id, reference, False, TagMode.TM_ADDBY_MATERIAL, TagOrientation.Horizontal, location)
					tag.ChangeTypeId(tagTypeId)
					Mattags.append(tag)
			else:
				for i, j in zip(elements, locationPts):
					if link != None:
						reference = Reference(i).CreateLinkReference(link)
					else:
						reference = Reference(i)
					location = toRvtPoint(j)
					tag = IndependentTag.Create(doc, views.Id, reference, False, TagMode.TM_ADDBY_MATERIAL, TagOrientation.Horizontal, location)
					tag.ChangeTypeId(tagTypeId)
					Mattags.append(tag)
			TransactionManager.Instance.TransactionTaskDone()
			result = Mattags
		else:
			TransactionManager.Instance.EnsureInTransaction(doc)
			tags = []
			if isinstance(views, list):
				for i,j,k in zip(elements, views, locationPts):
					if link != None:
						reference = Reference(i).CreateLinkReference(link)
					else:
						reference = Reference(i)
					location = toRvtPoint(k)
					tag = IndependentTag.Create(doc, j.Id, reference, False, TagMode.TM_ADDBY_CATEGORY, TagOrientation.Horizontal, location)
					tag.ChangeTypeId(tagTypeId)
					tags.append(tag)
			else:
				for i, j in zip(elements, locationPts):
					if link != None:
						reference = Reference(i).CreateLinkReference(link)
					else:
						reference = Reference(i)
					location = toRvtPoint(j)
					tag = IndependentTag.Create(doc, views.Id, reference, False, TagMode.TM_ADDBY_CATEGORY, TagOrientation.Horizontal, location)
					tag.ChangeTypeId(tagTypeId)
					tags.append(tag)
			TransactionManager.Instance.TransactionTaskDone()
			result = tags
	else:
		result = "RunIt is set to False."
except:
	# if error accurs anywhere in the process catch it
	import traceback
	errorReport = traceback.format_exc()

#Assign your output to the OUT variable
if errorReport == None:
	OUT = result
else:
	OUT = errorReport
# ----------------------------------------
code_block_90 = CodeBlock(PipeTags=python_script_3) { PipeTags; }
code_block_91 = CodeBlock { "Family and Type"; }
setParameterByName = Element.SetParameterByName(element=code_block_90, parameterName=code_block_91, value=flatten_9)

getItemAtIndex_12 = List.GetItemAtIndex(list=list_create_4, index=code_block_27.out1)
contains_15 = String.Contains(string=name_5, searchFor=getItemAtIndex_12@L1)
filterByBoolMask_13 = List.FilterByBoolMask(list=getItemAtIndex_2, mask=contains_15@L2)
flatten_10 = List.Flatten(list=filterByBoolMask_13.in)

# group: Python to get all elements in network
code_block_92 = CodeBlock(PipingSystem=flatten_10) { PipingSystem; }
python_pipe_network_2 = Python(IN[0]=code_block_92)  # IronPython2; same code as python_pipe_network
code_block_93 = CodeBlock(ElementsInPipingSystem=python_pipe_network_2) { ElementsInPipingSystem; }

# group: Get only pipes
getCategory_2 = Element.GetCategory(element=code_block_93)
string_from_object_5 = FromObject(obj=getCategory_2)
code_block_94 = CodeBlock { "Pipes"; }
contains_16 = String.Contains(string=string_from_object_5, searchFor=code_block_94)
filterByBoolMask_14 = List.FilterByBoolMask(list=code_block_93, mask=contains_16)
flatten_11 = List.Flatten(list=filterByBoolMask_14.in)

# group: Python to determine pipes' verticality
filter_lines_2 = Python(IN[0]=flatten_11)  # IronPython2; same code as filter_lines
code_block_95 = CodeBlock(x=filter_lines_2) { x[0]; x[1]; x[2]; }
code_block_96 = CodeBlock(Vertical=code_block_95.out0) { Vertical; }
code_block_97 = CodeBlock(Horizontal=code_block_95.out1) { Horizontal; }
code_block_98 = CodeBlock(Sloping=code_block_95.out2) { Sloping; }

# group: Get only vertical pipes visible in selected views
indexOf_10 = List.IndexOf(list=code_block_96, element=flatten_5)
code_block_99 = CodeBlock(x=indexOf_10) { x>=0; }
filterByBoolMask_15 = List.FilterByBoolMask(list=indexOf_10, mask=code_block_99)
isEmpty_2 = List.IsEmpty(list=filterByBoolMask_15.in, lacing=Longest)
filterByBoolMask_16 = List.FilterByBoolMask(list=filterByBoolMask_15.in, mask=isEmpty_2)
getItemAtIndex_13 = List.GetItemAtIndex(list=code_block_96, index=filterByBoolMask_16.out)

# group: Get Pipe Locations
getLocation_3 = Element.GetLocation(element=getItemAtIndex_13)

# group: Identify Which Pipes Have the Same X & Y Coordinates
startPoint_2 = Curve.StartPoint(curve=getLocation_3)
Y_3 = Point.Y(point=startPoint_2)
round_7 = Math.Round(number=Y_3)
groupByKey_3 = List.GroupByKey(list=startPoint_2, keys=round_7, lacing=Shortest)
X_3 = Point.X(point=groupByKey_3.groups)
round_8 = Math.Round(number=X_3)
groupByKey_4 = List.GroupByKey(list=groupByKey_3.groups@@L2, keys=round_8@L2, lacing=Shortest)
indexOf_11 = List.IndexOf(list=startPoint_2, element=groupByKey_4.groups, lacing=Longest)
getItemAtIndex_14 = List.GetItemAtIndex(list=getItemAtIndex_13@L2, index=indexOf_11, lacing=Longest)
code_block_100 = CodeBlock { 1; }
flatten_12 = List.Flatten(list=getItemAtIndex_14@L4, amount=code_block_100@L1, lacing=Longest)

list_create_6 = List.Create(item0=flatten_6, item1=flatten_12)
isEmpty_3 = List.IsEmpty(list=getItemAtIndex_13)
code_block_101 = CodeBlock(result=isEmpty_3) { result == true? 0: 1; }
getItemAtIndex_15 = List.GetItemAtIndex(list=list_create_6, index=code_block_101)

# group: Vertical pipes that will be tagged
firstItem_3 = List.FirstItem(list=getItemAtIndex_15@L2, lacing=Longest)

# group: Get Pipe Locations
getLocation_4 = Element.GetLocation(element=firstItem_3)

# group: Pipe Tag Location
endPoint_2 = Curve.EndPoint(curve=getLocation_4)
X_4 = Point.X(point=endPoint_2)
code_block_102 = CodeBlock(x=X_4, y=set_tag_location_away_from) { x+y; }
Y_4 = Point.Y(point=endPoint_2)
code_block_103 = CodeBlock(x=set_tag_location_away_from_2) { x+500; }
code_block_104 = CodeBlock(x=Y_4, y=code_block_103) { x+y; }
byCoordinates_2 = Point.ByCoordinates(x=code_block_102, y=code_block_104)

filterByBoolMask_17 = List.FilterByBoolMask(list=getItemAtIndex_4, mask=isEmpty_2)

# group: Views
count_3 = List.Count(list=getItemAtIndex_15, lacing=Longest)
cycle_2 = List.Cycle(list=filterByBoolMask_17.out, amount=count_3, lacing=Longest)
flatten_13 = List.Flatten(list=cycle_2)

# group: Dictionary for Tags-Size and System Name Manual
code_block_105 = CodeBlock { ["AT LL","AT HL","FB RTA","FB RTHL","FB RTLL","FB TO ATM","FHL RTA","FLL RTA","FLL RTHL"]; }
byKeysValues_3 = DesignScript.Builtin.Dictionary.ByKeysValues(keys=code_block_105, values=allIndicesOf_3)

# group: Dictionary for Tags-Size and System Abbreviation
code_block_106 = CodeBlock { ["AT HL","AT LL","FLL RTHL","FLL RTA","FB TO ATM","FB RTLL","FB RTHL","FB RTA","FHL RTA"]; }
byKeysValues_4 = DesignScript.Builtin.Dictionary.ByKeysValues(keys=code_block_106, values=allIndicesOf_4)

addItemToFront = List.AddItemToFront()  # unwired: item, list
flatten_14 = List.Flatten(list=firstItem_3)
code_block_107 = CodeBlock { "Associated Level"; }
getParameterValueByName_6 = Element.GetParameterValueByName(element=cycle_2, parameterName=code_block_107)
flatten_15 = List.Flatten(list=getParameterValueByName_6)
combine = List.Combine(comb=addItemToFront, list1=flatten_14, list2=flatten_15)
addItemToFront_2 = List.AddItemToFront()  # unwired: item, list

# group: Identify VP to ATM
code_block_108 = CodeBlock { "System Name"; }
getParameterValueByName_7 = Element.GetParameterValueByName(element=code_block_96, parameterName=code_block_108)
groupByKey_5 = List.GroupByKey(list=code_block_96, keys=getParameterValueByName_7)
code_block_109 = CodeBlock { "Invert Elevation"; }
getParameterValueByName_8 = Element.GetParameterValueByName(element=groupByKey_5.groups, parameterName=code_block_109)
code_block_110 = CodeBlock { "Length"; }
getParameterValueByName_9 = Element.GetParameterValueByName(element=groupByKey_5.groups, parameterName=code_block_110)
code_block_111 = CodeBlock(x=getParameterValueByName_8, y=getParameterValueByName_9) { x+y; }
maximumItem_2 = List.MaximumItem(list=code_block_111)
indexOf_12 = List.IndexOf(list=code_block_111@L2, element=maximumItem_2, lacing=Longest)
getItemAtIndex_16 = List.GetItemAtIndex(list=groupByKey_5.groups, index=indexOf_12, lacing=Longest)

code_block_112 = CodeBlock { "Invert Elevation"; }
getParameterValueByName_10 = Element.GetParameterValueByName(element=getItemAtIndex_16, parameterName=code_block_112)
code_block_113 = CodeBlock { "Length"; }
getParameterValueByName_11 = Element.GetParameterValueByName(element=getItemAtIndex_16, parameterName=code_block_113)
code_block_114 = CodeBlock(x=getParameterValueByName_10, y=getParameterValueByName_11) { x+y; }
lastItem_3 = List.LastItem(list=projectElevation_2)
code_block_115 = CodeBlock(val=lastItem_3) { val+3000; }
addItemToEnd = List.AddItemToEnd(item=code_block_115, list=projectElevation_2)
code_block_116 = CodeBlock { 0..1; }
code_block_117 = CodeBlock { 1; }
sublists_2 = List.Sublists(list=addItemToEnd, ranges=code_block_116, offset=code_block_117)
count_4 = List.Count(list=sublists_2@L2)
code_block_118 = CodeBlock(x=count_4) { x>1; }
filterByBoolMask_18 = List.FilterByBoolMask(list=sublists_2, mask=code_block_118)
lastItem_4 = List.LastItem(list=filterByBoolMask_18.in, lacing=Longest)
lt = code_block_114 < lastItem_4  # lacing=CrossProduct
code_block_119 = CodeBlock { true; }
indexOf_13 = List.IndexOf(list=lt, element=code_block_119, lacing=Longest)

# group: All Vent pipes to ATM
watch = Watch(getItemAtIndex_16)
getItemAtIndex_17 = List.GetItemAtIndex(list=name_6, index=indexOf_13)

combine_2 = List.Combine(comb=addItemToFront_2, list1=watch, list2=getItemAtIndex_17)
eq_2 = combine == combine_2  # lacing=CrossProduct
allTrue = List.AllTrue(list=eq_2@@L2)
identity_2 = Object.Identity()  # unwired: object
trueForAny_2 = List.TrueForAny(list=allTrue, queryFunction=identity_2, lacing=Longest)
code_block_120 = CodeBlock { "FB TO ATM"; }

# group: Get Invert & Top Elevations
code_block_121 = CodeBlock { "Invert Elevation"; }
getParameterValueByName_12 = Element.GetParameterValueByName(element=getItemAtIndex_15, parameterName=code_block_121)
pipe_invert = Math.Round(number=getParameterValueByName_12)
code_block_122 = CodeBlock { "Length"; }
getParameterValueByName_13 = Element.GetParameterValueByName(element=getItemAtIndex_15, parameterName=code_block_122)
top_elevation_2 = CodeBlock(x=getParameterValueByName_13, y=getParameterValueByName_12) { x+y; }
pipe_top = Math.Round(number=top_elevation_2)

code_block_123 = CodeBlock { "Associated Level"; }
getParameterValueByName_14 = Element.GetParameterValueByName(element=filterByBoolMask_17.out, parameterName=code_block_123)
list_create_7 = List.Create(item0=getParameterValueByName_5, item1=getParameterValueByName_14)
getItemAtIndex_18 = List.GetItemAtIndex(list=list_create_7, index=code_block_101)
lastItem_5 = List.LastItem(list=getItemAtIndex_18)
eq_3 = getItemAtIndex_7 == lastItem_5
indexOf_14 = List.IndexOf(list=name_6, element=lastItem_5)
code_block_124 = CodeBlock(val=indexOf_14) { val+1; }
code_block_125 = CodeBlock(result=eq_3, val1=indexOf_14, val2=code_block_124) { result == true? val1 : val2; }
getItemAtIndex_19 = List.GetItemAtIndex(list=name_6, index=code_block_125)
join_2 = List.Join(list0=getParameterValueByName_14, list1=getItemAtIndex_19)
indexOf_15 = List.IndexOf(list=name_6, element=join_2)
getItemAtIndex_20 = List.GetItemAtIndex(list=projectElevation_2, index=indexOf_15)
code_block_126 = CodeBlock { 0..1; }
code_block_127 = CodeBlock { 1; }
sublists_3 = List.Sublists(list=getItemAtIndex_20, ranges=code_block_126, offset=code_block_127)
count_5 = List.Count(list=sublists_3@L2)
code_block_128 = CodeBlock(x=count_5) { x>1; }
filterByBoolMask_19 = List.FilterByBoolMask(list=sublists_3, mask=code_block_128)
firstItem_4 = List.FirstItem(list=filterByBoolMask_19.in, lacing=Longest)
lastItem_6 = List.LastItem(list=filterByBoolMask_19.in, lacing=Longest)

# group: Identify whether pipe is FB, FLL or FHL
code_block_129 = CodeBlock(PipeInvert=pipe_invert, LvlBottomElevation=firstItem_4, LvlTopElevation=lastItem_6)
# ---------- code_block_129.designscript (4 lines) ----------
PipeInvert<LvlBottomElevation?"FB":
PipeInvert<(LvlBottomElevation+LvlTopElevation)/2 && PipeInvert>LvlBottomElevation?"FLL":
PipeInvert>(LvlBottomElevation+LvlTopElevation)/2 && PipeInvert<LvlTopElevation?"FHL":
"ERROR";
# ----------------------------------------
code_block_130 = CodeBlock(x=code_block_129) { x=="FB"?1:x=="FLL"?2:x=="FHL"?3:4; }
minimumItem_3 = List.MinimumItem(list=code_block_130)
code_block_131 = CodeBlock(x=minimumItem_3) { x==1?"FB":x==2?"FLL":x==3?"FHL":""; }

# group: Identify whether pipe RTA, RTLL or RTHL
code_block_132 = CodeBlock(PipeTop=pipe_top, LvlTopElevation=lastItem_6, LvlBottomElevation=firstItem_4)
# ---------- code_block_132.designscript (4 lines) ----------
PipeTop>LvlTopElevation?"RTA":
PipeTop<(LvlBottomElevation+LvlTopElevation)/2 && PipeTop>LvlBottomElevation?"RTLL":
PipeTop>(LvlBottomElevation+LvlTopElevation)/2 && PipeTop>LvlBottomElevation?"RTHL":
"ERROR";
# ----------------------------------------
code_block_133 = CodeBlock(x=code_block_132) { x=="RTA"?1:x=="RTHL"?2:x=="RTLL"?3:4; }
minimumItem_4 = List.MinimumItem(list=code_block_133)
code_block_134 = CodeBlock(x=minimumItem_4) { x==1?"RTA":x==2?"RTHL":x==3?"RTLL":""; }

# group: Create string
code_block_135 = CodeBlock(x=code_block_131, y=code_block_134) { x+" "+y; }

code_block_136 = CodeBlock { "FHL RTHL"; }
code_block_137 = CodeBlock { "AT HL"; }
replace_3 = String.Replace(string=code_block_135, searchFor=code_block_136, replaceWith=code_block_137)
code_block_138 = CodeBlock { "FLL RTLL"; }
code_block_139 = CodeBlock { "AT LL"; }
replace_4 = String.Replace(string=replace_3, searchFor=code_block_138, replaceWith=code_block_139)
list_create_8 = List.Create(item0=replace_2, item1=replace_4)
getItemAtIndex_21 = List.GetItemAtIndex(list=list_create_8, index=code_block_101)
flatten_16 = List.Flatten(list=getItemAtIndex_21)
code_block_140 = CodeBlock(result=trueForAny_2, val1=code_block_120, val2=flatten_16) { result == true? val1 : val2; }
count_6 = List.Count(list=getItemAtIndex_21, lacing=Longest)
chop = List.Chop(list=code_block_140, lengths=count_6)

# group: Get Values from Dictionary Based on Selected Pipe Tag
list_create_9 = List.Create(item0=byKeysValues_3, item1=byKeysValues_4)
code_block_141 = CodeBlock(PipeTag=code_block_54, x=list_create_9) { PipeTag=="Size and System Name Manual"?x[0]:x[1]; }

list_create_10 = List.Create(item0=code_block_85, item1=code_block_141)
getItemAtIndex_22 = List.GetItemAtIndex(list=list_create_10, index=code_block_101)

# group (continued): Get Values from Dictionary Based on Selected Pipe Tag
valueAtKey_2 = DesignScript.Builtin.Dictionary.ValueAtKey(dictionary=getItemAtIndex_22, key=chop)

# group: Pipe Tag Type
code_block_142 = CodeBlock { "HL_Tag_Pipe"; }
byName_9 = Family.ByName(name=code_block_142)
types_3 = Family.Types(family=byName_9)
code_block_143 = CodeBlock(PipeTag=code_block_54) { PipeTag=="Size and System Name Manual"?5:7; }
getItemAtIndex_23 = List.GetItemAtIndex(list=types_3, index=code_block_143)
getItemAtIndex_24 = List.GetItemAtIndex(list=types_3, index=valueAtKey_2)
flatten_17 = List.Flatten(list=getItemAtIndex_24)

# group: Create Pipe Tags for VP
empty = List.Empty()
code_block_144 = CodeBlock { LinkInstance:var=null; }
code_block_145 = CodeBlock(result=isEmpty_3) { result ==true? false: true; }
python_script_4 = Python(IN[0]=byCoordinates_2, IN[1]=getItemAtIndex_23, IN[2]=firstItem_3, IN[3]=flatten_13, IN[4]=code_block_144, IN[5]=code_block_145)  # IronPython2; same code as python_script_3
code_block_146 = CodeBlock(PipeTags=python_script_4) { PipeTags; }
list_create_11 = List.Create(item0=empty, item1=code_block_146)
code_block_147 = CodeBlock(result=isEmpty_3) { result ==true? 0 : 1; }
getItemAtIndex_25 = List.GetItemAtIndex(list=list_create_11, index=code_block_147)
code_block_148 = CodeBlock { "Family and Type"; }
setParameterByName_2 = Element.SetParameterByName(element=getItemAtIndex_25, parameterName=code_block_148, value=flatten_17)

list_create_12 = List.Create(item0=removeItemAtIndex_2, item1=filterByBoolMask_6.in)

# group: Python to get all Plumbing Fixtures in selected views
code_block_149 = CodeBlock { "Plumbing Fixtures"; }
byName_10 = Category.ByName(name=code_block_149)
python_script_5 = Python(IN[0]=getItemAtIndex_4, IN[1]=byName_10)  # IronPython2; same code as python_script_2
code_block_150 = CodeBlock(PlumbingFixtures=python_script_5) { PlumbingFixtures; }
flatten_18 = List.Flatten(list=code_block_150, lacing=Longest)

isEmpty_4 = List.IsEmpty(list=flatten_18, lacing=Longest)
identity_3 = Object.Identity()  # unwired: object
trueForAll = List.TrueForAll(list=isEmpty_4, queryFunction=identity_3)
code_block_151 = CodeBlock(result=trueForAll) { result == true? 0: 1; }
getItemAtIndex_26 = List.GetItemAtIndex(list=list_create_12, index=code_block_151)
list_create_13 = List.Create(item0=flatten_5, item1=flatten_18)
getItemAtIndex_27 = List.GetItemAtIndex(list=list_create_13, index=code_block_151)

# group: Get only Plumbing Fixtures visible in selected views
indexOf_16 = List.IndexOf(list=getItemAtIndex_26, element=getItemAtIndex_27)
code_block_152 = CodeBlock(x=indexOf_16) { x>=0; }
filterByBoolMask_20 = List.FilterByBoolMask(list=indexOf_16, mask=code_block_152)
isEmpty_5 = List.IsEmpty(list=filterByBoolMask_20.in, lacing=Longest)
filterByBoolMask_21 = List.FilterByBoolMask(list=filterByBoolMask_20.in, mask=isEmpty_5)
getItemAtIndex_28 = List.GetItemAtIndex(list=getItemAtIndex_26, index=filterByBoolMask_21.out)

# group: Get Locations
getLocation_5 = Element.GetLocation(element=getItemAtIndex_28)

list_create_14 = List.Create(item0=startPoint, item1=getLocation_5)
getItemAtIndex_29 = List.GetItemAtIndex(list=list_create_14, index=code_block_151)

# group: Plumbing Fixture Tag Location
X_5 = Point.X(point=getItemAtIndex_29)
code_block_153 = CodeBlock(x=X_5, y=set_tag_location_away_from) { x+y; }
Y_5 = Point.Y(point=getItemAtIndex_29)
code_block_154 = CodeBlock(x=Y_5, y=set_tag_location_away_from_2) { x+y; }
byCoordinates_3 = Point.ByCoordinates(x=code_block_153, y=code_block_154)
flatten_19 = List.Flatten(list=byCoordinates_3)

# group: Plumbing Fixture Tag Type
code_block_155 = CodeBlock { "HL_Tag_PlumbingFixtures"; }
byName_11 = Family.ByName(name=code_block_155)
types_4 = Family.Types(family=byName_11)
code_block_156 = CodeBlock { 0; }
getItemAtIndex_30 = List.GetItemAtIndex(list=types_4, index=code_block_156)

# group: Plumbing Fixtures to be tagged
flatten_20 = List.Flatten(list=getItemAtIndex_28)

# group: Views
filterByBoolMask_22 = List.FilterByBoolMask(list=getItemAtIndex_4, mask=isEmpty_5)
count_7 = List.Count(list=getItemAtIndex_28, lacing=Longest)
cycle_3 = List.Cycle(list=filterByBoolMask_22.out, amount=count_7, lacing=Longest)
flatten_21 = List.Flatten(list=cycle_3)

# group: Create Tags for Plumbing Fixtures
code_block_157 = CodeBlock { LinkInstance:var=null; }
code_block_158 = CodeBlock(result=trueForAll) { result ==true? false: true; }
python_script_6 = Python(IN[0]=flatten_19, IN[1]=getItemAtIndex_30, IN[2]=flatten_20, IN[3]=flatten_21, IN[4]=code_block_157, IN[5]=code_block_158)  # IronPython2; same code as python_script_3
code_block_159 = CodeBlock(TaggedPlumbingFixtures=python_script_6) { TaggedPlumbingFixtures; }

# group: Get only vertical pipes connected to Plumbing Fixtures visible in selected view
indexOf_17 = List.IndexOf(list=flatten_4, element=flatten_5)
code_block_160 = CodeBlock(x=indexOf_17) { x>=0; }
filterByBoolMask_23 = List.FilterByBoolMask(list=indexOf_17, mask=code_block_160)
isEmpty_6 = List.IsEmpty(list=filterByBoolMask_23.in, lacing=Longest)
filterByBoolMask_24 = List.FilterByBoolMask(list=filterByBoolMask_23.in, mask=isEmpty_6)
getItemAtIndex_31 = List.GetItemAtIndex(list=flatten_4, index=filterByBoolMask_24.out)

# group: Get Pipe Locations
getLocation_6 = Element.GetLocation(element=getItemAtIndex_31)

# group: Identify Which Pipes Have the Same X & Y Coordinates
startPoint_3 = Curve.StartPoint(curve=getLocation_6)
Y_6 = Point.Y(point=startPoint_3)
round_9 = Math.Round(number=Y_6)
groupByKey_6 = List.GroupByKey(list=startPoint_3, keys=round_9, lacing=Shortest)
X_6 = Point.X(point=groupByKey_6.groups)
round_10 = Math.Round(number=X_6)
groupByKey_7 = List.GroupByKey(list=groupByKey_6.groups@@L2, keys=round_10@L2, lacing=Shortest)
indexOf_18 = List.IndexOf(list=startPoint_3, element=groupByKey_7.groups, lacing=Longest)
getItemAtIndex_32 = List.GetItemAtIndex(list=getItemAtIndex_31@L2, index=indexOf_18, lacing=Longest)
code_block_161 = CodeBlock { 1; }
flatten_22 = List.Flatten(list=getItemAtIndex_32@L4, amount=code_block_161@L1, lacing=Longest)

list_create_15 = List.Create(item0=flatten_6, item1=flatten_22)
filterByBoolMask_25 = List.FilterByBoolMask(list=getItemAtIndex_4, mask=isEmpty_6)
isEmpty_7 = List.IsEmpty(list=filterByBoolMask_25.out)
code_block_162 = CodeBlock(result=isEmpty_7) { result == true? 0: 1; }
getItemAtIndex_33 = List.GetItemAtIndex(list=list_create_15, index=code_block_162)

# group: Vertical pipes that will be tagged
firstItem_5 = List.FirstItem(list=getItemAtIndex_33@L2, lacing=Longest)

# group: Get Pipe Locations
getLocation_7 = Element.GetLocation(element=firstItem_5)

# group: Pipe Tag Location
endPoint_3 = Curve.EndPoint(curve=getLocation_7)
X_7 = Point.X(point=endPoint_3)
code_block_163 = CodeBlock(x=X_7, y=set_tag_location_away_from) { x+y; }
Y_7 = Point.Y(point=endPoint_3)
code_block_164 = CodeBlock(x=Y_7, y=set_tag_location_away_from_2) { x+y; }
byCoordinates_4 = Point.ByCoordinates(x=code_block_163, y=code_block_164)

# group: Pipes to be tagged
flatten_23 = List.Flatten(list=firstItem_5)

# group: Views
count_8 = List.Count(list=getItemAtIndex_33, lacing=Longest)
cycle_4 = List.Cycle(list=filterByBoolMask_25.out, amount=count_8, lacing=Longest)
flatten_24 = List.Flatten(list=cycle_4)

# group: Identify index numbers inside th HL_Tag_Pipe family for required types
code_block_165 = CodeBlock { "HL_Tag_Pipe"; }
byName_12 = Family.ByName(name=code_block_165)
types_5 = Family.Types(family=byName_12)
string_from_object_6 = FromObject(obj=types_5)
code_block_166 = CodeBlock()
# ---------- code_block_166.designscript (10 lines) ----------
["System Name Manual and Comment",
"System Name Manual and FA CTD",
"System Name Manual and FA DTB",
"System Name Manual and FA DTHL",
"System Name Manual and FA DTLL",
"System Name Manual and FHL CTD",
"System Name Manual and FHL DTB",
"System Name Manual and FHL DTLL",
"System Name Manual and FLL CTD",
"System Name Manual and FLL DTB"];
# ----------------------------------------
contains_17 = String.Contains(string=string_from_object_6@L1, searchFor=code_block_166)
code_block_167 = CodeBlock { true; }
contains_18 = List.Contains(list=contains_17@L2, item=code_block_167)
allIndicesOf_5 = List.AllIndicesOf(list=contains_18, item=code_block_167)
code_block_168 = CodeBlock()
# ---------- code_block_168.designscript (10 lines) ----------
["Abbreviation and Comment",
"Abbreviation and FA DTLL",
"Abbreviation and FA CTD",
"Abbreviation and FA DTB",
"Abbreviation and FA DTHL",
"Abbreviation and FLL CTD",
"Abbreviation and FLL DTB",
"Abbreviation and FHL CTD",
"Abbreviation and FHL DTLL",
"Abbreviation and FHL DTB"];
# ----------------------------------------
contains_19 = String.Contains(string=string_from_object_6@L1, searchFor=code_block_168)
code_block_169 = CodeBlock { true; }
contains_20 = List.Contains(list=contains_19@L2, item=code_block_169)
allIndicesOf_6 = List.AllIndicesOf(list=contains_20, item=code_block_169)

# group: Dictionary for Tags-Size and System Name Manual
code_block_170 = CodeBlock { ["true","FA CTD","FA DTB","FA DTHL","FA DTLL","FHL CTD","FHL DTB","FHL DTLL","FLL CTD","FLL DTB"]; }
byKeysValues_5 = DesignScript.Builtin.Dictionary.ByKeysValues(keys=code_block_170, values=allIndicesOf_5)

# group: Dictionary for Tags-Size and System Abbreviation
code_block_171 = CodeBlock { ["true","FA DTLL","FA CTD","FA DTB","FA DTHL","FLL CTD","FLL DTB","FHL CTD","FHL DTLL","FHL DTB"]; }
byKeysValues_6 = DesignScript.Builtin.Dictionary.ByKeysValues(keys=code_block_171, values=allIndicesOf_6)

# group: Get Invert & Top Elevations
code_block_172 = CodeBlock { "Length"; }
getParameterValueByName_15 = Element.GetParameterValueByName(element=getItemAtIndex_33, parameterName=code_block_172)
code_block_173 = CodeBlock { "Invert Elevation"; }
getParameterValueByName_16 = Element.GetParameterValueByName(element=getItemAtIndex_33, parameterName=code_block_173)
top_elevation_3 = CodeBlock(x=getParameterValueByName_15, y=getParameterValueByName_16) { x+y; }
round_11 = Math.Round(number=top_elevation_3)
round_12 = Math.Round(number=getParameterValueByName_16)

code_block_174 = CodeBlock { "Associated Level"; }
getParameterValueByName_17 = Element.GetParameterValueByName(element=filterByBoolMask_25.out, parameterName=code_block_174)
indexOf_19 = List.IndexOf(list=name_6, element=getParameterValueByName_17)
code_block_175 = CodeBlock(val=indexOf_19) { val+1; }
join_3 = List.Join(list0=indexOf_19, list1=code_block_175)
sort = List.Sort(list=join_3)
getItemAtIndex_34 = List.GetItemAtIndex(list=name_6, index=sort)
code_block_176 = CodeBlock { 2; }
chop_2 = List.Chop(list=getItemAtIndex_34, lengths=code_block_176)
indexOf_20 = List.IndexOf(list=name_6, element=chop_2)
getItemAtIndex_35 = List.GetItemAtIndex(list=projectElevation_2, index=indexOf_20)
firstItem_6 = List.FirstItem(list=getItemAtIndex_35, lacing=Longest)
lastItem_7 = List.LastItem(list=getItemAtIndex_35, lacing=Longest)

# group: Identify whether pipe is FA, FHL or FLL
code_block_177 = CodeBlock(PipeTop=round_11, LvlBottomElevation=firstItem_6, LvlTopElevation=lastItem_7)
# ---------- code_block_177.designscript (3 lines) ----------
PipeTop>(LvlBottomElevation+LvlTopElevation)/2 && PipeTop<LvlTopElevation?"FHL":
PipeTop<(LvlBottomElevation+LvlTopElevation)/2 && PipeTop>LvlBottomElevation?"FLL":
PipeTop>LvlTopElevation?"FA":"";
# ----------------------------------------
code_block_178 = CodeBlock(x=code_block_177) { x=="FA"?1:x=="FHL"?2:x=="FLL"?3:4; }
minimumItem_5 = List.MinimumItem(list=code_block_178)
code_block_179 = CodeBlock(x=minimumItem_5) { x==1?"FA":x==2?"FHL":x==3?"FLL":""; }

# group: Identify whether pipe CTD, DTB, DTHL or DTLL
code_block_180 = CodeBlock(PipeInvert=round_12, LvlBottomElevation=firstItem_6, LvlTopElevation=lastItem_7)  # same code as code_block_77
code_block_181 = CodeBlock(x=code_block_180) { x=="CTD"?1:x=="DTB"?2:x=="DTLL"?3:x=="DTHL"?4:5; }
minimumItem_6 = List.MinimumItem(list=code_block_181)
code_block_182 = CodeBlock(x=minimumItem_6) { x==1?"CTD":x==2?"DTB":x==3?"DTLL":x==4?"DTHL":""; }

# group: Create string
code_block_183 = CodeBlock(x=code_block_179, y=code_block_182) { x+" "+y; }

code_block_184 = CodeBlock { "FHL"; }

# group: Get Type Abbreviation
elementType_3 = Element.ElementType(element=filterByBoolMask_6.in)
code_block_185 = CodeBlock { "Type Abbreviation"; }
getParameterValueByName_18 = Element.GetParameterValueByName(element=elementType_3, parameterName=code_block_185)

flatten_25 = List.Flatten(list=getItemAtIndex_32, lacing=Longest)
allIndicesOf_7 = List.AllIndicesOf(list=flatten_4, item=flatten_25)
flatten_26 = List.Flatten(list=allIndicesOf_7, lacing=Longest)
getItemAtIndex_36 = List.GetItemAtIndex(list=getParameterValueByName_18, index=flatten_26)
code_block_186 = CodeBlock(x=getItemAtIndex_36) { "FROM "+x; }
replace_5 = String.Replace(string=code_block_183, searchFor=code_block_184, replaceWith=code_block_186)

# group: Python to replace items in list
flatten_27 = List.Flatten(list=replace_5)
code_block_187 = CodeBlock { "true"; }
create = List.Create(item0=code_block_187)
flatten_28 = List.Flatten(list=create)
code_block_188 = CodeBlock { "FROM"; }
contains_21 = String.Contains(string=flatten_27, searchFor=code_block_188)
code_block_189 = CodeBlock { true; }
allIndicesOf_8 = List.AllIndicesOf(list=contains_21, item=code_block_189)
python_script_7 = Python(IN[0]=flatten_27, IN[1]=flatten_28, IN[2]=allIndicesOf_8)  # IronPython2
# ---------- python_script_7.python (9 lines) ----------
_list = IN[0]
rValues = IN[1]
iValues = IN[2]
if len(iValues) > 1 and len(rValues) == 1:
	rValues = [rValues[0]] * len(iValues)
if len(iValues) > 0:
	for (index, value) in zip(iValues, rValues):
		_list[index] = value
OUT = _list
# ----------------------------------------

# group: Get Values from Dictionary Based on Selected Pipe Tag
list_create_16 = List.Create(item0=byKeysValues_5, item1=byKeysValues_6)
code_block_190 = CodeBlock(PipeTag=code_block_54, x=list_create_16) { PipeTag=="Size and System Name Manual"?x[0]:x[1]; }
valueAtKey_3 = DesignScript.Builtin.Dictionary.ValueAtKey(dictionary=code_block_190, key=python_script_7)

# group: Pipe Tag Type
code_block_191 = CodeBlock { "HL_Tag_Pipe"; }
byName_13 = Family.ByName(name=code_block_191)
types_6 = Family.Types(family=byName_13)
code_block_192 = CodeBlock(PipeTag=code_block_54) { PipeTag=="Size and System Name Manual"?5:7; }
getItemAtIndex_37 = List.GetItemAtIndex(list=types_6, index=code_block_192)
getItemAtIndex_38 = List.GetItemAtIndex(list=types_6, index=valueAtKey_3)
flatten_29 = List.Flatten(list=getItemAtIndex_38)

# group: Create Pipe Tags for pipes connected to Plumbing Fixtures
empty_2 = List.Empty()
code_block_193 = CodeBlock { LinkInstance:var=null; }
code_block_194 = CodeBlock(result=isEmpty_7) { result ==true? false: true; }
python_script_8 = Python(IN[0]=byCoordinates_4, IN[1]=getItemAtIndex_37, IN[2]=flatten_23, IN[3]=flatten_24, IN[4]=code_block_193, IN[5]=code_block_194)  # IronPython2; same code as python_script_3
code_block_195 = CodeBlock(PipeTags=python_script_8) { PipeTags; }
list_create_17 = List.Create(item0=empty_2, item1=code_block_195)
code_block_196 = CodeBlock(result=isEmpty_7) { result ==true? 0 : 1; }
getItemAtIndex_39 = List.GetItemAtIndex(list=list_create_17, index=code_block_196)
code_block_197 = CodeBlock { "Family and Type"; }
setParameterByName_3 = Element.SetParameterByName(element=getItemAtIndex_39, parameterName=code_block_197, value=flatten_29)

join_4 = List.Join(list0=setParameterByName, list1=setParameterByName_2, list2=code_block_159, list3=setParameterByName_3)

# group: Background
string_from_object_7 = FromObject(obj=join_4)
code_block_198 = CodeBlock { "RunIt is set to False."; }
contains_22 = String.Contains(string=string_from_object_7, searchFor=code_block_198)
filterByBoolMask_26 = List.FilterByBoolMask(list=join_4, mask=contains_22)

# group: Add Leader to Tags
code_block_199 = CodeBlock { "Leader Line"; }
boolean_2 = BoolSelector(true)
setParameterByName_4 = Element.SetParameterByName(element=filterByBoolMask_26.out, parameterName=code_block_199, value=boolean_2)

# group: Write Comments Parameter
code_block_200 = CodeBlock { "Comments"; }
setParameterByName_5 = Element.SetParameterByName(element=flatten_25, parameterName=code_block_200, value=replace_5)

# group: All Vent vertical pipes
watch_2 = Watch(code_block_96)

# group: All Discharge vertical pipes
watch_3 = Watch(code_block_32)
