# Dynamo graph Rainwater Systems_Pipe Numbering v.2.0.dyn "Rainwater Systems_Pipe Numbering v.1.4" (Dynamo 2.13.1.3887)
# packages: Data-Shapes 2022.2.103

# group: DYNAMO COLOUR CODING LEGEND
# note: COLOUR CODING LEGEND

# group: Monitor
# note: USE:
# FOR IMPORTANT WATCH NODES

# group: Conditional
# note: USE:
# FOR CONDITIONAL NODES

# group: Python
# note: USE:
# FOR PYTHON NODES

# group: To Revit
# note: USE:
# FOR CHANGES TO REVIT

# group: Control
# note: USE:
# FOR USER CONTROL (SLIDERS ETC.)

# group: Input
# note: USE:
# FOR FIXED INPUT (FILE PATHS ETC.)

# group: Background
# note: USE:
# FOR GENERAL WORKFLOW NODES

# group: Get Only Piping Systems Containing 'Rainwater' in System Classification
code_block = CodeBlock { "Piping Systems"; }
byName = Category.ByName(name=code_block)
all_elements_of_category = ElementsOfCategory(Category=byName)
elementType = Element.ElementType(element=all_elements_of_category)
code_block_2 = CodeBlock { "Type Name"; }
getParameterValueByName = Element.GetParameterValueByName(element=elementType, parameterName=code_block_2)
code_block_3 = CodeBlock { "Ss_50_30_02 - Rainwater"; }
contains = String.Contains(string=getParameterValueByName, searchFor=code_block_3)
filterByBoolMask = List.FilterByBoolMask(list=all_elements_of_category, mask=contains)

name = Element.Name(element=filterByBoolMask.in)

# group: Python to sort strings with numbers
python_to_sort_strings_with = Python(IN[0]=name)  # "Python to sort strings with numbers"; IronPython2
# ---------- python_to_sort_strings_with.python (10 lines) ----------
import re

list = IN[0]

def natural_sort(l): 
    convert = lambda text: int(text) if text.isdigit() else text.lower() 
    alphanum_key = lambda key: [ convert(c) for c in re.split('([0-9]+)', key) ] 
    return sorted(l, key = alphanum_key)

OUT = natural_sort(list)
# ----------------------------------------

indexOf = List.IndexOf(list=name, element=python_to_sort_strings_with)
getItemAtIndex = List.GetItemAtIndex(list=filterByBoolMask.in, index=indexOf)

# group: User Interface
code_block_4 = CodeBlock { "Set Rainwater System Number"; null; "Proceed"; "Cancel"; 800; 700; 300; }
code_block_5 = CodeBlock { ["Pipe","System"]; }
code_block_6 = CodeBlock { "Select Pipe"; "Select"; }
code_block_7 = CodeBlock { "Pipes"; }
byName_2 = Category.ByName(name=code_block_7)
boolean = BoolSelector(true)
selectmodelelements_data = Custom[SelectModelElements Data](InputName=code_block_6.out0, ButtonText=code_block_6.out1, CategoryFilter=byName_2, SelectSingleElement=boolean)  # package Data-Shapes; Creates a Revit element selection input for UI.MultipleInputForm++ . Check out www.data-shapes.net for more infos!
code_block_8 = CodeBlock { "Select System"; }
boolean_2 = BoolSelector(false)
dropdown_data = Custom[DropDown Data](InputName=code_block_8, Keys=python_to_sort_strings_with, Values=getItemAtIndex, Sorted_optional=boolean_2)  # package Data-Shapes; Create data for DropDown input in UI.MultiInputForm ++ . Check out www.data-shapes.net for more infos.
list_create = List.Create(item0=selectmodelelements_data, item1=dropdown_data)
conditionalinput_data = Custom[ConditionalInput Data](Options=code_block_5, InputGroups_by_Option=list_create)  # package Data-Shapes; Allows to create inputs that are enabled/disabled by a condition dor UI.MultipleInputForm++.
code_block_9 = CodeBlock { "Choose Number"; }
boolean_3 = BoolSelector(true)
textbox_data = Custom[TextBox Data](InputName=code_block_9, IsNumberEntry=boolean_3)  # package Data-Shapes; Create Data for TextBox input in UI.MultipleInputForm ++ . Check out www.data-shapes.net for more informations
list_create_2 = List.Create(item0=conditionalinput_data, item1=textbox_data)
boolean_4 = BoolSelector(true)
multipleinputform = Custom[MultipleInputForm ++](Description_optional=code_block_4.out0, Logo_optional=code_block_4.out1, ButtonText_optional=code_block_4.out2, Inputs=list_create_2, Toggle=boolean_4, CancelButtonText_optional=code_block_4.out3, MaxHeight_optional=code_block_4.out4, Width_optional=code_block_4.out5, LabelWidth_optional=code_block_4.out6)  # package Data-Shapes; Create a form with multiple inputs. see www.data-shapes.net for tutorials and infos!

# group: User Selection: Selected Method
code_block_10 = CodeBlock(Method=multipleinputform.User_Inputs) { Method == "Pipe"? [1] : [2]; }

getItemAtIndex_2 = List.GetItemAtIndex(list=multipleinputform.User_Inputs, index=code_block_10)
code_block_11 = CodeBlock { "System Name"; }
getParameterValueByName_2 = Element.GetParameterValueByName(element=getItemAtIndex_2, parameterName=code_block_11)
indexOf_2 = List.IndexOf(list=python_to_sort_strings_with, element=getParameterValueByName_2)
getItemAtIndex_3 = List.GetItemAtIndex(list=getItemAtIndex, index=indexOf_2)

# group: Python to get all elements in network
python_pipe_network = Python(IN[0]=getItemAtIndex_3)  # IronPython2
# ---------- python_pipe_network.python (42 lines) ----------
import clr

clr.AddReference("RevitServices")
import RevitServices
from RevitServices.Persistence import DocumentManager
from RevitServices.Transactions import TransactionManager
doc = DocumentManager.Instance.CurrentDBDocument

clr.AddReference("RevitAPI")
import Autodesk
from Autodesk.Revit.DB import *

clr.AddReference("RevitNodes")
import Revit
clr.ImportExtensions(Revit.Elements)
clr.ImportExtensions(Revit.GeometryConversion)

#Many thanks to Konrad K Sobon for his awesome ProcessList function!
def Unwrap(item):
	return UnwrapElement(item)

def ProcessList(_func, _list):
    return map( lambda x: ProcessList(_func, x) if type(x)==list else _func(x), _list )

if isinstance(IN[0], list):
	systems = ProcessList(Unwrap, IN[0])
else:
	systems = [Unwrap(IN[0])]
	
	
def getNetwork(system):
	network = None
	try:
		network = [x.ToDSType(True) for x in system.PipingNetwork]
	except:
		pass
	return network

			
#Assign your output to the OUT variable.

OUT = ProcessList(getNetwork, systems)
# ----------------------------------------

# group: Get only pipes
getCategory = Element.GetCategory(element=python_pipe_network)
string_from_object = FromObject(object=getCategory)
code_block_12 = CodeBlock { "Pipes"; }
contains_2 = String.Contains(string=string_from_object, searchFor=code_block_12)
filterByBoolMask_2 = List.FilterByBoolMask(list=python_pipe_network, mask=contains_2)

# group: Get lowest pipe in the system
code_block_13 = CodeBlock { "Invert Elevation"; }
getParameterValueByName_3 = Element.GetParameterValueByName(element=filterByBoolMask_2.in, parameterName=code_block_13)
minimumItem = List.MinimumItem(list=getParameterValueByName_3, lacing=Longest)
allIndicesOf = List.AllIndicesOf(list=getParameterValueByName_3, item=minimumItem, lacing=Longest)
getItemAtIndex_4 = List.GetItemAtIndex(list=filterByBoolMask_2.in, index=allIndicesOf, lacing=Longest)
flatten = List.Flatten(list=getItemAtIndex_4)

# group: Python to evaluate elements in each network and output a sublist for each branch
walk_network_sublist_for = Python(IN[0]=flatten)  # "Walk Network, sublist for Branches"; IronPython2
# ---------- walk_network_sublist_for.python (113 lines) ----------
import clr

clr.AddReference("RevitAPI")
import Autodesk
from Autodesk.Revit.DB import *

clr.AddReference("RevitNodes")
import Revit
clr.ImportExtensions(Revit.Elements)


#MEP network walker, by Jared Linden jaredlinden@hoarelea.com


if isinstance(IN[0], list):
	elems = UnwrapElement(IN[0])
	islist = True
else:
	islist = False
	elems = [UnwrapElement(IN[0])]
	

output = []
debug_info = []

class ConnectorHelper:

	def __init__(self, con, system_id, checked_list):
		self.connector = con
		self.owner_id = con.Owner.Id.IntegerValue
		self.owner = con.Owner
		self.system_id = system_id
		checked_list.append(con.Owner.Id.IntegerValue)
		self.connected = (self.nextConHelper(rv_con,checked_list) for rv_con in con.AllRefs if rv_con.Owner.Id.IntegerValue != self.owner_id and rv_con.Owner.Id.IntegerValue not in checked_list and validNextConnector(rv_con, system_id))
		self.owners_conections = (list(self.nextConHelper(x,checked_list).connected) for x in sortedConnectors(con) if isValidIterableConnector(x) and x.Id != con.Id)
		
	def nextConHelper(self, con, checked_list):
		return ConnectorHelper(con, self.system_id, checked_list)
		
		
		
	def next(self):
		yield self.owner
		#should only be one connector connected to this
		#Ignore Caps
		next_conectors = [x[0] for x in self.owners_conections if isinstance(x,list) and len(x) > 0]
		try:
			some_object_iterator = iter(next_conectors)
		except TypeError as te:
			raise StopIteration
		#No connections
		if len(next_conectors) == 0:
			raise StopIteration
			
		#Multiple connections, return a list of their iterators
		#We want to do this first so the sublist is in the correct place
		for next_connector in next_conectors[1:]:
			next_iterator = next_connector.next()
			yield [next for next in next_iterator]
		
		#1 Connection, return its iterator
		next_iter = next_conectors[0].next()
		for next_item in next_iter:
			yield next_item
			

def sortedConnectors(con):
	return sorted(con.ConnectorManager.Connectors, key=lambda x : x.Angle)

def isValidIterableConnector(con):
	return (con.ConnectorType == ConnectorType.End or con.ConnectorType == ConnectorType.Curve) and con.IsConnected
	
	#Takes a revit connector object
def validNextConnector(revit_con, system_id):
	return isValidIterableConnector(revit_con) and len(list(revit_con.ConnectorManager.Connectors)) > 1 and revit_con.MEPSystem.Id.IntegerValue == system_id

def getConnectors(elem):
	try:
		connectors = elem.MEPModel.ConnectorManager.Connectors
	except:
		connectors = elem.ConnectorManager.Connectors
	return [x for x in connectors if isValidIterableConnector(x)]
	
def getAllConnectors(elem):
	try:
		return elem.MEPModel.ConnectorManager.Connectors
	except:
		return elem.ConnectorManager.Connectors





for i, elem in enumerate(elems):
	elem_list = []
	safe = 0
	for con in getAllConnectors(elem):
		system_id = con.MEPSystem.Id.IntegerValue
		con_list = []
		con_next = ConnectorHelper(con, system_id, []).next()
		for o in con_next:
			if safe > 9999:
				break
			safe +=1
			con_list.append(o)
		elem_list.append(con_list)
	output.append(elem_list)
	
#Assign your output to the OUT variable.
if islist:
	OUT = output
else:
	OUT = output[0]
# ----------------------------------------
code_block_14 = CodeBlock(out=walk_network_sublist_for) { out; }

code_block_15 = CodeBlock { 2; }
flatten_2 = List.Flatten(list=code_block_14, amount=code_block_15)
uniqueItems = List.UniqueItems(list=flatten_2)
flatten_3 = List.Flatten(list=uniqueItems)
code_block_16 = CodeBlock { "System Abbreviation"; }
getParameterValueByName_4 = Element.GetParameterValueByName(element=flatten_3, parameterName=code_block_16)

# group: User Input: Input Number
code_block_17 = CodeBlock(InputNumber=multipleinputform.User_Inputs) { InputNumber[3]; }

ceiling = Math.Ceiling(number=code_block_17)

# group: Get a number for each item in a list depending on depth and sub list number
code_block_18 = CodeBlock(ElementTree=uniqueItems, TreeNumber=ceiling) { ElementTree; TreeNumber; }
get_tag = Python(IN[0]=code_block_18.ElementTree, IN[1]=code_block_18.TreeNumber)  # IronPython2
# ---------- get_tag.python (37 lines) ----------
# Enable Python support and load DesignScript library
import clr
clr.AddReference('ProtoGeometry')
from Autodesk.DesignScript.Geometry import *

#By Jared Linden jaredlinden@hoarelea.com
# The inputs to this node will be stored as a list in the IN variables.
dataEnteringNode = IN[0]
number = IN[1]

output = []

#Sweet sweet recursion
def GetTagRecursive(item, current_branch):
		
	item_tags = []
	
	next_branches = current_branch[:]+[0]
	for x in item:
		#Check iterable
		if isinstance(x,list):
			next_branches[-1] = next_branches[-1] + 1
			item_tags.append(GetTagRecursive(x, next_branches))
		else:
			st = str(current_branch[0])
			for i in current_branch[1:]:
				st += "." + str(i)
			item_tags.append(st)
	return item_tags	
	

blobs = GetTagRecursive(dataEnteringNode, [number])
for x in blobs:
	output.append(x)

# Assign your output to the OUT variable.
OUT = output
# ----------------------------------------

flatten_4 = List.Flatten(list=get_tag)
code_block_19 = CodeBlock(x=getParameterValueByName_4, y=flatten_4) { x + " " + y; }

# group: Set Manual System Name Parameter
string = StringInput("Manual System Name")
setParameterByName = Element.SetParameterByName(element=flatten_3, parameterName=string, value=code_block_19)
