# Dynamo graph Rainwater Systems_Pipe Annotations_Multiple Levels v.3.1.dyn (Dynamo 2.16.1.2727)
# packages: Data-Shapes 2021.2.92

# group: DYNAMO COLOUR CODING LEGEND
# note: COLOUR CODING LEGEND

# group: Monitor
# note: USE:
# FOR IMPORTANT WATCH NODES

# group: Conditional
# note: USE:
# FOR CONDITIONAL NODES

# group: Python
# note: USE:
# FOR PYTHON NODES

# group: To Revit
# note: USE:
# FOR CHANGES TO REVIT

# group: Control
# note: USE:
# FOR USER CONTROL (SLIDERS ETC.)

# group: Input
# note: USE:
# FOR FIXED INPUT (FILE PATHS ETC.)

# group: Background
# note: USE:
# FOR GENERAL WORKFLOW NODES

# group: Get all piping systems, filter them and get only Rainwater
string = StringInput("Piping Systems")
byName = Category.ByName(name=string)
all_elements_of_category = ElementsOfCategory(Category=byName)
elementType = Element.ElementType(element=all_elements_of_category)
name = Element.Name(element=elementType)
code_block = CodeBlock { ["Ss_50_30_02 - Rainwater"]; }
contains = String.Contains(string=name, searchFor=code_block@L1)
filterByBoolMask = List.FilterByBoolMask(list=all_elements_of_category, mask=contains@L2)
flatten = List.Flatten(list=filterByBoolMask.in)
name_2 = Element.Name(element=flatten)

# group: Python to sort strings with numbers
python_to_sort_strings_with = Python(IN[0]=name_2)  # "Python to sort strings with numbers"; IronPython2
# ---------- python_to_sort_strings_with.python (10 lines) ----------
import re

list = IN[0]

def natural_sort(l): 
    convert = lambda text: int(text) if text.isdigit() else text.lower() 
    alphanum_key = lambda key: [ convert(c) for c in re.split('([0-9]+)', key) ] 
    return sorted(l, key = alphanum_key)

OUT = natural_sort(list)
# ----------------------------------------

indexOf = List.IndexOf(list=name_2, element=python_to_sort_strings_with)
getItemAtIndex = List.GetItemAtIndex(list=flatten, index=indexOf)
code_block_2 = CodeBlock { ["All","Selected"]; }
code_block_3 = CodeBlock { "All Rainwater systems"; }
textnote_data = Custom[TextNote Data](TextNote=code_block_3)  # package Data-Shapes; Create Data for TextNote input in UI.MultipleInputForm ++ . Check out www.data-shapes.net for more informations
code_block_4 = CodeBlock { "Select System"; false; }
listview_data = Custom[Listview Data](InputName=code_block_4.out0, Keys=python_to_sort_strings_with, Values=getItemAtIndex, SortItems_optionnal=code_block_4.out1, ShowId_optionnal=code_block_4.out1)  # package Data-Shapes; Create data for ListView input in UI.MultiInputForm ++ . Check out www.data-shapes.net for more infos.
list_create = List.Create(item0=textnote_data, item1=listview_data)
conditionalinput_data = Custom[ConditionalInput Data](Options=code_block_2, InputGroups_by_Option=list_create)  # package Data-Shapes; Allows to create inputs that are enabled/disabled by a condition dor UI.MultipleInputForm++.

# group: Get All Views
string_2 = StringInput("Views")
byName_2 = Category.ByName(name=string_2)
all_elements_of_category_2 = ElementsOfCategory(Category=byName_2)

# group: Remove nulls
isNull = Object.IsNull(object=all_elements_of_category_2)
not_ = Not(x=isNull)
filterByBoolMask_2 = List.FilterByBoolMask(list=all_elements_of_category_2, mask=not_)

# group: Get only Floor Plan Views
string_from_object = FromObject(object=filterByBoolMask_2.in)
code_block_5 = CodeBlock { "FloorPlanView"; }
contains_2 = String.Contains(string=string_from_object, searchFor=code_block_5)
filterByBoolMask_3 = List.FilterByBoolMask(list=filterByBoolMask_2.in, mask=contains_2)

name_3 = Element.Name(element=filterByBoolMask_3.in)

# group: Get All Levels
string_3 = StringInput("Levels")
byName_3 = Category.ByName(name=string_3)
all_elements_of_category_3 = ElementsOfCategory(Category=byName_3)

# group: Sort Levels by Elevation
projectElevation = Level.ProjectElevation()  # unwired: level
sortByFunction = List.SortByFunction(list=all_elements_of_category_3, sortFunction=projectElevation)

name_4 = Level.Name(level=sortByFunction)

# group: User Interface
code_block_6 = CodeBlock { "Rainwater Systems Annotations"; null; "Proceed"; "Cancel"; 800; 700; 300; }
code_block_7 = CodeBlock { "Select 'All' if you want to tag all rainwater systems in the model. 'Selected' option allows you to select and tag only specific rainwater systems."; }
textnote_data_2 = Custom[TextNote Data](TextNote=code_block_7)
code_block_8 = CodeBlock { "Select the type of tag you wish to use."; }
textnote_data_3 = Custom[TextNote Data](TextNote=code_block_8)
code_block_9 = CodeBlock { "Select Tag"; ["Size and System Abbreviation", "Size and System Name Manual"]; 0; false; }
dropdown_data = Custom[DropDown Data](InputName=code_block_9.out0, Keys=code_block_9.out1, Values=code_block_9.out1, DefaultValueIndex=code_block_9.out2, Sorted_optional=code_block_9.out3)  # package Data-Shapes; Create data for DropDown input in UI.MultiInputForm ++ . Check out www.data-shapes.net for more infos.
code_block_10 = CodeBlock { "Select the floor plan views where you wish to place your tags."; }
textnote_data_4 = Custom[TextNote Data](TextNote=code_block_10)
code_block_11 = CodeBlock { "Select Views"; false; }
listview_data_2 = Custom[Listview Data](InputName=code_block_11.out0, Keys=name_3, Values=filterByBoolMask_3.in, ShowId_optionnal=code_block_11.out1)
code_block_12 = CodeBlock { "Select the levels relevant to the rainwater systems."; }
textnote_data_5 = Custom[TextNote Data](TextNote=code_block_12)
code_block_13 = CodeBlock { "Select Levels"; false; }
listview_data_3 = Custom[Listview Data](InputName=code_block_13.out0, Keys=name_4, Values=sortByFunction, SortItems_optionnal=code_block_13.out1, ShowId_optionnal=code_block_13.out1)
list_create_2 = List.Create(item0=textnote_data_2, item1=conditionalinput_data, item2=textnote_data_3, item3=dropdown_data, item4=textnote_data_4, item5=listview_data_2, item6=textnote_data_5, item7=listview_data_3)
boolean = BoolSelector(true)
multipleinputform = Custom[MultipleInputForm ++](Description_optional=code_block_6.out0, Logo_optional=code_block_6.out1, ButtonText_optional=code_block_6.out2, Inputs=list_create_2, Toggle=boolean, CancelButtonText_optional=code_block_6.out3, MaxHeight_optional=code_block_6.out4, Width_optional=code_block_6.out5, LabelWidth_optional=code_block_6.out6)  # package Data-Shapes; Create a form with multiple inputs. see www.data-shapes.net for tutorials and infos!

# group: User Selection: Selected Systems
code_block_14 = CodeBlock(SelectedSystems=multipleinputform.User_Inputs) { SelectedSystems[1]; }

list_create_3 = List.Create(item0=getItemAtIndex, item1=code_block_14)

# group: User Selection: Selected Systems Option
code_block_15 = CodeBlock(SelectedSystemsOption=multipleinputform.User_Inputs) { SelectedSystemsOption[0]; }

# group: Conditional
code_block_16 = CodeBlock(result=code_block_15) { result=="All"? 0 : 1; }

getItemAtIndex_2 = List.GetItemAtIndex(list=list_create_3, index=code_block_16)

# group: Python to get all elements in network
code_block_17 = CodeBlock(PipingSystem=getItemAtIndex_2) { PipingSystem; }
python_pipe_network = Python(IN[0]=code_block_17)  # IronPython2
# ---------- python_pipe_network.python (42 lines) ----------
import clr

clr.AddReference("RevitServices")
import RevitServices
from RevitServices.Persistence import DocumentManager
from RevitServices.Transactions import TransactionManager
doc = DocumentManager.Instance.CurrentDBDocument

clr.AddReference("RevitAPI")
import Autodesk
from Autodesk.Revit.DB import *

clr.AddReference("RevitNodes")
import Revit
clr.ImportExtensions(Revit.Elements)
clr.ImportExtensions(Revit.GeometryConversion)

#Many thanks to Konrad K Sobon for his awesome ProcessList function!
def Unwrap(item):
	return UnwrapElement(item)

def ProcessList(_func, _list):
    return map( lambda x: ProcessList(_func, x) if type(x)==list else _func(x), _list )

if isinstance(IN[0], list):
	systems = ProcessList(Unwrap, IN[0])
else:
	systems = [Unwrap(IN[0])]
	
	
def getNetwork(system):
	network = None
	try:
		network = [x.ToDSType(True) for x in system.PipingNetwork]
	except:
		pass
	return network

			
#Assign your output to the OUT variable.

OUT = ProcessList(getNetwork, systems)
# ----------------------------------------
code_block_18 = CodeBlock(ElementsInPipingSystem=python_pipe_network) { ElementsInPipingSystem; }

# group: Get only plumbing fixtures
getCategory = Element.GetCategory(element=code_block_18)
string_from_object_2 = FromObject(object=getCategory)
code_block_19 = CodeBlock { "Plumbing Fixtures"; }
contains_3 = String.Contains(string=string_from_object_2, searchFor=code_block_19)
filterByBoolMask_4 = List.FilterByBoolMask(list=code_block_18, mask=contains_3)
flatten_2 = List.Flatten(list=filterByBoolMask_4.in)

# group: Get only plumbing fixtures with RWP in System Abbreviation
code_block_20 = CodeBlock { "System Abbreviation"; }
getParameterValueByName = Element.GetParameterValueByName(element=flatten_2, parameterName=code_block_20)
code_block_21 = CodeBlock { "RWP"; }
contains_4 = String.Contains(string=getParameterValueByName, searchFor=code_block_21, lacing=Longest)
filterByBoolMask_5 = List.FilterByBoolMask(list=flatten_2, mask=contains_4)

# group: Python to determine elements connected to RWO's
python_script = Python(IN[0]=filterByBoolMask_5.in)  # IronPython2
# ---------- python_script.python (63 lines) ----------
import clr
import math

clr.AddReference("RevitServices")
import RevitServices
from RevitServices.Persistence import DocumentManager
from RevitServices.Transactions import TransactionManager
doc = DocumentManager.Instance.CurrentDBDocument

clr.AddReference("RevitAPI")
import Autodesk
from Autodesk.Revit.DB import *

clr.AddReference("RevitNodes")
import Revit
clr.ImportExtensions(Revit.Elements)
clr.ImportExtensions(Revit.GeometryConversion)
#The inputs to this node will be stored as a list in the IN variables.
if isinstance(IN[0], list):
	fittings = UnwrapElement(IN[0])
	toggle = 0
else:
	toggle = 1
	fittings = [UnwrapElement(IN[0])]
	
rep = []
ref = []

for fitting in fittings:

	report = []
	refs = []
	
	try:
		connectors = fitting.MEPModel.ConnectorManager.Connectors
	except:
		try:
			connectors = fitting.ConnectorManager.Connectors
		except:
			rep.append(None)
			ref.append(None)
			continue
	for conn in connectors:
		result = ""
		try:
			result += "Direction: " + conn.Direction.ToString()
		except:
			result += "Direction: N/A"
		result += ", AllRefs Size: " + conn.AllRefs.Size.ToString()
		result += ", Domain: " + conn.Domain.ToString()
		result += ", Type: " + conn.ConnectorType.ToString()
		report.append(result)
		for c in conn.AllRefs:
			refs.append(c.Owner)
	rep.append(report)
	ref.append(refs)


#Assign your output to the OUT variable.
if toggle:
	OUT = report, refs
else:
	OUT = rep,ref
# ----------------------------------------
code_block_22 = CodeBlock(x=python_script) { x[0]; }
code_block_23 = CodeBlock(Direction=code_block_22) { Direction; }
code_block_24 = CodeBlock(x=python_script) { x[1]; }
code_block_25 = CodeBlock(ConnectedElements=code_block_24) { ConnectedElements; }

# group: Get pipes connected to RWO's
string_from_object_3 = FromObject(obj=code_block_25)
code_block_26 = CodeBlock { "Pipe"; }
contains_5 = String.Contains(string=string_from_object_3, searchFor=code_block_26)
filterByBoolMask_6 = List.FilterByBoolMask(list=code_block_25, mask=contains_5)
flatten_3 = List.Flatten(list=filterByBoolMask_6.in)

# group: Get only pipes
getCategory_2 = Element.GetCategory(element=code_block_18)
string_from_object_4 = FromObject(obj=getCategory_2)
code_block_27 = CodeBlock { "Pipes"; }
contains_6 = String.Contains(string=string_from_object_4, searchFor=code_block_27)
filterByBoolMask_7 = List.FilterByBoolMask(list=code_block_18, mask=contains_6)
flatten_4 = List.Flatten(list=filterByBoolMask_7.in)

# group: Python to determine pipes' verticality
filter_lines = Python(IN[0]=flatten_4)  # IronPython2
# ---------- filter_lines.python (30 lines) ----------
#Alban de Chasteigner 2020
#twitter : @geniusloci_bim
#geniusloci.bim@gmail.com

import clr
clr.AddReference('RevitAPI')
import Autodesk
from Autodesk.Revit.DB import *

clr.AddReference('RevitNodes')
import Revit
clr.ImportExtensions(Revit.GeometryConversion)

elements = UnwrapElement(IN[0]) if isinstance(IN[0],list) else [UnwrapElement(IN[0])]
	
horizontal,vertical, slope =[],[],[]

for element in elements:
	if hasattr(element, "Explode"):
		curve=element.ToRevitType()
	elif hasattr(element, "Location") and isinstance(element.Location, Autodesk.Revit.DB.LocationCurve):
		curve=element.Location.Curve
	if round(curve.GetEndPoint(0).Z,2) == round(curve.GetEndPoint(1).Z,2):
		horizontal.append(element)
	elif round(curve.GetEndPoint(0).X,2) == round(curve.GetEndPoint(1).X,2) and round(curve.GetEndPoint(0).Y,2) == round(curve.GetEndPoint(1).Y,2):
		vertical.append(element)
	else: slope.append(element)
	
if isinstance(IN[0], (list)): OUT = vertical,horizontal,slope
else: OUT = vertical[0],horizontal[0],slope[0]
# ----------------------------------------
code_block_28 = CodeBlock(x=filter_lines) { x[0]; x[1]; x[2]; }
code_block_29 = CodeBlock(Vertical=code_block_28.out0) { Vertical; }
code_block_30 = CodeBlock(Horizontal=code_block_28.out1) { Horizontal; }
code_block_31 = CodeBlock(Sloping=code_block_28.out2) { Sloping; }

# group: User Selection: Floor Plan(s)
code_block_32 = CodeBlock(SelectedViews=multipleinputform.User_Inputs) { SelectedViews[3]; }

code_block_33 = CodeBlock { "Associated Level"; }
getParameterValueByName_2 = Element.GetParameterValueByName(element=code_block_32, parameterName=code_block_33)

# group: User Selection: Levels
code_block_34 = CodeBlock(SelectedLevels=multipleinputform.User_Inputs) { SelectedLevels[4]; }

name_5 = Level.Name(level=code_block_34)
indexOf_2 = List.IndexOf(list=getParameterValueByName_2, element=name_5)
code_block_35 = CodeBlock(x=indexOf_2) { x >= 0; }
filterByBoolMask_8 = List.FilterByBoolMask(list=indexOf_2, mask=code_block_35)
getItemAtIndex_3 = List.GetItemAtIndex(list=code_block_32, index=filterByBoolMask_8.in)

# group: Get Pipes category
string_4 = StringInput("Pipes")
byName_4 = Category.ByName(name=string_4)

# group: Python to get all pipes in selected views
python_script_2 = Python(IN[0]=getItemAtIndex_3, IN[1]=byName_4)  # IronPython2
# ---------- python_script_2.python (40 lines) ----------
import clr
clr.AddReference('RevitAPI')
from Autodesk.Revit.DB import *

clr.AddReference("RevitNodes")
import Revit
clr.ImportExtensions(Revit.Elements)
clr.ImportExtensions(Revit.GeometryConversion)

clr.AddReference("RevitServices")
import RevitServices
from RevitServices.Persistence import DocumentManager

doc = DocumentManager.Instance.CurrentDBDocument
toggle = 0
if isinstance(IN[0], list):
	view = UnwrapElement(IN[0])
else:
	toggle = 1
	view = [UnwrapElement(IN[0])]

if isinstance(IN[1], list):
	category = UnwrapElement(IN[1])
else:
	category = [UnwrapElement(IN[1])]
	
listout = []

for x in view:
	viewlist = []
	for c in category:
		collector = FilteredElementCollector(doc,x.Id)
		elements = collector.OfCategoryId(c.Id).ToElements()
		viewlist.append(elements)
	listout.append(viewlist)

if toggle:
	OUT = viewlist
else:
	OUT = listout
# ----------------------------------------
code_block_36 = CodeBlock(Pipes=python_script_2) { Pipes; }
flatten_5 = List.Flatten(list=code_block_36, lacing=Longest)

# group: Get only vertical pipes visible in selected views and part of the selected systems
indexOf_3 = List.IndexOf(list=code_block_29, element=flatten_5)
code_block_37 = CodeBlock(x=indexOf_3) { x>=0; }
filterByBoolMask_9 = List.FilterByBoolMask(list=indexOf_3, mask=code_block_37)
isEmpty = List.IsEmpty(list=filterByBoolMask_9.in, lacing=Longest)
filterByBoolMask_10 = List.FilterByBoolMask(list=filterByBoolMask_9.in, mask=isEmpty)
getItemAtIndex_4 = List.GetItemAtIndex(list=code_block_29, index=filterByBoolMask_10.out)

# group: Get only vertical pipes connected to RWO's visible in selected view
indexOf_4 = List.IndexOf(list=flatten_3, element=getItemAtIndex_4)
code_block_38 = CodeBlock(x=indexOf_4) { x>=0; }
filterByBoolMask_11 = List.FilterByBoolMask(list=indexOf_4, mask=code_block_38)
isEmpty_2 = List.IsEmpty(list=filterByBoolMask_11.in, lacing=Longest)
filterByBoolMask_12 = List.FilterByBoolMask(list=filterByBoolMask_11.in, mask=isEmpty_2)
getItemAtIndex_5 = List.GetItemAtIndex(list=flatten_3, index=filterByBoolMask_12.out)

# group: Get Pipe Locations
getLocation = Element.GetLocation(element=getItemAtIndex_5)

# group: Identify Which Pipes Have the Same X & Y Coordinates
startPoint = Curve.StartPoint(curve=getLocation)
Y = Point.Y(point=startPoint)
round = Math.Round(number=Y)
groupByKey = List.GroupByKey(list=startPoint, keys=round, lacing=Shortest)
X = Point.X(point=groupByKey.groups)
round_2 = Math.Round(number=X)
groupByKey_2 = List.GroupByKey(list=groupByKey.groups@@L2, keys=round_2@L2, lacing=Shortest)
indexOf_5 = List.IndexOf(list=startPoint, element=groupByKey_2.groups, lacing=Longest)
getItemAtIndex_6 = List.GetItemAtIndex(list=getItemAtIndex_5@L2, index=indexOf_5, lacing=Longest)
code_block_39 = CodeBlock { 1; }
flatten_6 = List.Flatten(list=getItemAtIndex_6@L4, amount=code_block_39@L1, lacing=Longest)

flatten_7 = List.Flatten(list=flatten_6)

# group: Get Invert & Top Elevations
code_block_40 = CodeBlock { "Length"; }
getParameterValueByName_3 = Element.GetParameterValueByName(element=flatten_6, parameterName=code_block_40)
code_block_41 = CodeBlock { "Invert Elevation"; }
getParameterValueByName_4 = Element.GetParameterValueByName(element=flatten_6, parameterName=code_block_41)
top_elevation = CodeBlock(x=getParameterValueByName_3, y=getParameterValueByName_4) { x+y; }
round_3 = Math.Round(number=top_elevation)
round_4 = Math.Round(number=getParameterValueByName_4)

projectElevation_2 = Level.ProjectElevation(level=code_block_34)
filterByBoolMask_13 = List.FilterByBoolMask(list=getItemAtIndex_3, mask=isEmpty)
filterByBoolMask_14 = List.FilterByBoolMask(list=filterByBoolMask_13.out, mask=isEmpty_2)
code_block_42 = CodeBlock { "Associated Level"; }
getParameterValueByName_5 = Element.GetParameterValueByName(element=filterByBoolMask_14.out, parameterName=code_block_42)
indexOf_6 = List.IndexOf(list=name_5, element=getParameterValueByName_5)
code_block_43 = CodeBlock(val=indexOf_6) { val+1; }
getItemAtIndex_7 = List.GetItemAtIndex(list=name_5, index=code_block_43)
list_create_4 = List.Create(item0=getParameterValueByName_5, item1=getItemAtIndex_7)
transpose = List.Transpose(lists=list_create_4)
indexOf_7 = List.IndexOf(list=name_5, element=transpose)
getItemAtIndex_8 = List.GetItemAtIndex(list=projectElevation_2, index=indexOf_7)
firstItem = List.FirstItem(list=getItemAtIndex_8, lacing=Longest)
lastItem = List.LastItem(list=getItemAtIndex_8, lacing=Longest)

# group: Identify whether pipe is FA, FHL or FLL
code_block_44 = CodeBlock(PipeTop=round_3, LvlBottomElevation=firstItem, LvlTopElevation=lastItem)
# ---------- code_block_44.designscript (3 lines) ----------
PipeTop>(LvlBottomElevation+LvlTopElevation)/2 && PipeTop<LvlTopElevation?"FHL":
PipeTop<(LvlBottomElevation+LvlTopElevation)/2 && PipeTop>LvlBottomElevation?"FLL":
PipeTop>LvlTopElevation?"FA":"";
# ----------------------------------------
code_block_45 = CodeBlock(x=code_block_44) { x=="FA"?1:x=="FHL"?2:x=="FLL"?3:4; }
minimumItem = List.MinimumItem(list=code_block_45)
code_block_46 = CodeBlock(x=minimumItem) { x==1?"FA":x==2?"FHL":x==3?"FLL":""; }

# group: Identify whether pipe CTD, DTB, DTHL or DTLL
code_block_47 = CodeBlock(PipeInvert=round_4, LvlBottomElevation=firstItem, LvlTopElevation=lastItem)
# ---------- code_block_47.designscript (5 lines) ----------
PipeInvert==LvlBottomElevation?"CTD":
PipeInvert<LvlBottomElevation?"DTB":
PipeInvert>(LvlBottomElevation+LvlTopElevation)/2?"DTHL":
PipeInvert<(LvlBottomElevation+LvlTopElevation)/2 && PipeInvert>LvlBottomElevation?"DTLL":
"ERROR";
# ----------------------------------------
code_block_48 = CodeBlock(x=code_block_47) { x=="CTD"?1:x=="DTB"?2:x=="DTLL"?3:x=="DTHL"?4:5; }
minimumItem_2 = List.MinimumItem(list=code_block_48)
code_block_49 = CodeBlock(x=minimumItem_2) { x==1?"CTD":x==2?"DTB":x==3?"DTLL":x==4?"DTHL":""; }

# group: Create string
code_block_50 = CodeBlock(x=code_block_46, y=code_block_49) { x+" "+y; }

code_block_51 = CodeBlock { "FHL"; }

# group: Get Type Abbreviation
elementType_2 = Element.ElementType(element=filterByBoolMask_5.in)
code_block_52 = CodeBlock { "Type Abbreviation"; }
getParameterValueByName_6 = Element.GetParameterValueByName(element=elementType_2, parameterName=code_block_52)

flatten_8 = List.Flatten(list=getItemAtIndex_6, lacing=Longest)
allIndicesOf = List.AllIndicesOf(list=flatten_3, item=flatten_8)
flatten_9 = List.Flatten(list=allIndicesOf, lacing=Longest)
getItemAtIndex_9 = List.GetItemAtIndex(list=getParameterValueByName_6, index=flatten_9)
code_block_53 = CodeBlock(x=getItemAtIndex_9) { "FROM "+x; }
replace = String.Replace(string=code_block_50, searchFor=code_block_51, replaceWith=code_block_53)
code_block_54 = CodeBlock { "FLL"; }
replace_2 = String.Replace(string=replace, searchFor=code_block_54, replaceWith=code_block_53)

# group: Python to replace items in list
flatten_10 = List.Flatten(list=replace_2)
code_block_55 = CodeBlock { "FROM"; }
contains_7 = String.Contains(string=flatten_10, searchFor=code_block_55)
code_block_56 = CodeBlock { true; }
allIndicesOf_2 = List.AllIndicesOf(list=contains_7, item=code_block_56)
code_block_57 = CodeBlock { "true"; }
create = List.Create(item0=code_block_57)
flatten_11 = List.Flatten(list=create)
python_script_3 = Python(IN[0]=flatten_10, IN[1]=flatten_11, IN[2]=allIndicesOf_2)  # IronPython2
# ---------- python_script_3.python (9 lines) ----------
_list = IN[0]
rValues = IN[1]
iValues = IN[2]
if len(iValues) > 1 and len(rValues) == 1:
	rValues = [rValues[0]] * len(iValues)
if len(iValues) > 0:
	for (index, value) in zip(iValues, rValues):
		_list[index] = value
OUT = _list
# ----------------------------------------

getItemAtIndex_10 = List.GetItemAtIndex(list=flatten_7, index=allIndicesOf_2)
getItemAtIndex_11 = List.GetItemAtIndex(list=flatten_10, index=allIndicesOf_2)

# group: Write Comments Parameter
code_block_58 = CodeBlock { "Comments"; }
setParameterByName = Element.SetParameterByName(element=getItemAtIndex_10, parameterName=code_block_58, value=getItemAtIndex_11)

# group: Get Pipe Locations
getLocation_2 = Element.GetLocation(element=flatten_8)

# group: Tag Location: X Coordinate
set_tag_location_away_from = DoubleSlider(2500, range=-10000..10000 step 100)  # "Set Tag Location Away from Element_X Axis"

# group: Tag Location: Y Coordinate
set_tag_location_away_from_2 = DoubleSlider(2500, range=-10000..10000 step 100)  # "Set Tag Location Away from Element_Y Axis"

# group: Pipe Tag Location
endPoint = Curve.EndPoint(curve=getLocation_2)
X_2 = Point.X(point=endPoint)
code_block_59 = CodeBlock(x=X_2, y=set_tag_location_away_from) { x+y; }
Y_2 = Point.Y(point=endPoint)
code_block_60 = CodeBlock(x=Y_2, y=set_tag_location_away_from_2) { x+y; }
byCoordinates = Point.ByCoordinates(x=code_block_59, y=code_block_60)
flatten_12 = List.Flatten(list=byCoordinates)

# group: User Selection: Pipe Tag
code_block_61 = CodeBlock(PipeTag=multipleinputform.User_Inputs) { PipeTag[2]; }

# group: Pipes connected to RWO's to be tagged
flatten_13 = List.Flatten(list=flatten_8)

# group: Views
count = List.Count(list=flatten_8, lacing=Longest)
cycle = List.Cycle(list=filterByBoolMask_14.out, amount=count, lacing=Longest)
flatten_14 = List.Flatten(list=cycle)

# group: Remove pipes connected to RWO's
indexOf_8 = List.IndexOf(list=code_block_29, element=flatten_3)
removeItemAtIndex = List.RemoveItemAtIndex(list=code_block_29, indices=indexOf_8)

# group: Get only vertical pipes visible in active view
indexOf_9 = List.IndexOf(list=removeItemAtIndex, element=getItemAtIndex_4)
code_block_62 = CodeBlock(x=indexOf_9) { x>=0; }
filterByBoolMask_15 = List.FilterByBoolMask(list=indexOf_9, mask=code_block_62)
isEmpty_3 = List.IsEmpty(list=filterByBoolMask_15.in, lacing=Longest)
filterByBoolMask_16 = List.FilterByBoolMask(list=filterByBoolMask_15.in, mask=isEmpty_3)
getItemAtIndex_12 = List.GetItemAtIndex(list=removeItemAtIndex, index=filterByBoolMask_16.out)

# group: Get Pipe Locations
getLocation_3 = Element.GetLocation(element=getItemAtIndex_12)

# group: Identify Which Pipes Have the Same X & Y Coordinates
startPoint_2 = Curve.StartPoint(curve=getLocation_3)
Y_3 = Point.Y(point=startPoint_2)
round_5 = Math.Round(number=Y_3)
groupByKey_3 = List.GroupByKey(list=startPoint_2, keys=round_5, lacing=Shortest)
X_3 = Point.X(point=groupByKey_3.groups)
round_6 = Math.Round(number=X_3)
groupByKey_4 = List.GroupByKey(list=groupByKey_3.groups@@L2, keys=round_6@L2, lacing=Shortest)
indexOf_10 = List.IndexOf(list=startPoint_2, element=groupByKey_4.groups, lacing=Longest)
getItemAtIndex_13 = List.GetItemAtIndex(list=getItemAtIndex_12@L2, index=indexOf_10, lacing=Longest)
code_block_63 = CodeBlock { 1; }
flatten_15 = List.Flatten(list=getItemAtIndex_13@L4, amount=code_block_63@L1, lacing=Longest)

# group: Vertical pipes that will be tagged
firstItem_2 = List.FirstItem(list=flatten_15@L2, lacing=Longest)

# group: Get Pipe Locations
getLocation_4 = Element.GetLocation(element=firstItem_2)

# group: Pipe Tag Location
endPoint_2 = Curve.EndPoint(curve=getLocation_4)
X_4 = Point.X(point=endPoint_2)
code_block_64 = CodeBlock(x=X_4, y=set_tag_location_away_from) { x+y; }
Y_4 = Point.Y(point=endPoint_2)
code_block_65 = CodeBlock(x=Y_4, y=set_tag_location_away_from_2) { x+y; }
byCoordinates_2 = Point.ByCoordinates(x=code_block_64, y=code_block_65)

# group: Pipes to be tagged
flatten_16 = List.Flatten(list=firstItem_2)

filterByBoolMask_17 = List.FilterByBoolMask(list=getItemAtIndex_3, mask=isEmpty)

# group: Views
count_2 = List.Count(list=flatten_15, lacing=Longest)
cycle_2 = List.Cycle(list=filterByBoolMask_17.out, amount=count_2, lacing=Longest)
flatten_17 = List.Flatten(list=cycle_2)

# group: Get Plumbing Fixtures category
string_5 = StringInput("Plumbing Fixtures")
byName_5 = Category.ByName(name=string_5)

# group: Python to get all Plumbing Fixtures in selected views
python_script_4 = Python(IN[0]=getItemAtIndex_3, IN[1]=byName_5)  # IronPython2; same code as python_script_2
code_block_66 = CodeBlock(Pipes=python_script_4) { Pipes; }
flatten_18 = List.Flatten(list=code_block_66, lacing=Longest)

# group: Get only RWO's visible in selected view
indexOf_11 = List.IndexOf(list=filterByBoolMask_5.in, element=flatten_18)
code_block_67 = CodeBlock(x=indexOf_11) { x>=0; }
filterByBoolMask_18 = List.FilterByBoolMask(list=indexOf_11, mask=code_block_67)
isEmpty_4 = List.IsEmpty(list=filterByBoolMask_18.in, lacing=Longest)
filterByBoolMask_19 = List.FilterByBoolMask(list=filterByBoolMask_18.in, mask=isEmpty_4)
getItemAtIndex_14 = List.GetItemAtIndex(list=filterByBoolMask_5.in, index=filterByBoolMask_19.out)

# group: Get RWO's Locations
getLocation_5 = Element.GetLocation(element=getItemAtIndex_14)

# group: RWO Tag Location
X_5 = Point.X(point=getLocation_5)
code_block_68 = CodeBlock(x=X_5, y=set_tag_location_away_from) { x+y; }
Y_5 = Point.Y(point=getLocation_5)
code_block_69 = CodeBlock(x=Y_5, y=set_tag_location_away_from_2) { x+y; }
byCoordinates_3 = Point.ByCoordinates(x=code_block_68, y=code_block_69)
flatten_19 = List.Flatten(list=byCoordinates_3)

# group: RWO Tag Type
code_block_70 = CodeBlock { "HL_Tag_PlumbingFixtures"; }
byName_6 = Family.ByName(name=code_block_70)
types = Family.Types(family=byName_6)
code_block_71 = CodeBlock { 0; }
getItemAtIndex_15 = List.GetItemAtIndex(list=types, index=code_block_71)

# group: RWO's to be tagged
flatten_20 = List.Flatten(list=getItemAtIndex_14)

# group: Views
filterByBoolMask_20 = List.FilterByBoolMask(list=getItemAtIndex_3, mask=isEmpty_4)
count_3 = List.Count(list=getItemAtIndex_14, lacing=Longest)
cycle_3 = List.Cycle(list=filterByBoolMask_20.out, amount=count_3, lacing=Longest)
flatten_21 = List.Flatten(list=cycle_3)

# group: Create Tags for RWO's
code_block_72 = CodeBlock { LinkInstance:var=null; }
code_block_73 = CodeBlock(x=count_3) { x>0?true:false; }
identity = Object.Identity()  # unwired: object
trueForAny = List.TrueForAny(list=code_block_73, queryFunction=identity)
python_script_5 = Python(IN[0]=flatten_19, IN[1]=getItemAtIndex_15, IN[2]=flatten_20, IN[3]=flatten_21, IN[4]=code_block_72, IN[5]=trueForAny)  # IronPython2
# ---------- python_script_5.python (215 lines) ----------
import clr
clr.AddReference('ProtoGeometry')
from Autodesk.DesignScript.Geometry import *

# Import Element wrapper extension methods
clr.AddReference("RevitNodes")
import Revit
clr.ImportExtensions(Revit.Elements)

# Import geometry conversion extension methods
clr.ImportExtensions(Revit.GeometryConversion)

# Import DocumentManager and TransactionManager
clr.AddReference("RevitServices")
import RevitServices
from RevitServices.Persistence import DocumentManager
from RevitServices.Transactions import TransactionManager

doc = DocumentManager.Instance.CurrentDBDocument
uiapp = DocumentManager.Instance.CurrentUIApplication
app = uiapp.Application

# Import RevitAPI
clr.AddReference("RevitAPI")
import Autodesk
from Autodesk.Revit.DB import *

import sys
pyt_path = r'C:\Program Files (x86)\IronPython 2.7\Lib'
sys.path.append(pyt_path)

#The inputs to this node will be stored as a list in the IN variable.
dataEnteringNode = IN

locationPts = UnwrapElement(IN[0])
tagType = UnwrapElement(IN[1])
elements = UnwrapElement(IN[2])

if IN[4] != None:
	link = UnwrapElement(IN[4])
else:
	link = None
	
RunIt = IN[5]

if isinstance(IN[3], list):
	views = []
	for i in IN[3]:
		views.append(UnwrapElement(i))
else:
	views = UnwrapElement(IN[3])

def toRvtPoint(point):
	return point.ToXyz()

def toRvtId(_id):
	if isinstance(_id, int) or isinstance(_id, str):
		id = ElementId(int(_id))
		return id
	elif isinstance(_id, ElementId):
		return _id

def GetUVPoint(pt):
	if type(pt) == Autodesk.DesignScript.Geometry.Point:
		return Autodesk.Revit.DB.UV(pt.X, pt.Y)
	elif type(pt) == Autodesk.DesignScript.Geometry.UV:
		return Autodesk.Revit.DB.UV(pt.U, pt.V)

def CreateSpaceTag(space, uv, view):
	doc = DocumentManager.Instance.CurrentDBDocument
	return doc.Create.NewSpaceTag(space, uv, view)

tagTypeId = toRvtId(tagType.Id)
chk = []
try:
	errorReport = None
	if RunIt:
		if tagType.Category.Id == ElementId(BuiltInCategory.OST_RoomTags):

			roomTags = []
			if isinstance(views, list):
				#pulled views for statement out
				for j in views:
					for i,k in zip(elements, locationPts):
						TransactionManager.Instance.EnsureInTransaction(doc)
						#added the if statement to get roomId from the linked element.
						if link != None:
							roomId = LinkElementId(link.Id, i.Id)
						else:
							roomId = LinkElementId(i.Id)
						location = Autodesk.Revit.DB.UV(toRvtPoint(k).X, toRvtPoint(k).Y)
						roomTag = doc.Create.NewRoomTag(roomId, location, j.Id)
						roomTag.RoomTagType = tagType
						chk.append(roomId)
						roomTags.append(roomTag)
						TransactionManager.Instance.TransactionTaskDone()
			else:
				TransactionManager.Instance.EnsureInTransaction(doc)
				for i, j in zip(elements, locationPts):
					if link != None:
						roomId = LinkElementId(link.Id, i.Id)
					else:
						roomId = LinkElementId(i.Id)
					location = Autodesk.Revit.DB.UV(toRvtPoint(j).X, toRvtPoint(j).Y)
					roomTag = doc.Create.NewRoomTag(roomId, location, views.Id)
					roomTag.RoomTagType = tagType
					roomTags.append(roomTag)
				TransactionManager.Instance.TransactionTaskDone()
			result = roomTags
		elif tagType.Category.Id == ElementId(BuiltInCategory.OST_MEPSpaceTags):
			TransactionManager.Instance.EnsureInTransaction(doc)
			roomTags = []
			if isinstance(views, list):
				for j in views:
					for i, k in zip(elements, locationPts):
						uv = GetUVPoint(k)
						spaceTag = CreateSpaceTag(i, uv, j)
						spaceTag.SpaceTagType = tagType
						roomTags.append(spaceTag)
			else:
				for i, j in zip(elements, locationPts):
					uv = GetUVPoint(j)
					spaceTag = CreateSpaceTag(i, uv, views)
					spaceTag.SpaceTagType = tagType
					roomTags.append(spaceTag)
			TransactionManager.Instance.TransactionTaskDone()
			result = roomTags
		elif tagType.Category.Id == ElementId(BuiltInCategory.OST_MultiCategoryTags):
			TransactionManager.Instance.EnsureInTransaction(doc)
			multitags = []
			if isinstance(views, list):
				for j in views:
					for i, k in zip(elements, locationPts):
						if link != None:
							reference = Reference(i).CreateLinkReference(link)
						else:
							reference = Reference(i)
						location = toRvtPoint(k)
						tag = IndependentTag.Create(doc,j.Id, reference, False, TagMode.TM_ADDBY_MULTICATEGORY, TagOrientation.Horizontal, location)
					tag.ChangeTypeId(tagTypeId)
					multitags.append(tag)
			else:
				for i, j in zip(elements, locationPts):
					if link != None:
						reference = Reference(i).CreateLinkReference(link)
					else:
						reference = Reference(i)
					location = toRvtPoint(j)
					tag = IndependentTag.Create(doc, views.Id, reference, False, TagMode.TM_ADDBY_MULTICATEGORY, TagOrientation.Horizontal, location)
					tag.ChangeTypeId(tagTypeId)
					multitags.append(tag)
			TransactionManager.Instance.TransactionTaskDone()
			result = multitags
		elif tagType.Category.Id == ElementId(BuiltInCategory.OST_MaterialTags):
			TransactionManager.Instance.EnsureInTransaction(doc)
			Mattags = []
			if isinstance(views, list):
				for i,j,k in zip(elements, views, locationPts):
					if link != None:
						reference = Reference(i).CreateLinkReference(link)
					else:
						reference = Reference(i)
					location = toRvtPoint(k)
					tag = IndependentTag.Create(doc, j.Id, reference, False, TagMode.TM_ADDBY_MATERIAL, TagOrientation.Horizontal, location)
					tag.ChangeTypeId(tagTypeId)
					Mattags.append(tag)
			else:
				for i, j in zip(elements, locationPts):
					if link != None:
						reference = Reference(i).CreateLinkReference(link)
					else:
						reference = Reference(i)
					location = toRvtPoint(j)
					tag = IndependentTag.Create(doc, views.Id, reference, False, TagMode.TM_ADDBY_MATERIAL, TagOrientation.Horizontal, location)
					tag.ChangeTypeId(tagTypeId)
					Mattags.append(tag)
			TransactionManager.Instance.TransactionTaskDone()
			result = Mattags
		else:
			TransactionManager.Instance.EnsureInTransaction(doc)
			tags = []
			if isinstance(views, list):
				for i,j,k in zip(elements, views, locationPts):
					if link != None:
						reference = Reference(i).CreateLinkReference(link)
					else:
						reference = Reference(i)
					location = toRvtPoint(k)
					tag = IndependentTag.Create(doc, j.Id, reference, False, TagMode.TM_ADDBY_CATEGORY, TagOrientation.Horizontal, location)
					tag.ChangeTypeId(tagTypeId)
					tags.append(tag)
			else:
				for i, j in zip(elements, locationPts):
					if link != None:
						reference = Reference(i).CreateLinkReference(link)
					else:
						reference = Reference(i)
					location = toRvtPoint(j)
					tag = IndependentTag.Create(doc, views.Id, reference, False, TagMode.TM_ADDBY_CATEGORY, TagOrientation.Horizontal, location)
					tag.ChangeTypeId(tagTypeId)
					tags.append(tag)
			TransactionManager.Instance.TransactionTaskDone()
			result = tags
	else:
		result = "RunIt is set to False."
except:
	# if error accurs anywhere in the process catch it
	import traceback
	errorReport = traceback.format_exc()

#Assign your output to the OUT variable
if errorReport == None:
	OUT = result
else:
	OUT = errorReport
# ----------------------------------------
code_block_74 = CodeBlock(TaggedRWOs=python_script_5) { TaggedRWOs; }

code_block_75 = CodeBlock { "RunIt is set to False."; }

# group: Identify index numbers inside th HL_Tag_Pipe family for required types
code_block_76 = CodeBlock { "HL_Tag_Pipe"; }
byName_7 = Family.ByName(name=code_block_76)
types_2 = Family.Types(family=byName_7)
string_from_object_5 = FromObject(obj=types_2)
code_block_77 = CodeBlock()
# ---------- code_block_77.designscript (11 lines) ----------
["System Name Manual and AT LL",
"System Name Manual and AT HL",
"System Name Manual and FA CTD",
"System Name Manual and FA DTB",
"System Name Manual and FA DTHL",
"System Name Manual and FA DTLL",
"System Name Manual and FHL CTD",
"System Name Manual and FHL DTB",
"System Name Manual and FHL DTLL",
"System Name Manual and FLL CTD",
"System Name Manual and FLL DTB"];
# ----------------------------------------
contains_8 = String.Contains(string=string_from_object_5@L1, searchFor=code_block_77)
code_block_78 = CodeBlock { true; }
contains_9 = List.Contains(list=contains_8@L2, item=code_block_78)
allIndicesOf_3 = List.AllIndicesOf(list=contains_9, item=code_block_78)
code_block_79 = CodeBlock()
# ---------- code_block_79.designscript (11 lines) ----------
["Abbreviation and AT HL",
"Abbreviation and AT LL",
"Abbreviation and FA DTLL",
"Abbreviation and FA CTD",
"Abbreviation and FA DTB",
"Abbreviation and FA DTHL",
"Abbreviation and FLL CTD",
"Abbreviation and FLL DTB",
"Abbreviation and FHL CTD",
"Abbreviation and FHL DTLL",
"Abbreviation and FHL DTB"];
# ----------------------------------------
contains_10 = String.Contains(string=string_from_object_5@L1, searchFor=code_block_79)
code_block_80 = CodeBlock { true; }
contains_11 = List.Contains(list=contains_10@L2, item=code_block_80)
allIndicesOf_4 = List.AllIndicesOf(list=contains_11, item=code_block_80)

# group: Dictionary for Tags-Size and System Name Manual
code_block_81 = CodeBlock { ["AT LL","AT HL","FA CTD","FA DTB","FA DTHL","FA DTLL","FHL CTD","FHL DTB","FHL DTLL","FLL CTD","FLL DTB"]; }
byKeysValues = DesignScript.Builtin.Dictionary.ByKeysValues(keys=code_block_81, values=allIndicesOf_3)

# group: Dictionary for Tags-Size and System Abbreviation
code_block_82 = CodeBlock { ["AT HL","AT LL","FA DTLL","FA CTD","FA DTB","FA DTHL","FLL CTD","FLL DTB","FHL CTD","FHL DTLL","FHL DTB"]; }
byKeysValues_2 = DesignScript.Builtin.Dictionary.ByKeysValues(keys=code_block_82, values=allIndicesOf_4)

# group: Get Invert & Top Elevations
code_block_83 = CodeBlock { "Length"; }
getParameterValueByName_7 = Element.GetParameterValueByName(element=flatten_15, parameterName=code_block_83)
code_block_84 = CodeBlock { "Invert Elevation"; }
getParameterValueByName_8 = Element.GetParameterValueByName(element=flatten_15, parameterName=code_block_84)
top_elevation_2 = CodeBlock(x=getParameterValueByName_7, y=getParameterValueByName_8) { x+y; }
round_7 = Math.Round(number=top_elevation_2)
round_8 = Math.Round(number=getParameterValueByName_8)

code_block_85 = CodeBlock { "Associated Level"; }
getParameterValueByName_9 = Element.GetParameterValueByName(element=filterByBoolMask_17.out, parameterName=code_block_85)
maximumItem = List.MaximumItem(list=projectElevation_2)
indexOf_12 = List.IndexOf(list=projectElevation_2, element=maximumItem)
getItemAtIndex_16 = List.GetItemAtIndex(list=name_5, index=indexOf_12)
lastItem_2 = List.LastItem(list=getParameterValueByName_9)
eq = getItemAtIndex_16 == lastItem_2
indexOf_13 = List.IndexOf(list=name_5, element=lastItem_2)
code_block_86 = CodeBlock(val=indexOf_13) { val+1; }

# group: Conditional
code_block_87 = CodeBlock(result=eq, val1=indexOf_13, val2=code_block_86) { result == true? val1 : val2; }

getItemAtIndex_17 = List.GetItemAtIndex(list=name_5, index=code_block_87)
join = List.Join(list0=getParameterValueByName_9, list1=getItemAtIndex_17)
indexOf_14 = List.IndexOf(list=name_5, element=join)
getItemAtIndex_18 = List.GetItemAtIndex(list=projectElevation_2, index=indexOf_14)
code_block_88 = CodeBlock { 0..1; }
code_block_89 = CodeBlock { 1; }
sublists = List.Sublists(list=getItemAtIndex_18, ranges=code_block_88, offset=code_block_89)
count_4 = List.Count(list=sublists@L2)
code_block_90 = CodeBlock(x=count_4) { x>1; }
filterByBoolMask_21 = List.FilterByBoolMask(list=sublists, mask=code_block_90)
firstItem_3 = List.FirstItem(list=filterByBoolMask_21.in, lacing=Longest)
round_9 = Math.Round(number=firstItem_3)
lastItem_3 = List.LastItem(list=filterByBoolMask_21.in, lacing=Longest)
round_10 = Math.Round(number=lastItem_3)

# group: Identify whether pipe is FA, FHL or FLL
code_block_91 = CodeBlock(PipeTop=round_7, LvlBottomElevation=round_9, LvlTopElevation=round_10)  # same code as code_block_44
code_block_92 = CodeBlock(x=code_block_91) { x=="FA"?1:x=="FHL"?2:x=="FLL"?3:4; }
minimumItem_3 = List.MinimumItem(list=code_block_92)
code_block_93 = CodeBlock(x=minimumItem_3) { x==1?"FA":x==2?"FHL":x==3?"FLL":""; }

# group: Identify whether pipe CTD, DTB, DTHL or DTLL
code_block_94 = CodeBlock(PipeInvert=round_8, LvlBottomElevation=round_9, LvlTopElevation=round_10)
# ---------- code_block_94.designscript (5 lines) ----------
PipeInvert<LvlBottomElevation?"DTB":
PipeInvert==LvlBottomElevation?"CTD":
PipeInvert>(LvlBottomElevation+LvlTopElevation)/2?"DTHL":
PipeInvert<(LvlBottomElevation+LvlTopElevation)/2 && PipeInvert>LvlBottomElevation?"DTLL":
"ERROR";
# ----------------------------------------
code_block_95 = CodeBlock(x=code_block_94) { x=="CTD"?1:x=="DTB"?2:x=="DTLL"?3:x=="DTHL"?4:5; }
minimumItem_4 = List.MinimumItem(list=code_block_95)
code_block_96 = CodeBlock(x=minimumItem_4) { x==1?"CTD":x==2?"DTB":x==3?"DTLL":x==4?"DTHL":""; }

# group: Create string
code_block_97 = CodeBlock(x=code_block_93, y=code_block_96) { x+" "+y; }
code_block_98 = CodeBlock { "FHL DTHL"; }
code_block_99 = CodeBlock { "AT HL"; }
replace_3 = String.Replace(string=code_block_97, searchFor=code_block_98, replaceWith=code_block_99)
code_block_100 = CodeBlock { "FLL DTLL"; }
code_block_101 = CodeBlock { "AT LL"; }
replace_4 = String.Replace(string=replace_3, searchFor=code_block_100, replaceWith=code_block_101)

# group: Get Values from Dictionary Based on Selected Pipe Tag
list_create_5 = List.Create(item0=byKeysValues, item1=byKeysValues_2)
code_block_102 = CodeBlock(PipeTag=code_block_61, x=list_create_5) { PipeTag=="Size and System Name Manual"?x[0]:x[1]; }
valueAtKey = DesignScript.Builtin.Dictionary.ValueAtKey(dictionary=code_block_102, key=replace_4)

# group: Pipe Tag Type
code_block_103 = CodeBlock { "HL_Tag_Pipe"; }
byName_8 = Family.ByName(name=code_block_103)
types_3 = Family.Types(family=byName_8)
code_block_104 = CodeBlock(PipeTag=code_block_61) { PipeTag=="Size and System Name Manual"?5:7; }
getItemAtIndex_19 = List.GetItemAtIndex(list=types_3, index=code_block_104)
getItemAtIndex_20 = List.GetItemAtIndex(list=types_3, index=valueAtKey)
flatten_22 = List.Flatten(list=getItemAtIndex_20)

# group: Create Pipe Tags
code_block_105 = CodeBlock { LinkInstance:var=null; }
code_block_106 = CodeBlock(x=count_2) { x>0?true:false; }
identity_2 = Object.Identity()  # unwired: object
trueForAny_2 = List.TrueForAny(list=code_block_106, queryFunction=identity_2)
python_script_6 = Python(IN[0]=byCoordinates_2, IN[1]=getItemAtIndex_19, IN[2]=flatten_16, IN[3]=flatten_17, IN[4]=code_block_105, IN[5]=trueForAny_2)  # IronPython2; same code as python_script_5
code_block_107 = CodeBlock(PipeTags=python_script_6) { PipeTags; }
code_block_108 = CodeBlock { "Family and Type"; }
setParameterByName_2 = Element.SetParameterByName(element=code_block_107, parameterName=code_block_108, value=flatten_22)

# group: Identify index numbers inside th HL_Tag_Pipe family for required types
code_block_109 = CodeBlock { "HL_Tag_Pipe"; }
byName_9 = Family.ByName(name=code_block_109)
types_4 = Family.Types(family=byName_9)
string_from_object_6 = FromObject(obj=types_4)
code_block_110 = CodeBlock()
# ---------- code_block_110.designscript (12 lines) ----------
["System Name Manual and Comment",
"System Name Manual and AT LL",
"System Name Manual and AT HL",
"System Name Manual and FA CTD",
"System Name Manual and FA DTB",
"System Name Manual and FA DTHL",
"System Name Manual and FA DTLL",
"System Name Manual and FHL CTD",
"System Name Manual and FHL DTB",
"System Name Manual and FHL DTLL",
"System Name Manual and FLL CTD",
"System Name Manual and FLL DTB"];
# ----------------------------------------
contains_12 = String.Contains(string=string_from_object_6@L1, searchFor=code_block_110)
code_block_111 = CodeBlock { true; }
contains_13 = List.Contains(list=contains_12@L2, item=code_block_111)
allIndicesOf_5 = List.AllIndicesOf(list=contains_13, item=code_block_111)
code_block_112 = CodeBlock()
# ---------- code_block_112.designscript (12 lines) ----------
["Abbreviation and Comment",
"Abbreviation and AT HL",
"Abbreviation and AT LL",
"Abbreviation and FA DTLL",
"Abbreviation and FA CTD",
"Abbreviation and FA DTB",
"Abbreviation and FA DTHL",
"Abbreviation and FLL CTD",
"Abbreviation and FLL DTB",
"Abbreviation and FHL CTD",
"Abbreviation and FHL DTLL",
"Abbreviation and FHL DTB"];
# ----------------------------------------
contains_14 = String.Contains(string=string_from_object_6@L1, searchFor=code_block_112)
code_block_113 = CodeBlock { true; }
contains_15 = List.Contains(list=contains_14@L2, item=code_block_113)
allIndicesOf_6 = List.AllIndicesOf(list=contains_15, item=code_block_113)

# group: Dictionary for Tags-Size and System Name Manual
code_block_114 = CodeBlock { ["true","AT LL","AT HL","FA CTD","FA DTB","FA DTHL","FA DTLL","FHL CTD","FHL DTB","FHL DTLL","FLL CTD","FLL DTB"]; }
byKeysValues_3 = DesignScript.Builtin.Dictionary.ByKeysValues(keys=code_block_114, values=allIndicesOf_5)

# group: Dictionary for Tags-Size and System Abbreviation
code_block_115 = CodeBlock { ["true","AT HL","AT LL","FA DTLL","FA CTD","FA DTB","FA DTHL","FLL CTD","FLL DTB","FHL CTD","FHL DTLL","FHL DTB"]; }
byKeysValues_4 = DesignScript.Builtin.Dictionary.ByKeysValues(keys=code_block_115, values=allIndicesOf_6)

# group: Get Values from Dictionary Based on Selected Pipe Tag
list_create_6 = List.Create(item0=byKeysValues_3, item1=byKeysValues_4)
code_block_116 = CodeBlock(PipeTag=code_block_61, x=list_create_6) { PipeTag=="Size and System Name Manual"?x[0]:x[1]; }
valueAtKey_2 = DesignScript.Builtin.Dictionary.ValueAtKey(dictionary=code_block_116, key=python_script_3)

# group: Pipe Tag Type
code_block_117 = CodeBlock { "HL_Tag_Pipe"; }
byName_10 = Family.ByName(name=code_block_117)
types_5 = Family.Types(family=byName_10)
code_block_118 = CodeBlock(PipeTag=code_block_61) { PipeTag=="Size and System Name Manual"?5:7; }
getItemAtIndex_21 = List.GetItemAtIndex(list=types_5, index=code_block_118)
getItemAtIndex_22 = List.GetItemAtIndex(list=types_5, index=valueAtKey_2)
flatten_23 = List.Flatten(list=getItemAtIndex_22)

# group: Create Pipe Tags for Pipes Connected to RWO's
code_block_119 = CodeBlock { LinkInstance:var=null; }
code_block_120 = CodeBlock(x=count) { x>0?true:false; }
identity_3 = Object.Identity()  # unwired: object
trueForAny_3 = List.TrueForAny(list=code_block_120, queryFunction=identity_3)
python_script_7 = Python(IN[0]=flatten_12, IN[1]=getItemAtIndex_21, IN[2]=flatten_13, IN[3]=flatten_14, IN[4]=code_block_119, IN[5]=trueForAny_3)  # IronPython2; same code as python_script_5
code_block_121 = CodeBlock(PipeTags=python_script_7) { PipeTags; }
code_block_122 = CodeBlock { "Family and Type"; }
setParameterByName_3 = Element.SetParameterByName(element=code_block_121, parameterName=code_block_122, value=flatten_23)

join_2 = List.Join(list0=code_block_121, list1=code_block_107, list2=code_block_74)
string_from_object_7 = FromObject(obj=join_2)
contains_16 = String.Contains(string=string_from_object_7, searchFor=code_block_75)
filterByBoolMask_22 = List.FilterByBoolMask(list=join_2, mask=contains_16)

# group: Add Leader to Tags
code_block_123 = CodeBlock { "Leader Line"; }
boolean_2 = BoolSelector(true)
setParameterByName_4 = Element.SetParameterByName(element=filterByBoolMask_22.out, parameterName=code_block_123, value=boolean_2)

watch = Watch(filterByBoolMask_13.out)
